# Grasshopper definition Room_v15.gh (Grasshopper 0.9.72)
# plug-ins: DIVA.ForGrasshopper

grid_angle = Slider(0, range=0..90)
panel_spacing = Slider(0.5, range=0..1000)
frame_size_y = Slider(0.5, range=0..5000)
frame_size_x = Slider(4.5, range=0..5000)
panel_size = Slider(0.4, range=0..1000)
panel_angle_3 = Slider(0, range=0..90)
actuator_length = Slider(0.22, range=0..220)
vertical_rotation = Slider(0, range=-90..90)
panel_angle_2 = Slider(0, range=0..90)
orizontal_rotation = Slider(30, range=0..90)
panel_angle_1 = Slider(0, range=-89..91)
orizontal_rotation_2 = Slider(60, range=0..90)
orizontal_rotation_3 = Slider(15, range=0..90)
orizontal_rotation_4 = Slider(75, range=0..90)
vertical_rotation_2 = Slider(0, range=-90..90)
vertical_rotation_3 = Slider(0, range=-90..90)
vertical_rotation_4 = Slider(0, range=-90..90)
orizontal_rotation_5 = Slider(45, range=0..90)
vertical_rotation_5 = Slider(0, range=-90..90)
number_slider = Slider(10, range=0..10)
multiplication = Multiplication(A=panel_spacing, B=number_slider)
pt = ConstructPoint(XCoordinate=expr("-x/2", multiplication), YCoordinate=0, ZCoordinate=expr("-x/2", multiplication))
panel = Panel([panel_angle_2, orizontal_rotation_3, orizontal_rotation, orizontal_rotation_5, orizontal_rotation_2, orizontal_rotation_4])
rad = Radians(Degrees=grid_angle)
xz = XZPlane(Origin=pt)
xz_2 = XZPlane(Origin=Point(0, 0, 0))
pt_2 = ConstructPoint(XCoordinate=expr("-x/2", frame_size_x), YCoordinate=0, ZCoordinate=expr("-x/2", frame_size_y))
rotate = Rotate(Geometry=xz, Angle=rad, Plane=xz_2)  # -> Geometry, Transform
xz_3 = XZPlane(Origin=pt_2)
rectangle = Rectangle(Plane=xz_3, XSize=frame_size_x, YSize=frame_size_y, Radius=0)  # -> Rectangle, Length
recgrid = Rectangular(Plane=rotate.Geometry, SizeX=panel_spacing, SizeY=panel_spacing, ExtentX=number_slider, ExtentY=number_slider)  # -> Cells, Points
incurve = PointInCurve(Point=recgrid.Points, Curve=rectangle.Rectangle)  # -> Relationship, Point
rad_2 = Radians(Degrees=panel_angle_1)
rad_3 = Radians(Degrees=panel_angle_2)
dispatch = Dispatch(List=recgrid.Points, DispatchPattern=incurve.Relationship)  # -> simplify(ListA), ListB
flip = FlipMatrix(Data=recgrid.Points)
xz_4 = XZPlane(Origin=dispatch.ListA)
xy = XYPlane(Origin=dispatch.ListA)
yz = YZPlane(Origin=dispatch.ListA)
pline = PolyLine(Vertices=flip, Closed=False)  # -> simplify(Polyline)
pline_2 = PolyLine(Vertices=recgrid.Points, Closed=False)  # -> simplify(Polyline)
rotate_2 = Rotate(Geometry=xz_4, Angle=rad_2, Plane=xy)  # -> Geometry, Transform
ccx = CurveCurve(CurveA=pline, CurveB=rectangle.Rectangle)  # -> Points, ParamsA, ParamsB
ccx_2 = CurveCurve(CurveA=pline_2, CurveB=rectangle.Rectangle)  # -> Points, ParamsA, ParamsB
rotate_3 = Rotate(Geometry=rotate_2.Geometry, Angle=rad_3, Plane=yz)  # -> Geometry, Transform
pline_3 = PolyLine(Vertices=ccx_2.Points, Closed=False)
pline_4 = PolyLine(Vertices=ccx.Points, Closed=False)
clean = CleanTree(Tree=dispatch.ListA, CleanInvalid=True, CleanEmpty=True)  # -> flatten(Tree)
partition = PartitionList(List=clean, Size=3)  # -> simplify(Chunks)

rad_4 = Radians(Degrees=vertical_rotation)
rad_5 = Radians(Degrees=orizontal_rotation_3)
xy_2 = XYPlane(Origin=dispatch.ListA)
xz_5 = XZPlane(Origin=dispatch.ListA)
yz_2 = YZPlane(Origin=dispatch.ListA)
rotate_4 = Rotate(Geometry=xz_5, Angle=rad_4, Plane=xy_2)  # -> Geometry, Transform
rotate_5 = Rotate(Geometry=rotate_4.Geometry, Angle=rad_5, Plane=yz_2)  # -> Geometry, Transform
deplane = DeconstructPlane(Plane=rotate_5.Geometry)  # -> Origin, XAxis, YAxis, ZAxis
actuator_lenght = Number(0.22)
pdecon = Deconstruct(Point=deplane.Origin)  # -> XComponent, YComponent, ZComponent
addition = Addition(A=pdecon.YComponent, B=actuator_lenght)
pt_3 = ConstructPoint(XCoordinate=pdecon.XComponent, YCoordinate=addition, ZCoordinate=pdecon.ZComponent)
vec2pt = Vector2Pt(PointA=deplane.Origin, PointB=pt_3, Unitize=False)  # -> Vector, Length
move = Move(Geometry=rotate_5.Geometry, Motion=vec2pt.Vector)  # -> Geometry, Transform
deplane_2 = DeconstructPlane(Plane=move.Geometry)  # -> Origin, XAxis, YAxis, ZAxis
neg = Negative(Value=deplane_2.ZAxis)
unit = UnitVector(Vector=neg)
extrusion_height = Number(0.004)
number = Number(0.01)
multiplication_2 = Multiplication(A=unit, B=number)
multiplication_3 = Multiplication(A=unit, B=extrusion_height)
panel_size_2 = Number(0.4)
move_2 = Move(Geometry=move.Geometry, Motion=multiplication_2)  # -> Geometry, Transform
dom = ConstructDomain(DomainStart=expr("-x/2", panel_size_2), DomainEnd=expr("x/2", panel_size_2))
rectangle_2 = Rectangle(Plane=move_2.Geometry, XSize=dom, YSize=dom, Radius=0)  # -> Rectangle, Length
system_rotation = Number(180)
extr = Extrude(Base=rectangle_2.Rectangle, Direction=multiplication_3)
rad_6 = Radians(Degrees=system_rotation)
xy_3 = XYPlane(Origin=Point(0, 0, 0))
cap = CapHoles(Brep=extr)
position_750 = Number(0.75)
rotate_6 = Rotate(Geometry=flatten(cap), Angle=rad_6, Plane=xy_3)  # -> Geometry, Transform
Z = UnitZ(Factor=position_750)
move_3 = Move(Geometry=rotate_6.Geometry, Motion=Z)  # -> Geometry, Transform

rad_7 = Radians(Degrees=vertical_rotation_2)
rad_8 = Radians(Degrees=orizontal_rotation)
xy_4 = XYPlane(Origin=dispatch.ListA)
xz_6 = XZPlane(Origin=dispatch.ListA)
yz_3 = YZPlane(Origin=dispatch.ListA)
rotate_7 = Rotate(Geometry=xz_6, Angle=rad_7, Plane=xy_4)  # -> Geometry, Transform
rotate_8 = Rotate(Geometry=rotate_7.Geometry, Angle=rad_8, Plane=yz_3)  # -> Geometry, Transform
deplane_3 = DeconstructPlane(Plane=rotate_8.Geometry)  # -> Origin, XAxis, YAxis, ZAxis
actuator_lenght_2 = Number(0.22)
pdecon_2 = Deconstruct(Point=deplane_3.Origin)  # -> XComponent, YComponent, ZComponent
addition_2 = Addition(A=pdecon_2.YComponent, B=actuator_lenght_2)
pt_4 = ConstructPoint(XCoordinate=pdecon_2.XComponent, YCoordinate=addition_2, ZCoordinate=pdecon_2.ZComponent)
vec2pt_2 = Vector2Pt(PointA=deplane_3.Origin, PointB=pt_4, Unitize=False)  # -> Vector, Length
move_4 = Move(Geometry=rotate_8.Geometry, Motion=vec2pt_2.Vector)  # -> Geometry, Transform
deplane_4 = DeconstructPlane(Plane=move_4.Geometry)  # -> Origin, XAxis, YAxis, ZAxis
neg_2 = Negative(Value=deplane_4.ZAxis)
unit_2 = UnitVector(Vector=neg_2)
extrusion_height_2 = Number(0.004)
number_2 = Number(0.01)
multiplication_4 = Multiplication(A=unit_2, B=number_2)
multiplication_5 = Multiplication(A=unit_2, B=extrusion_height_2)
panel_size_3 = Number(0.4)
move_5 = Move(Geometry=move_4.Geometry, Motion=multiplication_4)  # -> Geometry, Transform
dom_2 = ConstructDomain(DomainStart=expr("-x/2", panel_size_3), DomainEnd=expr("x/2", panel_size_3))
rectangle_3 = Rectangle(Plane=move_5.Geometry, XSize=dom_2, YSize=dom_2, Radius=0)  # -> Rectangle, Length
system_rotation_2 = Number(180)
extr_2 = Extrude(Base=rectangle_3.Rectangle, Direction=multiplication_5)
rad_9 = Radians(Degrees=system_rotation_2)
xy_5 = XYPlane(Origin=Point(0, 0, 0))
cap_2 = CapHoles(Brep=extr_2)
position_250 = Number(0.25)
rotate_9 = Rotate(Geometry=flatten(cap_2), Angle=rad_9, Plane=xy_5)  # -> Geometry, Transform
Z_2 = UnitZ(Factor=position_250)
move_6 = Move(Geometry=rotate_9.Geometry, Motion=Z_2)  # -> Geometry, Transform

rad_10 = Radians(Degrees=vertical_rotation_3)
rad_11 = Radians(Degrees=orizontal_rotation_5)
xy_6 = XYPlane(Origin=dispatch.ListA)
xz_7 = XZPlane(Origin=dispatch.ListA)
yz_4 = YZPlane(Origin=dispatch.ListA)
rotate_10 = Rotate(Geometry=xz_7, Angle=rad_10, Plane=xy_6)  # -> Geometry, Transform
rotate_11 = Rotate(Geometry=rotate_10.Geometry, Angle=rad_11, Plane=yz_4)  # -> Geometry, Transform
deplane_5 = DeconstructPlane(Plane=rotate_11.Geometry)  # -> Origin, XAxis, YAxis, ZAxis
actuator_lenght_3 = Number(0.22)
pdecon_3 = Deconstruct(Point=deplane_5.Origin)  # -> XComponent, YComponent, ZComponent
addition_3 = Addition(A=pdecon_3.YComponent, B=actuator_lenght_3)
pt_5 = ConstructPoint(XCoordinate=pdecon_3.XComponent, YCoordinate=addition_3, ZCoordinate=pdecon_3.ZComponent)
vec2pt_3 = Vector2Pt(PointA=deplane_5.Origin, PointB=pt_5, Unitize=False)  # -> Vector, Length
move_7 = Move(Geometry=rotate_11.Geometry, Motion=vec2pt_3.Vector)  # -> Geometry, Transform
deplane_6 = DeconstructPlane(Plane=move_7.Geometry)  # -> Origin, XAxis, YAxis, ZAxis
neg_3 = Negative(Value=deplane_6.ZAxis)
unit_3 = UnitVector(Vector=neg_3)
extrusion_height_3 = Number(0.004)
number_3 = Number(0.01)
multiplication_6 = Multiplication(A=unit_3, B=number_3)
multiplication_7 = Multiplication(A=unit_3, B=extrusion_height_3)
panel_size_4 = Number(0.4)
move_8 = Move(Geometry=move_7.Geometry, Motion=multiplication_6)  # -> Geometry, Transform
dom_3 = ConstructDomain(DomainStart=expr("-x/2", panel_size_4), DomainEnd=expr("x/2", panel_size_4))
rectangle_4 = Rectangle(Plane=move_8.Geometry, XSize=dom_3, YSize=dom_3, Radius=0)  # -> Rectangle, Length
system_rotation_3 = Number(180)
extr_3 = Extrude(Base=rectangle_4.Rectangle, Direction=multiplication_7)
rad_12 = Radians(Degrees=system_rotation_3)
xy_7 = XYPlane(Origin=Point(0, 0, 0))
cap_3 = CapHoles(Brep=extr_3)
position_250_2 = Number(-0.25)
rotate_12 = Rotate(Geometry=flatten(cap_3), Angle=rad_12, Plane=xy_7)  # -> Geometry, Transform
Z_3 = UnitZ(Factor=position_250_2)
move_9 = Move(Geometry=rotate_12.Geometry, Motion=Z_3)  # -> Geometry, Transform

rad_13 = Radians(Degrees=vertical_rotation_5)
rad_14 = Radians(Degrees=orizontal_rotation_2)
xy_8 = XYPlane(Origin=dispatch.ListA)
xz_8 = XZPlane(Origin=dispatch.ListA)
yz_5 = YZPlane(Origin=dispatch.ListA)
rotate_13 = Rotate(Geometry=xz_8, Angle=rad_13, Plane=xy_8)  # -> Geometry, Transform
rotate_14 = Rotate(Geometry=rotate_13.Geometry, Angle=rad_14, Plane=yz_5)  # -> Geometry, Transform
deplane_7 = DeconstructPlane(Plane=rotate_14.Geometry)  # -> Origin, XAxis, YAxis, ZAxis
actuator_lenght_4 = Number(0.22)
pdecon_4 = Deconstruct(Point=deplane_7.Origin)  # -> XComponent, YComponent, ZComponent
addition_4 = Addition(A=pdecon_4.YComponent, B=actuator_lenght_4)
pt_6 = ConstructPoint(XCoordinate=pdecon_4.XComponent, YCoordinate=addition_4, ZCoordinate=pdecon_4.ZComponent)
vec2pt_4 = Vector2Pt(PointA=deplane_7.Origin, PointB=pt_6, Unitize=False)  # -> Vector, Length
move_10 = Move(Geometry=rotate_14.Geometry, Motion=vec2pt_4.Vector)  # -> Geometry, Transform
deplane_8 = DeconstructPlane(Plane=move_10.Geometry)  # -> Origin, XAxis, YAxis, ZAxis
neg_4 = Negative(Value=deplane_8.ZAxis)
unit_4 = UnitVector(Vector=neg_4)
number_4 = Number(0.01)
extrusion_height_4 = Number(0.004)
multiplication_8 = Multiplication(A=unit_4, B=number_4)
multiplication_9 = Multiplication(A=unit_4, B=extrusion_height_4)
panel_size_5 = Number(0.4)
move_11 = Move(Geometry=move_10.Geometry, Motion=multiplication_8)  # -> Geometry, Transform
dom_4 = ConstructDomain(DomainStart=expr("-x/2", panel_size_5), DomainEnd=expr("x/2", panel_size_5))
rectangle_5 = Rectangle(Plane=move_11.Geometry, XSize=dom_4, YSize=dom_4, Radius=0)  # -> Rectangle, Length
system_rotation_4 = Number(180)
extr_4 = Extrude(Base=rectangle_5.Rectangle, Direction=multiplication_9)
rad_15 = Radians(Degrees=system_rotation_4)
xy_9 = XYPlane(Origin=Point(0, 0, 0))
cap_4 = CapHoles(Brep=extr_4)
position_750_2 = Number(-0.75)
rotate_15 = Rotate(Geometry=flatten(cap_4), Angle=rad_15, Plane=xy_9)  # -> Geometry, Transform
Z_4 = UnitZ(Factor=position_750_2)
move_12 = Move(Geometry=rotate_15.Geometry, Motion=Z_4)  # -> Geometry, Transform

deplane_9 = DeconstructPlane(Plane=rotate_3.Geometry)  # -> Origin, XAxis, YAxis, ZAxis

rad_16 = Radians(Degrees=vertical_rotation_4)
rad_17 = Radians(Degrees=orizontal_rotation_4)
xy_10 = XYPlane(Origin=dispatch.ListA)
xz_9 = XZPlane(Origin=dispatch.ListA)
yz_6 = YZPlane(Origin=dispatch.ListA)
rotate_16 = Rotate(Geometry=xz_9, Angle=rad_16, Plane=xy_10)  # -> Geometry, Transform
rotate_17 = Rotate(Geometry=rotate_16.Geometry, Angle=rad_17, Plane=yz_6)  # -> Geometry, Transform
deplane_10 = DeconstructPlane(Plane=rotate_17.Geometry)  # -> Origin, XAxis, YAxis, ZAxis
actuator_lenght_5 = Number(220)
pdecon_5 = Deconstruct(Point=deplane_10.Origin)  # -> XComponent, YComponent, ZComponent
addition_5 = Addition(A=pdecon_5.YComponent, B=actuator_lenght_5)
pt_7 = ConstructPoint(XCoordinate=pdecon_5.XComponent, YCoordinate=addition_5, ZCoordinate=pdecon_5.ZComponent)
vec2pt_5 = Vector2Pt(PointA=deplane_10.Origin, PointB=pt_7, Unitize=False)  # -> Vector, Length
move_13 = Move(Geometry=rotate_17.Geometry, Motion=vec2pt_5.Vector)  # -> Geometry, Transform
deplane_11 = DeconstructPlane(Plane=move_13.Geometry)  # -> Origin, XAxis, YAxis, ZAxis
neg_5 = Negative(Value=deplane_11.ZAxis)
unit_5 = UnitVector(Vector=neg_5)
number_5 = Number(0.01)
extrusion_height_5 = Number(4)
multiplication_10 = Multiplication(A=unit_5, B=number_5)
multiplication_11 = Multiplication(A=unit_5, B=extrusion_height_5)
panel_size_6 = Number(400)
move_14 = Move(Geometry=move_13.Geometry, Motion=multiplication_10)  # -> Geometry, Transform
dom_5 = ConstructDomain(DomainStart=expr("-x/2", panel_size_6), DomainEnd=expr("x/2", panel_size_6))
rectangle_6 = Rectangle(Plane=move_14.Geometry, XSize=dom_5, YSize=dom_5, Radius=0)  # -> Rectangle, Length
system_rotation_5 = Number(180)
extr_5 = Extrude(Base=rectangle_6.Rectangle, Direction=multiplication_11)
rad_18 = Radians(Degrees=system_rotation_5)
xy_11 = XYPlane(Origin=Point(0, 0, 0))
cap_5 = CapHoles(Brep=extr_5)
position_1250 = Number(-1.25)
rotate_18 = Rotate(Geometry=flatten(cap_5), Angle=rad_18, Plane=xy_11)  # -> Geometry, Transform
Z_5 = UnitZ(Factor=position_1250)
move_15 = Move(Geometry=rotate_18.Geometry, Motion=Z_5)  # -> Geometry, Transform

xz_10 = XZPlane(Origin=partition)
pdecon_6 = Deconstruct(Point=deplane_9.Origin)  # -> XComponent, YComponent, ZComponent
pt_8 = Point(Point(0, 0, 0))
addition_6 = Addition(A=pdecon_6.YComponent, B=actuator_length)
xz_11 = XZPlane(Origin=pt_8)
rotate_19 = Rotate(Geometry=xz_10, Angle=rad, Plane=xz_10)  # -> Geometry, Transform
pt_9 = ConstructPoint(XCoordinate=pdecon_6.XComponent, YCoordinate=addition_6, ZCoordinate=pdecon_6.ZComponent)
brep = Brep([<brep referenced from the Rhino model> x6])
vec2pt_6 = Vector2Pt(PointA=deplane_9.Origin, PointB=pt_9, Unitize=False)  # -> Vector, Length
lng = ListLength(List=brep)
flatten = FlattenTree(Tree=rotate_19.Geometry, Path="{0}")
move_16 = Move(Geometry=rotate_3.Geometry, Motion=vec2pt_6.Vector)  # -> Geometry, Transform
dup = DuplicateData(Data=flatten, Number=lng, Order=True)
lng_2 = ListLength(List=flatten)
partition_2 = PartitionList(List=dup, Size=lng_2)  # -> simplify(Chunks)
orient = Orient(Geometry=graft(brep), Source=xz_11, Target=partition_2)  # -> Geometry, Transform
brep_2 = Brep([<brep referenced from the Rhino model> x5])
deplane_12 = DeconstructPlane(Plane=move_16.Geometry)  # -> Origin, XAxis, YAxis, ZAxis
lng_3 = ListLength(List=brep_2)
neg_6 = Negative(Value=deplane_12.ZAxis)
flatten_2 = FlattenTree(Tree=move_16.Geometry, Path="{0}")
unit_6 = UnitVector(Vector=neg_6)
pt_10 = Point(Point(0, 68.75, 0))
dup_2 = DuplicateData(Data=flatten_2, Number=lng_3, Order=True)
lng_4 = ListLength(List=flatten_2)
xz_12 = XZPlane(Origin=pt_10)
multiplication_12 = Multiplication(A=unit_6, B=Slider(0.01, range=0..100))
partition_3 = PartitionList(List=dup_2, Size=lng_4)  # -> simplify(Chunks)
rad_19 = Radians(Degrees=panel_angle_3)
orient_2 = Orient(Geometry=graft(brep_2), Source=xz_12, Target=partition_3)  # -> Geometry, Transform
move_17 = Move(Geometry=move_16.Geometry, Motion=multiplication_12)  # -> Geometry, Transform
dom_6 = ConstructDomain(DomainStart=expr("-x/2", panel_size), DomainEnd=expr("x/2", panel_size))
rotate_20 = Rotate(Geometry=move_17.Geometry, Angle=rad_19, Plane=move_17.Geometry)  # -> Geometry, Transform
rectangle_7 = Rectangle(Plane=rotate_20.Geometry, XSize=dom_6, YSize=dom_6, Radius=0)  # -> Rectangle, Length
multiplication_13 = Multiplication(A=unit_6, B=Slider(0.004, range=0..100))

# ----
# create grid of points on surface, then pick only points with indexes [1,1],[1,3],[3,1] and [3,3]
_4 = Number(4)
geo = Geometry(rectangle_2.Rectangle)
sdivide = DivideSurface(Surface=geo, UCount=_4, VCount=_4)  # -> Points, Normals, Parameters
_3 = Number(3)
_1 = Number(1)
item = ListItem(List=sdivide.Points, Index=[_1, _3], Wrap=True)
sift = SiftPattern(List=flatten(item), SiftPattern=[0, 0, 1, 1, 0, 0, 1, 1, 0, 0])  # -> Output0, Output1
geo_2 = Geometry(sift.Output1)
rotate_21 = Rotate(Geometry=flatten(geo_2), Angle=rad_6, Plane=xy_3)  # -> Geometry, Transform
move_18 = Move(Geometry=rotate_21.Geometry, Motion=Z)  # -> Geometry, Transform

_4_2 = Number(4)
geo_3 = Geometry(rectangle_3.Rectangle)
sdivide_2 = DivideSurface(Surface=geo_3, UCount=_4_2, VCount=_4_2)  # -> Points, Normals, Parameters
_3_2 = Number(3)
_1_2 = Number(1)
item_2 = ListItem(List=sdivide_2.Points, Index=[_1_2, _3_2], Wrap=True)
sift_2 = SiftPattern(List=flatten(item_2), SiftPattern=[0, 0, 1, 1, 0, 0, 1, 1, 0, 0])  # -> Output0, Output1
geo_4 = Geometry(sift_2.Output1)
rotate_22 = Rotate(Geometry=flatten(geo_4), Angle=rad_9, Plane=xy_5)  # -> Geometry, Transform
move_19 = Move(Geometry=rotate_22.Geometry, Motion=Z_2)  # -> Geometry, Transform

_4_3 = Number(4)
geo_5 = Geometry(rectangle_5.Rectangle)

_4_4 = Number(4)
geo_6 = Geometry(rectangle_4.Rectangle)
sdivide_3 = DivideSurface(Surface=geo_6, UCount=_4_4, VCount=_4_4)  # -> Points, Normals, Parameters
_3_3 = Number(3)
_1_3 = Number(1)
item_3 = ListItem(List=sdivide_3.Points, Index=[_1_3, _3_3], Wrap=True)
sift_3 = SiftPattern(List=flatten(item_3), SiftPattern=[0, 0, 1, 1, 0, 0, 1, 1, 0, 0])  # -> Output0, Output1
geo_7 = Geometry(sift_3.Output1)
rotate_23 = Rotate(Geometry=flatten(geo_7), Angle=rad_12, Plane=xy_7)  # -> Geometry, Transform
move_20 = Move(Geometry=rotate_23.Geometry, Motion=Z_3)  # -> Geometry, Transform

xz_13 = XZPlane(Origin=Point(0, 0, 0))
_4_5 = Number(4)
geo_8 = Geometry(rectangle_6.Rectangle)
extr_6 = Extrude(Base=rectangle_7.Rectangle, Direction=multiplication_13)
crv = Curve(<curve referenced from the Rhino model>)
sdivide_4 = DivideSurface(Surface=geo_5, UCount=_4_3, VCount=_4_3)  # -> Points, Normals, Parameters
sdivide_5 = DivideSurface(Surface=geo_8, UCount=_4_5, VCount=_4_5)  # -> Points, Normals, Parameters
vec2pt_7 = Vector2Pt(PointA=xz_13, PointB=partition, Unitize=False)  # -> Vector, Length
cap_6 = CapHoles(Brep=extr_6)
_3_4 = Number(3)
_1_4 = Number(1)
_3_5 = Number(3)
_1_5 = Number(1)
move_21 = Move(Geometry=crv, Motion=vec2pt_7.Vector)  # -> Geometry, Transform

system_rotation_6 = Slider(180, range=0..360)
rad_20 = Radians(Degrees=system_rotation_6)
xy_12 = XYPlane(Origin=Point(0, 0, 0))
rotate_24 = Rotate(Geometry=flatten(cap_6), Angle=rad_20, Plane=xy_12)  # -> Geometry, Transform

item_4 = ListItem(List=sdivide_4.Points, Index=[_1_4, _3_4], Wrap=True)
item_5 = ListItem(List=sdivide_5.Points, Index=[_1_5, _3_5], Wrap=True)
flatten_3 = FlattenTree(Tree=move_21.Geometry, Path="{0}")  # -> simplify(graft(Tree))
flatten_4 = FlattenTree(Tree=move_16.Geometry, Path="{0}")  # -> simplify(graft(Tree))
sift_4 = SiftPattern(List=flatten(item_4), SiftPattern=[0, 0, 1, 1, 0, 0, 1, 1, 0, 0])  # -> Output0, Output1
sift_5 = SiftPattern(List=flatten(item_5), SiftPattern=[0, 0, 1, 1, 0, 0, 1, 1, 0, 0])  # -> Output0, Output1
Y = UnitY(Factor=1)
geo_9 = Geometry(sift_4.Output1)
projecta = ProjectAlong(Geometry=flatten_3, Plane=flatten_4, Direction=Y)  # -> Geometry, Transform
geo_10 = Geometry(sift_5.Output1)
merge = Merge(Data1=flatten_3, Data2=projecta.Geometry)
rotate_25 = Rotate(Geometry=flatten(geo_9), Angle=rad_15, Plane=xy_9)  # -> Geometry, Transform
rotate_26 = Rotate(Geometry=flatten(geo_10), Angle=rad_18, Plane=xy_11)  # -> Geometry, Transform
position_1250_2 = Number(1.25)
loft = Loft(Curves=merge, Options={Adjust=False, Closed=False, LoftEnds=0, LoftSimp=0, LoftType=0, Rebuild=10, Refit=0.01})
merge_2 = Merge(
    Data1=loft,
    Data2=cap_6,
    Data3=orient_2.Geometry,
    Data4=orient.Geometry,
    Data5=rectangle.Rectangle,
    Data6=pline_3,
    Data7=pline_4)

system_rotation_7 = Slider(180, range=0..360)
rad_21 = Radians(Degrees=system_rotation_7)
xy_13 = XYPlane(Origin=Point(0, 0, 0))
rotate_27 = Rotate(Geometry=merge_2, Angle=rad_21, Plane=xy_13)  # -> Geometry, Transform

move_22 = Move(Geometry=rotate_25.Geometry, Motion=Z_4)  # -> Geometry, Transform
Z_6 = UnitZ(Factor=position_1250_2)

# ----
# create grid of points on surface, then pick only points with indexes [1,1],[1,3],[3,1] and [3,3]
_4_6 = Number(4)
geo_11 = Geometry(rectangle_7.Rectangle)
sdivide_6 = DivideSurface(Surface=geo_11, UCount=_4_6, VCount=_4_6)  # -> Points, Normals, Parameters
_3_6 = Number(3)
_1_6 = Number(1)
item_6 = ListItem(List=sdivide_6.Points, Index=[_1_6, _3_6], Wrap=True)
sift_6 = SiftPattern(List=flatten(item_6), SiftPattern=[0, 0, 1, 1, 0, 0, 1, 1, 0, 0])  # -> Output0, Output1
geo_12 = Geometry(sift_6.Output1)
rotate_28 = Rotate(Geometry=flatten(geo_12), Angle=rad_20, Plane=xy_12)  # -> Geometry, Transform
move_23 = Move(Geometry=rotate_28.Geometry, Motion=Z_6)  # -> Geometry, Transform

move_24 = Move(Geometry=rotate_26.Geometry, Motion=Z_5)  # -> Geometry, Transform
move_25 = Move(Geometry=rotate_24.Geometry, Motion=Z_6)  # -> Geometry, Transform
_0_001 = Number(0.001)
scale = Scale(Geometry=move_24.Geometry, Center=Point(0, 0, 0), Factor=_0_001)  # -> Geometry, Transform
clean_2 = CleanTree(Tree=scale.Geometry, CleanInvalid=True, CleanEmpty=False)
toggle = BooleanToggle(False)
number_slider_2 = Slider(0.5, range=0..1)
wu = WindowUnit(
    Brep=<geometry referenced from the Rhino model>,
    Brep_2=<geometry referenced from the Rhino model>,
    GetAssembly=7,
    GetCustom=False,
    GetGas=[-1, -1],
    GetGlass=[-1, -1, -1],
    GetLayerNum=1,
    GetSimpleState=0)  # -> Window, Window_2
ca = ConstructionAssembly(
    Brep=<geometry referenced from the Rhino model>,
    Brep_2=<geometry referenced from the Rhino model>,
    GetAssembly=12,
    GetCustom=False,
    GetLayerNum=1,
    GetMaterials=[-1, -1, -1, -1, -1])  # -> Zone, Zone_2
ca_2 = ConstructionAssembly(
    Brep=[<geometry referenced from the Rhino model> x5],
    Brep_2=[<geometry referenced from the Rhino model> x5],
    GetAssembly=6,
    GetCustom=False,
    GetLayerNum=1,
    GetMaterials=[-1, -1, -1, -1, -1])  # -> Zone, Zone_2
shade = Shade(
    Brep=move_15.Geometry,
    SR=number_slider_2,
    VR=number_slider_2,
    GlazedFraction=0,
    Brep_2=move_15.Geometry,
    SR_2=number_slider_2,
    VR_2=number_slider_2,
    GlazedFraction_2=0)  # -> Shade, Shade_2
toggle_2 = BooleanToggle(False)
panel_2 = Panel("Grasshopper_Thermal_no1")
viper = ViperDIVAThermalAnalysisForGH(
    ProjectName=panel_2,
    People_m2=0.1,
    Lights_W_m2=11.74,
    Equipment_W_m2=4,
    HeatingSetPoint_deg_C=22,
    CoolingSetPoint_deg_C=26,
    HeatingCOP=0.8,
    CoolingCOP=3,
    Infiltration=0.5,
    FreshAir=0.00944,
    ZoneBreps=[ca_2.Zone_2, ca.Zone_2],
    Window=wu.Window_2,
    Shade=shade.Shade_2,
    WriteOnly=False,
    RunSimulation=toggle_2,
    ProjectName_2=panel_2,
    People_m2_2=0.1,
    Lights_W_m2_2=11.74,
    Equipment_W_m2_2=4,
    HeatingSetPoint_deg_C_2=22,
    CoolingSetPoint_deg_C_2=26,
    HeatingCOP_2=0.8,
    CoolingCOP_2=3,
    Infiltration_2=0.5,
    FreshAir_2=0.00944,
    ZoneBreps_2=[ca_2.Zone_2, ca.Zone_2],
    Window_2=wu.Window_2,
    Shade_2=shade.Shade_2,
    WriteOnly_2=False,
    RunSimulation_2=toggle_2,
    CustomDates=False,
    Location=16,
    Occupancy=0,
    OutputStates=[True, True, False, False, True, False, True, True, False, False, False, False, False, False, False, False, False, False, False],
    ReportingPeriod=2,
    RunPeriod=0,
    ShadowFreq=30,
    ShadowOverlap=15000,
    SolarDist=2,
    Timestep=0)  # -> OutputMessage, MetricHeatingE, MetricCoolingE, MetricElecLights, MetricGainsBeam, MetricGainsDifffuse, OutputMessage_2, MetricHeatingE_2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
panel_3 = Panel(viper.OutputMessage_2)
panel_4 = Panel([viper.MetricHeatingE_2, viper.MetricCoolingE_2])
panel_5 = Panel(viper.MetricElecLights_2)
panel_6 = Panel([viper.MetricGainsBeam_2, viper.MetricGainsDifffuse_2])
