# Grasshopper definition Room_v18.gh (Grasshopper 0.9.76)
# plug-ins: DIVA.ForGrasshopper

panel_angle_1 = Slider(0, range=-90..90)
# Panel Angle 1 - tilt along the horizontal axis
# Panel Angle 2 - Tilt along the vertical axis
# Panel Angle 3 - Rotate along the normal axis
panel_angle_2 = Slider(45, range=1..89)
grid_angle = Slider(0, range=0..90)
panel_spacing = Slider(500, range=0..1000)
frame_size_x = Slider(4500, range=0..5000)
panel_size = Slider(400, range=0..1000)
panel_angle_3 = Slider(0, range=0..90)
actuator_length = Slider(300, range=0..300)
frame_size_y = Slider(5000, range=0..5000)
number_slider = Slider(10, range=0..10)
file_name = VBScript()  # -> out, A
# ---------- file_name: C# ----------
    print(y + x * 100)
# ---------- end file_name ----------
file_name_2 = VBScript()  # -> out, A; same code as file_name
multiplication = Multiplication(A=panel_spacing, B=number_slider)
boolean_toggle = BooleanToggle(False)
construct_point = ConstructPoint(XCoordinate=expr("-x/2", multiplication), YCoordinate=0, ZCoordinate=expr("-x/2", multiplication))
radians = Radians(Degrees=grid_angle)
xz_plane = XZPlane(Origin=Point(0, 0, 0))
xz_plane_2 = XZPlane(Origin=construct_point)
construct_point_2 = ConstructPoint(XCoordinate=expr("-x/2", frame_size_x), YCoordinate=0, ZCoordinate=expr("-x/2", frame_size_y))
rotate = Rotate(Geometry=xz_plane_2, Angle=radians, Plane=xz_plane)  # -> Geometry, Transform
xz_plane_3 = XZPlane(Origin=construct_point_2)
rectangular = Rectangular(Plane=rotate.Geometry, SizeX=panel_spacing, SizeY=panel_spacing, ExtentX=number_slider, ExtentY=number_slider)  # -> Cells, Points
rectangle = Rectangle(Plane=xz_plane_3, XSize=frame_size_x, YSize=frame_size_y, Radius=0)  # -> Rectangle, Length
panel = Panel(rectangular.Points)
point_in_curve = PointInCurve(Point=rectangular.Points, Curve=rectangle.Rectangle)  # -> Relationship, Point
radians_h = Radians(Degrees=panel_angle_1)
radians_v = Radians(Degrees=panel_angle_2)
# Selects the pannels within the boundry into List A
dispatch = Dispatch(List=rectangular.Points, DispatchPattern=point_in_curve.Relationship)  # -> simplify(ListA), ListB
flip_matrix = FlipMatrix(Data=rectangular.Points)
xz_plane_4 = XZPlane(Origin=dispatch.ListA)
polyline = PolyLine(Vertices=flip_matrix, Closed=False)  # -> simplify(Polyline)
xy_plane = XYPlane(Origin=dispatch.ListA)
panel_2 = Panel(dispatch.ListA)
rotate_h = Rotate(Geometry=xz_plane_4, Angle=radians_h, Plane=xy_plane)  # -> Geometry, Transform
polyline_2 = PolyLine(Vertices=rectangular.Points, Closed=False)  # -> simplify(Polyline)
yz_plane = YZPlane(Origin=dispatch.ListA)
curve_curve = CurveCurve(CurveA=polyline, CurveB=rectangle.Rectangle)  # -> Points, ParamsA, ParamsB
curve_curve_2 = CurveCurve(CurveA=polyline_2, CurveB=rectangle.Rectangle)  # -> Points, ParamsA, ParamsB
rotate_v = Rotate(Geometry=rotate_h.Geometry, Angle=radians_v, Plane=yz_plane)  # -> Geometry, Transform
polyline_3 = PolyLine(Vertices=curve_curve.Points, Closed=False)
# combines the multiple arrays into a single array
clean_tree = CleanTree(Tree=dispatch.ListA, CleanInvalid=True, CleanEmpty=True)  # -> flatten(Tree)
polyline_4 = PolyLine(Vertices=curve_curve_2.Points, Closed=False)
deconstruct_plane = DeconstructPlane(Plane=rotate_v.Geometry)  # -> Origin, XAxis, YAxis, ZAxis
partition_list = PartitionList(List=clean_tree, Size=3)  # -> simplify(Chunks)
panel_3 = Panel(clean_tree)
deconstruct = Deconstruct(Point=deconstruct_plane.Origin)  # -> XComponent, YComponent, ZComponent
xz_plane_5 = XZPlane(Origin=partition_list)
point = Point(Point(0, 0, 0))
panel_4 = Panel("Add Actuator Length")
xz_plane_6 = XZPlane(Origin=point)
addition = Addition(A=deconstruct.YComponent, B=actuator_length)
rotate_2 = Rotate(Geometry=xz_plane_5, Angle=radians, Plane=xz_plane_5)  # -> Geometry, Transform
construct_point_3 = ConstructPoint(XCoordinate=deconstruct.XComponent, YCoordinate=addition, ZCoordinate=deconstruct.ZComponent)
brep = Brep([<brep referenced from the Rhino model> x6])
list_length = ListLength(List=brep)
flatten_tree = FlattenTree(Tree=rotate_2.Geometry, Path="{0}")
vector_2pt = Vector2Pt(PointA=deconstruct_plane.Origin, PointB=construct_point_3, Unitize=False)  # -> Vector, Length
list_length_2 = ListLength(List=flatten_tree)
panel_5 = Panel(flatten_tree)
duplicate_data = DuplicateData(Data=flatten_tree, Number=list_length, Order=True)
# moving planes back by the cantelever size
move = Move(Geometry=rotate_v.Geometry, Motion=vector_2pt.Vector)  # -> Geometry, Transform
panel_6 = Panel(move.Geometry)
deconstruct_plane_2 = DeconstructPlane(Plane=move.Geometry)  # -> Origin, XAxis, YAxis, ZAxis
partition_list_2 = PartitionList(List=duplicate_data, Size=list_length_2)  # -> simplify(Chunks)
panel_7 = Panel(duplicate_data)
panel_8 = Panel(deconstruct_plane_2.ZAxis)
negative = Negative(Value=deconstruct_plane_2.ZAxis)
orient = Orient(Geometry=graft(brep), Source=xz_plane_6, Target=partition_list_2)  # -> Geometry, Transform
panel_9 = Panel("Extrusion Vector")
panel_10 = Panel(partition_list_2)
unit_vector = UnitVector(Vector=negative)
radians_2 = Radians(Degrees=panel_angle_3)
construct_domain = ConstructDomain(DomainStart=expr("-x/2", panel_size), DomainEnd=expr("x/2", panel_size))
panel_11 = Panel("Size of panels")
panel_12 = Panel("Panel Thickness")
panel_13 = Panel(orient.Geometry)
multiplication_2 = Multiplication(A=unit_vector, B=Slider(10, range=0..100))
move_2 = Move(Geometry=move.Geometry, Motion=multiplication_2)  # -> Geometry, Transform
multiplication_3 = Multiplication(A=unit_vector, B=Slider(4, range=0..100))
# Rotating the panel along the y (outward facing) axis
rotate_3 = Rotate(Geometry=move_2.Geometry, Angle=radians_2, Plane=move_2.Geometry)  # -> Geometry, Transform
rectangle_2 = Rectangle(Plane=rotate_3.Geometry, XSize=construct_domain, YSize=construct_domain, Radius=0)  # -> Rectangle, Length
# Producing the physical geometry
extrude = Extrude(Base=rectangle_2.Rectangle, Direction=multiplication_3)
cap_holes = CapHoles(Brep=extrude)
# Data 2- Physical Geometry?
# D4- I think it is meant to be the PV locations
# D5 - Frame Size
# D6- Vertical Lines
# D7- Horizontal Lines
merge = Merge(Data2=cap_holes, Data4=orient.Geometry, Data5=rectangle.Rectangle, Data6=polyline_4, Data7=polyline_3)

system_rotation = Slider(180, range=0..360)
xy_plane_2 = XYPlane(Origin=Point(0, 0, 0))
# I think that this is some form of recording or debugging
radians_3 = Radians(Degrees=system_rotation)
rotate_4 = Rotate(Geometry=merge, Angle=radians_3, Plane=xy_plane_2)  # -> Geometry, Transform

# ----
# Why are we doing a negative offset and rotating 180degrees
system_rotation_2 = Slider(180, range=0..360)
# Change the orientation of the facade
radians_4 = Radians(Degrees=system_rotation_2)
xy_plane_3 = XYPlane(Origin=Point(0, 0, 0))
rotate_5 = Rotate(Geometry=flatten(cap_holes), Angle=radians_4, Plane=xy_plane_3)  # -> Geometry, Transform

position_1250 = Number(1250)
unit_z = UnitZ(Factor=position_1250)
panel_14 = Panel(rotate_5.Geometry)
number = Number(0.5)
brep_2 = Brep([<brep referenced from the Rhino model> x99])
brep_3 = Brep(<brep referenced from the Rhino model>)
# I think the move is to get 6 lines of PV pannels fixed over the window
move_3 = Move(Geometry=rotate_5.Geometry, Motion=unit_z)  # -> Geometry, Transform
brep_4 = Brep([<brep referenced from the Rhino model> x5])
brep_5 = Brep(<brep referenced from the Rhino model>)
shade = Shade(Brep=brep_2, SR=number, VR=number, GlazedFraction=0, Brep_2=brep_2, SR_2=number, VR_2=number, GlazedFraction_2=0)  # -> Shade, Shade_2
window_unit = WindowUnit(
    Brep=brep_3,
    Brep_2=brep_3,
    GetAssembly=9,
    GetCustom=False,
    GetGas=[-1, -1],
    GetGlass=[-1, -1, -1],
    GetLayerNum=1,
    GetSimpleState=0)  # -> Window, Window_2
construction_assembly = ConstructionAssembly(Brep=brep_4, Brep_2=brep_4, GetAssembly=6, GetCustom=False, GetLayerNum=1, GetMaterials=[-1, -1, -1, -1, -1])  # -> Zone, Zone_2
construction_assembly_2 = ConstructionAssembly(Brep=brep_5, Brep_2=brep_5, GetAssembly=12, GetCustom=False, GetLayerNum=1, GetMaterials=[-1, -1, -1, -1, -1])  # -> Zone, Zone_2
# what material should be used
material = Material(Geometry=move_3.Geometry, Geometry_2=move_3.Geometry, Material="OutsideFacade_35")  # -> GeometryWithMaterialAssigned, GeometryWithMaterialAssigned_2
diva_daylight_analysis_for_gh = DIVADaylightAnalysisForGH(
    ProjectName="323",
    GeometryWithRadianceMaterialReference=material.GeometryWithMaterialAssigned_2,
    WriteOnly=False,
    RunSimulation=boolean_toggle,
    ProjectName_2="323",
    GeometryWithRadianceMaterialReference_2=material.GeometryWithMaterialAssigned_2,
    WriteOnly_2=False,
    RunSimulation_2=boolean_toggle,
    Climate_Occ=0,
    Climate_RadParam="-ab 2 -ad 1000 -as 20 -ar 300 -aa 0.1",
    DF_RadParam="-ab 2 -ad 1000 -as 20 -ar 300 -aa 0.1",
    DimIrr=200,
    DirIrr=800,
    Ill_RadParam="-ab 2 -ad 1000 -as 20 -ar 300 -aa 0.1",
    Insol_CustomDates=False,
    Insol_EndDay=30,
    Insol_EndMonth=11,
    Insol_RadParam="-ab 2 -ad 1000 -as 20 -ar 300 -aa 0.1",
    Insol_StartDay=0,
    Insol_StartMonth=0,
    Insol_Vis_RadParam="-ab 2 -ad 1000 -as 20 -ar 300 -aa 0.1",
    InsolationPeriod=0,
    Irr_FC_legend_max="auto",
    Light_Operation=3,
    Lighting_Param="-W 250.0 -Set 300 -Loss 20 -Standby 0.0",
    Location="CHE_Geneva.067000_IWEC.epw",
    Lum_FC_legend_max="auto",
    MDH_Input=False,
    MinIll=300,
    OutputStates=[True, False, False, False, False],
    Quality=0,
    Rhino_Include=True,
    SimulationType=5,
    SkyCond=0,
    StartDay=20,
    StartHour=12,
    StartMonth=5,
    Vis_RadParam="-ps 8 -pt .15 -pj .6 -dj 0 -ds .5 -dt .5 -dc .25 -dr 0 -dp 64 -st .85 -ab 2 -aa .25 -ar 16 -ad 512 -as 128 -lr 4 -lw .05 -av 0 0 0",
    X_Resolution=920,
    Y_Resolution=480)  # -> OutputMessage, MetricTIF, OutputMessage_2, MetricTIF_2
panel_15 = Panel(diva_daylight_analysis_for_gh.MetricTIF_2)
panel_16 = Panel(diva_daylight_analysis_for_gh.OutputMessage_2)
boolean_toggle_2 = BooleanToggle(False)
viper_diva_thermal_analysis_for_gh = ViperDIVAThermalAnalysisForGH(
    ProjectName="Viper_Temp",
    People_m2=0.1,
    Lights_W_m2=11.74,
    Equipment_W_m2=4,
    HeatingSetPoint_deg_C=22,
    CoolingSetPoint_deg_C=26,
    HeatingCOP=0.8,
    CoolingCOP=3,
    Infiltration=0.5,
    FreshAir=0.00944,
    ZoneBreps=[construction_assembly_2.Zone_2, construction_assembly.Zone_2],
    Window=window_unit.Window_2,
    Shade=shade.Shade_2,
    WriteOnly=False,
    RunSimulation=boolean_toggle_2,
    ProjectName_2="Viper_Temp",
    People_m2_2=0.1,
    Lights_W_m2_2=11.74,
    Equipment_W_m2_2=4,
    HeatingSetPoint_deg_C_2=22,
    CoolingSetPoint_deg_C_2=26,
    HeatingCOP_2=0.8,
    CoolingCOP_2=3,
    Infiltration_2=0.5,
    FreshAir_2=0.00944,
    ZoneBreps_2=[construction_assembly_2.Zone_2, construction_assembly.Zone_2],
    Window_2=window_unit.Window_2,
    Shade_2=shade.Shade_2,
    WriteOnly_2=False,
    RunSimulation_2=boolean_toggle_2,
    CustomDates=False,
    Location=16,
    Occupancy=0,
    OutputStates=[True, True, False, False, True, True, False, False, False, False, False, False, False, False, False, False, False, False, False],
    ReportingPeriod=2,
    RunPeriod=0,
    ShadowFreq=30,
    ShadowOverlap=15000,
    SolarDist=2,
    Timestep=2)  # -> OutputMessage, MetricHeatingE, MetricCoolingE, MetricElecLights, MetricElecEquip, OutputMessage_2, MetricHeatingE_2, MetricCoolingE_2, MetricElecLights_2, MetricElecEquip_2
panel_17 = Panel(viper_diva_thermal_analysis_for_gh.MetricHeatingE_2)
panel_18 = Panel(viper_diva_thermal_analysis_for_gh.MetricCoolingE_2)
bar_graph = BarGraph(viper_diva_thermal_analysis_for_gh.MetricHeatingE_2, BarColor=RGB(255, 0, 90))
panel_19 = Panel(viper_diva_thermal_analysis_for_gh.OutputMessage_2)
