# Grasshopper definition shading_study_test_case_CWM.gh (Grasshopper 0.9.76)
# plug-ins: Python Interpreter

ladybug = Ladybug_Ladybug()  # -> Vviiiiiiiiiizzz; plug-in component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
number_slider = Slider(6, range=1..24)
open_weather_file = Ladybug_OpenEPWWeatherFile(open=Toggle(True))  # -> epwFile; plug-in component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
panel = Panel("C:\Users\Assistenz\ASF_Simulation\WeatherData\CHE_Geneva.067000_IWEC.epw")
addition = Addition(A=number_slider, B=Slider(1, range=1..24))
gencumulativeskymtx = Ladybug_GenCumulativeSkyMtx(epwFile=panel, skyDensity=0, useOldRes=Toggle(True), runIt=True)  # -> readMe, cumulativeSkyMtx; plug-in component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
analysisperiod = Ladybug_AnalysisPeriod(
    fromMonth=Slider(6, range=1..12),
    fromDay=Slider(21, range=0..31),
    fromHour=number_slider,
    toMonth=Slider(6, range=1..12),
    toDay=Slider(21, range=0..100),
    toHour=addition)  # -> readMe, analysisPeriod; plug-in component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
panel_2 = Panel(gencumulativeskymtx.readMe)
selectskymtx = Ladybug_selectSkyMtx(
    cumulativeSkyMtx=gencumulativeskymtx.cumulativeSkyMtx,
    analysisPeriod=analysisperiod.analysisPeriod,
    removeDiffuse=Toggle(False),
    removeDirect=False)  # -> readMe, selectedSkyMtx; plug-in component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
north_vector = Vector2Pt(PointA=Point(-313.3265514, 19.84750166, 0), PointB=Point(-313.3265514, 345.3380921, 0), Unitize=False)  # -> Vector, Length
vdis = VectorDisplay(Anchor=Point(-313.3265514, 19.84750166, 0), Vector=north_vector.Vector)
windows = Geometry(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)
opaque = Geometry([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])
windows_2 = Geometry(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)
panel_3 = Panel(selectskymtx.selectedSkyMtx)
opaque_2 = Geometry(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)
toggle = BooleanToggle(True)
# west base case
radiationanalysis = Ladybug_RadiationAnalysis(
    north=north_vector.Vector,
    geometry=flatten(windows_2),
    context=flatten(opaque_2),
    gridSize=Slider(0.5, range=0..1),
    disFromBase=Slider(0.01, range=0..0.01),
    selectedSkyMtx=flatten(selectskymtx.selectedSkyMtx),
    runIt=Toggle(True))  # -> readMe, contextMesh, analysisMesh, testPts, testVec, port, radiationResult, radiationMesh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; plug-in component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
# west base case shade
radiationanalysis_2 = Ladybug_RadiationAnalysis(
    north=north_vector.Vector,
    geometry=flatten(windows),
    context=flatten(opaque),
    gridSize=Slider(0.5, range=0..1),
    disFromBase=Slider(0.01, range=0..0.01),
    selectedSkyMtx=flatten(selectskymtx.selectedSkyMtx),
    runIt=Toggle(True))  # -> readMe, contextMesh, analysisMesh, testPts, testVec, port, radiationResult, radiationMesh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; plug-in component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
skydome = Ladybug_SkyDome(north=north_vector.Vector, selectedSkyMtx=selectskymtx.selectedSkyMtx, showTotalOnly=toggle, runIt=toggle, bakeIt=False)  # -> readMe, skyPatchesMesh, baseCrvs, legend, legendBasePts, skyPatchesCenPts, skyPatchesAreas, skyPatchesAsBrep, values; plug-in component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
mesh = Mesh(radiationanalysis_2.radiationLegend)
mesh_2 = Mesh(radiationanalysis.analysisMesh)
mesh_3 = Mesh(radiationanalysis.radiationMesh)
mesh_4 = Mesh(radiationanalysis.contextMesh)
mesh_5 = Mesh(radiationanalysis_2.analysisMesh)
mesh_6 = Mesh(radiationanalysis_2.radiationMesh)
mesh_7 = Mesh(radiationanalysis_2.contextMesh)
radiation_w_shading_kwh = Panel(radiationanalysis_2.totalRadiation)
radiation_w_shading_kwh_2 = Panel(radiationanalysis.totalRadiation)
number_slider_2 = Slider(15, range=1..24)
# SHGC for VNE 1-63
panel_4 = Panel(".29")  # disabled
# SHGC for VNE 1-63
panel_5 = Panel(".29")
multiplication = Multiplication(A=radiation_w_shading_kwh, B=panel_4)  # disabled
multiplication_2 = Multiplication(A=radiation_w_shading_kwh_2, B=panel_5)
addition_2 = Addition(A=number_slider_2, B=Slider(1, range=0..1))
# KWh Solar Gain accounting for SHGC
panel_6 = Panel(multiplication)  # disabled
# KWh Solar Gain accounting for SHGC
panel_7 = Panel(multiplication_2)
analysisperiod_2 = Ladybug_AnalysisPeriod(
    fromMonth=Slider(6, range=1..12),
    fromDay=Slider(21, range=0..100),
    fromHour=number_slider_2,
    toMonth=Slider(6, range=1..12),
    toDay=Slider(21, range=0..100),
    toHour=addition_2)  # -> readMe, analysisPeriod; plug-in component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
panel_8 = Panel("3.412")  # disabled
multiplication_3 = Multiplication(A=panel_6, B=panel_8)  # disabled
multiplication_4 = Multiplication(A=panel_7, B="3.412")
# kBTU solar gain accounting for SHGC
panel_9 = Panel(multiplication_3)  # disabled
# kBTU solar gain accounting for SHGC
panel_10 = Panel(multiplication_4)
division = Division(A=panel_9, B=panel_10)
expression = Expression(x=division, Expression="1-x")
panel_11 = Panel(expression)
