# Grasshopper definition PJ_Trial.gh (Grasshopper 0.9.76)
# plug-ins: DIVA.ForGrasshopper, Python Interpreter, HoopSnake

# ----
# Building Geometry Inputs
vertical_downward_translation = Slider(220, range=-1000..1000)
panel_thickness_mm = Slider(0.9, range=0.5..10)
panel_spacing_mm = Slider(609.7, range=200..1500)
edge_tolerance = Slider(142.2, range=0..1000)
panel_offset_mm = Slider(700, range=100..1000)
room_height = Slider(3100, range=1000..20000)
room_depth = Slider(4576, range=1000..20000)
room_width = Slider(5324, range=1000..20000)
glazing = Slider(0.85, range=0..1)
panel_size_mm = Slider(261.5, range=100..500)

# ----
# ASF Inputs
number_of_custers = Slider(3, range=1..3)
combination = Slider(5341, range=0..10000)

# ----
# Render the Building
render_room = PythonScript(room_depth=room_depth, room_width=room_width, room_height=room_height, glazing_percentage=glazing)  # -> WallF, AdiabaticSurfaces, WallG
# ---------- render_room: Python ----------
#12.10.2015
#Prageeth Jayathissa
#Script for rendering the room based on input dimensions

import rhinoscriptsyntax as rs

#Room Dimensions (mm)
#room_depth=5000
#room_width=3700
#room_height=3000 #Check value (approximation)
#floorThick=200
#ceilThick=200
#intWallThick=110 #Real value is 110mm
#glazeThick=110 #Check this value again

intWallHeight=room_height

gp=glazing_percentage


#Define Global Plane
planexy=rs.WorldXYPlane()
planezx=rs.WorldZXPlane()
planeyz=rs.WorldYZPlane()

print planexy
#Create rectangle of floor and extrude 200mm
#base=rs.AddRectangle(plane, room_width+intWallThick*2, room_depth)

planeR=rs.PlaneFromNormal((room_width,0,0),(1,0,0))
planeB=rs.PlaneFromNormal((0,room_depth,0),(0,1,0))
planeC=rs.PlaneFromNormal((0,0,room_height),(0,0,1))
#myBox=rs.ExtrudeCurveStraight(base,(0,0,0),(0,0,room_height))

WallF=rs.AddPlaneSurface(planezx,room_height,room_width)
WallL=rs.AddPlaneSurface(planeyz,room_depth,room_height)
WallR=rs.AddPlaneSurface(planeR,room_depth,room_height)
WallB=rs.AddPlaneSurface(planeB,room_height,room_width)

Floor=rs.AddPlaneSurface(planexy,room_width,room_depth)
Ceiling=rs.AddPlaneSurface(planeC,room_width,room_depth)

WallG=rs.AddPlaneSurface(planezx,room_height*gp,room_width*gp)
WallG=rs.MoveObject(WallG,((1-gp)*room_width/2,0,(1-gp)*room_height/2))

AdiabaticSurfaces=[Floor,Ceiling,WallL,WallR,WallB]
# ---------- end render_room ----------

# ----
# GraveYard
# Comment: Use this to Bypass the Slow Combination Maker Function.
internal_wall_thickness = Slider(110, range=10..500)
glazing_thickness = Slider(110, range=10..500)
ceiling_thickness = Slider(10, range=10..500)
floor_thickness = Slider(10, range=10..500)
xy_plane = XYPlane(Origin=Point(0, 0, 0))
x_angle = Slider(0, range=0..90)
y_angle = Slider(45, range=-45..45)
rectangle = Rectangle(Plane=xy_plane, XSize=Domain(-1, 1), YSize=Domain(-2, 2), Radius=0)  # -> Rectangle, Length
render_room_2 = PythonScript(
    intWallThick=internal_wall_thickness,
    floorThick=floor_thickness,
    ceilThick=ceiling_thickness,
    glazeThick=glazing_thickness)  # -> floor, WallR, WallL, WallB, WallG, Ceiling
# ---------- render_room_2: Python ----------
#12.10.2015
#Prageeth Jayathissa
#Script for rendering the room based on input dimensions

import rhinoscriptsyntax as rs

#Room Dimensions (mm)
#room_depth=5000
#room_width=3700
#room_height=3000 #Check value (approximation)
#floorThick=200
#ceilThick=200
#intWallThick=110 #Real value is 110mm
#glazeThick=110 #Check this value again

intWallHeight=room_height


#Define Global Plane
plane=rs.WorldXYPlane()

#Create rectangle of floor and extrude 200mm
base=rs.AddRectangle(plane, room_width+intWallThick*2, room_depth)
floor=rs.ExtrudeCurveStraight(base,(0,0,0),(0,0,floorThick))

#Create three adiabatic walls and extrude
#Right Wall
Wbase=rs.AddRectangle(plane, intWallThick,room_depth)
WallR=rs.ExtrudeCurveStraight(Wbase,(0,0,0),(0,0,intWallHeight))
WallR=rs.MoveObject(WallR,[room_width+intWallThick,0,floorThick])
#Left wall using WBase
WallL=rs.ExtrudeCurveStraight(Wbase,(0,0,0),(0,0,intWallHeight))
WallL=rs.MoveObject(WallL,[0,0,floorThick])

#Back Wall
WbaseB=rs.AddRectangle(plane, room_width, intWallThick)
WallB=rs.ExtrudeCurveStraight(WbaseB,(0,0,0),(0,0,intWallHeight))
WallB=rs.MoveObject(WallB, [intWallThick, room_depth-intWallThick,floorThick])

#Glazing
WbaseG=rs.AddRectangle(plane, room_width, glazeThick)
WallG=rs.ExtrudeCurveStraight(WbaseG,(0,0,0),(0,0,intWallHeight))
WallG=rs.MoveObject(WallG,[intWallThick,0,floorThick])

#Ceiling
Ceiling=rs.ExtrudeCurveStraight(base,(0,0,0),(0,0,ceilThick))
Ceiling=rs.MoveObject(Ceiling, [0,0,room_height+floorThick])

#ASF Frame Size
#ASFheight=intWallHeight
#ASFWidth=room_width
# ---------- end render_room_2 ----------
box_rectangle = BoxRectangle(Rectangle=rectangle.Rectangle, Height=Domain(0, 10))
back_wall = Box(render_room_2.WallB)
ceiling = Box(render_room_2.Ceiling)
glazing_2 = Box(render_room_2.WallG)
left_wall = Box(render_room_2.WallL)
right_wall = Box(render_room_2.WallR)
floor = Box(render_room_2.floor)
angles_generator_bypass = PythonScript(xangle=x_angle, yangle=y_angle)  # -> out, outputASFangles
# ---------- angles_generator_bypass: Python ----------
#13.10.2015
#Prageeth Jayathissa
#Python script to render angles of the facade quickly

#Status: Complete

#------------------------------------------------

import json
import rhinoscriptsyntax as rs
import copy

#Load JSON file

XANGLES=[0,90]
YANGLES=[-45,-30,-15,0,15,30,45]

#xangle=45
#yangle=10
ASFarray=json.loads(outputASFarray)

ASFangles=copy.deepcopy(ASFarray)


for kk in range(2): #range(len(XANGLES)**len(ASFarray)):
    icount=0
    for ii in ASFarray:
        jcount=0
        xangle=xangle
        for jj in ii:
            ASFangles[icount][jcount]=[xangle,yangle]
    
    
            jcount+=1
        icount+=1


#Output ASFangles as a JSON
outputASFangles=json.dumps(ASFangles)


print 'done'
# ---------- end angles_generator_bypass ----------
deconstruct_brep = DeconstructBrep(Brep=box_rectangle)  # -> Faces, Edges, Vertices
combination_maker_v1 = PythonScript()  # -> out, outputListASFangles
# ---------- combination_maker_v1: Python ----------
#13.10.2015
#Prageeth Jayathissa
#Python script to produce all possible angle combinations of the facade

#Status: Complete but difficult to read

#Warning: If NoCluster>2 then the program becomes slow

#------------------------------------------------
'''README

This code can be read as three chapters

Chapter1: Produces a list of possible angle combinations for a single panel
    Output: ANGLES - a list of all possible angle combinations

Chapter2: Splits the facade into independant clusters of rows. 
    Output: rowsplit - a list of intergers that indicate the start and end point
        of clusters
    Example: If a facade with 9 rows is split into 2 clusters, rowsplit=[0,4,9]
        this indicates that one cluser starts at 0 and ends at 4
        the second cluster starts at 4 and ends at 9

Chapter3: Itterates through all possible panel combinations and produces an output
    list which contains each outputASFangle combination
    Output: ListASFangles - a list of all possible ASFangles
    
Chapter4: Determines that combination of Angles should be recorded for each itteration
    How it works: In priciple, this is a counter where base= Number of angle combinations
    Example: If number of angles =10 and number of clusters =2 this would be a normal 2digit base10 counter
    rowVal=[0,0]
    rowVal=[0,1]
    ...
    rowVal=[0,9]
    rowVal=[1,0]
    
    if number of angles =49 then
    rowVal=[0,0]
    rowVal=[0,1]
    ...
    rowVal=[0,48]
    rowVal=[1,0]
    rowVal=[1,1] etc
    
    This numer rowVal is then used to call on the ANGLE list produced in Chapter 1
    which is then fed into Chapter 3
        
        '''

#Import Modules------------------------------------------------

import json
import math
import copy
####---CHAPTER1-------------------------

#unpack json file and coppy ASF array to create an empty anglearray
ASFarray=json.loads(outputASFarray)
ASFangles=copy.deepcopy(ASFarray)

#Possible ANgles in simulation
XANGLES=[0,15,30,45,60,75,90]
YANGLES=[-45,-30,-15,0,15,30,45]

#Array to hold final list
ListASFangles=[]

#Number of groups that the facade can exist in (now input to function)
NoClusters=int(NoClusters)
#NoClusters=1
#Number of angle combinations
NoAngles=len(XANGLES)*len(YANGLES)

#Define the angle value that a row is in
#the value is between 0 and NoAngles
rowVal=[0]*NoClusters

#Make a list of all angle combinations
ANGLES= [(x, y) for x in XANGLES for y in YANGLES]

####---CHAPTER2-------------------------

#Deside which rows to break according to the Number
#of clusters
#How many items do we split the ASF into
rowdivide=int(math.floor(len(ASFangles)/NoClusters))
#What is remaining
rowremain=len(ASFangles)%NoClusters
print rowdivide
print rowremain
rowsplit=[]
ii=0
#These are positions within ASF array where we split
for ii in range(NoClusters-1):
    rowsplit.append(rowdivide*(ii+1)+1) #a =y, b=2y...
rowsplit.append(rowdivide*(ii+2)+rowremain) #c=2y+x
#Add a 0 at the start of the list to indicate the top row is 0
rowsplit = [0] + rowsplit
#Bypass funciton if the number of clusters is 1
if NoClusters==1:
    rowsplit=[]
    rowsplit.append(rowdivide) #Note rowdivide=Number of rows
    rowsplit = [0] + rowsplit

print rowsplit

####---CHAPTER3-------------------------

#Loop through all combinations of the facade
keepLooping=True
while keepLooping:
    #If we have reached the maximum number of combinations then break the main loop
    if rowVal==[NoAngles-1]*NoClusters: #eg: if [48,48,48]==[48,48,48]
        keepLooping=False
    #re-initialise jj  jcount and icount 
    jj=0
    jcount=0
    icount=0
    
    #Script to make the ASFAngle matrix
    #Loop through the number of divisions in the facade
    rscount=0 
    #print 'hello'
    #loop through ASFangles matrix to substitute values
    for icount,ii in enumerate(ASFangles):
        for jcount,jj in enumerate(ii):
            
            #if the row is at the point that it should go to the next rowsplit combiniation
            #eg, rowsplit =[0,4,9]
            #+1 is required because icount and rscount start at 0
            if icount+1==rowsplit[rscount+1]: #eg if 4==4
                #if it is not the last element because otherwise rscount is out of bounds
                if rowsplit[-2]!=rowsplit[rscount]:
                    #move to the next rowsplit value
                    rscount+=1
                    
            #Replace ASFAngle unit with angle
            #rowVal: is the ANGLE element identifier between 1,49
            #eg: rowVal=[5,29] the first element is the angle identifier for the top cluster, 
                #the second element is the angle identifier for the second cluster
            #rscount: is rowVal element identifier        
            ASFangles[icount][jcount]=ANGLES[rowVal[rscount]]
    #Store the computed ASFangle in the global array to export
    ListASFangles.append(copy.deepcopy(ASFangles))
    

####---CHAPTER4-------------------------

    #Find the next itteration or rowVal, the Agnel element identifier
    #Process: very similar to a counter where the base=NoAngles, eg base49
    for jcount,jj in enumerate(rowVal):
        #if the number of the position has it its maximum, set to zero
        #and itterate the next column
        if jj==NoAngles-1:
            rowVal[jcount]=0
        #if the number is not the maximum, then increase once more and break the loop
        else:
            rowVal[jcount]+=1
            break

outputListASFangles=json.dumps(ListASFangles)


#This has been commented out as it is not used in Combination Selector
#if combination<len(ListASFangles):
#    outputASFangles=json.dumps(ListASFangles[int(combination)])
#else:
#    outputASFangles=json.dumps(ListASFangles[0])
    
#print ListASFangles
# ---------- end combination_maker_v1 ----------
point = Point(deconstruct_brep.Vertices)
combination_selector = PythonScript(outputListASFangles=combination_maker_v1.outputListASFangles)  # -> out, outputASFangles
# ---------- combination_selector: Python ----------
#16.10.2015
#Prageeth Jayathissa
#Python script to extract the correct ASFangle matrix based on the combination requested

#Status: Complete

#------------------------------------------------

import json
import math
import copy

#unpack json file
ListASFangles=json.loads(outputListASFangles)
#Statemente to print to console
print 'Max Number of combinations=', len(ListASFangles)

#Check that the input combination is within the boundaries of ListASFangles
if combination<len(ListASFangles):
    #Output the requested ASFangle
    outputASFangles=json.dumps(ListASFangles[int(combination)])
else:
    #If it is not available then return the angle with a console logged error
    outputASFangles=json.dumps(ListASFangles[0])
    print 'Warning! Requested Combination is not available'
# ---------- end combination_selector ----------
trash_bin = Panel("Trash Bin")
list_item = ListItem(List=deconstruct_brep.Faces, Index=Slider(0, range=0..5), Wrap=True)
surface = Surface(list_item)
check_output_is_the_same = PythonScript(y=combination_selector.outputASFangles)  # -> out, a
# ---------- check_output_is_the_same: Python ----------
import json

x
y


a=json.loads(x)
b=json.loads(y)

print a==b
# ---------- end check_output_is_the_same ----------

# ----
# Make sure that this is connected to to 'itteration count'
iterations_count = Integer(combination)

# ----
# Render the ASF
generate_diamond_array = PythonScript(
    V_translation=vertical_downward_translation,
    edgeTol=edge_tolerance,
    panelThick=panel_thickness_mm,
    panelOffset=panel_offset_mm,
    panelSize=panel_size_mm,
    panelSpacing=panel_spacing_mm,
    room_width=room_width,
    room_height=room_height)  # -> outputASFarray, panelSize, panelOffset, panelThick
# ---------- generate_diamond_array: Python ----------
#12.10.2015
#Prageeth Jayathissa
#Script for calculating the grid layout of the ASF

#Staus: Complete

#BUGS:
    #the array appears to be shifted a little to the right, check the centering
    #Add function to ensure the panel offset is greater than the panel size
#------------------------------------------------------------------------------

import rhinoscriptsyntax as rs
import Grasshopper as gh
import Rhino
import math
import json

#Function to determine the location of the first panel
def first_coordinate():
    x=-((No_Hpanels-1)*Hspacing)/2+room_width/2-panelSize/2
    print x
    y=((No_Vpanels-1)*Vspacing)/2 +(room_height)/2-V_translation
    if center_long:
        if bigstart:
            x=x
        else:
            x+=(Hspacing/2)
    else:
        if bigstart:
            x-=(Hspacing/2)
            print 'me'
        else:
            x=x
    return (x,y)
            

#import paramters:
#room_width=3700.0
#room_height=3000.00



#panel size and spacing along the diagonal axis
#panelSize=400.0
#panelSpacing=500.0
#panelThick=2
#panelOffset=500

#minor adjustments to the panel size
#edgeTol=1.4
#V_translation=100
edgeOverlap=(edgeTol/100)*panelSpacing


#transform spacing into vertical and horizontal components
#Note: sin(45) = 1/math.sqrt(2)
Hspacing=(panelSpacing/math.sqrt(2))*2
Vspacing = panelSpacing/math.sqrt(2)

#initialise boolean to determine whether the center pannel line is long
center_long=True
#initialise boolean to determine wether the middle row needs to be offset
center_offset=False 

#find out how many panels fit on the horizontal axis
#The edgeOverlap allows for more or less panels to fit around the edge
No_Hpanels=int(math.floor((room_width-panelSize+edgeOverlap)/Hspacing))

#The number of panels on the middle axis is always odd
#check if the number is even, and if so subtract 1 and define center as a short row
if not No_Hpanels & 1: #binary logic to determine if the number is even
    print 'even'
    No_Hpanels-=1 #subtract by one to make it odd
    center_long=False #state that the middle row is now the shorter row


print 'Hpanels',No_Hpanels

#find out how many panels fit on the vertical axis accounting for an overlap
No_Vpanels=int(math.floor((room_height-panelSize+edgeOverlap)/Vspacing))

#Number of rows must also be odd for asthetic reasons
if not No_Vpanels &1:
    print 'even Vpanels'
    center_offset=True
    No_Vpanels-=1  
    
print 'V panels' , No_Vpanels
#Very Messy shit code to determine wether the first row has more panels than the second row

#if (No_Vpanels-1)/2 is odd, then the top row has the same number of panels as the middle
#if it is even then it has one more or one less depending on whether the center is long or short
checker=int((No_Vpanels-1)/2)
print 'checker',checker
print 'center_long?', center_long
if center_long:
    if checker &1: #if checker is odd
        print '3,7,11 etc Vpanels1'
        bigstart=False #Top row is shorter than second row
        oneswitch=-1 #top row has one less panel than middle row
    else:
        print '1,5,9 etc Vpanels2'
        bigstart=True #top row is longer than second row
        oneswitch=0
else:
    if checker &1:
        print '3,7,11 etc Vpanels3'
        bigstart=True
        oneswitch=1 #top panel has one more panel than the middle row
    else:
        print '1,5,9 etc Vpanels4'
        bigstart=False
        oneswitch=0

#End of messy shitty code

#prints for debugging
print 'bigstart', bigstart 
print 'oneswitch',oneswitch

#initialise ASFarray List
ASFarray=[]

#Produce an empy list nested in a list. The nested list represents each row
for ii in range(No_Vpanels):
    ASFarray.append([])
   


#aquire the first coordinate of the top left panel
(x,y)=first_coordinate()  #see function at the top
x_first=x #store initial x coordinate
y_first=y #store initial y coordinate


#This next for loop records the coordinate positions of each panel
#initialise row counter
icount=0
for ii in ASFarray:
    #initialise collumn counter
    jcount=0
    
    for jj in range(No_Hpanels+oneswitch): #first row
        ii.append((x+jcount*Hspacing,y-icount*Vspacing)) #Append panel coordinate
        jcount+=1 #next column
    #Switches so the next row has either one more or one less panel
    #logic: If the center row is long, then it will switch between its own size
    #and a size smaller. If not it will switch between its own size and one bigger
    if center_long:
        oneswitch-=1
        oneswitch=(oneswitch%2)*-1 #output either 0 or -1
    else:
        oneswitch+=1
        oneswitch=oneswitch%2 #output is either 0 or 1
    icount+=1
    
    #Determines the starting position of the first panel of the row depending on
    #if its long or short
    if icount &1: #if odd
        if bigstart:
            x=x_first+(Hspacing/2) #start half a space to the right
        else:
            x=x_first -(Hspacing/2) #start half a space to the left
    else:
        x=x_first
    
    


#Write the array output as a json and send to next python file
#Note: Lists in Lists cannot be sent over grasshopper
outputASFarray=json.dumps(ASFarray)
# ---------- end generate_diamond_array ----------
combination_maker_v2 = PythonScript(combination=iterations_count, NoClusters=number_of_custers, outputASFarray=generate_diamond_array.outputASFarray)  # -> out, maxcomb, outputASFangles
# ---------- combination_maker_v2: Python ----------
#13.10.2015
#Prageeth Jayathissa
#Python script to produce all possible angle combinations of the facade

#Status: Complete but difficult to read

#Warning: If NoCluster>2 then the program becomes slow

#------------------------------------------------
'''README

This code can be read as three chapters

Chapter1: Produces a list of possible angle combinations for a single panel
    Output: ANGLES - a list of all possible angle combinations

Chapter2: Splits the facade into independant clusters of rows. 
    Output: rowsplit - a list of intergers that indicate the start and end point
        of clusters
    Example: If a facade with 9 rows is split into 2 clusters, rowsplit=[0,4,9]
        this indicates that one cluser starts at 0 and ends at 4
        the second cluster starts at 4 and ends at 9

Chapter3: Itterates through all possible panel combinations and produces an output
    list which contains each outputASFangle combination
    Output: ListASFangles - a list of all possible ASFangles
    
Chapter4: Determines that combination of Angles should be recorded for each itteration
    How it works: In priciple, this is a counter where base= Number of angle combinations
    Example: If number of angles =10 and number of clusters =2 this would be a normal 2digit base10 counter
    rowVal=[0,0]
    rowVal=[0,1]
    ...
    rowVal=[0,9]
    rowVal=[1,0]
    
    if number of angles =49 then
    rowVal=[0,0]
    rowVal=[0,1]
    ...
    rowVal=[0,48]
    rowVal=[1,0]
    rowVal=[1,1] etc
    
    This numer rowVal is then used to call on the ANGLE list produced in Chapter 1
    which is then fed into Chapter 3
        
        '''

#Import Modules------------------------------------------------

import json
import math
import copy
####---CHAPTER1-------------------------

#unpack json file and coppy ASF array to create an empty anglearray
ASFarray=json.loads(outputASFarray)
ASFangles=copy.deepcopy(ASFarray)

#Possible ANgles in simulation
XANGLES=[0,15,30,45,60,75,90]
YANGLES=[-45,-30,-15,0,15,30,45]

#Array to hold final list
ListASFangles=[]

#Number of groups that the facade can exist in (now input to function)
NoClusters=int(NoClusters)
#NoClusters=1
#Number of angle combinations
NoAngles=len(XANGLES)*len(YANGLES)

#Define the angle value that a row is in
#the value is between 0 and NoAngles
rowVal=[0]*NoClusters

#Make a list of all angle combinations
ANGLES= [(x, y) for x in XANGLES for y in YANGLES]

####---CHAPTER2-------------------------

#Deside which rows to break according to the Number
#of clusters
#How many items do we split the ASF into
rowdivide=int(math.floor(len(ASFangles)/NoClusters))
#What is remaining
rowremain=len(ASFangles)%NoClusters
#print rowdivide
#print rowremain
rowsplit=[]
ii=0
#These are positions within ASF array where we split
for ii in range(NoClusters-1):
    rowsplit.append(rowdivide*(ii+1)+1) #a =y, b=2y...
rowsplit.append(rowdivide*(ii+2)+rowremain) #c=2y+x
#Add a 0 at the start of the list to indicate the top row is 0
rowsplit = [0] + rowsplit
#Bypass funciton if the number of clusters is 1
if NoClusters==1:
    rowsplit=[]
    rowsplit.append(rowdivide) #Note rowdivide=Number of rows
    rowsplit = [0] + rowsplit

#print rowsplit

####---CHAPTER3-------------------------

#Loop through all combinations of the facade
keepLooping=True
combcount=0
while keepLooping:
    #If we have reached the maximum number of combinations then break the main loop
    if rowVal==[NoAngles-1]*NoClusters: #eg: if [48,48,48]==[48,48,48]
        keepLooping=False
    #re-initialise jj  jcount and icount 
    jj=0
    jcount=0
    icount=0
    
    if combcount==combination:
    
        #Script to make the ASFAngle matrix
        #Loop through the number of divisions in the facade
        rscount=0 
        #print 'hello'
        #loop through ASFangles matrix to substitute values
        for icount,ii in enumerate(ASFangles):
            for jcount,jj in enumerate(ii):
                
                #if the row is at the point that it should go to the next rowsplit combiniation
                #eg, rowsplit =[0,4,9]
                #+1 is required because icount and rscount start at 0
                if icount+1==rowsplit[rscount+1]: #eg if 4==4
                    #if it is not the last element because otherwise rscount is out of bounds
                    if rowsplit[-2]!=rowsplit[rscount]:
                        #move to the next rowsplit value
                        rscount+=1
                        
                #Replace ASFAngle unit with angle
                #rowVal: is the ANGLE element identifier between 1,49
                #eg: rowVal=[5,29] the first element is the angle identifier for the top cluster, 
                    #the second element is the angle identifier for the second cluster
                #rscount: is rowVal element identifier        
                ASFangles[icount][jcount]=ANGLES[rowVal[rscount]]
            
            
            
            

    ####---CHAPTER4-------------------------

    #Find the next itteration or rowVal, the Agnel element identifier
    #Process: very similar to a counter where the base=NoAngles, eg base49
    for jcount,jj in enumerate(rowVal):
        #if the number of the position has it its maximum, set to zero
        #and itterate the next column
        if jj==NoAngles-1:
            rowVal[jcount]=0
        #if the number is not the maximum, then increase once more and break the loop
        else:
            rowVal[jcount]+=1
            break
    combcount+=1
    
#outputListASFangles=json.dumps(ListASFangles)


#This has been commented out as it is not used in Combination Selector
#if combination<len(ListASFangles):
#    outputASFangles=json.dumps(ListASFangles[int(combination)])
#else:
#    outputASFangles=json.dumps(ListASFangles[0])
    
#print ListASFangles

maxcomb=NoAngles**NoClusters

print 'max number of combinations is', maxcomb
if combination>combcount:
    print 'Warning! Requested Combination is not available'

outputASFangles=json.dumps(ASFangles)
# ---------- end combination_maker_v2 ----------
render_diamond_array = PythonScript(
    outputASFangles=combination_maker_v2.outputASFangles,
    outputASFarray=generate_diamond_array.outputASFarray,
    panelSize=generate_diamond_array.panelSize,
    panelOffset=generate_diamond_array.panelOffset,
    panelThick=generate_diamond_array.panelThick)  # -> out, temprender
# ---------- render_diamond_array: Python ----------
#13.10.2015
#Prageeth Jayathissa
#Python script to render the ASF based on room given array and angles

#Status: Completed with issues

#Issues: When rotating panels, the rotation around the Y axis doesn't rotate
#around the global Y axis, but the new Y axis based off the previous X axis roation
#------------------------------------------------

import json
import rhinoscriptsyntax as rs
import copy

#Load JSON file
ASFarray=json.loads(outputASFarray)
ASFangles=json.loads(outputASFangles)

#define Plane where ASF will be built
plane=rs.WorldZXPlane()

#temprender is used for temproarily rendering the ASF
temprender=[]
#duplicate the ASFarray wihout linking it togher
#Note: ASFrectangles=ASFarray doesn't work as they will both be edited
ASFrectangles=copy.deepcopy(ASFarray)

#initialise row counter
icount=0
for ii in ASFarray:
    #initialise column counter
    jcount=0
    for jj in ii:
        #Draw rectange on the ZX plane
        new_panel=rs.AddRectangle(plane, panelSize, panelSize)
        #rotate it to make the diamond shape
        new_panel=rs.RotateObject(new_panel,[panelSize/2,panelSize/2,0],45,axis=(0,1,0))
        #Extrude it and cap the holes
        #new_panel=rs.ExtrudeCurveStraight(new_panel,(0,0,0),(0,-panelThick,0))
        #rs.CapPlanarHoles(new_panel)
        #tilt the panels
        new_panel=rs.RotateObject(new_panel,[panelSize/2,panelSize/2,0],-ASFangles[icount][jcount][0],axis=(1,0,0))
        new_panel=rs.RotateObject(new_panel,[panelSize/2,panelSize/2,0],ASFangles[icount][jcount][1],axis=(0,0,1))
        new_panel=rs.MoveObject(new_panel,(jj[0],-panelOffset,jj[1]))
        
        temprender.append(new_panel)
        #This is the true output which will be used for further analysis
        ASFrectangles[icount][jcount]=new_panel

        jcount+=1
    icount+=1
# ---------- end render_diamond_array ----------

max_combinations = Panel(combination_maker_v2.out)
surface_2 = Surface(render_room.WallF)
surface_3 = Surface(render_room.AdiabaticSurfaces)
surface_4 = Surface(render_room.WallG)
number_slider = Slider(4, range=0..10)
render_panel_layout = Brep(render_diamond_array.temprender)
number_slider_2 = Slider(0.5, range=0..1)

# ----
# Convert planar surfaces
#  to DIVA inputs
shade = Shade(
    Brep=render_panel_layout,
    SR=number_slider_2,
    VR=number_slider_2,
    GlazedFraction=0,
    Brep_2=render_panel_layout,
    SR_2=number_slider_2,
    VR_2=number_slider_2,
    GlazedFraction_2=0)  # -> Shade, Shade_2
facade = ConstructionAssembly(Brep=surface_2, Brep_2=surface_2, GetAssembly=12, GetCustom=False, GetLayerNum=1, GetMaterials=[-1, -1, -1, -1, -1])  # -> Zone, Zone_2
all_adiabatic = ConstructionAssembly(Brep=surface_3, Brep_2=surface_3, GetAssembly=6, GetCustom=False, GetLayerNum=1, GetMaterials=[-1, -1, -1, -1, -1])  # -> Zone, Zone_2
# A Zone is a Box
# A window is a planar surface that overlaps the zone
# Shade can be a box or plane
window_unit = WindowUnit(
    Brep=surface_4,
    Brep_2=surface_4,
    GetAssembly=7,
    GetCustom=False,
    GetGas=[-1, -1],
    GetGlass=[-1, -1, -1],
    GetLayerNum=1,
    GetSimpleState=0)  # -> Window, Window_2

boolean_toggle = BooleanToggle(False)
boolean_toggle_2 = BooleanToggle(False)
number_slider_3 = Slider(5, range=0..10)
_300 = Integer(300)
addition = Addition(A=hoopsnake.IterationsCounter, B=1)
# Make sure second number is connected to maxcomb
smaller_than = SmallerThan(FirstNumber=addition, SecondNumber=combination_maker_v2.maxcomb)  # -> SmallerThan, OrEqualTo
hoopsnake = HoopSnake(
    StartingData=Slider(0, range=0..100),
    Data=addition,
    TerminationCondition=smaller_than.SmallerThan,
    Hoopsnake_Data_autoUpdate=False,
    Hoopsnake_Data_dataLimit=2147483647,
    Hoopsnake_Data_delay=0,
    Hoopsnake_Data_resetCounter=True,
    Hoopsnake_Data_updateView=True)  # -> Feedback, CumulativeFeedback, LoopsCounter, IterationsCounter
# Run the E+ Simulation
viper_diva_thermal_analysis_for_gh = ViperDIVAThermalAnalysisForGH(
    ProjectName=hoopsnake.Feedback,
    People_m2=0.1,
    Lights_W_m2=11.74,
    Equipment_W_m2=4,
    HeatingSetPoint_deg_C=22,
    CoolingSetPoint_deg_C=26,
    HeatingCOP=number_slider_3,
    CoolingCOP=3,
    Infiltration=0.5,
    FreshAir=0.00944,
    LightingControl_lux=_300,
    ZoneBreps=[facade.Zone_2, all_adiabatic.Zone_2],
    Window=window_unit.Window_2,
    Shade=shade.Shade_2,
    WriteOnly=boolean_toggle,
    RunSimulation=boolean_toggle_2,
    ProjectName_2=hoopsnake.Feedback,
    People_m2_2=0.1,
    Lights_W_m2_2=11.74,
    Equipment_W_m2_2=4,
    HeatingSetPoint_deg_C_2=22,
    CoolingSetPoint_deg_C_2=26,
    HeatingCOP_2=number_slider_3,
    CoolingCOP_2=3,
    Infiltration_2=0.5,
    FreshAir_2=0.00944,
    LightingControl_lux_2=_300,
    ZoneBreps_2=[facade.Zone_2, all_adiabatic.Zone_2],
    Window_2=window_unit.Window_2,
    Shade_2=shade.Shade_2,
    WriteOnly_2=boolean_toggle,
    RunSimulation_2=boolean_toggle_2,
    CustomDates=False,
    Location=16,
    Occupancy=0,
    OutputStates=[True, True, False, False, True, True, False, False, False, False, False, False, False, False, False, False, False, False, False],
    ReportingPeriod=0,
    RunPeriod=0,
    ShadowFreq=30,
    ShadowOverlap=15000,
    SolarDist=2,
    Timestep=2)  # -> OutputMessage, MetricHeatingE, flatten(MetricCoolingE), flatten(MetricElecLights), MetricElecEquip, OutputMessage_2, MetricHeatingE_2, flatten(MetricCoolingE_2), flatten(MetricElecLights_2), MetricElecEquip_2
mass_addition = MassAddition(Input=viper_diva_thermal_analysis_for_gh.MetricCoolingE_2)  # -> Result, PartialResults
panel = Panel(viper_diva_thermal_analysis_for_gh.OutputMessage_2)
panel_2 = Panel(viper_diva_thermal_analysis_for_gh.MetricElecLights_2)
python_script = PythonScript(
    loopNo=hoopsnake.IterationsCounter,
    Heating=viper_diva_thermal_analysis_for_gh.MetricHeatingE_2,
    Cooling=viper_diva_thermal_analysis_for_gh.MetricCoolingE_2,
    Lighting=viper_diva_thermal_analysis_for_gh.MetricElecLights_2,
    Equip=viper_diva_thermal_analysis_for_gh.MetricElecEquip_2)  # -> out, a; inputs Heating: list, Cooling: list, Lighting: list, Equip: list
# ---------- python_script: Python ----------
#13.10.2015
#Prageeth Jayathissa
#Python script to read DIVA inputs and produce a CSV file

import sys, os
import datetime


#Create empty .csv files
if loopNo==0:
    with open(os.path.join('C:/Users/User/Documents/01_SuAT/01_HiLo/04_Facade/Rhino_Simulations','heating.csv'),'w') as f:
        pass
    with open(os.path.join('C:/Users/User/Documents/01_SuAT/01_HiLo/04_Facade/Rhino_Simulations','cooling.csv'),'w') as f:
        pass
    with open(os.path.join('C:/Users/User/Documents/01_SuAT/01_HiLo/04_Facade/Rhino_Simulations','lighting.csv'),'w') as f:
        pass
    with open(os.path.join('C:/Users/User/Documents/01_SuAT/01_HiLo/04_Facade/Rhino_Simulations','time.csv'),'w') as f:
        pass

#Write to csv files

#Each itteration will be stored in a row of a csv file
writestring=''

with open(os.path.join('C:/Users/User/Documents/01_SuAT/01_HiLo/04_Facade/Rhino_Simulations','heating.csv'),'a') as f:
    for ii in Heating:
        #Create row in csv
        writestring=writestring+str(ii)+','
    #remove the last comma
    writestring=writestring[:-1]
    #add a new line and write
    f.write(writestring+'\n')
    f.close()

writestring=''
with open(os.path.join('C:/Users/User/Documents/01_SuAT/01_HiLo/04_Facade/Rhino_Simulations','cooling.csv'),'a') as f:
    for ii in Cooling:

        writestring=writestring+str(ii)+','
    #print writestring
    writestring=writestring[:-1]
    f.write(writestring+'\n')
    f.close()
    
writestring=''
with open(os.path.join('C:/Users/User/Documents/01_SuAT/01_HiLo/04_Facade/Rhino_Simulations','lighting.csv'),'a') as f:
    for ii in Lighting:

        writestring=writestring+str(ii)+','
    #print writestring
    writestring=writestring[:-1]
    f.write(writestring+'\n')
    f.close()
    
with open(os.path.join('C:/Users/User/Documents/01_SuAT/01_HiLo/04_Facade/Rhino_Simulations','time.csv'),'a') as f:
    f.write(str(datetime.datetime.utcnow())+'\n')


#totalHeat=sum(Heating)
#totalCool=sum(Cool)
#totalLights=sum(Lights)
#totalEquip=sum(Equip)
# ---------- end python_script ----------
panel_3 = Panel(viper_diva_thermal_analysis_for_gh.MetricHeatingE_2)
panel_4 = Panel(python_script.out)
mass_addition_2 = MassAddition(Input=viper_diva_thermal_analysis_for_gh.MetricElecLights_2)  # -> Result, PartialResults
panel_5 = Panel(mass_addition.Result)
panel_6 = Panel(mass_addition_2.Result)
