# Grasshopper definition honeybee_similar_to_Diva_custom_occ_schedule.gh (Grasshopper 0.9.76)
# plug-ins: DIVA.ForGrasshopper, Python Interpreter, ItemSelector, Human, HoopSnake

number_of_panels_in_first_row = Slider(9, range=0..20)
number_of_rows = Slider(6, range=0..9)

# ----
# ASF Inputs
panel = Panel("YANGLES = [0]")
# PARAMETERS
panel_2 = Panel("XANGLES = [0,30,45,60,90]")
combination = Slider(1, range=0..49)
number_of_clusters = Slider(1, range=1..3)

# ----
# Building Geometry Inputs
panel_thickness_mm = Slider(10, range=0.5..10)
panel_spacing_mm = Slider(500, range=200..1500)
edge_tolerance = Slider(0, range=0..1000)
panel_offset_mm = Slider(576, range=100..1000)
room_height = Slider(3100, range=1000..20000)
room_depth = Slider(7000, range=1000..20000)
room_width = Slider(4900, range=1000..20000)
glazing_height = Slider(0.9677, range=0..1)
glazing_width = Slider(0.9183, range=0..1)
panel_size_mm = Slider(400, range=1..500)

boolean_top_row_short = BooleanToggle(False)
boolean_diamond_array = BooleanToggle(True)
callfromepconstrlibrary = Honeybee_CallFromEPConstructionLibrary()  # -> ThermMaterials, EPMaterials, EPWindowMaterials, EPConstructions; plug-in component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

# ----
# Loop hours of year
hours_in_the_year = Integer(8760)

callfromepconstrlibrary_2 = Honeybee_CallFromEPConstructionLibrary(keywords="clear")  # -> ThermMaterials, EPMaterials, EPWindowMaterials, EPConstructions; plug-in component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
callfromepconstrlibrary_3 = Honeybee_CallFromEPConstructionLibrary(keywords="air")  # -> ThermMaterials, EPMaterials, EPWindowMaterials, EPConstructions; plug-in component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
callfromepconstrlibrary_4 = Honeybee_CallFromEPConstructionLibrary(keywords="window")  # -> ThermMaterials, EPMaterials, EPWindowMaterials, EPConstructions; plug-in component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
ladybug = Ladybug_Ladybug()  # -> Vviiiiiiiiiizzz; plug-in component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
int = Integer(1000)
# Convert to meters
# for HB
division = Division(A=room_depth, B=int)
division_2 = Division(A=room_width, B=int)
division_3 = Division(A=room_height, B=int)

# ----
# Render the ASF
# Set Building Geometry
generate_diamond_array = PythonScript(
    edgeTol=edge_tolerance,
    panelThick=panel_thickness_mm,
    numberHorizontal=number_of_panels_in_first_row,
    Top_row_short=boolean_top_row_short,
    numberVertical=number_of_rows,
    panelOffset=panel_offset_mm,
    panelSize=panel_size_mm,
    panelSpacing=panel_spacing_mm,
    room_width=room_width,
    room_height=room_height,
    diamond_flag=boolean_diamond_array)  # -> outputASFarray, panelSize, panelOffset, panelThick, diamond_flag
# ---------- generate_diamond_array: Python ----------
#15.12.2015
#Prageeth Jayathissa
#Script for calculating the grid layout of the ASF
#Edited by Jeremias Schmidli

#Description:
    #This script has three parts, out of which only one is executed, depending 
    #on the booleans diamond_flag (diamond- or rectangular-pattern) and 
    #only_odd_rows (if true it automatically determines pattern depending on 
    #room size, if false the number of panels in the first row, the number of 
    #rows and whether the first row is short or long has to be spezified).

#Notes:
    #All coordinates described as "y-value" actually correspond to the "z-value"
    #in Grasshopper.
    #To maximize performance of a simulation, it should be made sure, that this 
    #script is only evaluated once. 

#Staus: Complete

#To Do:
    #Add function to ensure the panel offset is greater than the panel size
#------------------------------------------------------------------------------

import rhinoscriptsyntax as rs
import Grasshopper as gh
import Rhino
import math
import json


#specify if layout should be generated automatically, depending on room size 
#(If False, the inputs numberHorizontal, Top_row_short and numberVertical are needed.
# If True, the input edgeTol is needed.
# Works only for diamond pattern):
automatic_layout = False

# calculate diamond pattern if True:
if diamond_flag == True:
    
    # code from PJ, generates automatic layout:
    if automatic_layout == True:
        
        #Function to determine the location of the first panel
        def first_coordinate():
            x=room_width/2 -((No_Hpanels-1)*Hspacing)/2 
            print x
            y=((No_Vpanels-1)*Vspacing)/2 +(room_height)/2
            
            if center_long:
                if bigstart:
                    x=x
                else:
                    x+=(Hspacing/2)
            else:
                if bigstart:
                    x-=(Hspacing/2)
                    print 'me'
                else:
                    x=x
            return (x,y)
                    
        
        #import paramters:
        #room_width=3700.0
        #room_height=3000.00
        
        
        
        #panel size and spacing along the diagonal axis
        #panelSize=400.0
        #panelSpacing=500.0
        #panelThick=2
        #panelOffset=500
        
        #minor adjustments to the panel size
        #edgeTol=1.4
        #V_translation=100
        edgeOverlap=(edgeTol/100)*panelSpacing
        
        
        #transform spacing into vertical and horizontal components
        #Note: sin(45) = 1/math.sqrt(2)
        Hspacing=(panelSpacing/math.sqrt(2))*2
        Vspacing = panelSpacing/math.sqrt(2)
        
        #initialise boolean to determine whether the center pannel line is long
        center_long=True
        #initialise boolean to determine wether the middle row needs to be offset
        center_offset=False 
        
        #find out how many panels fit on the horizontal axis
        #The edgeOverlap allows for more or less panels to fit around the edge
        No_Hpanels=int(math.floor((room_width-panelSize+edgeOverlap)/Hspacing))
        
        #The number of panels on the middle axis is always odd
        #check if the number is even, and if so subtract 1 and define center as a short row
        if not No_Hpanels & 1: #binary logic to determine if the number is even
            print 'even'
            No_Hpanels-=1 #subtract by one to make it odd
            center_long=False #state that the middle row is now the shorter row
        
        
        print 'Hpanels',No_Hpanels
        
        #find out how many panels fit on the vertical axis accounting for an overlap
        No_Vpanels=int(math.floor((room_height-panelSize+edgeOverlap)/Vspacing))
        
        #Number of rows must also be odd for asthetic reasons
        if not No_Vpanels &1:
            print 'even Vpanels'
            center_offset=True
            No_Vpanels-=1  
            
        print 'V panels' , No_Vpanels
        #Very Messy shit code to determine wether the first row has more panels than the second row
        
        #if (No_Vpanels-1)/2 is odd, then the top row has the same number of panels as the middle
        #if it is even then it has one more or one less depending on whether the center is long or short
        checker=int((No_Vpanels-1)/2)
        print 'checker',checker
        print 'center_long?', center_long
        if center_long:
            if checker &1: #if checker is odd
                print '3,7,11 etc Vpanels1'
                bigstart=False #Top row is shorter than second row
                oneswitch=-1 #top row has one less panel than middle row
            else:
                print '1,5,9 etc Vpanels2'
                bigstart=True #top row is longer than second row
                oneswitch=0
        else:
            if checker &1:
                print '3,7,11 etc Vpanels3'
                bigstart=True
                oneswitch=1 #top panel has one more panel than the middle row
            else:
                print '1,5,9 etc Vpanels4'
                bigstart=False
                oneswitch=0
        
        #End of messy shitty code
        
        #prints for debugging
        print 'bigstart', bigstart 
        print 'oneswitch',oneswitch
        
        #initialise ASFarray List
        ASFarray=[]
        
        #Produce an empy list nested in a list. The nested list represents each row
        for ii in range(No_Vpanels):
            ASFarray.append([])
           
        
        
        #aquire the first coordinate of the top left panel
        (x,y)=first_coordinate()  #see function at the top
        x_first=x #store initial x coordinate
        y_first=y #store initial y coordinate
        
        
        #This next for loop records the coordinate positions of each panel
        #initialise row counter
        icount=0
        for ii in ASFarray:
            #initialise collumn counter
            jcount=0
            
            for jj in range(No_Hpanels+oneswitch): #first row
                ii.append((x+jcount*Hspacing,y-icount*Vspacing)) #Append panel coordinate
                jcount+=1 #next column
            #Switches so the next row has either one more or one less panel
            #logic: If the center row is long, then it will switch between its own size
            #and a size smaller. If not it will switch between its own size and one bigger
            if center_long:
                oneswitch-=1
                oneswitch=(oneswitch%2)*-1 #output either 0 or -1
            else:
                oneswitch+=1
                oneswitch=oneswitch%2 #output is either 0 or 1
            icount+=1
            
            #Determines the starting position of the first panel of the row depending on
            #if its long or short
            if icount &1: #if odd
                if bigstart:
                    x=x_first+(Hspacing/2) #start half a space to the right
                else:
                    x=x_first -(Hspacing/2) #start half a space to the left
            else:
                x=x_first
            
            
        
        
        #Write the array output as a json and send to next python file
        #Note: Lists in Lists cannot be sent over grasshopper
        outputASFarray=json.dumps(ASFarray)
        print ASFarray
        
    # Code Jeremias, uses manual specification of number of panels in grid:
    else:
        #make number of rows and columns integers:
        numberHorizontal = int(numberHorizontal)
        numberVertical = int(numberVertical)
        
        #initialise ASFarray List:
        ASFarray=[]
        
            #Produce an empty list nested in a list. The nested list represents each row
        for ii in range(int(numberVertical)):
            ASFarray.append([])
        
        
        #store x and y coordinate of first panel in the top row 
        #( & 1 checks if the number is odd):
            
        #find initial x-coordinate:
        if numberHorizontal & 1 and Top_row_short:
            x_first=room_width/2-panelSpacing*math.sqrt(2)*(numberHorizontal-1)/2 
        elif numberHorizontal & 1 and not Top_row_short:
            x_first=room_width/2-panelSpacing*math.sqrt(2)*(numberHorizontal-1)/2 
        elif not numberHorizontal & 1 and Top_row_short:
            x_first=room_width/2-panelSpacing*math.sqrt(2)*(numberHorizontal)/2
        elif not numberHorizontal & 1 and not Top_row_short:
            x_first=room_width/2-panelSpacing*math.sqrt(2)*(numberHorizontal-1)/2 
            
        #find initial y-coordinate:
        if numberVertical & 1:
            y_first=room_height/2+panelSpacing*(math.sqrt(2)/2)*(numberVertical-1)/2
        else:
            y_first=room_height/2+panelSpacing*(math.sqrt(2)/2)*(numberVertical-1)/2 
            
        
        #This next for loop records the coordinate positions of each panel
        
        #initialise x and y coordinate:
        x = x_first
        y = y_first
        
        #initialise row counter
        icount=0
        for ii in ASFarray:
            #initialise collumn counter
            jcount=0
            
            if (numberHorizontal & 1) and (icount & 1) and Top_row_short:
                
                for jj in range(int(numberHorizontal)+1): #first row
                    ii.append((x-panelSpacing*math.sqrt(2)/2+jcount*panelSpacing*math.sqrt(2),y-icount*panelSpacing*math.sqrt(2)/2)) #Append panel coordinate
                    jcount+=1 #next column
                    
            elif (numberHorizontal & 1) and not (icount & 1) and Top_row_short:
                
                for jj in range(int(numberHorizontal)): #first row
                    ii.append((x+jcount*panelSpacing*math.sqrt(2),y-icount*panelSpacing*math.sqrt(2)/2)) #Append panel coordinate
                    jcount+=1 #next column
                    
            elif (numberHorizontal & 1) and (icount & 1) and not Top_row_short:
                
                for jj in range(int(numberHorizontal)-1): #first row
                    ii.append((x+panelSpacing*math.sqrt(2)/2+jcount*panelSpacing*math.sqrt(2),y-icount*panelSpacing*math.sqrt(2)/2)) #Append panel coordinate
                    jcount+=1 #next column
                    
            elif (numberHorizontal & 1) and not (icount & 1) and not Top_row_short:
                
                for jj in range(int(numberHorizontal)): #first row
                    ii.append((x+jcount*panelSpacing*math.sqrt(2),y-icount*panelSpacing*math.sqrt(2)/2)) #Append panel coordinate
                    jcount+=1 #next column
                    
            elif not (numberHorizontal & 1) and (icount & 1) and Top_row_short:
                
                for jj in range(int(numberHorizontal)+1): #first row
                    ii.append((x+jcount*panelSpacing*math.sqrt(2),y-icount*panelSpacing*math.sqrt(2)/2)) #Append panel coordinate
                    jcount+=1 #next column
            
            elif not (numberHorizontal & 1) and not (icount & 1) and Top_row_short:
                
                for jj in range(int(numberHorizontal)): #first row
                    ii.append((x+panelSpacing*math.sqrt(2)/2+jcount*panelSpacing*math.sqrt(2),y-icount*panelSpacing*math.sqrt(2)/2)) #Append panel coordinate
                    jcount+=1 #next column
            elif not (numberHorizontal & 1) and (icount & 1) and not Top_row_short:
                
                for jj in range(int(numberHorizontal)-1): #first row
                    ii.append((x+panelSpacing*math.sqrt(2)/2+jcount*panelSpacing*math.sqrt(2),y-icount*panelSpacing*math.sqrt(2)/2)) #Append panel coordinate
                    jcount+=1 #next column
            
            elif not (numberHorizontal & 1) and not (icount & 1) and not Top_row_short:
                
                for jj in range(int(numberHorizontal)): #first row
                    ii.append((x+jcount*panelSpacing*math.sqrt(2),y-icount*panelSpacing*math.sqrt(2)/2)) #Append panel coordinate
                    jcount+=1 #next columnelse :
           
            #next row
            icount+=1
            
            
        #Write the array output as a json and send to next python file
        #Note: Lists in Lists cannot be sent over grasshopper
        outputASFarray=json.dumps(ASFarray)
        print ASFarray
    
# calculate rectangular pattern:
else:
    
    #make number of rows and columns integers:
    numberHorizontal = int(numberHorizontal)
    numberVertical = int(numberVertical)
    
    #initialise ASFarray List:
    ASFarray=[]
    
        #Produce an empy list nested in a list. The nested list represents each row
    for ii in range(int(numberVertical)):
        ASFarray.append([])
    
    
    #store initial x and y coordinate:
    if numberHorizontal & 1:
        x_first=room_width/2-panelSpacing*(numberHorizontal-1)/2 
    else:
        x_first=room_width/2-panelSpacing*(numberHorizontal-2)/2 - panelSpacing/2 
    if numberVertical & 1:
        y_first=room_height/2+panelSpacing*(numberVertical-1)/2
    else:
        y_first=room_height/2+panelSpacing*(numberVertical-2)/2 + panelSpacing/2
        
    
    #This next for loop records the coordinate positions of each panel
    
    #initialise x and y coordinate:
    x = x_first
    y = y_first
    
    #initialise row counter
    icount=0
    for ii in ASFarray:
        #initialise collumn counter
        jcount=0
        
        for jj in range(int(numberHorizontal)): #first row
            ii.append((x+jcount*panelSpacing,y-icount*panelSpacing)) #Append panel coordinate
            jcount+=1 #next column
        
        #next row
        icount+=1
        
        
    #Write the array output as a json and send to next python file
    #Note: Lists in Lists cannot be sent over grasshopper
    outputASFarray=json.dumps(ASFarray)
    print ASFarray
# ---------- end generate_diamond_array ----------
combination_maker_v2 = PythonScript(
    combination=combination,
    XANGLES=panel_2,
    YANGLES=panel,
    NoClusters=number_of_clusters,
    outputASFarray=generate_diamond_array.outputASFarray)  # -> out, maxcomb, outputASFangles
# ---------- combination_maker_v2: Python ----------
#13.10.2015
#Prageeth Jayathissa
#Python script to produce all possible angle combinations of the facade

#Status: Complete but difficult to read

#Warning: If NoCluster>2 then the program becomes slow

#------------------------------------------------
'''README

This code can be read as three chapters

Chapter1: Produces a list of possible angle combinations for a single panel
    Output: ANGLES - a list of all possible angle combinations

Chapter2: Splits the facade into independant clusters of rows. 
    Output: rowsplit - a list of intergers that indicate the start and end point
        of clusters
    Example: If a facade with 9 rows is split into 2 clusters, rowsplit=[0,4,9]
        this indicates that one cluser starts at 0 and ends at 4
        the second cluster starts at 4 and ends at 9

Chapter3: Itterates through all possible panel combinations and produces an output
    list which contains each outputASFangle combination
    Output: ListASFangles - a list of all possible ASFangles
    
Chapter4: Determines that combination of Angles should be recorded for each itteration
    How it works: In priciple, this is a counter where base= Number of angle combinations
    Example: If number of angles =10 and number of clusters =2 this would be a normal 2digit base10 counter
    rowVal=[0,0]
    rowVal=[0,1]
    ...
    rowVal=[0,9]
    rowVal=[1,0]
    
    if number of angles =49 then
    rowVal=[0,0]
    rowVal=[0,1]
    ...
    rowVal=[0,48]
    rowVal=[1,0]
    rowVal=[1,1] etc
    
    This numer rowVal is then used to call on the ANGLE list produced in Chapter 1
    which is then fed into Chapter 3
        
        '''

#Import Modules------------------------------------------------

import json
import math
import copy
####---CHAPTER1-------------------------

#unpack json file and coppy ASF array to create an empty anglearray
ASFarray=json.loads(outputASFarray)
ASFangles=copy.deepcopy(ASFarray)


#Possible Angles in simulation
#XANGLES=[0,30,45,60,90]#[0,45,90]#[0,15,30,45,60,75,90]
#YANGLES=[0]#[-45,0,45]#[-45,-30,-15,0,15,30,45]
exec XANGLES
exec YANGLES
print XANGLES
print YANGLES

#Array to hold final list
ListASFangles=[]

#Number of groups that the facade can exist in (now input to function)
NoClusters=int(NoClusters)
#NoClusters=1
#Number of angle combinations
NoAngles=len(XANGLES)*len(YANGLES)

#Define the angle value that a row is in
#the value is between 0 and NoAngles
rowVal=[0]*NoClusters

#Make a list of all angle combinations
ANGLES= [(x, y) for x in XANGLES for y in YANGLES]

####---CHAPTER2-------------------------

#Deside which rows to break according to the Number
#of clusters
#How many items do we split the ASF into
rowdivide=int(math.floor(len(ASFangles)/NoClusters))
#What is remaining
rowremain=len(ASFangles)%NoClusters
#print rowdivide
#print rowremain
rowsplit=[]
ii=0
#These are positions within ASF array where we split
for ii in range(NoClusters-1):
    rowsplit.append(rowdivide*(ii+1)+1) #a =y, b=2y...
rowsplit.append(rowdivide*(ii+2)+rowremain) #c=2y+x
#Add a 0 at the start of the list to indicate the top row is 0
rowsplit = [0] + rowsplit
#Bypass funciton if the number of clusters is 1
if NoClusters==1:
    rowsplit=[]
    rowsplit.append(rowdivide) #Note rowdivide=Number of rows
    rowsplit = [0] + rowsplit

#print rowsplit

####---CHAPTER3-------------------------

#Loop through all combinations of the facade
keepLooping=True
combcount=0
while keepLooping:
    #If we have reached the maximum number of combinations then break the main loop
    if rowVal==[NoAngles-1]*NoClusters: #eg: if [48,48,48]==[48,48,48]
        keepLooping=False
    #re-initialise jj  jcount and icount 
    jj=0
    jcount=0
    icount=0
    
    if combcount==combination:
    
        #Script to make the ASFAngle matrix
        #Loop through the number of divisions in the facade
        rscount=0 
        #print 'hello'
        #loop through ASFangles matrix to substitute values
        for icount,ii in enumerate(ASFangles):
            for jcount,jj in enumerate(ii):
                
                #if the row is at the point that it should go to the next rowsplit combiniation
                #eg, rowsplit =[0,4,9]
                #+1 is required because icount and rscount start at 0
                if icount+1==rowsplit[rscount+1]: #eg if 4==4
                    #if it is not the last element because otherwise rscount is out of bounds
                    if rowsplit[-2]!=rowsplit[rscount]:
                        #move to the next rowsplit value
                        rscount+=1
                        
                #Replace ASFAngle unit with angle
                #rowVal: is the ANGLE element identifier between 1,49
                #eg: rowVal=[5,29] the first element is the angle identifier for the top cluster, 
                    #the second element is the angle identifier for the second cluster
                #rscount: is rowVal element identifier        
                ASFangles[icount][jcount]=ANGLES[rowVal[rscount]]
            
            
            
            

    ####---CHAPTER4-------------------------

    #Find the next itteration or rowVal, the Agnel element identifier
    #Process: very similar to a counter where the base=NoAngles, eg base49
    for jcount,jj in enumerate(rowVal):
        #if the number of the position has it its maximum, set to zero
        #and itterate the next column
        if jj==NoAngles-1:
            rowVal[jcount]=0
        #if the number is not the maximum, then increase once more and break the loop
        else:
            rowVal[jcount]+=1
            break
    combcount+=1
    
#outputListASFangles=json.dumps(ListASFangles)


#This has been commented out as it is not used in Combination Selector
#if combination<len(ListASFangles):
#    outputASFangles=json.dumps(ListASFangles[int(combination)])
#else:
#    outputASFangles=json.dumps(ListASFangles[0])
    
#print ListASFangles

maxcomb=NoAngles**NoClusters

print 'max number of combinations is', maxcomb
if combination>combcount:
    print 'Warning! Requested Combination is not available'

outputASFangles=json.dumps(ASFangles)

#print (outputASFangles)
# ---------- end combination_maker_v2 ----------
render_diamond_array = PythonScript(
    outputASFangles=combination_maker_v2.outputASFangles,
    outputASFarray=generate_diamond_array.outputASFarray,
    panelSize=generate_diamond_array.panelSize,
    panelOffset=generate_diamond_array.panelOffset,
    panelThick=generate_diamond_array.panelThick,
    diamond_flag=generate_diamond_array.diamond_flag)  # -> out, temprender
# ---------- render_diamond_array: Python ----------
#13.10.2015
#Prageeth Jayathissa
#Python script to render the ASF based on room given array and angles

#Status: Completed with issues

#Issues: When rotating panels, the rotation around the Y axis doesn't rotate
#around the global Y axis, but the new Y axis based off the previous X axis roation
#------------------------------------------------

import json
import rhinoscriptsyntax as rs
import copy
import math

#diamond_flag = False
#Load JSON file
ASFarray=json.loads(outputASFarray)
ASFangles=json.loads(outputASFangles)


#define Plane where ASF will be built
plane=rs.WorldZXPlane()

#temprender is used for temproarily rendering the ASF
temprender=[]
#duplicate the ASFarray wihout linking it togher
#Note: ASFrectangles=ASFarray doesn't work as they will both be edited
ASFrectangles=copy.deepcopy(ASFarray)


print ASFangles


if diamond_flag:
    
    #initialise row counter
    icount=0
    for ii in ASFarray:
        #initialise column counter
        jcount=0
        for jj in ii:
            #Draw rectange on the ZX plane
            
            new_panel=rs.AddRectangle(plane, panelSize, panelSize)
            new_panel=rs.MoveObject(new_panel,(-panelSize/2,0,-panelSize/2))
            #rotate it to make the diamond shape
            new_panel=rs.RotateObject(new_panel,[0,0,0],45,axis=(0,1,0))
            #Extrude it and cap the holes
            #new_panel=rs.ExtrudeCurveStraight(new_panel,(0,0,0),(0,-panelThick,0))
            #rs.CapPlanarHoles(new_panel)
            #tilt the panels
            new_panel=rs.RotateObject(new_panel,[0,0,0],-ASFangles[icount][jcount][0],axis=(1,0,0))
            z_new = (0, -math.sin(math.pi/180*(-ASFangles[icount][jcount][0])) , math.cos(math.pi/180*(-ASFangles[icount][jcount][0])))
            print z_new
            new_panel=rs.RotateObject(new_panel,[0,0,0],ASFangles[icount][jcount][1],axis=z_new)
            new_panel=rs.MoveObject(new_panel,(jj[0],-panelOffset,jj[1]))
            
            temprender.append(new_panel)
            #This is the true output which will be used for further analysis
            ASFrectangles[icount][jcount]=new_panel

            jcount+=1
        icount+=1
        
else:
    #initialise row counter
    icount=0
    for ii in ASFarray:
        #initialise column counter
        jcount=0
        for jj in ii:
            #Draw rectange on the ZX plane
            
            new_panel=rs.AddRectangle(plane, panelSize, panelSize)
            new_panel=rs.MoveObject(new_panel,(-panelSize/2,0,-panelSize/2))
            #rotate it to make the diamond shape
            #new_panel=rs.RotateObject(new_panel,[0,0,0],45,axis=(0,1,0))
            #Extrude it and cap the holes
            #new_panel=rs.ExtrudeCurveStraight(new_panel,(0,0,0),(0,-panelThick,0))
            #rs.CapPlanarHoles(new_panel)
            #tilt the panels
            new_panel=rs.RotateObject(new_panel,[0,0,0],-ASFangles[icount][jcount][0],axis=(1,0,0))
            z_new = (0, -math.sin(math.pi/180*(-ASFangles[icount][jcount][0])) , math.cos(math.pi/180*(-ASFangles[icount][jcount][0])))
            print z_new
            new_panel=rs.RotateObject(new_panel,[0,0,0],ASFangles[icount][jcount][1],axis=z_new)
            new_panel=rs.MoveObject(new_panel,(jj[0],-panelOffset,jj[1]))
            
            temprender.append(new_panel)
            #This is the true output which will be used for further analysis
            ASFrectangles[icount][jcount]=new_panel
    
            jcount+=1
        icount+=1
# ---------- end render_diamond_array ----------

searchepconstruction = Honeybee_SearchEPConstruction(
    EPConstrList=callfromepconstrlibrary.EPConstructions,
    standard=Slider(3, range=0..100),
    climateZone="8",
    surfaceType=Slider(0, range=0..100))  # -> EPSelectedConstr; plug-in component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
# Render the Building
render_room = PythonScript(
    room_depth=division,
    room_width=division_2,
    room_height=division_3,
    glazing_percentage_w=glazing_width,
    glazing_percentage_h=glazing_height)  # -> WallF, AdiabaticSurfaces, AdiabaticWalls, Ceiling, Floor, WallG
# ---------- render_room: Python ----------
#12.10.2015
#Prageeth Jayathissa
#Script for rendering the room based on input dimensions

import rhinoscriptsyntax as rs

#Room Dimensions (mm)
#room_depth=5000
#room_width=3700
#room_height=3000 #Check value (approximation)
#floorThick=200
#ceilThick=200
#intWallThick=110 #Real value is 110mm
#glazeThick=110 #Check this value again

intWallHeight=room_height

gpw=glazing_percentage_w
gph=glazing_percentage_h


#Define Global Plane
planexy=rs.WorldXYPlane()
planezx=rs.WorldZXPlane()
planeyz=rs.WorldYZPlane()

print planexy
#Create rectangle of floor and extrude 200mm
#base=rs.AddRectangle(plane, room_width+intWallThick*2, room_depth)

planeR=rs.PlaneFromNormal((room_width,0,0),(1,0,0))
planeB=rs.PlaneFromNormal((0,room_depth,0),(0,1,0))
planeC=rs.PlaneFromNormal((0,0,room_height),(0,0,1))
#myBox=rs.ExtrudeCurveStraight(base,(0,0,0),(0,0,room_height))

WallF=rs.AddPlaneSurface(planezx,room_height,room_width)
WallL=rs.AddPlaneSurface(planeyz,room_depth,room_height)
WallR=rs.AddPlaneSurface(planeR,room_depth,room_height)
WallB=rs.AddPlaneSurface(planeB,room_height,room_width)

Floor=rs.AddPlaneSurface(planexy,room_width,room_depth)
Ceiling=rs.AddPlaneSurface(planeC,room_width,room_depth)

WallG=rs.AddPlaneSurface(planezx,room_height*gph,room_width*gpw)
WallG=rs.MoveObject(WallG,((1-gpw)*room_width/2,0,(1-gph)*room_height/2))

AdiabaticSurfaces=[Floor,Ceiling,WallL,WallR,WallB]
AdiabaticWalls=[WallL,WallR,WallB]
# ---------- end render_room ----------
list = Honeybee_ItemSelector(
    callfromepconstrlibrary_4.EPConstructions,
    {"ASHRAE 189.1-2009 EXTWINDOW CLIMATEZONE 1", "ASHRAE 189.1-2009 EXTWINDOW CLIMATEZONE 2", "ASHRAE 189.1-2009 EXTWINDOW CLIMATEZONE 3", "ASHRAE 189.1-2009 EXTWINDOW CLIMATEZONE 4-5", "ASHRAE 189.1-2009 EXTWINDOW CLIMATEZONE 6", "ASHRAE 189.1-2009 EXTWINDOW CLIMATEZONE 7-8"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}, selected="ASHRAE 189.1-2009 EXTWINDOW CLIMATEZONE 1")
# Save Inputs
save_parameters = PythonScript(
    XANGLES=panel_2,
    YANGLES=panel,
    NoClusters=number_of_clusters,
    panelSize=panel_size_mm,
    panelSpacing=panel_spacing_mm,
    outputASFarray=generate_diamond_array.outputASFarray)  # -> out, a
# ---------- save_parameters: Python ----------
#06.01.2016
#Jeremias Schmidli
#Python script to produce a python file with ASF layout and combination parameters for post processing

import sys, os
import json

# possible paths to save data:
destination_PJ = 'C:/Users/User/Documents/01_SuAT/01_HiLo/04_Facade/Rhino_Simulations'
destination_J = 'C:/Users/Assistenz/Documents/MT_Jeremias/Simulation_Data'

# assign destination:
destination = destination_J

#unpack json file and coppy ASF array to create an empty anglearray
ASFarray=json.loads(outputASFarray)

#Create empty .csv file and add information on parameters

with open(os.path.join(destination,'LayoutAndCombinations.txt'),'w') as f:
    f.write(XANGLES+'\n')
    f.write(YANGLES+'\n')
    f.write('NoClusters = ' + str(NoClusters) +'\n')
    f.write('panelSize = ' + str(panelSize) +'\n')
    f.write('panelSpacing = ' + str(panelSpacing) +'\n')
    f.write('ASFarray = ' + str(ASFarray))
    f.close()
# ---------- end save_parameters ----------
epconstruction = Honeybee_EnergyPlusConstruction(
    name="doublePane",
    layer_1=callfromepconstrlibrary_2.EPWindowMaterials,
    layer_2=callfromepconstrlibrary_3.EPWindowMaterials,
    layer_3=callfromepconstrlibrary_2.EPWindowMaterials)  # -> EPConstruction; plug-in component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
list_2 = Honeybee_ItemSelector(
    searchepconstruction,
    {"ASHRAE 189.1-2009 EXTWALL MASS CLIMATEZONE 7-8", "ASHRAE 189.1-2009 EXTWALL MASS CLIMATEZONE ALT-RES 8", "ASHRAE 189.1-2009 EXTWALL METAL CLIMATEZONE 4-8", "ASHRAE 189.1-2009 EXTWALL STEELFRAME CLIMATEZONE 4-8", "ASHRAE 189.1-2009 EXTWALL WOODFRAME CLIMATEZONE 6-8"}, selected="ASHRAE 189.1-2009 EXTWALL METAL CLIMATEZONE 4-8")
decomposeepconstruction = Honeybee_DecomposeEPConstruction(cnstrName=list_2)  # -> materials, comments, UValue_SI, UValue_IP, RValue_SI, RValue_IP; plug-in component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
list_3 = Honeybee_ItemSelector(decomposeepconstruction.materials, {"Metal Siding", "Wall Insulation [38]", "1/2IN Gypsum"}, selected="Metal Siding")
decomposeepmaterial = Honeybee_DecomposeEPMaterial(materialName=simplify(list_3))  # -> names, values, comments, UValue_SI, UValue_IP, RValue_SI, RValue_IP; plug-in component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
panel_3 = Panel(decomposeepmaterial.values)
panel_4 = Panel(decomposeepmaterial.comments)
surface = Surface(reparameterize(graft(render_room.Floor)))
surface_2 = Surface(reparameterize(graft(render_room.Ceiling)))
surface_3 = Surface(reparameterize(graft(render_room.AdiabaticWalls)))
surface_4 = Surface(reparameterize(graft(render_room.WallG)))
surface_5 = Surface(simplify(flatten(render_room.WallF)))
surface_6 = Surface(reparameterize(graft(render_room.AdiabaticSurfaces)))
panel_5 = Panel(epconstruction)
panel_6 = Panel("Adiabatic")
addtoeplibrary = Honeybee_AddToEnergyPlusLibrary(EPObject=epconstruction, addToProjectLib=Toggle(True))  # -> readMe; plug-in component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
max_combinations = Panel(combination_maker_v2.out)
max_combination = Slider(4, range=0..10)
number_slider = Slider(0.5, range=0..1)
render_panel_layout = Brep(render_diamond_array.temprender)
panel_7 = Panel("C:\Users\Assistenz\ASF_Simulation\WeatherData\CHE_Geneva.067000_IWEC.stat")

# ----
# SURFACE CONVERSION
number_slider_2 = Slider(0, range=0..100)

# ----
# Convert planar surfaces
#  to DIVA inputs
shade = Shade(
    Brep=render_panel_layout,
    SR=number_slider,
    VR=number_slider,
    GlazedFraction=0,
    Brep_2=render_panel_layout,
    SR_2=number_slider,
    VR_2=number_slider,
    GlazedFraction_2=0)  # -> Shade, Shade_2
facade = ConstructionAssembly(Brep=surface_5, Brep_2=surface_5, GetAssembly=12, GetCustom=False, GetLayerNum=1, GetMaterials=[-1, -1, -1, -1, -1])  # -> Zone, Zone_2
all_adiabatic = ConstructionAssembly(Brep=surface_6, Brep_2=surface_6, GetAssembly=6, GetCustom=False, GetLayerNum=1, GetMaterials=[-1, -1, -1, -1, -1])  # -> Zone, Zone_2
# A Zone is a Box
# A window is a planar surface that overlaps the zone
# Shade can be a box or plane
window_unit = WindowUnit(
    Brep=surface_4,
    Brep_2=surface_4,
    GetAssembly=7,
    GetCustom=False,
    GetGas=[3, -1],
    GetGlass=[-1, -1, -1],
    GetLayerNum=2,
    GetSimpleState=0)  # -> Window, Window_2

epconstruction_2 = Honeybee_EnergyPlusConstruction()  # -> EPConstruction; plug-in component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
importstat = Ladybug_ImportStat(statFile=panel_7)  # -> readMe, ashraeClimateZone, koppenClimateZone, port, heatingDesignTemp, coolingDesignTemp, port_2, extremeHotWeek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; plug-in component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
panel_8 = Panel(importstat.ashraeClimateZone)
srfattributelist = Honeybee_SurfaceAttributeList({"Name": "name", "Radiance Material": "RadMaterial", "EnergyPlus Construction": "EPConstruction", "Surface Type": "type", "Boundary Condition": "BC", "Sun Exposure": "sunExposure", "Wind Exposure": "windExposure", "Has Child Surface": "hasChild", "Is Child Surface": "isChild", "Is Planar": "isPlanar", "Srf Type Set By User": "srfTypeByUser", "Boundary Condition Set By User": "srfBCByUser"}, selected="EnergyPlus Construction")
callfromepconstrlibrary_5 = Honeybee_CallFromEPConstructionLibrary()  # -> ThermMaterials, EPMaterials, EPWindowMaterials, EPConstructions; plug-in component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
int_2 = Integer(0)
gentestpts = Honeybee_GenerateTestPoints(testSurface=surface, gridSize="1", distBaseSrf="1", moveTestMesh=True)  # -> readMe, simplify(testPoints), simplify(ptsVectors), simplify(facesArea), simplify(mesh); plug-in component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
searchepconstruction_2 = Honeybee_SearchEPConstruction(
    EPConstrList=callfromepconstrlibrary_5.EPConstructions,
    standard=Slider(4, range=0..100),
    climateZone=panel_8,
    surfaceType=Slider(0, range=0..100))  # -> EPSelectedConstr; plug-in component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
list_4 = Honeybee_ItemSelector(
    searchepconstruction_2,
    {"CBECS 1980-2004 EXTWALL MASS CLIMATEZONE 4A", "CBECS 1980-2004 EXTWALL METAL CLIMATEZONE 4A", "CBECS 1980-2004 EXTWALL STEELFRAME CLIMATEZONE 4A", "CBECS 1980-2004 EXTWALL WOODFRAME CLIMATEZONE 4A"}, selected="CBECS 1980-2004 EXTWALL STEELFRAME CLIMATEZONE 4A")
panel_9 = Panel(searchepconstruction_2)
analysisperiod = Ladybug_AnalysisPeriod(fromHour="9", toHour="18")  # -> readMe, analysisPeriod; plug-in component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
panel_10 = Panel("""0
0
0
0
0
0
1
1
1
1
1
1
0
1
1
1
1
1
1
1
0
0
0
0""")
int_3 = Integer(panel_10)
cop = Slider(5, range=0..10)
cop_2 = Slider(3, range=0..10)
occupancygenerator = Honeybee_DaysimOccupancyGenerator(occupancyPeriod=analysisperiod.analysisPeriod, weekendDays=[1, 2], fileName="LabSchedule2", writeTheOcc=Toggle(True))  # -> occupancyFile; plug-in component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
dselectricallightinguse = Honeybee_DaysimElectricalLightingUse()  # -> electricLightingUse; plug-in component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
panel_11 = Panel(occupancygenerator)

# ----
# Ladybug solar analysis
# north orientation
# Run Ladybug
# Calculate Radiation on Panels
# Set Legend of Radiation Results
# Save Radiation Results
# Create Sky Matrix
# Sky Dome for reference
# Set Evaluation Period
hour_of_year = Slider(1, range=1..8760)
number_slider_3 = Slider(6, range=1..12)
panel_12 = Panel("C:\Users\Assistenz\ASF_Simulation\WeatherData\CHE_Geneva.067000_IWEC.epw")
number_slider_4 = Slider(21, range=1..31)
number_slider_5 = Slider(21, range=1..31)
_180 = Addition(A=hour_of_year, B=180)
panel_13 = Panel(ladybug)
calculate_mdh = PythonScript(Hour_of_Year=_180)  # -> out, month, day, hour; inputs Hour_of_Year: Int32
# ---------- calculate_mdh: Python ----------
#06.01.2016
#Jeremias Schmidli
#Python script to calculate month, day, and hour based on hour of the year
import math
message = ''
hours_per_day=24
#days_in_month=[31,28,31,30,31,30,31,31,30,31,30,31]
days_in_month=[0,31,59,90,120,151,181,212,243,273,304,334,365]

day_in_year=math.floor((Hour_of_Year-1)/hours_per_day)+1
hour_of_day=(Hour_of_Year-1)%hours_per_day+1

for i in range(0,len(days_in_month)):
    if day_in_year<=days_in_month[i]:
        month = i
        day = int(day_in_year-days_in_month[i-1])
        break
    else:
        pass

print 'hour in the year: ', int(Hour_of_Year)
print 'day in the year: ', int(day_in_year)
hour = int(hour_of_day)

print 'month: ', month
print 'day: ', day
print 'hour: ', hour

#return month, day, hour
# ---------- end calculate_mdh ----------
calculate_mdh_2 = PythonScript(Hour_of_Year=hour_of_year)  # -> out, month, day, hour; inputs Hour_of_Year: Int32; same code as calculate_mdh
addition = Addition(A=Slider(12, range=1..24), B=1)
panel_14 = Panel(calculate_mdh_2.out)
analysisperiod_2 = Ladybug_AnalysisPeriod(
    fromMonth=calculate_mdh_2.month,
    fromDay=calculate_mdh_2.day,
    fromHour=calculate_mdh_2.hour,
    toMonth=calculate_mdh.month,
    toDay=calculate_mdh.day,
    toHour=calculate_mdh.hour)  # -> readMe, analysisPeriod; plug-in component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
importepw = Ladybug_ImportEpw(epwFile=panel_12)  # -> readMe, latitude, location, dryBulbTemperature, dewPointTemperature, relativeHumidity, windSpeed, windDirection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; plug-in component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
analysisperiod_3 = Ladybug_AnalysisPeriod(
    fromMonth=calculate_mdh_2.month,
    fromDay=calculate_mdh_2.day,
    fromHour=calculate_mdh_2.hour,
    toMonth=calculate_mdh.month,
    toDay=calculate_mdh.day,
    toHour=calculate_mdh.hour)  # -> readMe, analysisPeriod; plug-in component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
sun_basepoint = Point(<point referenced from the Rhino model>)
sun_direction = Point(<point referenced from the Rhino model>)
gencumulativeskymtx = Ladybug_GenCumulativeSkyMtx(epwFile=panel_12, skyDensity=0, useOldRes=Toggle(True), runIt=Toggle(True))  # -> readMe, cumulativeSkyMtx; plug-in component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
vec2pt = Vector2Pt(PointA=sun_basepoint, PointB=sun_direction, Unitize=False)  # -> Vector, Length
panel_15 = Panel(analysisperiod_2.analysisPeriod)
panel_16 = Panel(analysisperiod_3.analysisPeriod)
pt = ConstructPoint(
    XCoordinate=Slider(-1200, range=-1500..190),
    YCoordinate=Slider(14.5, range=0..100),
    ZCoordinate=Slider(14, range=0..100))
legendpar = Ladybug_LegendParameters(
    decimalPlaces=Slider(4, range=0..6),
    removeLessThan=Slider(0.0001, range=0..1),
    legendLocation=pt,
    legendScale=Slider(5.4, range=0..10),
    fontSize=Slider(100, range=0..100))  # -> legendPar; plug-in component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
flip = Flip(Surface=render_panel_layout)  # -> Surface, Result
pt_2 = Point(Point(8638.094015, 3329.922026, 0))
num = Number(0.01)
panel_17 = Panel("C:\Users\Assistenz\Documents\MT_Jeremias\Simulation_Data\RadiationEvaluation\RadiationResults.csv")

# ----
# Honeybee thermal analysis
honeybee = Honeybee_Honeybee()  # -> Vviiiiiiiiiizzz; plug-in component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
panel_18 = Panel(honeybee)
panel_19 = Panel("5")
flip_2 = Flip(Surface=surface)  # -> Surface, Result
createhbsrfs = Honeybee_createHBSrfs(geometry=surface_5, srfType="0", EPConstruction=list_2)  # -> readMe, simplify(HBSurface); plug-in component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
createhbsrfs_2 = Honeybee_createHBSrfs(geometry=surface_2, srfType="3", EPBC="Adiabatic")  # -> readMe, simplify(HBSurface); plug-in component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
createhbsrfs_3 = Honeybee_createHBSrfs(geometry=flip_2.Surface, srfType="2", EPBC="Adiabatic")  # -> readMe, simplify(HBSurface); plug-in component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
createhbsrfs_4 = Honeybee_createHBSrfs(geometry=surface_3, srfType="0")  # -> readMe, simplify(HBSurface); plug-in component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
createhbsrfs_5 = Honeybee_createHBSrfs(geometry=surface_4)  # -> readMe, simplify(HBSurface); plug-in component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
makeadiabatic = Honeybee_MakeAdiabatic(HBSrfs=createhbsrfs_3.HBSurface)  # -> HBSrfs; plug-in component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
makeadiabatic_2 = Honeybee_MakeAdiabatic(HBSrfs=createhbsrfs_2.HBSurface)  # -> HBSrfs; plug-in component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
makeadiabatic_3 = Honeybee_MakeAdiabatic(HBSrfs=createhbsrfs_4.HBSurface)  # -> HBSrfs; plug-in component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
bldgprograms = Honeybee_bldgPrograms({"Office": 0, "Retail": 1, "MidriseApartment": 2, "PrimarySchool": 3, "SecondarySchool": 4, "SmallHotel": 5, "LargeHotel": 6, "Hospital": 7, "Outpatient": 8, "Warehouse": 9, "SuperMarket": 10, "FullServiceRestaurant": 11, "QuickServiceRestaurant": 12}, selected="Office")
addhbglz = Honeybee_addHBGlz(HBObj=createhbsrfs.HBSurface, childSurfaces=flatten(createhbsrfs_5.HBSurface), EPConstructions=list)  # -> simplify(HBObjWGLZ); plug-in component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
listzoneprograms = Honeybee_ListZonePrograms(bldgProgram=bldgprograms)  # -> OfficeZonePrograms; plug-in component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
list_5 = ItemSelector(
    listzoneprograms,
    {"Office::BreakRoom", "Office::Storage", "Office::Vending", "Office::OpenOffice", "Office::ClosedOffice", "Office::Conference", "Office::PrintRoom", "Office::Restroom", "Office::Elec/MechRoom", "Office::IT_Room", "Office::Stair", "Office::Corridor", "Office::Lobby"}, selected="Office::ClosedOffice")
simcontrol = Honeybee_SimulationControl()  # -> simControls; plug-in component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
shadowpar = Honeybee_ShadowPar()  # -> shadowPar; plug-in component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
createhbzones = Honeybee_createHBZones(
    name="HBZone1",
    zoneProgram=list_5,
    HBSurfaces=flatten([addhbglz, makeadiabatic, makeadiabatic_2, makeadiabatic_3]),
    isConditioned=Toggle(True))  # -> readMe, HBZone; plug-in component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
panel_20 = Panel("C:\Users\Assistenz\ASF_Simulation\WeatherData\CHE_Geneva.067000_IWEC.epw")
int_4 = Integer(3)
epoutput = Honeybee_GenerateEPOutput(
    zoneEnergyUse=Toggle(True),
    zoneGainsAndLosses="False",
    zoneComfortMetrics="False",
    surfaceTempAnalysis="False",
    timestep="hourly")  # -> report, simulationOutputs; plug-in component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
setepzonethresholds = Honeybee_SetEnergyPlusZoneThresholds(HBZones=createhbzones.HBZone, coolingSetPt=Slider(26, range=0..30), heatingSetPt=Slider(22, range=0..30))  # -> readMe, HBZones; plug-in component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
energysimpar = Honeybee_EnergySimulationPar(timestep=6, shadowCalcPar=shadowpar, solarDistribution=int_4, terrain=int_2)  # -> energySimPar; plug-in component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
toggle = BooleanToggle(True)
int_5 = Integer(0)

setepzonecnstr = Honeybee_SetEPZoneConstruction(HBZone=setepzonethresholds.HBZones, windowEPConstruction="doublePane")  # -> simplify(modifiedHBZone); plug-in component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
labelsurfaces = Honeybee_LabelZoneSurfaces(HBObjects=flatten(createhbzones.HBZone), attribute=srfattributelist, windows=Toggle(False))  # -> surfaceTxtLabels, labelBasePts, brepTxtLabels, surfaceWireFrames; plug-in component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
annualdaylightsimulation = Honeybee_AnnualDaylightSimulation(epwWeatherFile=panel_20, testPoints=gentestpts.testPoints)  # -> analysisRecipe; plug-in component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
rundaylightanalysis = Honeybee_RunDaylightSimulation(
    HBObjects=flatten(setepzonethresholds.HBZones),
    analysisRecipe=annualdaylightsimulation,
    writeRad=Toggle(True),
    runRad=Toggle(True),
    radFileName="Test_HB_Daylight2",
    overwriteResults=True)  # -> readMe, analysisType, resultsUnit, results, testPts, annual_analysis_files, radGeoFile, studyFolder, done; plug-in component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
panel_21 = Panel(rundaylightanalysis.readMe)
readannualresultsi = Honeybee_ReadAnnualResultI(
    illFilesAddress=rundaylightanalysis.annual_analysis_files,
    testPoints=simplify(rundaylightanalysis.testPts),
    occupancyFiles=occupancygenerator,
    DLAIllumThresholds=300,
    runIt=Toggle(True))  # -> DLA, UDLI_Less_100, UDLI_100_2000, UDLI_More_2000, CDA, sDA, annualProfiles, htmReport; plug-in component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
flatten = FlattenTree(Tree=readannualresultsi.annualProfiles, Path="{0}")
setepzoneschedules = Honeybee_SetEnergyPlusZoneSchedules(HBZones=setepzonecnstr, lightingSchedules=flatten)  # -> schedules, simplify(HBZones); plug-in component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

# ---- group: one for each zone
panel_22 = Panel(readannualresultsi.annualProfiles)

# ----
panel_23 = Panel(setepzoneschedules.schedules)
askme = Honeybee_AskMe(HBObjects=setepzoneschedules.HBZones)  # -> readMe; plug-in component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
# surface grid display
panel_24 = Panel(askme)

# ----
# Run the E+ Simulation
# Save Thermal and Lighting Data
cooling_setpoint = Slider(26, range=10..30)
heating_setpoint = Slider(22, range=10..30)
heating_cop = Slider(5, range=0..10)
boolean_toggle = BooleanToggle(False)
boolean_toggle_2 = BooleanToggle(True)
_300 = Integer(300)
viper_diva_thermal_analysis_for_gh = ViperDIVAThermalAnalysisForGH(
    ProjectName="Viper_Temp",
    People_m2=0.1,
    Lights_W_m2=11.74,
    Equipment_W_m2=4,
    HeatingSetPoint_deg_C=22,
    CoolingSetPoint_deg_C=26,
    HeatingCOP=heating_cop,
    CoolingCOP=3,
    Infiltration=0.5,
    FreshAir=0.00944,
    LightingControl_lux=_300,
    ZoneBreps=[facade.Zone_2, all_adiabatic.Zone_2],
    Window=window_unit.Window_2,
    WriteOnly=boolean_toggle,
    RunSimulation=boolean_toggle_2,
    ProjectName_2="Viper_Temp",
    People_m2_2=0.1,
    Lights_W_m2_2=11.74,
    Equipment_W_m2_2=4,
    HeatingSetPoint_deg_C_2=22,
    CoolingSetPoint_deg_C_2=26,
    HeatingCOP_2=heating_cop,
    CoolingCOP_2=3,
    Infiltration_2=0.5,
    FreshAir_2=0.00944,
    LightingControl_lux_2=_300,
    ZoneBreps_2=[facade.Zone_2, all_adiabatic.Zone_2],
    Window_2=window_unit.Window_2,
    WriteOnly_2=boolean_toggle,
    RunSimulation_2=boolean_toggle_2,
    CustomDates=False,
    Location=16,
    Occupancy=0,
    OutputStates=[True, True, False, False, True, True, False, False, False, False, False, False, False, False, False, False, False, False, False],
    ReportingPeriod=0,
    RunPeriod=0,
    ShadowFreq=30,
    ShadowOverlap=15000,
    SolarDist=2,
    Timestep=2)  # -> OutputMessage, MetricHeatingE, flatten(MetricCoolingE), flatten(MetricElecLights), MetricElecEquip, OutputMessage_2, MetricHeatingE_2, flatten(MetricCoolingE_2), flatten(MetricElecLights_2), MetricElecEquip_2
panel_25 = Panel(viper_diva_thermal_analysis_for_gh.OutputMessage_2)
mass_addition = MassAddition(Input=viper_diva_thermal_analysis_for_gh.MetricElecLights_2)  # -> Result, PartialResults
mass_addition_2 = MassAddition(Input=viper_diva_thermal_analysis_for_gh.MetricHeatingE_2)  # -> Result, PartialResults
mass_addition_3 = MassAddition(Input=viper_diva_thermal_analysis_for_gh.MetricCoolingE_2)  # -> Result, PartialResults
panel_26 = Panel(mass_addition_2.Result)
panel_27 = Panel(mass_addition_3.Result)
panel_28 = Panel(mass_addition.Result)
panel_29 = Panel(viper_diva_thermal_analysis_for_gh.MetricHeatingE_2)

runenergysimulation = Honeybee_RunEnergySimulation(
    north=int_5,
    epwFile=panel_20,
    energySimPar=energysimpar,
    HBZones=flatten(setepzoneschedules.HBZones),
    simulationOutputs=flatten(epoutput.simulationOutputs),
    writeIdf=toggle,
    runEnergyPlus=toggle,
    idfFileName="Test_HB")  # -> report, idfFileAddress, resultFileAddress; plug-in component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
readepresult = Honeybee_ReadEPResult(resultFileAddress=runenergysimulation.resultFileAddress, normByFloorArea=Toggle(False))  # -> totalThermalEnergy, thermalEnergyBalance, cooling, heating, electricLight, electricEquip, port, port_2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; plug-in component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
separatedata = Ladybug_SeparateData(inputList=flatten(readepresult.cooling))  # -> numbers, strings; plug-in component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
separatedata_2 = Ladybug_SeparateData(inputList=flatten(readepresult.heating))  # -> numbers, strings; plug-in component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
separatedata_3 = Ladybug_SeparateData(inputList=flatten(readepresult.electricLight))  # -> numbers, strings; plug-in component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
_3dchart = Ladybug_3DChart(
    inputData=flatten([readepresult.electricLight, readepresult.heating, readepresult.cooling, readepresult.totalThermalEnergy]),
    xScale=Slider(0, range=0..1000),
    yScale=Slider(10, range=0..1000),
    zScale=Slider(0, range=0..1000))  # -> readMe, graphMesh, graphCurves, legend, legendBasePts, title, titleBasePts, dataPts, conditionalHOY; plug-in component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
ma = MassAddition(Input=separatedata_3.numbers)  # -> Result, PartialResults
panel_30 = Panel(ma.Result)

division_4 = Division(A=separatedata.numbers, B=cop_2)
division_5 = Division(A=separatedata_2.numbers, B=cop)

ma_2 = MassAddition(Input=division_5)  # -> Result, PartialResults
ma_3 = MassAddition(Input=division_4)  # -> Result, PartialResults
panel_31 = Panel(ma_2.Result)
panel_32 = Panel(ma_3.Result)

panel_33 = Panel(readepresult.electricLight)

panel_34 = Panel("""0
0
0
0
0
0
0.2
0.5
0.6
0.7
0.9
1
0.5
1
1
0.8
0.7
0.6
0.5
0.3
0.2
0.1
0
0""")
panel_35 = Panel("""0
0
0
0
0
0
1
1
1
1
1
1
1
1
1
1
0
0
0
0
0
0
0
0""")
dup = DuplicateData(Data=int_3, Number="5", Order=True)
dup_2 = DuplicateData(Data=panel_35, Number="2", Order=True)
data = Data([dup, dup_2])

int_6 = Integer(data)

dup_3 = DuplicateData(Data=int_6, Number="52", Order=True)  # -> flatten(Data)
data_2 = Data([int_3, dup_3])

csvschedule = Honeybee_CreateCSVSchedule(values=data_2, scheduleName="LabSchedule", writeFile=Toggle(True))  # -> readMe, flatten(csvSchedule); plug-in component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
occupancygenerator_2 = Honeybee_DaysimOccupancyGeneratorBasedOnList(occValues=data_2, fileName="LabSchedule", writeTheOcc=Toggle(True))  # -> occupancyFile; plug-in component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

panel_36 = Panel(csvschedule.csvSchedule)

panel_37 = Panel(occupancygenerator_2)

smaller_than = SmallerThan(FirstNumber=addition_2, SecondNumber=hours_in_the_year)  # -> SmallerThan, OrEqualTo
addition_2 = Addition(A=hoopsnake.IterationsCounter, B=1)
hoopsnake = HoopSnake(
    StartingData=Slider(1, range=0..100),
    Data=addition_2,
    TerminationCondition=smaller_than.OrEqualTo,
    Hoopsnake_Data_autoUpdate=False,
    Hoopsnake_Data_dataLimit=2147483647,
    Hoopsnake_Data_delay=0,
    Hoopsnake_Data_resetCounter=True,
    Hoopsnake_Data_updateView=True)  # -> Feedback, CumulativeFeedback, LoopsCounter, IterationsCounter

panel_38 = Panel(hoopsnake.Feedback)
selectskymtx = Ladybug_selectSkyMtx(
    cumulativeSkyMtx=gencumulativeskymtx.cumulativeSkyMtx,
    HOY=panel_38,
    removeDiffuse=Toggle(False),
    removeDirect=Toggle(False))  # -> readMe, selectedSkyMtx; plug-in component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
panel_39 = Panel(selectskymtx.selectedSkyMtx)
radiationanalysis = Ladybug_RadiationAnalysis(
    north=0,
    geometry=flatten(flip.Surface),
    gridSize=Slider(50, range=0..200),
    disFromBase=Slider(0.644, range=-1..1),
    selectedSkyMtx=flatten(selectskymtx.selectedSkyMtx),
    legendPar=flatten(legendpar),
    parallel=Toggle(False),
    runIt=Toggle(False),
    projectName="testproject_01")  # -> readMe, contextMesh, analysisMesh, testPts, testVec, port, radiationResult, radiationMesh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; plug-in component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
skydome = Ladybug_SkyDome(
    selectedSkyMtx=selectskymtx.selectedSkyMtx,
    centerPoint=pt_2,
    scale=num,
    showTotalOnly=False,
    runIt=Toggle(True),
    bakeIt=False)  # -> readMe, skyPatchesMesh, baseCrvs, legend, legendBasePts, skyPatchesCenPts, skyPatchesAreas, skyPatchesAsBrep, values; plug-in component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
ma_4 = MassAddition(Input=skydome.values)  # -> Result, PartialResults
panel_41 = Panel(ma_4.Result)
panel_42 = Panel(radiationanalysis.testPts)
panel_43 = Panel(radiationanalysis.radiationResult)
panel_44 = Panel(radiationanalysis.totalRadiation)
c_script = CSharpScript(
    hourOfYear=panel_38,
    totalRadiation=radiationanalysis.totalRadiation,
    panelSize=generate_diamond_array.panelSize,
    radiationPerPanel=radiationanalysis.radiationResult,
    fileName=panel_17)  # -> out, A; inputs hourOfYear: Int32, totalRadiation: Double, panelSize: Double, radiationPerPanel: tree of Double, fileName: String
# ---------- c_script: C# ----------
    //
    // write text file
    //
    if(hourOfYear == 1)
    {
      List<string> allLines = new List<string>();

      allLines.Add("total_radiation_(kWh per year)");
      allLines.Add(totalRadiation.ToString());
      allLines.Add("panel size (mm)");
      allLines.Add(panelSize.ToString());
      allLines.Add("iteration number");
      allLines.Add(hourOfYear.ToString());



      allLines.Add("radiation of each grid point (kWh/m² per year, one panel per line)");
      int fieldsPerPanel = radiationPerPanel.Branches[0].Count;
      for(int i = 0; i < radiationPerPanel.BranchCount; i++){
        fieldsPerPanel = radiationPerPanel.Branches[i].Count;
        string radPerPanel = "";
        for (int t = 0; t < fieldsPerPanel - 1; t++){
          radPerPanel += radiationPerPanel.Branches[i][t].ToString() + ",";
        }
        int ti = fieldsPerPanel - 1;
        radPerPanel += radiationPerPanel.Branches[i][ti].ToString();
        allLines.Add(radPerPanel);
      }


      System.IO.File.WriteAllLines(fileName, allLines);
    }
    else
    {
      List<string> allLines = new List<string>();
      
      allLines.Add("iteration number");
      allLines.Add(hourOfYear.ToString());

      allLines.Add("radiation of each grid point (kWh/m² per year, one panel per line)");
      int fieldsPerPanel = radiationPerPanel.Branches[0].Count;
      for(int i = 0; i < radiationPerPanel.BranchCount; i++){
        fieldsPerPanel = radiationPerPanel.Branches[i].Count;
        string radPerPanel = "";
        for (int t = 0; t < fieldsPerPanel - 1; t++){
          radPerPanel += radiationPerPanel.Branches[i][t].ToString() + ",";
        }
        int ti = fieldsPerPanel - 1;
        radPerPanel += radiationPerPanel.Branches[i][ti].ToString();
        allLines.Add(radPerPanel);
      }

      System.IO.File.AppendAllLines(fileName, allLines);
    }


    //
    // save screenshot
    //

    // get viewport, create bitmap object, save to file

    //Rhino.Display.RhinoView myView = Rhino.RhinoDoc.ActiveDoc.Views.ActiveView;
    //Bitmap myBitmap = myView.CaptureToBitmap();
    //myBitmap.Save(pngPath);
# ---------- end c_script ----------

# ----
# Make sure that this is connected to 'iteration count'
iterations_count = Integer(hoopsnake_2.IterationsCounter)

smaller_than_2 = SmallerThan(FirstNumber=addition_3, SecondNumber=combination_maker_v2.maxcomb)  # -> SmallerThan, OrEqualTo
addition_3 = Addition(A=hoopsnake_2.IterationsCounter, B=1)
# Loop
hoopsnake_2 = HoopSnake(
    StartingData=number_slider_2,
    Data=addition_3,
    TerminationCondition=smaller_than_2.SmallerThan,
    Hoopsnake_Data_autoUpdate=False,
    Hoopsnake_Data_dataLimit=2147483647,
    Hoopsnake_Data_delay=0,
    Hoopsnake_Data_resetCounter=True,
    Hoopsnake_Data_updateView=True)  # -> Feedback, CumulativeFeedback, LoopsCounter, IterationsCounter

python_script = PythonScript(
    loopNo=hoopsnake_2.IterationsCounter,
    Heating=viper_diva_thermal_analysis_for_gh.MetricHeatingE_2,
    Cooling=viper_diva_thermal_analysis_for_gh.MetricCoolingE_2,
    Lighting=viper_diva_thermal_analysis_for_gh.MetricElecLights_2,
    Equip=viper_diva_thermal_analysis_for_gh.MetricElecEquip_2)  # -> out, a; inputs Heating: list, Cooling: list, Lighting: list, Equip: list; disabled
# ---------- python_script: Python ----------
#13.10.2015
#Prageeth Jayathissa
#Python script to read DIVA inputs and produce a CSV file

import sys, os
import datetime

# possible paths to save data:
destination_PJ = 'C:/Users/User/Documents/01_SuAT/01_HiLo/04_Facade/Rhino_Simulations'
destination_J = 'C:/Users/Assistenz/Documents/MT_Jeremias/Simulation_Data'

# assign destination:
destination = destination_J

#Create empty .csv files
if loopNo==0:
    with open(os.path.join(destination,'heating.csv'),'w') as f:
        pass
    with open(os.path.join(destination,'cooling.csv'),'w') as f:
        pass
    with open(os.path.join(destination,'lighting.csv'),'w') as f:
        pass
    with open(os.path.join(destination,'time.csv'),'w') as f:
        pass

#Write to csv files

#Each itteration will be stored in a row of a csv file
writestring=''

with open(os.path.join(destination,'heating.csv'),'a') as f:
    for ii in Heating:
        #Create row in csv
        writestring=writestring+str(ii)+','
    #remove the last comma
    writestring=writestring[:-1]
    #add a new line and write
    f.write(writestring+'\n')
    f.close()

writestring=''
with open(os.path.join(destination,'cooling.csv'),'a') as f:
    for ii in Cooling:

        writestring=writestring+str(ii)+','
    #print writestring
    writestring=writestring[:-1]
    f.write(writestring+'\n')
    f.close()
    
writestring=''
with open(os.path.join(destination,'lighting.csv'),'a') as f:
    for ii in Lighting:

        writestring=writestring+str(ii)+','
    #print writestring
    writestring=writestring[:-1]
    f.write(writestring+'\n')
    f.close()
    
with open(os.path.join(destination,'time.csv'),'a') as f:
    f.write(str(datetime.datetime.utcnow())+'\n')


#totalHeat=sum(Heating)
#totalCool=sum(Cool)
#totalLights=sum(Lights)
#totalEquip=sum(Equip)
# ---------- end python_script ----------
panel_45 = Panel(python_script.out)
