# Grasshopper definition example_010_Honeybee EnergyPlus Simulation.gh (Grasshopper 0.9.76)
# plug-ins: Python Interpreter

# ----
# Set Up An Energy Simulation
# Set Building Geometry
brep = Brep(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)
splitmass = Honeybee_SplitBuildingMass(bldgMasses=brep, bldgsFlr2FloorHeights="@3", perimeterZoneDepth="@3", runIt=Toggle(True))  # -> readMe, splitBldgMasses; plug-in component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
mass2zone = Honeybee_Masses2Zones(zoneMasses=flatten(splitmass.splitBldgMasses), isConditioned=True, maxRoofAngle=30, createHBZones=Toggle(True))  # -> readMe, HBZones; plug-in component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
solveadjc = Honeybee_SolveAdjacencies(HBZones=flatten(mass2zone.HBZones), removeCurrentAdjc=False, findAdjc=Toggle(True))  # -> readMe, HBZonesWADJ; plug-in component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
panel = Panel("""0.2
0.4
0.6
0.4""")
glazingcreator = Honeybee_GlazingBasedOnRatio(HBObjects=solveadjc.HBZonesWADJ, glzRatio=panel, breakUpWindow=Toggle(False), runIt=Toggle(True))  # -> readMe, HBObjWGLZ; plug-in component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
panel_2 = Panel("http://apps1.eere.energy.gov/buildings/energyplus/weatherdata/4_north_and_central_america_wmo_region_4/1_usa/USA_NY_New.York-J.F.Kennedy.Intl.AP.744860_TMY3.zip")
epoutput = Honeybee_GenerateEPOutput(
    zoneEnergyUse=Toggle(True),
    zoneGainsAndLosses="False",
    zoneComfortMetrics="False",
    surfaceTempAnalysis="False",
    timestep="hourly")  # -> report, simulationOutputs; plug-in component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
setepzonethresholds = Honeybee_SetEnergyPlusZoneThresholds(HBZones=glazingcreator.HBObjWGLZ, coolingSetPt=Slider(24, range=22..28), heatingSetPt=Slider(19, range=16..20))  # -> readMe, HBZones; plug-in component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
open_epw_stat = Ladybug_OpenEPWAndSTATWeatherFiles(weatherFileURL=panel_2)  # -> epwFile, statFile; plug-in component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

ladybug = Ladybug_Ladybug()  # -> Vviiiiiiiiiizzz; plug-in component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
honeybee = Honeybee_Honeybee()  # -> Vviiiiiiiiiizzz; plug-in component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

# ----
# Visualize the Zones
decomposebytype = Honeybee_DecomposeBasedOnType(HBZone=setepzonethresholds.HBZones)  # -> walls, interiorWalls, airWalls, windows, interiorWindows, skylights, roofs, ceilings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; plug-in component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
preview = CustomPreview(Geometry=decomposebytype.windows, Shader=ColourSwatch(SwatchColor=RGBA(178, 232, 255, 108)))
preview_2 = CustomPreview(Geometry=decomposebytype.walls, Shader=ColourSwatch(SwatchColor=RGB(255, 252, 178)))
preview_3 = CustomPreview(Geometry=[decomposebytype.exposedFloors, decomposebytype.floors], Shader=ColourSwatch(SwatchColor=RGB(214, 131, 131)))
preview_4 = CustomPreview(Geometry=decomposebytype.roofs, Shader=ColourSwatch(SwatchColor=RGB(128, 128, 128)))

# ----
# Run the Simulation
panel_3 = Panel("Test_IDF")
toggle = BooleanToggle(False)
# Run the Energy Simulation + Get Results
runenergysimulation = Honeybee_RunEnergySimulation(
    epwFile=open_epw_stat.epwFile,
    HBZones=flatten(setepzonethresholds.HBZones),
    simulationOutputs=flatten(epoutput.simulationOutputs),
    writeIdf=toggle,
    runEnergyPlus=toggle,
    idfFileName=panel_3,
    meshSettings=1)  # -> report, idfFileAddress, resultFileAddress; plug-in component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
readepresult = Honeybee_ReadEPResult(resultFileAddress=runenergysimulation.resultFileAddress)  # -> totalThermalEnergy, thermalEnergyBalance, cooling, heating, electricLight, electricEquip, fanElectric, peopleGains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; plug-in component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

# ----
# Color Zones With Results
colorzones = Honeybee_ColorZonesByEPResult(zoneData=readepresult.heating, HBZones=flatten(setepzonethresholds.HBZones), runIt=Toggle(False))  # -> readMe, zoneColoredMesh, zoneWireFrame, legend, legendBasePt, zoneBreps, zoneColors, zoneValues, floorNormZoneData; plug-in component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
preview_5 = CustomPreview(Geometry=colorzones.zoneBreps, Shader=colorzones.zoneColors)

# ----
# 8760 Hourly Values in Each List
panel_4 = Panel(readepresult.heating)
# One List for Each Zone
viewer = ParamViewer(readepresult.heating)
