# Grasshopper definition include_radiation_on_panels.gh (Grasshopper 0.9.76)
# plug-ins: DIVA.ForGrasshopper, Python Interpreter, HoopSnake

number_of_panels_in_first_row = Slider(6, range=0..20)
number_of_rows = Slider(9, range=0..9)

# ----
# Building Geometry Inputs
panel_thickness_mm = Slider(10, range=0.5..10)
panel_spacing_mm = Slider(500, range=200..1500)
edge_tolerance = Slider(0, range=0..1000)
panel_offset_mm = Slider(576, range=100..1000)
room_height = Slider(3100, range=1000..20000)
room_depth = Slider(7000, range=1000..20000)
room_width = Slider(4900, range=1000..20000)
glazing = Slider(0.91, range=0..1)
panel_size_mm = Slider(400, range=1..500)

# ----
# ASF Inputs
number_of_clusters = Slider(2, range=1..3)
combination = Slider(0, range=0..49)

boolean_top_row_short = BooleanToggle(False)
boolean_diamond_array = BooleanToggle(True)

# ----
# ITERATION (HOOPSNAKE)
number_slider = Slider(0.6, range=0..1)
number_slider_2 = Slider(-90, range=-90..90)
number_slider_3 = Slider(90, range=-90..90)
number_slider_4 = Slider(2, range=0..2)
number_slider_5 = Slider(2, range=0..10)
number_slider_6 = Slider(0.6, range=0..1)
expression = Expression(minX=number_slider_4, maxX=number_slider_5, step=Slider(0.4, range=0..1), Expression="(maxX - minX) / step + 1")
expression_2 = Expression(minX=number_slider, maxX=number_slider_6, step=Slider(0.15, range=0..1), Expression="(maxX - minX) / step + 1")
expression_3 = Expression(minX=number_slider_2, maxX=number_slider_3, step=Slider(1, range=0..60), Expression="(maxX - minX) / step + 1")
mm = MassMultiplication(Input=[expression, expression_2, expression_3])  # -> Result, PartialResults
int = Integer(mm.Result)

# ----
# north orientation
sun_basepoint = Point(<point referenced from the Rhino model>)
sun_direction = Point(<point referenced from the Rhino model>)

# ----
# Render the ASF
generate_diamond_array = PythonScript(
    edgeTol=edge_tolerance,
    panelThick=panel_thickness_mm,
    numberHorizontal=number_of_panels_in_first_row,
    Top_row_short=boolean_top_row_short,
    numberVertical=number_of_rows,
    panelOffset=panel_offset_mm,
    panelSize=panel_size_mm,
    panelSpacing=panel_spacing_mm,
    room_width=room_width,
    room_height=room_height,
    diamond_flag=boolean_diamond_array)  # -> outputASFarray, panelSize, panelOffset, panelThick, diamond_flag
# ---------- generate_diamond_array: Python ----------
#15.12.2015
#Prageeth Jayathissa
#Script for calculating the grid layout of the ASF
#Edited by Jeremias Schmidli

#Description:
    #This script has three parts, out of which only one is executed, depending 
    #on the booleans diamond_flag (diamond- or rectangular-pattern) and 
    #only_odd_rows (if true it automatically determines pattern depending on 
    #room size, if false the number of panels in the first row, the number of 
    #rows and whether the first row is short or long has to be spezified).

#Notes:
    #All coordinates described as "y-value" actually correspond to the "z-value"
    #in Grasshopper.
    #To maximize performance of a simulation, it should be made sure, that this 
    #script is only evaluated once. 

#Staus: Complete

#To Do:
    #Add function to ensure the panel offset is greater than the panel size
#------------------------------------------------------------------------------

import rhinoscriptsyntax as rs
import Grasshopper as gh
import Rhino
import math
import json


#specify if layout should be generated automatically, depending on room size 
#(If False, the inputs numberHorizontal, Top_row_short and numberVertical are needed.
# If True, the input edgeTol is needed.
# Works only for diamond pattern):
automatic_layout = False

# calculate diamond pattern if True:
if diamond_flag == True:
    
    # code from PJ, generates automatic layout:
    if automatic_layout == True:
        
        #Function to determine the location of the first panel
        def first_coordinate():
            x=room_width/2 -((No_Hpanels-1)*Hspacing)/2 
            print x
            y=((No_Vpanels-1)*Vspacing)/2 +(room_height)/2
            
            if center_long:
                if bigstart:
                    x=x
                else:
                    x+=(Hspacing/2)
            else:
                if bigstart:
                    x-=(Hspacing/2)
                    print 'me'
                else:
                    x=x
            return (x,y)
                    
        
        #import paramters:
        #room_width=3700.0
        #room_height=3000.00
        
        
        
        #panel size and spacing along the diagonal axis
        #panelSize=400.0
        #panelSpacing=500.0
        #panelThick=2
        #panelOffset=500
        
        #minor adjustments to the panel size
        #edgeTol=1.4
        #V_translation=100
        edgeOverlap=(edgeTol/100)*panelSpacing
        
        
        #transform spacing into vertical and horizontal components
        #Note: sin(45) = 1/math.sqrt(2)
        Hspacing=(panelSpacing/math.sqrt(2))*2
        Vspacing = panelSpacing/math.sqrt(2)
        
        #initialise boolean to determine whether the center pannel line is long
        center_long=True
        #initialise boolean to determine wether the middle row needs to be offset
        center_offset=False 
        
        #find out how many panels fit on the horizontal axis
        #The edgeOverlap allows for more or less panels to fit around the edge
        No_Hpanels=int(math.floor((room_width-panelSize+edgeOverlap)/Hspacing))
        
        #The number of panels on the middle axis is always odd
        #check if the number is even, and if so subtract 1 and define center as a short row
        if not No_Hpanels & 1: #binary logic to determine if the number is even
            print 'even'
            No_Hpanels-=1 #subtract by one to make it odd
            center_long=False #state that the middle row is now the shorter row
        
        
        print 'Hpanels',No_Hpanels
        
        #find out how many panels fit on the vertical axis accounting for an overlap
        No_Vpanels=int(math.floor((room_height-panelSize+edgeOverlap)/Vspacing))
        
        #Number of rows must also be odd for asthetic reasons
        if not No_Vpanels &1:
            print 'even Vpanels'
            center_offset=True
            No_Vpanels-=1  
            
        print 'V panels' , No_Vpanels
        #Very Messy shit code to determine wether the first row has more panels than the second row
        
        #if (No_Vpanels-1)/2 is odd, then the top row has the same number of panels as the middle
        #if it is even then it has one more or one less depending on whether the center is long or short
        checker=int((No_Vpanels-1)/2)
        print 'checker',checker
        print 'center_long?', center_long
        if center_long:
            if checker &1: #if checker is odd
                print '3,7,11 etc Vpanels1'
                bigstart=False #Top row is shorter than second row
                oneswitch=-1 #top row has one less panel than middle row
            else:
                print '1,5,9 etc Vpanels2'
                bigstart=True #top row is longer than second row
                oneswitch=0
        else:
            if checker &1:
                print '3,7,11 etc Vpanels3'
                bigstart=True
                oneswitch=1 #top panel has one more panel than the middle row
            else:
                print '1,5,9 etc Vpanels4'
                bigstart=False
                oneswitch=0
        
        #End of messy shitty code
        
        #prints for debugging
        print 'bigstart', bigstart 
        print 'oneswitch',oneswitch
        
        #initialise ASFarray List
        ASFarray=[]
        
        #Produce an empy list nested in a list. The nested list represents each row
        for ii in range(No_Vpanels):
            ASFarray.append([])
           
        
        
        #aquire the first coordinate of the top left panel
        (x,y)=first_coordinate()  #see function at the top
        x_first=x #store initial x coordinate
        y_first=y #store initial y coordinate
        
        
        #This next for loop records the coordinate positions of each panel
        #initialise row counter
        icount=0
        for ii in ASFarray:
            #initialise collumn counter
            jcount=0
            
            for jj in range(No_Hpanels+oneswitch): #first row
                ii.append((x+jcount*Hspacing,y-icount*Vspacing)) #Append panel coordinate
                jcount+=1 #next column
            #Switches so the next row has either one more or one less panel
            #logic: If the center row is long, then it will switch between its own size
            #and a size smaller. If not it will switch between its own size and one bigger
            if center_long:
                oneswitch-=1
                oneswitch=(oneswitch%2)*-1 #output either 0 or -1
            else:
                oneswitch+=1
                oneswitch=oneswitch%2 #output is either 0 or 1
            icount+=1
            
            #Determines the starting position of the first panel of the row depending on
            #if its long or short
            if icount &1: #if odd
                if bigstart:
                    x=x_first+(Hspacing/2) #start half a space to the right
                else:
                    x=x_first -(Hspacing/2) #start half a space to the left
            else:
                x=x_first
            
            
        
        
        #Write the array output as a json and send to next python file
        #Note: Lists in Lists cannot be sent over grasshopper
        outputASFarray=json.dumps(ASFarray)
        print ASFarray
        
    # Code Jeremias, uses manual specification of number of panels in grid:
    else:
        #make number of rows and columns integers:
        numberHorizontal = int(numberHorizontal)
        numberVertical = int(numberVertical)
        
        #initialise ASFarray List:
        ASFarray=[]
        
            #Produce an empty list nested in a list. The nested list represents each row
        for ii in range(int(numberVertical)):
            ASFarray.append([])
        
        
        #store x and y coordinate of first panel in the top row 
        #( & 1 checks if the number is odd):
            
        #find initial x-coordinate:
        if numberHorizontal & 1 and Top_row_short:
            x_first=room_width/2-panelSpacing*math.sqrt(2)*(numberHorizontal-1)/2 
        elif numberHorizontal & 1 and not Top_row_short:
            x_first=room_width/2-panelSpacing*math.sqrt(2)*(numberHorizontal-1)/2 
        elif not numberHorizontal & 1 and Top_row_short:
            x_first=room_width/2-panelSpacing*math.sqrt(2)*(numberHorizontal)/2
        elif not numberHorizontal & 1 and not Top_row_short:
            x_first=room_width/2-panelSpacing*math.sqrt(2)*(numberHorizontal-1)/2 
            
        #find initial y-coordinate:
        if numberVertical & 1:
            y_first=room_height/2+panelSpacing*(math.sqrt(2)/2)*(numberVertical-1)/2
        else:
            y_first=room_height/2+panelSpacing*(math.sqrt(2)/2)*(numberVertical-1)/2 
            
        
        #This next for loop records the coordinate positions of each panel
        
        #initialise x and y coordinate:
        x = x_first
        y = y_first
        
        #initialise row counter
        icount=0
        for ii in ASFarray:
            #initialise collumn counter
            jcount=0
            
            if (numberHorizontal & 1) and (icount & 1) and Top_row_short:
                
                for jj in range(int(numberHorizontal)+1): #first row
                    ii.append((x-panelSpacing*math.sqrt(2)/2+jcount*panelSpacing*math.sqrt(2),y-icount*panelSpacing*math.sqrt(2)/2)) #Append panel coordinate
                    jcount+=1 #next column
                    
            elif (numberHorizontal & 1) and not (icount & 1) and Top_row_short:
                
                for jj in range(int(numberHorizontal)): #first row
                    ii.append((x+jcount*panelSpacing*math.sqrt(2),y-icount*panelSpacing*math.sqrt(2)/2)) #Append panel coordinate
                    jcount+=1 #next column
                    
            elif (numberHorizontal & 1) and (icount & 1) and not Top_row_short:
                
                for jj in range(int(numberHorizontal)-1): #first row
                    ii.append((x+panelSpacing*math.sqrt(2)/2+jcount*panelSpacing*math.sqrt(2),y-icount*panelSpacing*math.sqrt(2)/2)) #Append panel coordinate
                    jcount+=1 #next column
                    
            elif (numberHorizontal & 1) and not (icount & 1) and not Top_row_short:
                
                for jj in range(int(numberHorizontal)): #first row
                    ii.append((x+jcount*panelSpacing*math.sqrt(2),y-icount*panelSpacing*math.sqrt(2)/2)) #Append panel coordinate
                    jcount+=1 #next column
                    
            elif not (numberHorizontal & 1) and (icount & 1) and Top_row_short:
                
                for jj in range(int(numberHorizontal)+1): #first row
                    ii.append((x+jcount*panelSpacing*math.sqrt(2),y-icount*panelSpacing*math.sqrt(2)/2)) #Append panel coordinate
                    jcount+=1 #next column
            
            elif not (numberHorizontal & 1) and not (icount & 1) and Top_row_short:
                
                for jj in range(int(numberHorizontal)): #first row
                    ii.append((x+panelSpacing*math.sqrt(2)/2+jcount*panelSpacing*math.sqrt(2),y-icount*panelSpacing*math.sqrt(2)/2)) #Append panel coordinate
                    jcount+=1 #next column
            elif not (numberHorizontal & 1) and (icount & 1) and not Top_row_short:
                
                for jj in range(int(numberHorizontal)-1): #first row
                    ii.append((x+panelSpacing*math.sqrt(2)/2+jcount*panelSpacing*math.sqrt(2),y-icount*panelSpacing*math.sqrt(2)/2)) #Append panel coordinate
                    jcount+=1 #next column
            
            elif not (numberHorizontal & 1) and not (icount & 1) and not Top_row_short:
                
                for jj in range(int(numberHorizontal)): #first row
                    ii.append((x+jcount*panelSpacing*math.sqrt(2),y-icount*panelSpacing*math.sqrt(2)/2)) #Append panel coordinate
                    jcount+=1 #next columnelse :
           
            #next row
            icount+=1
            
            
        #Write the array output as a json and send to next python file
        #Note: Lists in Lists cannot be sent over grasshopper
        outputASFarray=json.dumps(ASFarray)
        print ASFarray
    
# calculate rectangular pattern:
else:
    
    #make number of rows and columns integers:
    numberHorizontal = int(numberHorizontal)
    numberVertical = int(numberVertical)
    
    #initialise ASFarray List:
    ASFarray=[]
    
        #Produce an empy list nested in a list. The nested list represents each row
    for ii in range(int(numberVertical)):
        ASFarray.append([])
    
    
    #store initial x and y coordinate:
    if numberHorizontal & 1:
        x_first=room_width/2-panelSpacing*(numberHorizontal-1)/2 
    else:
        x_first=room_width/2-panelSpacing*(numberHorizontal-2)/2 - panelSpacing/2 
    if numberVertical & 1:
        y_first=room_height/2+panelSpacing*(numberVertical-1)/2
    else:
        y_first=room_height/2+panelSpacing*(numberVertical-2)/2 + panelSpacing/2
        
    
    #This next for loop records the coordinate positions of each panel
    
    #initialise x and y coordinate:
    x = x_first
    y = y_first
    
    #initialise row counter
    icount=0
    for ii in ASFarray:
        #initialise collumn counter
        jcount=0
        
        for jj in range(int(numberHorizontal)): #first row
            ii.append((x+jcount*panelSpacing,y-icount*panelSpacing)) #Append panel coordinate
            jcount+=1 #next column
        
        #next row
        icount+=1
        
        
    #Write the array output as a json and send to next python file
    #Note: Lists in Lists cannot be sent over grasshopper
    outputASFarray=json.dumps(ASFarray)
    print ASFarray
# ---------- end generate_diamond_array ----------
combination_maker_v2 = PythonScript(combination=combination, NoClusters=number_of_clusters, outputASFarray=generate_diamond_array.outputASFarray)  # -> out, maxcomb, outputASFangles
# ---------- combination_maker_v2: Python ----------
#13.10.2015
#Prageeth Jayathissa
#Python script to produce all possible angle combinations of the facade

#Status: Complete but difficult to read

#Warning: If NoCluster>2 then the program becomes slow

#------------------------------------------------
'''README

This code can be read as three chapters

Chapter1: Produces a list of possible angle combinations for a single panel
    Output: ANGLES - a list of all possible angle combinations

Chapter2: Splits the facade into independant clusters of rows. 
    Output: rowsplit - a list of intergers that indicate the start and end point
        of clusters
    Example: If a facade with 9 rows is split into 2 clusters, rowsplit=[0,4,9]
        this indicates that one cluser starts at 0 and ends at 4
        the second cluster starts at 4 and ends at 9

Chapter3: Itterates through all possible panel combinations and produces an output
    list which contains each outputASFangle combination
    Output: ListASFangles - a list of all possible ASFangles
    
Chapter4: Determines that combination of Angles should be recorded for each itteration
    How it works: In priciple, this is a counter where base= Number of angle combinations
    Example: If number of angles =10 and number of clusters =2 this would be a normal 2digit base10 counter
    rowVal=[0,0]
    rowVal=[0,1]
    ...
    rowVal=[0,9]
    rowVal=[1,0]
    
    if number of angles =49 then
    rowVal=[0,0]
    rowVal=[0,1]
    ...
    rowVal=[0,48]
    rowVal=[1,0]
    rowVal=[1,1] etc
    
    This numer rowVal is then used to call on the ANGLE list produced in Chapter 1
    which is then fed into Chapter 3
        
        '''

#Import Modules------------------------------------------------

import json
import math
import copy
####---CHAPTER1-------------------------

#unpack json file and coppy ASF array to create an empty anglearray
ASFarray=json.loads(outputASFarray)
ASFangles=copy.deepcopy(ASFarray)

#Possible ANgles in simulation
XANGLES=[0,15,30,45,60,75,90]#[0,45,90]#[0,15,30,45,60,75,90]
YANGLES=[-45,-30,-15,0,15,30,45]#[-45,0,45]#[-45,-30,-15,0,15,30,45]

#Array to hold final list
ListASFangles=[]

#Number of groups that the facade can exist in (now input to function)
NoClusters=int(NoClusters)
#NoClusters=1
#Number of angle combinations
NoAngles=len(XANGLES)*len(YANGLES)

#Define the angle value that a row is in
#the value is between 0 and NoAngles
rowVal=[0]*NoClusters

#Make a list of all angle combinations
ANGLES= [(x, y) for x in XANGLES for y in YANGLES]

####---CHAPTER2-------------------------

#Deside which rows to break according to the Number
#of clusters
#How many items do we split the ASF into
rowdivide=int(math.floor(len(ASFangles)/NoClusters))
#What is remaining
rowremain=len(ASFangles)%NoClusters
#print rowdivide
#print rowremain
rowsplit=[]
ii=0
#These are positions within ASF array where we split
for ii in range(NoClusters-1):
    rowsplit.append(rowdivide*(ii+1)+1) #a =y, b=2y...
rowsplit.append(rowdivide*(ii+2)+rowremain) #c=2y+x
#Add a 0 at the start of the list to indicate the top row is 0
rowsplit = [0] + rowsplit
#Bypass funciton if the number of clusters is 1
if NoClusters==1:
    rowsplit=[]
    rowsplit.append(rowdivide) #Note rowdivide=Number of rows
    rowsplit = [0] + rowsplit

#print rowsplit

####---CHAPTER3-------------------------

#Loop through all combinations of the facade
keepLooping=True
combcount=0
while keepLooping:
    #If we have reached the maximum number of combinations then break the main loop
    if rowVal==[NoAngles-1]*NoClusters: #eg: if [48,48,48]==[48,48,48]
        keepLooping=False
    #re-initialise jj  jcount and icount 
    jj=0
    jcount=0
    icount=0
    
    if combcount==combination:
    
        #Script to make the ASFAngle matrix
        #Loop through the number of divisions in the facade
        rscount=0 
        #print 'hello'
        #loop through ASFangles matrix to substitute values
        for icount,ii in enumerate(ASFangles):
            for jcount,jj in enumerate(ii):
                
                #if the row is at the point that it should go to the next rowsplit combiniation
                #eg, rowsplit =[0,4,9]
                #+1 is required because icount and rscount start at 0
                if icount+1==rowsplit[rscount+1]: #eg if 4==4
                    #if it is not the last element because otherwise rscount is out of bounds
                    if rowsplit[-2]!=rowsplit[rscount]:
                        #move to the next rowsplit value
                        rscount+=1
                        
                #Replace ASFAngle unit with angle
                #rowVal: is the ANGLE element identifier between 1,49
                #eg: rowVal=[5,29] the first element is the angle identifier for the top cluster, 
                    #the second element is the angle identifier for the second cluster
                #rscount: is rowVal element identifier        
                ASFangles[icount][jcount]=ANGLES[rowVal[rscount]]
            
            
            
            

    ####---CHAPTER4-------------------------

    #Find the next itteration or rowVal, the Agnel element identifier
    #Process: very similar to a counter where the base=NoAngles, eg base49
    for jcount,jj in enumerate(rowVal):
        #if the number of the position has it its maximum, set to zero
        #and itterate the next column
        if jj==NoAngles-1:
            rowVal[jcount]=0
        #if the number is not the maximum, then increase once more and break the loop
        else:
            rowVal[jcount]+=1
            break
    combcount+=1
    
#outputListASFangles=json.dumps(ListASFangles)


#This has been commented out as it is not used in Combination Selector
#if combination<len(ListASFangles):
#    outputASFangles=json.dumps(ListASFangles[int(combination)])
#else:
#    outputASFangles=json.dumps(ListASFangles[0])
    
#print ListASFangles

maxcomb=NoAngles**NoClusters

print 'max number of combinations is', maxcomb
if combination>combcount:
    print 'Warning! Requested Combination is not available'

outputASFangles=json.dumps(ASFangles)

#print (outputASFangles)
# ---------- end combination_maker_v2 ----------
render_diamond_array = PythonScript(
    outputASFangles=combination_maker_v2.outputASFangles,
    outputASFarray=generate_diamond_array.outputASFarray,
    panelSize=generate_diamond_array.panelSize,
    panelOffset=generate_diamond_array.panelOffset,
    panelThick=generate_diamond_array.panelThick,
    diamond_flag=generate_diamond_array.diamond_flag)  # -> out, temprender
# ---------- render_diamond_array: Python ----------
#13.10.2015
#Prageeth Jayathissa
#Python script to render the ASF based on room given array and angles

#Status: Completed with issues

#Issues: When rotating panels, the rotation around the Y axis doesn't rotate
#around the global Y axis, but the new Y axis based off the previous X axis roation
#------------------------------------------------

import json
import rhinoscriptsyntax as rs
import copy
import math

#diamond_flag = False
#Load JSON file
ASFarray=json.loads(outputASFarray)
ASFangles=json.loads(outputASFangles)


#define Plane where ASF will be built
plane=rs.WorldZXPlane()

#temprender is used for temproarily rendering the ASF
temprender=[]
#duplicate the ASFarray wihout linking it togher
#Note: ASFrectangles=ASFarray doesn't work as they will both be edited
ASFrectangles=copy.deepcopy(ASFarray)


print ASFangles


if diamond_flag:
    
    #initialise row counter
    icount=0
    for ii in ASFarray:
        #initialise column counter
        jcount=0
        for jj in ii:
            #Draw rectange on the ZX plane
            
            new_panel=rs.AddRectangle(plane, panelSize, panelSize)
            new_panel=rs.MoveObject(new_panel,(-panelSize/2,0,-panelSize/2))
            #rotate it to make the diamond shape
            new_panel=rs.RotateObject(new_panel,[0,0,0],45,axis=(0,1,0))
            #Extrude it and cap the holes
            #new_panel=rs.ExtrudeCurveStraight(new_panel,(0,0,0),(0,-panelThick,0))
            #rs.CapPlanarHoles(new_panel)
            #tilt the panels
            new_panel=rs.RotateObject(new_panel,[0,0,0],-ASFangles[icount][jcount][0],axis=(1,0,0))
            z_new = (0, -math.sin(math.pi/180*(-ASFangles[icount][jcount][0])) , math.cos(math.pi/180*(-ASFangles[icount][jcount][0])))
            print z_new
            new_panel=rs.RotateObject(new_panel,[0,0,0],ASFangles[icount][jcount][1],axis=z_new)
            new_panel=rs.MoveObject(new_panel,(jj[0],-panelOffset,jj[1]))
            
            temprender.append(new_panel)
            #This is the true output which will be used for further analysis
            ASFrectangles[icount][jcount]=new_panel

            jcount+=1
        icount+=1
        
else:
    #initialise row counter
    icount=0
    for ii in ASFarray:
        #initialise column counter
        jcount=0
        for jj in ii:
            #Draw rectange on the ZX plane
            
            new_panel=rs.AddRectangle(plane, panelSize, panelSize)
            new_panel=rs.MoveObject(new_panel,(-panelSize/2,0,-panelSize/2))
            #rotate it to make the diamond shape
            #new_panel=rs.RotateObject(new_panel,[0,0,0],45,axis=(0,1,0))
            #Extrude it and cap the holes
            #new_panel=rs.ExtrudeCurveStraight(new_panel,(0,0,0),(0,-panelThick,0))
            #rs.CapPlanarHoles(new_panel)
            #tilt the panels
            new_panel=rs.RotateObject(new_panel,[0,0,0],-ASFangles[icount][jcount][0],axis=(1,0,0))
            z_new = (0, -math.sin(math.pi/180*(-ASFangles[icount][jcount][0])) , math.cos(math.pi/180*(-ASFangles[icount][jcount][0])))
            print z_new
            new_panel=rs.RotateObject(new_panel,[0,0,0],ASFangles[icount][jcount][1],axis=z_new)
            new_panel=rs.MoveObject(new_panel,(jj[0],-panelOffset,jj[1]))
            
            temprender.append(new_panel)
            #This is the true output which will be used for further analysis
            ASFrectangles[icount][jcount]=new_panel
    
            jcount+=1
        icount+=1
# ---------- end render_diamond_array ----------

# ----
# PARAMETERS
max_combinations = Panel(combination_maker_v2.out)

# ----
# input mesh
mesh = Mesh(<mesh referenced from the Rhino model>)
chosen_mesh = Mesh(mesh)

# ----
# Render the Building
render_room = PythonScript(room_depth=room_depth, room_width=room_width, room_height=room_height, glazing_percentage=glazing)  # -> WallF, AdiabaticSurfaces, WallG
# ---------- render_room: Python ----------
#12.10.2015
#Prageeth Jayathissa
#Script for rendering the room based on input dimensions

import rhinoscriptsyntax as rs

#Room Dimensions (mm)
#room_depth=5000
#room_width=3700
#room_height=3000 #Check value (approximation)
#floorThick=200
#ceilThick=200
#intWallThick=110 #Real value is 110mm
#glazeThick=110 #Check this value again

intWallHeight=room_height

gp=glazing_percentage


#Define Global Plane
planexy=rs.WorldXYPlane()
planezx=rs.WorldZXPlane()
planeyz=rs.WorldYZPlane()

print planexy
#Create rectangle of floor and extrude 200mm
#base=rs.AddRectangle(plane, room_width+intWallThick*2, room_depth)

planeR=rs.PlaneFromNormal((room_width,0,0),(1,0,0))
planeB=rs.PlaneFromNormal((0,room_depth,0),(0,1,0))
planeC=rs.PlaneFromNormal((0,0,room_height),(0,0,1))
#myBox=rs.ExtrudeCurveStraight(base,(0,0,0),(0,0,room_height))

WallF=rs.AddPlaneSurface(planezx,room_height,room_width)
WallL=rs.AddPlaneSurface(planeyz,room_depth,room_height)
WallR=rs.AddPlaneSurface(planeR,room_depth,room_height)
WallB=rs.AddPlaneSurface(planeB,room_height,room_width)

Floor=rs.AddPlaneSurface(planexy,room_width,room_depth)
Ceiling=rs.AddPlaneSurface(planeC,room_width,room_depth)

WallG=rs.AddPlaneSurface(planezx,room_height*gp,room_width*gp)
WallG=rs.MoveObject(WallG,((1-gp)*room_width/2,0,(1-gp)*room_height/2))

AdiabaticSurfaces=[Floor,Ceiling,WallL,WallR,WallB]
# ---------- end render_room ----------

# ----
# help lines for mesh reconstruction
line_y = Geometry(<curve referenced from the Rhino model>)
line_x = Geometry(<curve referenced from the Rhino model>)

surface = Surface(render_room.WallF)
surface_2 = Surface(render_room.AdiabaticSurfaces)
surface_3 = Surface(render_room.WallG)
max_combination = Slider(4, range=0..10)
number_slider_7 = Slider(0.5, range=0..1)
render_panel_layout = Brep(render_diamond_array.temprender)
medges = MeshEdges(Mesh=chosen_mesh)  # -> NakedEdges, InteriorEdges, NonManifoldEdges
geo = Geometry(medges.NakedEdges)
# SURFACE CONVERSION
number_slider_8 = Slider(0, range=0..100)

# ----
# Convert planar surfaces
#  to DIVA inputs
shade = Shade(
    Brep=render_panel_layout,
    SR=number_slider_7,
    VR=number_slider_7,
    GlazedFraction=0,
    Brep_2=render_panel_layout,
    SR_2=number_slider_7,
    VR_2=number_slider_7,
    GlazedFraction_2=0)  # -> Shade, Shade_2
facade = ConstructionAssembly(Brep=surface, Brep_2=surface, GetAssembly=12, GetCustom=False, GetLayerNum=1, GetMaterials=[-1, -1, -1, -1, -1])  # -> Zone, Zone_2
all_adiabatic = ConstructionAssembly(Brep=surface_2, Brep_2=surface_2, GetAssembly=6, GetCustom=False, GetLayerNum=1, GetMaterials=[-1, -1, -1, -1, -1])  # -> Zone, Zone_2
# A Zone is a Box
# A window is a planar surface that overlaps the zone
# Shade can be a box or plane
window_unit = WindowUnit(
    Brep=surface_3,
    Brep_2=surface_3,
    GetAssembly=7,
    GetCustom=False,
    GetGas=[-1, -1],
    GetGlass=[-1, -1, -1],
    GetLayerNum=1,
    GetSimpleState=0)  # -> Window, Window_2

panel = Panel(render_panel_layout)

# ----
# projected surface curves
number_slider_9 = Slider(50, range=0..100)
len = Length(Curve=line_y)
multiplication = Multiplication(A=len, B=0.999)
addition = Addition(A=number_slider_9, B=1)
division = Division(A=multiplication, B=number_slider_9)
series = Series(Start=0, Step=division, Count=addition)
Y = UnitY(Factor=series)
move = Move(Geometry=line_x, Motion=Y)  # -> Geometry, Transform
crv = Curve(move.Geometry)
c_project = CSharpScript(curves=crv, baseMesh=chosen_mesh)  # -> out, A; inputs curves: Curve, baseMesh: Mesh
# ---------- c_project: C# ----------
    A = Curve.ProjectToMesh(curves, baseMesh, new Vector3d(0, 0, -1), 0.001);
# ---------- end c_project ----------
reb = RebuildCurve(Curve=c_project.A, Count=Slider(60, range=0..100), Tangents=False)
cdiv = Derivatives(Curve=reb, Parameter="15")  # -> Point, FirstDerivative
X = UnitX(Factor=1)
dprod = DotProduct(VectorA=cdiv.FirstDerivative, VectorB=X, Unitize=False)
smaller = SmallerThan(FirstNumber=dprod, SecondNumber=0)  # -> SmallerThan, OrEqualTo
dispatch = Dispatch(List=reb, DispatchPattern=smaller.SmallerThan)  # -> ListA, ListB
flip = FlipCurve(Curve=dispatch.ListB)  # -> Curve, Flag
crv_2 = Curve([dispatch.ListA, flip.Curve])

boolean_toggle = BooleanToggle(False)
boolean_toggle_2 = BooleanToggle(False)
cooling_setpoint = Slider(26, range=10..30)
heating_setpoint = Slider(22, range=10..30)
heating_cop = Slider(5, range=0..10)
_300 = Integer(300)

# ----
# STRIP ORIENTATION
number_slider_10 = Slider(30, range=-180..90)
angle = Number(number_slider_10)
cos = Cosine(Value=degrees(angle))
sin = Sine(Value=degrees(angle))
vec = VectorXYZ(XComponent=cos, YComponent=sin, ZComponent=0)  # -> Vector, Length

# ----
# reconstructed surface
number_slider_11 = Slider(24, range=0..100)
len_2 = Length(Curve=crv_2)
division_2 = Division(A=len_2, B=number_slider_11)
divlength = DivideLength(Curve=crv_2, Length=division_2)  # -> simplify(Points), Tangents, Parameters
geo_2 = Geometry(flatten(divlength.Points))
lng = ListLength(List=flatten(crv_2))
srfgrid = SurfaceFromPoints(Points=geo_2, UCount=lng, Interpolate=False)
edges = BrepEdges(Brep=srfgrid)  # -> Naked, Interior, NonManifold

edges_2 = BrepEdges(Brep=srfgrid)  # -> Naked, Interior, NonManifold
geo_3 = Geometry(edges_2.Naked)
edges_3 = BrepEdges(Brep=srfgrid)  # -> Naked, Interior, NonManifold
join = JoinCurves(Curves=edges_3.Naked, Preserve=False)
project = Project(Geometry=join, Plane=PlaneXY(0, 0, 0))  # -> Geometry, Transform
offset = Offset(Curve=project.Geometry, Distance=Slider(-0.5, range=-1..0), Plane=PlaneXY(0, 0, 0), Corners=1)
toggle = BooleanToggle(True)
c_extend = CSharpScript(inputSurface=srfgrid, extension=Slider(1.2, range=0..10))  # -> out, extendedSurface; inputs inputSurface: Surface, extension: Double
# ---------- c_extend: C# ----------
    Surface extSurface = inputSurface.Extend(IsoStatus.East, extension, true);
    extSurface = extSurface.Extend(IsoStatus.West, extension, true);
    extSurface = extSurface.Extend(IsoStatus.North, extension, true);
    extSurface = extSurface.Extend(IsoStatus.South, extension, true);

    extendedSurface = extSurface;
# ---------- end c_extend ----------

# ----
# offset shell
offset_2 = Slider(0.11, range=0..1)
offset_3 = Offset(Surface=srfgrid, Distance=offset_2, Retrim=True)
crv_3 = Curve(offset_3)
reb_2 = RebuildCurve(Curve=crv_3, Count=Slider(256, range=0..1000), Tangents=False)
cp = ControlPoints(Curve=reb_2)  # -> Points, Weights, Knots

# ----
# create parallel strips
number_slider_12 = Slider(172.2, range=160..175)
panel_segment_length = Slider(0.2, range=0..1)
panel_width = Slider(0.6, range=0..1)
max_nr_of_strips = Slider(50, range=0..80)
borderwidth = Slider(0.5, range=0..1)
diagonal_direction = BooleanToggle(False)
gap_width = Slider(0.1, range=0..1)
pt = ConstructPoint(XCoordinate=number_slider_12, YCoordinate=Slider(22.5, range=0..100), ZCoordinate=Slider(16, range=0..100))
c_create_strips = CSharpScript(
    startPoint=pt,
    baseSurface=offset_3,
    surfEdgePoints=cp.Points,
    borderWidth=borderwidth,
    longDirection=vec.Vector,
    panelWidth=panel_width,
    segmentLength=panel_segment_length,
    maxSegments=Slider(100, range=0..500),
    gapWidth=gap_width,
    walkWidth=Slider(0.1, range=0..1),
    nrPanels=max_nr_of_strips,
    diagonalDirection=diagonal_direction)  # -> out, originalPanel, neighbourPanels, meshOut, radiusesOut, radiusCirclesOut, triangleMeshOut, A; inputs startPoint: Point3d, baseSurface: Surface, surfEdgePoints: list of Point3d, borderWidth: Double, longDirection: Vector3d, panelWidth: Double, segmentLength: Double, maxSegments: Int32, gapWidth: Double, walkWidth: Double, nrPanels: Int32, diagonalDirection: Boolean
# ---------- c_create_strips: C# ----------
    bendedPanel.baseSurface = baseSurface;
    bendedPanel.panelWidth = panelWidth;
    bendedPanel.segmentLength = segmentLength;
    bendedPanel.borderWidth = borderWidth;
    bendedPanel.maxSegments = maxSegments;
    bendedPanel.surfEdgePoints = surfEdgePoints;
    bendedPanel.secondPointBaseDistance();
    bendedPanel.secondPointRadius();
    bendedPanel.overlapTolerance = 0.01;
    bendedPanel.intersectPrecision = 0.001;

    DataTree<Curve> panelCurves = new DataTree<Curve>();
    DataTree<double> panelDeviation = new DataTree<double>();
    DataTree<double> pointRadius = new DataTree<double>();
    DataTree<Curve> radiusCircleTree = new DataTree<Curve>();
    DataTree<int> panelIndex = new DataTree<int>();
    List<Mesh> triangleMeshes = new List<Mesh>();


    List<Point3d> startPointPoints = new List<Point3d>();
    List<bendedPanel> bestPanels = new List<bendedPanel>();

    //
    //  panel creation
    //

    // start panel
    bendedPanel basePanel = new bendedPanel(startPoint, longDirection);
    basePanel.createDualGeometry(diagonalDirection);
    triangleMeshes.Add(basePanel.createTriangleMesh(diagonalDirection));
    bestPanels.Add(basePanel);
    bendedPanel previousPanel = basePanel;

    // create panels in positive direction
    //
    int panelCount = 1;
    while(previousPanel != null && (panelCount < nrPanels / 2)){
      // create new start points based on previous panel
      double panelDistance = gapWidth;
      if ( (panelCount - 1) % 2 == 0){
        panelDistance = walkWidth;
      }

      List < Point3d > startPoints = previousPanel.newStartPoints(panelDistance, true);
      if((startPoints != null) && (startPoints.Count() > 1)){
        startPointPoints.AddRange(startPoints);
        List<Vector3d> startDirections = previousPanel.getEdgeDirections(true);
        bendedPanel generatedPanel = createNewPanel(startPoints, startDirections, previousPanel, diagonalDirection);

        if(generatedPanel != null){
          bestPanels.Add(generatedPanel);
          triangleMeshes.Add(generatedPanel.createTriangleMesh(diagonalDirection));
        }
        previousPanel = generatedPanel; // this can cause issues in the next loop, why?
      } else {
        previousPanel = null;
        break;
      }
      panelCount++;
    }


    // create first panel in other direction; get neighbour points from original panel, but at opposite side

    List<Point3d> startPointsOpposite = basePanel.newStartPoints(gapWidth, false);
    startPointPoints.AddRange(startPointsOpposite);
    List<Vector3d> startDirectionsOpposite = basePanel.getEdgeDirections(false);
    // generate new panel
    bendedPanel oppositeBasePanel = createNewPanel(startPointsOpposite, startDirectionsOpposite, basePanel, diagonalDirection);
    if(oppositeBasePanel != null){
      bestPanels.Add(oppositeBasePanel);
      triangleMeshes.Add(oppositeBasePanel.createTriangleMesh(diagonalDirection));
    }
    panelCount++;
    previousPanel = oppositeBasePanel;

    // negative direction
    panelCount = 1;
    while(previousPanel != null && panelCount < nrPanels / 2){
      // create new start points based on previous panel
      double panelDistance = gapWidth;
      if ((panelCount - 1) % 2 == 0){
        panelDistance = walkWidth;
      }

      List<Point3d> startPoints = previousPanel.newStartPoints(panelDistance, true);
      if((startPoints != null) && (startPoints.Count() > 1)){
        startPointPoints.AddRange(startPoints);
        List<Vector3d> startDirections = previousPanel.getEdgeDirections(true);

        // generate new panel
        bendedPanel generatedPanel = createNewPanel(startPoints, startDirections, previousPanel, diagonalDirection);
        if(generatedPanel != null){
          bestPanels.Add(generatedPanel);
          triangleMeshes.Add(generatedPanel.createTriangleMesh(diagonalDirection));
        }
        previousPanel = generatedPanel;
      }else{
        previousPanel = null;
        break;
      }
      panelCount++;
    }


    //
    //  output data
    //

    originalPanel = basePanel.lineCollection;

    saveData(bestPanels, ref panelCurves);
    neighbourPanels = panelCurves;

    // meshes
    List<Rhino.Geometry.Mesh> meshCollector = new List<Rhino.Geometry.Mesh>();
    foreach(bendedPanel thisPanel in bestPanels){
      meshCollector.Add(thisPanel.createMesh());
    }
    meshOut = meshCollector;

    // radius list
    List < double[] > radiusCollector = new List<double[]>();
    foreach(bendedPanel thisPanel in bestPanels){
      radiusCollector.Add(thisPanel.calculateRadiuses());
    }
    for(int i = 0; i < radiusCollector.Count(); i++){
      double[] thisRadiusList = radiusCollector[i];
      for(int x = 0; x < thisRadiusList.Length; x++){
        GH_Path thisPath = new GH_Path(i, x);
        pointRadius.Add(thisRadiusList[x], thisPath);
      }
    }

    // radius curves
    List<Curve[]> radiusCurveCollection = new List<Curve[]>();
    foreach(bendedPanel thisPanel in bestPanels){
      radiusCurveCollection.Add(thisPanel.getRadiusCircles());
    }
    for(int i = 0; i < radiusCurveCollection.Count(); i++){
      Curve[] thisCircleList = radiusCurveCollection[i];
      for(int x = 0; x < thisCircleList.Length; x++){
        GH_Path thisPath = new GH_Path(i, x);
        radiusCircleTree.Add(thisCircleList[x], thisPath);
      }
    }

    A = startPointPoints;
    triangleMeshOut = triangleMeshes;
    radiusCirclesOut = radiusCircleTree;
    radiusesOut = pointRadius;
# ---------- c_create_strips: C# additional code ----------
  bendedPanel createNewPanel(List < Point3d > startPoints, List<Vector3d> startDirections, bendedPanel previousPanel, bool triDir){
    if(startPoints == null || startDirections == null || previousPanel == null){
      return null;
    }

    // prepare for storing information about which panel is the most parallel
    double divergenceSuitability = 0; // processed divergence value, not the same as return value from divergence method
    int bestPanelIndex = 0;

    List<bendedPanel> collectedPanels = new List<bendedPanel>();
    bool panelFound = false;
    if(startPoints.Count > 1){

      // for each point, create a panel
      for(int i = 0; i < startPoints.Count() - 1; i++){ //
        bendedPanel tempPanel = new bendedPanel(startPoints[i], startDirections[i]);
        collectedPanels.Add(tempPanel);
        tempPanel.createDualGeometry(triDir);
        if(tempPanel.lineCollection != null){
          double thisPanelSuitability = getPanelSuitability((tempPanel.lineCollection.Count() / 2 - 1) * bendedPanel.segmentLength, tempPanel.divergence(previousPanel));
          if((thisPanelSuitability > divergenceSuitability) && (tempPanel.lineCollection.Count() > 4)){
            divergenceSuitability = thisPanelSuitability;
            bestPanelIndex = i;
            panelFound = true;
          }
        }
      }
    }

    // return panel
    return(panelFound ? collectedPanels[bestPanelIndex] : null);
  }

  double getPanelSuitability(double panelLength, double divergence){
    return (panelLength / Math.Sqrt(divergence + 0.1));
  }

  void saveData(List < bendedPanel > resultingPanels, ref DataTree<Curve> panelCurves){
    for(int i = 0; i < resultingPanels.Count(); i++){
      bendedPanel thisPanel = resultingPanels[i];
      GH_Path panelPath = new GH_Path(i);
      foreach(Curve someCurve in thisPanel.lineCollection){
        panelCurves.Add(someCurve, panelPath);
      }
    }
  }

  public class bendedPanel
  {
    public static Surface baseSurface;
    public static double panelWidth;
    public static double segmentLength;
    public static double borderWidth;
    public static int maxSegments;
    public static List<Point3d> surfEdgePoints = new List<Point3d>();
    public static double overlapTolerance;
    public static double intersectPrecision;

    public Point3d startPoint;
    Point3d basePoint1; // left
    Point3d basePoint2; // right
    Vector3d longDirection;
    Vector3d shortDirection;
    double uPos; // our start point position in surface coordinates
    double vPos;
    static public double pointDistance;
    static public double pointRadius;

    public List<Point3d> sidePoints = new List<Point3d>();
    public List<Point3d> oppositePoints = new List<Point3d>();
    public List<Curve> lineCollection = new List<Curve>();
    List<Curve> diagonalLineCollection = new List<Curve>();
    List<Curve> leftLineCollection = new List<Curve>();
    List<Curve> rightLineCollection = new List<Curve>();

    public bendedPanel(Point3d startPoint, Vector3d startDirection){ // constructor
      this.startPoint = startPoint;
      this.longDirection = startDirection;

      // find second point of start line
      baseSurface.ClosestPoint(this.startPoint, out uPos, out vPos);
      basePoint1 = baseSurface.PointAt(uPos, vPos);
      basePoint2 = new Point3d();
      shortDirection = new Vector3d(-this.longDirection.Y, this.longDirection.X, 0);
      Circle baseCircle = new Circle(new Plane(this.basePoint1, this.longDirection), panelWidth);
      Rhino.Geometry.Intersect.CurveIntersections baseCircleIntersections = Rhino.Geometry.Intersect.Intersection.CurveSurface(baseCircle.ToNurbsCurve(), baseSurface, intersectPrecision, overlapTolerance);
      foreach( Rhino.Geometry.Intersect.IntersectionEvent iEvent in baseCircleIntersections){
        // get dot product of shortDirection and direction to intersection; if positive, assign point to basePoint2;
        Vector3d toPointA = Point3d.Subtract(iEvent.PointA, basePoint1);
        if(Vector3d.Multiply(shortDirection, toPointA) > 0){
          basePoint2 = iEvent.PointA;
        }
      }

      // create base line, add to collection
      lineCollection.Add(new Line(this.basePoint1, this.basePoint2).ToNurbsCurve());
      sidePoints.Add(basePoint1);
      oppositePoints.Add(basePoint2);
    }

    public static void secondPointBaseDistance(){
      double a = panelWidth;
      double b = segmentLength;
      double c = Math.Pow(a * a + b * b, 0.5);
      double sideProjectionDistance = (c * c - a * a + b * b) / (2 * c);
      pointDistance = c - sideProjectionDistance;
    }

    public static void secondPointRadius(){
      double a = panelWidth;
      double b = segmentLength;
      double c = Math.Pow(a * a + b * b, 0.5);
      double sideProjectionDistance = (c * c - a * a + b * b) / (2 * c);
      pointRadius = Math.Pow(b * b - sideProjectionDistance * sideProjectionDistance, 0.5);
    }

    private Point3d getRightPointOnSurface(Point3d currentPosition, Rhino.Geometry.Intersect.CurveIntersections intersections, Vector3d desiredDirection){
      //bool pointFound = false;
      Point3d foundPoint = new Point3d();
      double bestDotProduct = 0;
      foreach(Rhino.Geometry.Intersect.IntersectionEvent iEvent in intersections){ // get dot product of shortDirection and direction to intersection; if positive, assign point to newPoint1;
        Vector3d intersectionDirection = Point3d.Subtract(iEvent.PointA, currentPosition);
        //intersectionDirection.Z = 0;
        double thisDotProduct = Vector3d.Multiply(desiredDirection, intersectionDirection);
        if(thisDotProduct > bestDotProduct){
          bestDotProduct = thisDotProduct;
          foundPoint = iEvent.PointA;
          //pointFound = true;
        }
      }

      /*
      if(!pointFound){
        Rhino.RhinoApp.WriteLine("no intersection point found");
        Rhino.RhinoApp.WriteLine("currentPosition is " + currentPosition.X.ToString() + "," + currentPosition.Y.ToString() + "," + currentPosition.Z.ToString());
        Rhino.RhinoApp.WriteLine("desiredDirection is " + desiredDirection.X.ToString() + "," + desiredDirection.Y.ToString() + "," + desiredDirection.Z.ToString());
        foreach(Rhino.Geometry.Intersect.IntersectionEvent iEvent in intersections){
          Rhino.RhinoApp.WriteLine("intersection point: " + iEvent.PointA.X.ToString() + "," + iEvent.PointA.Y.ToString() + "," + iEvent.PointA.Z.ToString());
        }
      }
      */

      return foundPoint;
    }

    public void createDualGeometry(bool triDir){
      createGeometry(true, triDir);
      createGeometry(false, triDir);
    }

    public void createGeometry(bool directionFront, bool triDir){
      int iterator = 0;
      Point3d pointA = basePoint1;
      Point3d pointB = basePoint2;
      Vector3d creationDirection = longDirection;
      if(!directionFront){
        creationDirection = -longDirection;
        //pointA = basePoint2;
        //pointB = basePoint1;
      }

      while(safeBorderDistance(pointA, pointB) && (iterator < maxSegments) && !((pointA.X == 0 && pointA.Y == 0) || (pointB.X == 0 && pointB.Y == 0))){
        if((triDir && directionFront) || (!triDir && !directionFront)){
          iterator++;

          // create intersection points for first point
          Vector3d startLineDirA = Point3d.Subtract(pointB, pointA);
          Circle segmentCircleA = new Circle(new Plane(pointA, startLineDirA), segmentLength);
          Rhino.Geometry.Intersect.CurveIntersections CircleIntersectionsA = Rhino.Geometry.Intersect.Intersection.CurveSurface(segmentCircleA.ToNurbsCurve(), baseSurface, intersectPrecision, overlapTolerance);

          // calculate local unfolding direction
          double uA;
          double vA;
          baseSurface.ClosestPoint(pointA, out uA, out vA);
          Vector3d surfaceNormalA = baseSurface.NormalAt(uA, vA);
          //Vector3d localCreationDirection = new Vector3d(startLineDirA);
          surfaceNormalA.Rotate(Math.PI / 2, startLineDirA);
          if(!directionFront){
            surfaceNormalA = -surfaceNormalA;
          }

          // create new point on this side of panel
          Point3d newPoint1 = getRightPointOnSurface(pointA, CircleIntersectionsA, surfaceNormalA);
          if (newPoint1 == null){
            break;
          }

          // create new point on other side of panel, using a circle around an exact point on the newly created diagonal
          Vector3d startLineDirB = Point3d.Subtract(newPoint1, pointB);
          startLineDirB.Unitize();
          Point3d pointBB = new Point3d(newPoint1.X - pointDistance * startLineDirB.X, newPoint1.Y - pointDistance * startLineDirB.Y, newPoint1.Z - pointDistance * startLineDirB.Z);
          Circle segmentCircleB = new Circle(new Plane(pointBB, startLineDirB), pointRadius);
          Rhino.Geometry.Intersect.CurveIntersections CircleIntersectionsB = Rhino.Geometry.Intersect.Intersection.CurveSurface(segmentCircleB.ToNurbsCurve(), baseSurface, intersectPrecision, overlapTolerance);
          Point3d newPoint2 = getRightPointOnSurface(pointB, CircleIntersectionsB, surfaceNormalA);
          if (newPoint2 == null){
            break;
          }

          // add points and lines to collections
          if(directionFront){
            // add to end
            sidePoints.Add(newPoint1);
            oppositePoints.Add(newPoint2);
            leftLineCollection.Add(new Line(pointA, newPoint1).ToNurbsCurve());
            rightLineCollection.Add(new Line(pointB, newPoint2).ToNurbsCurve());
            diagonalLineCollection.Add(new Line(pointB, newPoint1).ToNurbsCurve());
            lineCollection.Add(new Line(newPoint1, newPoint2).ToNurbsCurve());
          }else{
            // add to beginning
            sidePoints.Insert(0, newPoint1);
            oppositePoints.Insert(0, newPoint2);
            leftLineCollection.Insert(0, new Line(pointA, newPoint1).ToNurbsCurve());
            rightLineCollection.Insert(0, new Line(pointB, newPoint2).ToNurbsCurve());
            diagonalLineCollection.Insert(0, new Line(pointB, newPoint1).ToNurbsCurve());
            lineCollection.Insert(0, new Line(newPoint1, newPoint2).ToNurbsCurve());
          }

          // set new points as start points
          pointA = newPoint1;
          pointB = newPoint2;


        }else{ // work in flipped way
          iterator++;

          // create intersection points for first point
          Vector3d startLineDirA = Point3d.Subtract(pointB, pointA);
          Circle segmentCircleA = new Circle(new Plane(pointB, startLineDirA), segmentLength);
          Rhino.Geometry.Intersect.CurveIntersections CircleIntersectionsA = Rhino.Geometry.Intersect.Intersection.CurveSurface(segmentCircleA.ToNurbsCurve(), baseSurface, intersectPrecision, overlapTolerance);

          // calculate local unfolding direction
          double uA;
          double vA;
          baseSurface.ClosestPoint(pointB, out uA, out vA);
          Vector3d surfaceNormalA = baseSurface.NormalAt(uA, vA);
          //Vector3d localCreationDirection = new Vector3d(startLineDirA);
          surfaceNormalA.Rotate(Math.PI / 2, startLineDirA);
          if(!directionFront){
            surfaceNormalA = -surfaceNormalA;
          }

          // create new point on this side of panel
          Point3d newPoint1 = getRightPointOnSurface(pointB, CircleIntersectionsA, surfaceNormalA);
          if (newPoint1 == null){
            break;
          }

          // create new point on other side of panel, using a circle around an exact point on the newly created diagonal
          Vector3d startLineDirB = Point3d.Subtract(newPoint1, pointA);
          startLineDirB.Unitize();
          Point3d pointBB = new Point3d(newPoint1.X - pointDistance * startLineDirB.X, newPoint1.Y - pointDistance * startLineDirB.Y, newPoint1.Z - pointDistance * startLineDirB.Z);
          Circle segmentCircleB = new Circle(new Plane(pointBB, startLineDirB), pointRadius);
          Rhino.Geometry.Intersect.CurveIntersections CircleIntersectionsB = Rhino.Geometry.Intersect.Intersection.CurveSurface(segmentCircleB.ToNurbsCurve(), baseSurface, intersectPrecision, overlapTolerance);
          Point3d newPoint2 = getRightPointOnSurface(pointA, CircleIntersectionsB, surfaceNormalA);
          if (newPoint2 == null){
            break;
          }

          // add points and lines to collections
          if(directionFront){
            // add to end
            sidePoints.Add(newPoint2);
            oppositePoints.Add(newPoint1);
            leftLineCollection.Add(new Line(pointA, newPoint2).ToNurbsCurve());
            rightLineCollection.Add(new Line(pointB, newPoint1).ToNurbsCurve());
            diagonalLineCollection.Add(new Line(pointA, newPoint1).ToNurbsCurve());
            lineCollection.Add(new Line(newPoint1, newPoint2).ToNurbsCurve());
          }else{
            // add to beginning
            sidePoints.Insert(0, newPoint2);
            oppositePoints.Insert(0, newPoint1);
            leftLineCollection.Insert(0, new Line(pointA, newPoint2).ToNurbsCurve());
            rightLineCollection.Insert(0, new Line(pointB, newPoint1).ToNurbsCurve());
            diagonalLineCollection.Insert(0, new Line(pointA, newPoint1).ToNurbsCurve());
            lineCollection.Insert(0, new Line(newPoint1, newPoint2).ToNurbsCurve());
          }

          // set new points as start points
          pointA = newPoint2;
          pointB = newPoint1;

        }
      }
    }

    private bool safeBorderDistance(Point3d point1, Point3d point2){
      double smallestBorderDistance = Double.MaxValue;
      foreach(Point3d borderPoint in surfEdgePoints){
        smallestBorderDistance = Math.Min(smallestBorderDistance, point1.DistanceTo(borderPoint));
        smallestBorderDistance = Math.Min(smallestBorderDistance, point2.DistanceTo(borderPoint));
      }
      return(smallestBorderDistance > borderWidth);
    }

    public List<Point3d> newStartPoints(double edgeDistance, bool right){
      if(oppositePoints == null || oppositePoints.Count == 0 || sidePoints == null || sidePoints.Count == 0 || baseSurface == null){
        return null;
      }
      List<Point3d> newPoints = new List<Point3d>();
      List<Point3d> pointsThisSide;
      List<Point3d> pointsOtherSide;
      if(right){
        pointsThisSide = oppositePoints;
        pointsOtherSide = sidePoints;
      } else {
        pointsThisSide = sidePoints;
        pointsOtherSide = oppositePoints;
      }
      // for all points in pointThisSide (except last)
      for (int i = 0; i < pointsThisSide.Count() - 1; i++){

        // get directions
        Vector3d leftRight = Point3d.Subtract(pointsThisSide[i], pointsOtherSide[i]);
        Vector3d edgeDirection = Point3d.Subtract(pointsThisSide[i + 1], pointsThisSide[i]);

        // draw circle with radius of edgeDistance
        Plane pointPlane = new Plane(pointsThisSide[i], edgeDirection);
        Circle offsetCircle = new Circle(pointPlane, edgeDistance);

        // find intersections with surface
        Rhino.Geometry.Intersect.CurveIntersections circleIntersections = Rhino.Geometry.Intersect.Intersection.CurveSurface(offsetCircle.ToNurbsCurve(), baseSurface, intersectPrecision, overlapTolerance);

        // compare vectors to intersection with left-right vector; if dot product > 0, add to newPoints list
        foreach( Rhino.Geometry.Intersect.IntersectionEvent iEvent in circleIntersections){
          Point3d intPoint = iEvent.PointA;
          Vector3d toIntersection = Point3d.Subtract(intPoint, pointsThisSide[i]);
          if(Vector3d.Multiply(leftRight, toIntersection) > 0){
            newPoints.Add(intPoint);
            break;
          }
        }
      }
      return newPoints;
    }


    public double minDistance(bendedPanel neighborPanel){
      // get vertex lists from this panel and neighbour panel
      List<Point3d> pointsThisPanel = (Vector3d.Multiply(shortDirection, Point3d.Subtract(neighborPanel.sidePoints[0], this.sidePoints[0])) > 0) ? oppositePoints : sidePoints;
      List<Point3d> pointsNeighborPanel = (Vector3d.Multiply(shortDirection, Point3d.Subtract(neighborPanel.sidePoints[0], this.sidePoints[0])) > 0) ? neighborPanel.sidePoints : neighborPanel.oppositePoints;

      // get distance at start: find point closest to this startpoint, then get distance from there to closest point on this side
      double minDistance = Double.MaxValue;
      for(int i = 0; i < pointsNeighborPanel.Count(); i++){
        for(int j = 0; j < pointsThisPanel.Count(); j++){
          minDistance = Math.Min(minDistance, pointsThisPanel[j].DistanceTo(pointsNeighborPanel[i]));
        }
      }

      return (minDistance);
    }

    //
    // divergence: gets a value indicating how parallel this strip is to its neighbour, by comparing the distances between them at both ends
    // perfectly parallel strips would return 0, badly diverging strips return values closer to 1
    //

    public double divergence(bendedPanel neighborPanel){
      // get vertex lists from this panel and neighbour panel; try to get nearest edge of neighbour and furthest edge of this new panel
      // note: this might return the other edges, or in case of the first panel in negative direction, the two closest or the two furthest edges. This should still work though.
      List<Point3d> pointsThisPanel = (Vector3d.Multiply(shortDirection, Point3d.Subtract(neighborPanel.sidePoints[0], this.sidePoints[0])) > 0) ? sidePoints : oppositePoints; // get points that are furthest away from neighbour
      List<Point3d> pointsNeighborPanel = (Vector3d.Multiply(shortDirection, Point3d.Subtract(neighborPanel.sidePoints[0], this.sidePoints[0])) > 0) ? neighborPanel.sidePoints : neighborPanel.oppositePoints;

      // get distance at start: find point closest to this startpoint, then get distance from there to closest point on this side
      double startDistance = Double.MaxValue;
      Vector3d startDistanceVector = new Vector3d();
      int closestIndex = 0;
      for(int i = 0; i < pointsNeighborPanel.Count(); i++){
        if(pointsThisPanel[0].DistanceTo(pointsNeighborPanel[i]) < startDistance){
          startDistance = pointsThisPanel[0].DistanceTo(pointsNeighborPanel[i]);
          closestIndex = i;
        }
      }
      startDistance = Double.MaxValue;
      for(int j = 0; j < pointsThisPanel.Count(); j++){
        if(pointsNeighborPanel[closestIndex].DistanceTo(pointsThisPanel[j]) < startDistance){
          startDistance = pointsNeighborPanel[closestIndex].DistanceTo(pointsThisPanel[j]);
          startDistanceVector = Point3d.Subtract(pointsNeighborPanel[closestIndex], pointsThisPanel[j]);
        }
      }

      // get distance at end: find point closest to this endpoint, then get distance from there to closest point on this side
      double endDistance = Double.MaxValue;
      Vector3d endDistanceVector = new Vector3d();
      int closestIndexEnd = 0;
      for(int i = 0; i < pointsNeighborPanel.Count(); i++){
        if(pointsThisPanel[pointsThisPanel.Count() - 1].DistanceTo(pointsNeighborPanel[i]) < endDistance){
          endDistance = pointsThisPanel[pointsThisPanel.Count() - 1].DistanceTo(pointsNeighborPanel[i]);
          closestIndexEnd = i;
        }
      }
      endDistance = Double.MaxValue;
      for(int j = 0; j < pointsThisPanel.Count(); j++){
        if(pointsNeighborPanel[closestIndexEnd].DistanceTo(pointsThisPanel[j]) < endDistance){
          endDistance = pointsNeighborPanel[closestIndexEnd].DistanceTo(pointsThisPanel[j]);
          endDistanceVector = Point3d.Subtract(pointsNeighborPanel[closestIndexEnd], pointsThisPanel[j]);
        }
      }

      return (1 - Math.Min(endDistance / startDistance, startDistance / endDistance));
    }

    public List<Vector3d> getEdgeDirections(bool right){
      List<Vector3d> edgeDirections = new List<Vector3d>();

      if(right){
        List<Point3d> edgePoints = oppositePoints;
        for (int i = 0; i < edgePoints.Count() - 1; i++){
          edgeDirections.Add(Point3d.Subtract(edgePoints[i + 1], edgePoints[i]));
        }
      }else{
        List<Point3d> edgePoints = sidePoints;
        for (int i = 1; i < edgePoints.Count(); i++){
          edgeDirections.Add(Point3d.Subtract(edgePoints[i - 1], edgePoints[i]));
        }
      }
      return edgeDirections;
    }

    public Rhino.Geometry.Mesh createMesh(){
      // create new mesh object
      Rhino.Geometry.Mesh generatedMesh = new Rhino.Geometry.Mesh();

      // add vertices from sidePoints and oppositePoints
      foreach(Point3d L1p in sidePoints){
        generatedMesh.Vertices.Add(L1p);
      }
      foreach(Point3d L2p in oppositePoints){
        generatedMesh.Vertices.Add(L2p);
      }

      // add faces
      int nrPoints = sidePoints.Count();
      for(int i = 0; i < nrPoints - 1; i++){
        generatedMesh.Faces.AddFace(i, i + 1, i + nrPoints + 1, i + nrPoints);
      }

      // process and return mesh
      generatedMesh.Normals.ComputeNormals();
      //generatedMesh.Normals.Reverse();
      generatedMesh.Compact();
      return generatedMesh;
    }

    public Rhino.Geometry.Mesh createTriangleMesh(bool direction){ // true is original direction, false has flipped diagonals
      // create new mesh object
      Rhino.Geometry.Mesh generatedMesh = new Rhino.Geometry.Mesh();

      // add vertices from sidePoints and oppositePoints
      foreach(Point3d L1p in sidePoints){
        generatedMesh.Vertices.Add(L1p);
      }
      foreach(Point3d L2p in oppositePoints){
        generatedMesh.Vertices.Add(L2p);
      }

      if(direction){
        // add faces
        int nrPoints = sidePoints.Count();
        for(int i = 0; i < nrPoints - 1; i++){
          generatedMesh.Faces.AddFace(i + nrPoints, i, i + 1);
          generatedMesh.Faces.AddFace(i + 1, i + nrPoints + 1, i + nrPoints);
        }
      }else{
        // add faces
        int nrPoints = sidePoints.Count();
        for(int i = 0; i < nrPoints - 1; i++){
          generatedMesh.Faces.AddFace(i + nrPoints + 1, i + nrPoints, i);
          generatedMesh.Faces.AddFace(i + nrPoints + 1, i, i + 1);
        }
      }

      // process and return mesh
      generatedMesh.Normals.ComputeNormals();
      generatedMesh.Compact();
      return generatedMesh;
    }


    public double[] calculateRadiuses(){
      int nrPoints = sidePoints.Count(); // number of points per side
      double[] radiuses = new double[2 * (nrPoints)];

      // get angles on first side
      for (int i = 1; i < nrPoints - 1; i++){ // skip first and last points
        // get vectors to neighbour points and angle between them
        Vector3d directionBack = Point3d.Subtract(sidePoints[i - 1], sidePoints[i]);
        Vector3d directionForward = Point3d.Subtract(sidePoints[i + 1], sidePoints[i]);
        double angleAtPoint = Vector3d.VectorAngle(directionBack, directionForward);
        // calculate radius and store it
        radiuses[i] = 0.5 * segmentLength / Math.Sin(0.5 * (Math.PI - angleAtPoint));
      }
      // for first and last point, use value calculated from neighbour
      radiuses[0] = radiuses[1];
      radiuses[nrPoints - 1] = radiuses[nrPoints - 2];

      // do the same for points on the other side
      for (int i = 1; i < nrPoints - 1; i++){ // skip first and last points
        // get vectors to neighbour points and angle between them
        Vector3d directionBack = Point3d.Subtract(oppositePoints[i - 1], oppositePoints[i]);
        Vector3d directionForward = Point3d.Subtract(oppositePoints[i + 1], oppositePoints[i]);
        double angleAtPoint = Vector3d.VectorAngle(directionBack, directionForward);
        // calculate radius and store it
        radiuses[i + nrPoints] = 0.5 * segmentLength / Math.Sin(0.5 * (Math.PI - angleAtPoint));
      }
      // for first and last point, use value calculated from neighbour
      radiuses[nrPoints] = radiuses[nrPoints + 1];
      radiuses[2 * nrPoints - 1] = radiuses[2 * nrPoints - 2];
      return radiuses;
    }

    public Curve[] getRadiusCircles(){
      int nrPoints = sidePoints.Count(); // number of points per side
      Curve[] radiusCircles = new Curve[2 * (nrPoints)];

      // draw circles on first side
      for (int i = 1; i < nrPoints - 1; i++){ // skip first and last points
        // get vectors to neighbour points and angle between them
        Vector3d directionBack = Point3d.Subtract(sidePoints[i - 1], sidePoints[i]);
        Vector3d directionForward = Point3d.Subtract(sidePoints[i + 1], sidePoints[i]);
        double angleAtPoint = Vector3d.VectorAngle(directionBack, directionForward);
        Vector3d directionCircle = Vector3d.Add(directionBack, directionForward);
        directionCircle.Unitize();
        Vector3d circleNormal = Vector3d.CrossProduct(directionBack, directionForward);
        double circleRadius = 0.5 * segmentLength / Math.Sin(0.5 * (Math.PI - angleAtPoint));
        // midPoint
        Point3d circleCenter = Point3d.Add(sidePoints[i], Vector3d.Multiply(directionCircle, circleRadius));
        Circle radiusCircle = new Circle(new Plane(circleCenter, circleNormal), circleRadius);
        radiusCircles[i] = radiusCircle.ToNurbsCurve();
      }
      // for first and last point, use value calculated from neighbour
      radiusCircles[0] = radiusCircles[1];
      radiusCircles[nrPoints - 1] = radiusCircles[nrPoints - 2];

      // todo: add circles on other side
      for (int i = 1; i < nrPoints - 1; i++){ // skip first and last points
        // get vectors to neighbour points and angle between them
        Vector3d directionBack = Point3d.Subtract(oppositePoints[i - 1], oppositePoints[i]);
        Vector3d directionForward = Point3d.Subtract(oppositePoints[i + 1], oppositePoints[i]);
        double angleAtPoint = Vector3d.VectorAngle(directionBack, directionForward);
        Vector3d directionCircle = Vector3d.Add(directionBack, directionForward);
        directionCircle.Unitize();
        Vector3d circleNormal = Vector3d.CrossProduct(directionBack, directionForward);
        double circleRadius = 0.5 * segmentLength / Math.Sin(0.5 * (Math.PI - angleAtPoint));
        // midPoint
        Point3d circleCenter = Point3d.Add(oppositePoints[i], Vector3d.Multiply(directionCircle, circleRadius));
        Circle radiusCircle = new Circle(new Plane(circleCenter, circleNormal), circleRadius);
        radiusCircles[i + nrPoints] = radiusCircle.ToNurbsCurve();
      }
      // for first and last point, use value calculated from neighbour
      radiusCircles[nrPoints] = radiusCircles[1];
      radiusCircles[2 * nrPoints - 1] = radiusCircles[nrPoints - 2];

      return radiusCircles;
    }

  }
# ---------- end c_create_strips ----------
radius_circles = Circle(c_create_strips.radiusCirclesOut)
triangle_mesh = Geometry(c_create_strips.triangleMeshOut)
strip_mesh = Mesh(c_create_strips.meshOut)
radiuses = Number(c_create_strips.radiusesOut)

# ----
# single surface following curvature direction
srf = Surface(offset_3)  # disabled
number_slider_13 = Slider(110, range=0..180)  # disabled
# GEOMETRY
number_slider_14 = Slider(171.52, range=160..175)  # disabled
number_slider_15 = Slider(25.8, range=18..26)  # disabled
number_slider_16 = Slider(17.5, range=13..20)  # disabled
number_slider_17 = Slider(0.2, range=0..2)  # disabled
number_slider_18 = Slider(13.2, range=0..30)  # disabled
rad = Radians(Degrees=number_slider_13)  # disabled
number_slider_19 = Slider(0.3, range=0..1)  # disabled
number_slider_20 = Slider(10, range=0..10)  # disabled
pt_2 = ConstructPoint(XCoordinate=number_slider_14, YCoordinate=number_slider_15, ZCoordinate=number_slider_16)  # disabled
c_construct_folded_surface = CSharpScript(
    baseSurface=srf,
    basePoint=pt_2,
    panelAngle=rad,
    width=number_slider_18,
    height=number_slider_19,
    segmentLength=number_slider_17,
    maxStep=number_slider_20)  # -> out, A, B, C, D, E, F; inputs baseSurface: Surface, basePoint: Point3d, panelAngle: Double, width: Double, height: Double, segmentLength: Double, maxStep: Double; disabled
# ---------- c_construct_folded_surface: C# ----------
    double u;
    double v;
    double intersectPrecision = 0.001;
    baseSurface.ClosestPoint(basePoint, out u, out v);
    Point3d midPoint = baseSurface.PointAt(u, v);
    halfPanel.intersectPrecision = intersectPrecision;
    halfPanel.segmentLength = segmentLength;
    halfPanel.maxStep = maxStep;

    double cornerAngle = Math.Atan(height / width);

    int angleStep = 1;
    int nrSteps = 180 / angleStep;

    // store line points
    Point3d[] startPoints = new Point3d[nrSteps];
    Point3d[] endPoints = new Point3d[nrSteps];

    // store normal differences
    double[] normalProducts = new double[nrSteps];

    // store line lengths and surface distance
    double[] lineLengths = new double[nrSteps];
    double[] surfaceDistances = new double[nrSteps];
    double[] angles = new double[nrSteps];


    //
    // split face along diagonal (following main bending line)
    //

    // generate diagonals, get data for each of them
    for(int degAngle = 0; degAngle < nrSteps; degAngle++){
      double angle = degAngle * angleStep * Math.PI / 180;

      // calculate diagonal length
      double lineLength;
      if(angle < cornerAngle || angle > (Math.PI - cornerAngle)){
        lineLength = Math.Abs(width / Math.Cos(angle));
      }else{
        lineLength = height / Math.Cos(0.5 * Math.PI - angle);
      }

      // construct plane in edge direction
      Vector3d midNormal = baseSurface.NormalAt(u, v);
      Vector3d midPerpendicular = new Vector3d(-midNormal.Y, midNormal.X, 0);
      Vector3d angleDirection = new Vector3d(Math.Cos(angle + panelAngle), Math.Sin(angle + panelAngle), 0);
      Plane splitPlane = new Plane(midPoint, midNormal, angleDirection);

      // create first intersection point (left point)
      Circle tempCircle = new Circle(splitPlane, lineLength / 2);
      Point3d iPoint0 = new Point3d();
      Rhino.Geometry.Intersect.CurveIntersections circleSurfPoints = Rhino.Geometry.Intersect.Intersection.CurveSurface(tempCircle.ToNurbsCurve(), baseSurface, intersectPrecision, 0.0001);
      foreach( Rhino.Geometry.Intersect.IntersectionEvent iEvent in circleSurfPoints){
        if(Vector3d.Multiply(midPerpendicular, Point3d.Subtract(iEvent.PointA, midPoint)) > 0){
          iPoint0 = iEvent.PointA;
        }
      }

      // create second intersection point
      tempCircle = new Circle(splitPlane, iPoint0, lineLength);
      Point3d iPoint1 = new Point3d();
      circleSurfPoints = Rhino.Geometry.Intersect.Intersection.CurveSurface(tempCircle.ToNurbsCurve(), baseSurface, intersectPrecision, 0.0001);
      foreach( Rhino.Geometry.Intersect.IntersectionEvent iEvent in circleSurfPoints){
        if(Point3d.Subtract(midPoint, iEvent.PointA).Length < Point3d.Subtract(iPoint0, iEvent.PointA).Length){
          iPoint1 = iEvent.PointA;
        }
      }

      // get normal product
      double u0;
      double v0;
      double u1;
      double v1;
      baseSurface.ClosestPoint(iPoint0, out u0, out v0);
      baseSurface.ClosestPoint(iPoint1, out u1, out v1);
      Vector3d normal0 = baseSurface.NormalAt(u0, v0);
      Vector3d normal1 = baseSurface.NormalAt(u1, v1);

      // get surface distance at midpoint
      Point3d lineMid = new Point3d();
      lineMid.Interpolate(iPoint0, iPoint1, 0.5);
      double um;
      double vm;
      baseSurface.ClosestPoint(lineMid, out um, out vm);
      Point3d surfaceLineMid = baseSurface.PointAt(um, vm);
      Vector3d midDistanceVector = Point3d.Subtract(lineMid, surfaceLineMid);
      double midDistance = midDistanceVector.Length;

      // store line data
      startPoints[degAngle] = iPoint0;
      endPoints[degAngle] = iPoint1;
      normalProducts[degAngle] = Vector3d.Multiply(normal0, normal1);
      lineLengths[degAngle] = lineLength;
      surfaceDistances[degAngle] = midDistance;
      angles[degAngle] = angle;
    }



    // process collected data: find best diagonal
    List<int> goodIndices = halfPanel.getGoodIndices(normalProducts);
    int bestIndex = halfPanel.getBestDiagonalIndex(goodIndices, lineLengths, surfaceDistances);

    // draw best diagonal
    Line bestDiagonal = new Line(startPoints[bestIndex], endPoints[bestIndex]);


    //
    // create two half panels
    //

    // get edge lengths
    double bestAngle = angles[bestIndex];
    double thirdLength = 0;
    double side0 = 0;
    double side1 = 0;
    if(bestAngle < cornerAngle || bestAngle > (Math.PI - cornerAngle)){ // cut through sides
      side0 = 0.5 * height - Math.Tan(bestAngle) * 0.5 * width;
      side1 = 0.5 * height + Math.Tan(bestAngle) * 0.5 * width;
      thirdLength = width;
    }else if(bestAngle == cornerAngle){
      // todo: two triangles
    }else{ // cut through top and bottom
      side0 = 0.5 * width - Math.Tan(0.5 * Math.PI - bestAngle) * 0.5 * height;
      side1 = 0.5 * width + Math.Tan(0.5 * Math.PI - bestAngle) * 0.5 * height;
      thirdLength = height;
    }

    //
    // create panels from start point
    //

    // create halfPanel objects for both directions
    Vector3d diagonalDirection = Point3d.Subtract(endPoints[bestIndex], startPoints[bestIndex]);
    Vector3d diagonalPerpendicular = new Vector3d(-diagonalDirection.Y, diagonalDirection.X, 0);
    halfPanel panel0 = new halfPanel(startPoints[bestIndex], endPoints[bestIndex], diagonalPerpendicular, baseSurface, side0, side1, thirdLength);
    halfPanel panel1 = new halfPanel(endPoints[bestIndex], startPoints[bestIndex], -diagonalPerpendicular, baseSurface, side0, side1, thirdLength);

    // develop ordinary part

    List<Line> diagonals0 = new List<Line>();
    while(!panel0.isTriangle){
      diagonals0.Add(panel0.developOnceBest());
    }

    List<Line> diagonals1 = new List<Line>();
    while(!panel1.isTriangle){
      diagonals1.Add(panel1.developOnceBest());
    }


    // develop triangle part
    List<Line> triangles0 = new List<Line>();
    int loopCheck = 0;
    while (!panel0.cornerReached && loopCheck < 40){
      loopCheck++;
      Print("triangle 0");
      triangles0.Add(panel0.developTriOnceBest());
    }

    loopCheck = 0;
    List<Line> triangles1 = new List<Line>();
    while (!panel1.cornerReached && loopCheck < 40){
      loopCheck++;
      Print("triangle 1");
      triangles1.Add(panel1.developTriOnceBest());
    }





    A = bestDiagonal;
    B = diagonals0;
    C = diagonals1;
    D = triangles0;
    E = triangles1;
    F = midPoint;
# ---------- c_construct_folded_surface: C# additional code ----------
  public class halfPanel
  {
    public static Surface baseSurface;
    public bool isTriangle = false;
    public bool cornerReached = false;
    public Point3d activePoint0;
    public Point3d activePoint1;
    public double remainingLength0;
    public double remainingLength1;
    public double triLength0;
    public double triLength1;
    double sideLength;
    public double sideDifference; // positive when right is longer than left
    public double thirdSegmentLength;
    public Vector3d panelDirection;
    public static double intersectPrecision;
    public static double segmentLength;
    public static double maxStep;

    public halfPanel(Point3d startPoint0, Point3d startPoint1, Vector3d direction, Surface baseSurface, double l0, double l1, double l2){ // constructor
      activePoint0 = startPoint0; // left
      activePoint1 = startPoint1; // right
      panelDirection = direction;
      halfPanel.baseSurface = baseSurface;
      remainingLength0 = l0;
      remainingLength1 = l1;
      thirdSegmentLength = l2;
      sideLength = l0 + l1;
      sideDifference = l1 - l0;
    }

    public List<double> getDistances(double gap, bool side){
      List<double> distances = new List<double>();
      double length = (side) ? remainingLength1 : remainingLength0;
      length = Math.Min(length, maxStep);
      int nrSegments = Convert.ToInt32(length / gap) + 1;
      double actualSegmentLength = length / nrSegments;
      for(int i = 0; i < nrSegments; i++){
        distances.Add(actualSegmentLength * (i + 1));
      }
      return distances;
    }

    public List<double> getTriDistances(double pointDistance, bool side){
      List<double> distances = new List<double>();
      double length = (side) ? triLength1 : triLength0;
      length = Math.Min(length, maxStep);
      int nrSegments = Convert.ToInt32(length / pointDistance) + 1;
      double actualSegmentLength = length / nrSegments;
      for(int i = 0; i < nrSegments; i++){
        distances.Add(actualSegmentLength * (i + 1));
      }
      return distances;
    }

    public double getMatchingDistance(double givenDistance, bool side){
      if(side){ // if side, create points right
        return (Math.Sqrt((sideDifference - givenDistance) * (sideDifference - givenDistance) + thirdSegmentLength * thirdSegmentLength));
      }else{ // otherwise, create points left
        return (Math.Sqrt((sideDifference + givenDistance) * (sideDifference + givenDistance) + thirdSegmentLength * thirdSegmentLength));
      }
    }

    public double getMatchingTriDistance(double givenDistance, bool side){
      if(side){ // points on right side
        double angle = Math.Atan((triLength1 - givenDistance) / triLength0);
        return (triLength0 / Math.Cos(angle));
      }else{ // points on left side
        double angle = Math.Atan((triLength0 - givenDistance) / triLength1);
        return (triLength1 / Math.Cos(angle));
      }
    }

    List<double> getNormalProducts(Point3d basePoint, List<Point3d> otherPoints, Surface baseSurface){
      List<double> products = new List<double>();
      foreach(Point3d otherPoint in otherPoints){
        double u0;
        double v0;
        double u1;
        double v1;
        baseSurface.ClosestPoint(basePoint, out u0, out v0);
        baseSurface.ClosestPoint(otherPoint, out u1, out v1);
        Vector3d normal0 = baseSurface.NormalAt(u0, v0);
        Vector3d normal1 = baseSurface.NormalAt(u1, v1);
        products.Add(Vector3d.Multiply(normal0, normal1));
      }
      return products;
    }

    public static List<int> getGoodIndices(double[] normalDotProducts){
      List<int> goodIndices = new List<int>();
      // add first?
      if(normalDotProducts.Length == 1){
        goodIndices.Add(0);
      }else{
        if(normalDotProducts[0] > normalDotProducts[1]){
          goodIndices.Add(0);
        }
        // add last?
        if(normalDotProducts[normalDotProducts.Count() - 1] > normalDotProducts[normalDotProducts.Count() - 2]){
          goodIndices.Add(normalDotProducts.Count() - 1);
        }
      }
      // add all good candidates (better dot product than neighbours)
      if(normalDotProducts.Length > 1){
        for(int i = 1; i < normalDotProducts.Count() - 2; i++){
          if((normalDotProducts[i] > normalDotProducts[i - 1]) && (normalDotProducts[i] > normalDotProducts[i + 1])){
            goodIndices.Add(i);
          }
        }
      }
      return goodIndices;
    }

    public static int getBestDiagonalIndex(List<int> goodIndices, double[] collectedLengths, double[] connectionHeights){
      double bestProximity = double.MaxValue;
      int bestIndex = 0;

      for(int i = 0; i < goodIndices.Count(); i++){
        // calculate surface proximity
        double thisProximity = connectionHeights[goodIndices[i]] / collectedLengths[goodIndices[i]];

        if (thisProximity < bestProximity){
          bestIndex = goodIndices[i];
          bestProximity = thisProximity;
        }
      }
      return(bestIndex);
    }

    void setPanelDirection(){
      Vector3d edgeDirection = Point3d.Subtract(activePoint1, activePoint0);
      panelDirection = new Vector3d(-edgeDirection.Y, edgeDirection.X, 0);
    }

    double midDistance(Line studyLine){
      Point3d lineMid = studyLine.PointAt(0.5);
      double um;
      double vm;
      baseSurface.ClosestPoint(lineMid, out um, out vm);
      Point3d surfaceLineMid = baseSurface.PointAt(um, vm);
      Vector3d midDistanceVector = Point3d.Subtract(lineMid, surfaceLineMid);
      return midDistanceVector.Length;
    }

    public Line developTriOnceBest(){
      // get best point on both sides, create lines
      Point3d bestRightPoint = developTriOnce(true);
      Point3d bestLeftPoint = developTriOnce(false);
      Line bestRightLine = new Line(activePoint0, bestRightPoint);
      Line bestLeftLine = new Line(activePoint1, bestLeftPoint);

      // for both lines, get deviation
      if(midDistance(bestRightLine) < midDistance(bestLeftLine)){
        // update parameters
        Vector3d pointDistance = Point3d.Subtract(bestRightPoint, activePoint1);
        activePoint1 = bestRightPoint;
        triLength1 -= pointDistance.Length;
        if(triLength1 < segmentLength / 10){
          cornerReached = true;
        }
        setPanelDirection();

        // return best line
        return bestRightLine;
      }else{
        // update parameters
        Vector3d pointDistance = Point3d.Subtract(bestLeftPoint, activePoint0);
        activePoint0 = bestLeftPoint;
        triLength0 -= pointDistance.Length;
        if(triLength0 < segmentLength / 10){
          cornerReached = true;
        }
        setPanelDirection();

        // return best line
        return bestLeftLine;
      }
    }

    public Line developOnceBest(){
      // get best point on both sides, create lines
      Point3d bestRightPoint = developOnce(true); // true: new point on right side
      Point3d bestLeftPoint = developOnce(false); // false: new point on left side
      Line bestRightLine = new Line(activePoint0, bestRightPoint);
      Line bestLeftLine = new Line(activePoint1, bestLeftPoint);

      // for both lines, get deviation
      if(midDistance(bestRightLine) < midDistance(bestLeftLine)){
        // update parameters
        Vector3d pointDistance = Point3d.Subtract(bestRightPoint, activePoint1);
        activePoint1 = bestRightPoint;
        sideDifference -= pointDistance.Length;
        remainingLength1 -= pointDistance.Length;
        if(remainingLength1 < segmentLength / 10){
          isTriangle = true;
          triLength1 = thirdSegmentLength;
          triLength0 = remainingLength0;
        }
        setPanelDirection();
        // return best line
        return bestRightLine;
      }else{
        // update parameters
        Vector3d pointDistance = Point3d.Subtract(bestLeftPoint, activePoint0);
        activePoint0 = bestLeftPoint;
        sideDifference += pointDistance.Length;
        remainingLength0 -= pointDistance.Length;
        if(remainingLength0 < segmentLength / 10){
          isTriangle = true;
          triLength0 = thirdSegmentLength;
          triLength1 = remainingLength1;
        }
        setPanelDirection();
        // return best line
        return bestLeftLine;
      }
    }

    //
    // develop panel by one step
    //

    public Point3d developOnce(bool newPointSide){
      Point3d fixedPoint = newPointSide ? activePoint0 : activePoint1;
      Point3d freePoint = newPointSide ? activePoint1 : activePoint0;

      // calculate distances
      List<double> myDistances = getDistances(segmentLength, newPointSide);
      List<double> longDistances = new List<double>();
      foreach(double myDistance in myDistances){
        longDistances.Add(getMatchingDistance(myDistance, newPointSide));
      }

      // create potential points, get normal dot products and select good candidates
      List<Point3d> intersectPoints = getIntersectPoints(fixedPoint, freePoint, myDistances, longDistances);
      List<double> myNormalProducts = getNormalProducts(fixedPoint, intersectPoints, baseSurface);
      List<int> myGoodIndices = getGoodIndices(myNormalProducts.ToArray());

      // pick best point, based on distance to surface
      double[] myCollectedLengths = new double[intersectPoints.Count];
      double[] myCollectedHeights = new double[intersectPoints.Count];
      for(int i = 0; i < intersectPoints.Count; i++){
        Line tempLine = new Line(fixedPoint, intersectPoints[i]);
        myCollectedLengths[i] = tempLine.Length;
        myCollectedHeights[i] = midDistance(tempLine);
      }
      int myBestIndex = getBestDiagonalIndex(myGoodIndices, myCollectedLengths, myCollectedHeights);

      return intersectPoints[myBestIndex];
    }

    //
    // develop final triangle of panel, one step
    //

    public Point3d developTriOnce(bool newPointSide){
      Point3d fixedPoint = newPointSide ? activePoint0 : activePoint1;
      Point3d freePoint = newPointSide ? activePoint1 : activePoint0;

      // calculate distances
      List<double> myDistances = getTriDistances(segmentLength, newPointSide);
      List<double> longDistances = new List<double>();
      foreach(double myDistance in myDistances){
        longDistances.Add(getMatchingTriDistance(myDistance, newPointSide));
      }

      // create potential points, get normal dot products and select good candidates
      List<Point3d> intersectPoints = getIntersectPoints(fixedPoint, freePoint, myDistances, longDistances);
      List<double> myNormalProducts = getNormalProducts(fixedPoint, intersectPoints, baseSurface);

      //Rhino.RhinoApp.WriteLine("number of intersect points found:");
      //Rhino.RhinoApp.WriteLine(intersectPoints.Count.ToString());

      if(intersectPoints.Count > 0){
        List<int> myGoodIndices = getGoodIndices(myNormalProducts.ToArray());

        // pick best point, based on distance to surface
        double[] myCollectedLengths = new double[intersectPoints.Count];
        double[] myCollectedHeights = new double[intersectPoints.Count];
        for(int i = 0; i < intersectPoints.Count; i++){
          Line tempLine = new Line(fixedPoint, intersectPoints[i]);
          myCollectedLengths[i] = tempLine.Length;
          myCollectedHeights[i] = midDistance(tempLine);
        }
        int myBestIndex = getBestDiagonalIndex(myGoodIndices, myCollectedLengths, myCollectedHeights);
        return intersectPoints[myBestIndex];

      }
      // return final corner point
      Rhino.RhinoApp.WriteLine("returning corner point");
      List<double> firstDistance = new List<double>();
      List<double> secondDistance = new List<double>();
      firstDistance.Add(triLength0);
      secondDistance.Add(triLength1);
      List<Point3d> finalPoint = getIntersectPoints(activePoint1, activePoint0, firstDistance, secondDistance);
      return finalPoint[0];
    }


    //
    // create intersection points, based on start points and lists of distances
    //

    List<Point3d> getIntersectPoints(Point3d fixedPoint, Point3d freePoint, List<double> myDistances, List<double> longDistances){
      List<Point3d> intersectPoints = new List<Point3d>();
      for(int i = 0; i < myDistances.Count; i++){
        //Rhino.RhinoApp.WriteLine("new distances: " + myDistances[i].ToString() + " " + longDistances[i].ToString());
        // create spheres on both points, intersect, pick right point
        Sphere sphere0 = new Sphere(fixedPoint, longDistances[i]);
        Sphere sphere1 = new Sphere(freePoint, myDistances[i]);
        Circle intersectCircle;
        Rhino.Geometry.Intersect.Intersection.SphereSphere(sphere0, sphere1, out intersectCircle);

        // intersect circle with surface
        if(intersectCircle.IsValid){
          Rhino.Geometry.Intersect.CurveIntersections baseCircleIntersections = Rhino.Geometry.Intersect.Intersection.CurveSurface(intersectCircle.ToNurbsCurve(), baseSurface, intersectPrecision, 0.01);
          Point3d intersectPoint = new Point3d();
          foreach( Rhino.Geometry.Intersect.IntersectionEvent iEvent in baseCircleIntersections){
            //Rhino.RhinoApp.WriteLine("valid intersection point");
            // get dot product of shortDirection and direction to intersection; if positive, assign point to basePoint2;
            Vector3d toPointA = Point3d.Subtract(iEvent.PointA, freePoint);
            if(Vector3d.Multiply(panelDirection, toPointA) > 0){
              //Rhino.RhinoApp.WriteLine("accepted");
              intersectPoint = iEvent.PointA;
            }
          }
          intersectPoints.Add(intersectPoint);
        }
      }
      return intersectPoints;
    }

  }
# ---------- end c_construct_folded_surface ----------
geo_4 = Geometry(c_construct_folded_surface.E)  # disabled
geo_5 = Geometry(c_construct_folded_surface.F)  # disabled
geo_6 = Geometry(c_construct_folded_surface.D)  # disabled
geo_7 = Geometry(c_construct_folded_surface.A)  # disabled
geo_8 = Geometry(c_construct_folded_surface.B)  # disabled
geo_9 = Geometry(c_construct_folded_surface.C)  # disabled
geo_10 = Geometry([geo_7, geo_8, geo_9, geo_6, geo_4])  # disabled

# ----
# split into panels
number_slider_21 = Slider(2, range=0..10)
c_split_into_panels = CSharpScript(meshStrips=triangle_mesh, segmentLength=panel_segment_length, panelLength=number_slider_21, direction=diagonal_direction)  # -> out, panels, panelCount; inputs meshStrips: Mesh, segmentLength: Double, panelLength: Double, direction: Boolean
# ---------- c_split_into_panels: C# ----------
    // note: this script deals with one strip at a time, so as far as the code is concerned, only one strip exists
    // It only works on triangle strips, as vertex indices are used to reconstruct faces.

    List<Mesh> collectedPanels = new List<Mesh>();

    // first figure out how many panels would fit: get the number of points on one side, multiply with segmentLength to get the total length. then divide by panel length
    int originalPointsPerSide = (meshStrips.Vertices.Count / 2);
    double stripLength = (originalPointsPerSide - 1) * segmentLength;
    int nrPanels = Convert.ToInt32(Math.Floor(stripLength / panelLength));
    int segmentsPerPanelSide = Convert.ToInt32(panelLength / segmentLength);
    int pointsPerPanelSide = segmentsPerPanelSide + 1;
    int extraPoints = originalPointsPerSide - nrPanels * segmentsPerPanelSide - 1;
    int startPointIndex = extraPoints / 2;
    int startFaceIndex = 2 * startPointIndex;

    // generate panel meshes
    for (int i = 0; i < nrPanels; i++){
      int panelStartPointIndex = startPointIndex + i * segmentsPerPanelSide;
      Mesh generatedPanel = createTriangleMesh(panelStartPointIndex, pointsPerPanelSide, meshStrips, direction);
      collectedPanels.Add(generatedPanel);
    }

    panels = collectedPanels;
    panelCount = collectedPanels.Count;
# ---------- c_split_into_panels: C# additional code ----------
  public Rhino.Geometry.Mesh createTriangleMesh(int startPointIndex, int pointsPerPanelSide, Mesh inputMesh, bool direction){ // true is original direction, false has flipped diagonals
    int originalPointsPerSide = inputMesh.Vertices.Count / 2;

    // create new mesh object
    Rhino.Geometry.Mesh generatedMesh = new Rhino.Geometry.Mesh();

    // get appropriate vertices from old mesh
    for(int i = 0; i < pointsPerPanelSide; i++){
      generatedMesh.Vertices.Add(inputMesh.Vertices[startPointIndex + i]);
    }

    for(int i = 0; i < pointsPerPanelSide; i++){
      generatedMesh.Vertices.Add(inputMesh.Vertices[originalPointsPerSide + startPointIndex + i]);
    }

    // add faces
    if(direction){
      for(int i = 0; i < pointsPerPanelSide - 1; i++){
        generatedMesh.Faces.AddFace(i, i + 1, i + pointsPerPanelSide);
        generatedMesh.Faces.AddFace(i + 1, i + pointsPerPanelSide + 1, i + pointsPerPanelSide);
      }
    }else{
      for(int i = 0; i < pointsPerPanelSide - 1; i++){
        generatedMesh.Faces.AddFace(i, i + pointsPerPanelSide + 1, i + pointsPerPanelSide);
        generatedMesh.Faces.AddFace(i, i + 1, i + pointsPerPanelSide + 1);
      }
    }

    // process and return mesh
    generatedMesh.Normals.ComputeNormals();
    generatedMesh.Compact();
    return generatedMesh;
  }
# ---------- end c_split_into_panels ----------
geo_11 = Geometry(c_split_into_panels.panels)
ma = MassAddition(Input=c_split_into_panels.panelCount)  # -> Result, PartialResults
dispatch_2 = Dispatch(List=geo_11, DispatchPattern=[True, False])  # -> ListA, ListB
total_panel_count = Integer(ma.Result)
even_panels = Geometry(flatten(dispatch_2.ListA))
odd_panels = Geometry(flatten(dispatch_2.ListB))

item = ListItem(List=strip_mesh, Index=0, Wrap=True)  # disabled
c_end_directions = CSharpScript(roofStrips=simplify(graft(strip_mesh)))  # -> out, point_A, vector_A, point_B, vector_B; inputs roofStrips: tree of Mesh
# ---------- c_end_directions: C# ----------
    List<Point3d> points_A_L = new List<Point3d>();
    List<Point3d> points_B_L = new List<Point3d>();
    List<Point3d> points_A_R = new List<Point3d>();
    List<Point3d> points_B_R = new List<Point3d>();
    List<Vector3d> vectors_A_L = new List<Vector3d>();
    List<Vector3d> vectors_B_L = new List<Vector3d>();
    List<Vector3d> vectors_A_R = new List<Vector3d>();
    List<Vector3d> vectors_B_R = new List<Vector3d>();

    List<Point3d> points_L = new List<Point3d>();
    List<Point3d> points_R = new List<Point3d>();
    List<Vector3d> vectors_L = new List<Vector3d>();
    List<Vector3d> vectors_R = new List<Vector3d>();


    for(int i = 0; i < roofStrips.Paths.Count; i++){
      Mesh strip = roofStrips.Branches[i][0];
      int pointCount = strip.Vertices.Count;
      // process start edge
      points_L.Add(strip.Vertices.First());
      vectors_L.Add(Point3d.Subtract(strip.Vertices[0], strip.Vertices[1]));
      points_R.Add(strip.Vertices[pointCount / 2]);
      vectors_R.Add(Point3d.Subtract(strip.Vertices[pointCount / 2], strip.Vertices[pointCount / 2 + 1]));

      // process end edge
      points_L.Add(strip.Vertices.Last());
      vectors_L.Add(Point3d.Subtract(strip.Vertices.Last(), strip.Vertices[pointCount - 2]));
      points_R.Add(strip.Vertices[pointCount / 2 - 1]);
      vectors_R.Add(Point3d.Subtract(strip.Vertices[pointCount / 2 - 1], strip.Vertices[pointCount / 2 - 2]));


      // process end edge


    }
    point_A = points_L;
    point_B = points_R;
    vector_A = vectors_L;
    vector_B = vectors_R;
# ---------- end c_end_directions ----------
clean = CleanTree(RemoveNulls=False, RemoveInvalid=True, RemoveEmpty=True, Tree=c_split_into_panels.panels)
vdis = VectorDisplay(Anchor=c_end_directions.point_A, Vector=c_end_directions.vector_A)
vdis_2 = VectorDisplay(Anchor=c_end_directions.point_B, Vector=c_end_directions.vector_B)
panels = Mesh(clean)

# ----
# Ladybug solar analysis
panel_2 = Panel("C:\Users\Assistenz\ASF_Simulation\WeatherData\CHE_Geneva.067000_IWEC.epw")
number_slider_22 = Slider(11, range=1..24)
number_slider_23 = Slider(12, range=1..25)
number_slider_24 = Slider(21, range=1..31)
addition_2 = Addition(A=number_slider_22, B=1)
python = PythonScript()  # -> out, a
# ---------- python: Python ----------
myTuple = (1,2,3)
a = ((1,1,0), ((1,1,1)))
# ---------- end python ----------
ladybug = Ladybug_Ladybug()  # -> Vviiiiiiiiiizzz; plug-in component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
number_slider_25 = Slider(2, range=1..12)
number_slider_26 = Slider(7, range=1..12)
importepw = Ladybug_ImportEpw(epwFile=panel_2)  # -> readMe, latitude, location, dryBulbTemperature, dewPointTemperature, relativeHumidity, windSpeed, windDirection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; plug-in component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
analysisperiod = Ladybug_AnalysisPeriod(
    fromMonth=number_slider_26,
    fromDay=number_slider_24,
    fromHour=number_slider_22,
    toMonth=number_slider_26,
    toDay=Slider(21, range=1..31),
    toHour=addition_2)  # -> readMe, analysisPeriod; plug-in component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
panel_3 = Panel(python.a)
number_slider_27 = Slider(5009, range=1..8760)
gencumulativeskymtx = Ladybug_GenCumulativeSkyMtx(epwFile=panel_2, skyDensity=0, useOldRes=Toggle(True), runIt=Toggle(True))  # -> readMe, cumulativeSkyMtx; plug-in component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
number_slider_28 = Slider(2, range=0..10)
number_slider_29 = Slider(0, range=0..1)
pt_3 = ConstructPoint(
    XCoordinate=Slider(-1000, range=-1000..190),
    YCoordinate=Slider(14.5, range=0..100),
    ZCoordinate=Slider(14, range=0..100))
selectskymtx = Ladybug_selectSkyMtx(
    cumulativeSkyMtx=gencumulativeskymtx.cumulativeSkyMtx,
    analysisPeriod=analysisperiod.analysisPeriod,
    removeDiffuse=Toggle(True),
    removeDirect=False)  # -> readMe, selectedSkyMtx; plug-in component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
legendpar = Ladybug_LegendParameters(
    lowBound=Slider(0, range=0..1000),
    highBound=Slider(1, range=0..10000),
    legendLocation=pt_3,
    legendScale=Slider(5.4, range=0..10),
    fontSize=Slider(0.3, range=0..1))  # -> legendPar; plug-in component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
mesh_2 = Mesh(panels)
vec2pt = Vector2Pt(PointA=sun_basepoint, PointB=sun_direction, Unitize=False)  # -> Vector, Length
radiationanalysis = Ladybug_RadiationAnalysis(
    north=vec2pt.Vector,
    geometry=flatten(render_panel_layout),
    context=flatten(render_panel_layout),
    gridSize=Slider(50, range=0..100),
    disFromBase=Slider(0.02, range=0..1),
    selectedSkyMtx=flatten(selectskymtx.selectedSkyMtx),
    legendPar=flatten(legendpar),
    parallel=Toggle(True),
    runIt=Toggle(True),
    projectName="testproject_01")  # -> readMe, contextMesh, analysisMesh, testPts, testVec, port, radiationResult, radiationMesh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; plug-in component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
multiplication_2 = Multiplication(A=radiationanalysis.totalRadiation, B=0.14)
demesh = DeconstructMesh(Mesh=radiationanalysis.analysisMesh)  # -> Vertices, Faces, Colours, Normals
panel_4 = Panel(radiationanalysis.testPts)
panel_5 = Panel(radiationanalysis.totalRadiation)
deface = DeconstructFace(Face=demesh.Faces)  # -> CornerA, CornerB, CornerC, CornerD
item_2 = ListItem(List=demesh.Vertices, Index=deface.CornerA, Wrap=True)
item_3 = ListItem(List=demesh.Vertices, Index=deface.CornerB, Wrap=True)
item_4 = ListItem(List=demesh.Vertices, Index=deface.CornerC, Wrap=True)
srf4pt = _4PointSurface(CornerA=item_2, CornerB=item_3, CornerC=item_4)
area = Area(Geometry=flatten(srf4pt))  # -> Area, Centroid
ma_2 = MassAddition(Input=area.Area)  # -> Result, PartialResults

# ----
# orientation uniformity
c_orientation_consistency = CSharpScript(panel=simplify(panels))  # -> out, averageDotProduct, dotProductList, minimalDotProduct; inputs panel: Mesh
# ---------- c_orientation_consistency: C# ----------
    double dotProductSum = 0.0;
    List<double> collectedDotProducts = new List<double>();
    double minDotProduct = 1.0;

    // get average normal
    Vector3d averageNormal = new Vector3d();
    foreach(Vector3d fNormal in panel.FaceNormals){
      averageNormal += fNormal;
    }
    averageNormal.Unitize();

    // get dot products of all normals
    foreach(Vector3d fNormal in panel.FaceNormals){
      double dotProduct = Vector3d.Multiply(fNormal, averageNormal);
      dotProductSum += dotProduct;
      collectedDotProducts.Add(dotProduct);
      minDotProduct = Math.Min(minDotProduct, dotProduct);
    }

    averageDotProduct = dotProductSum / panel.Faces.Count;
    dotProductList = collectedDotProducts;
    minimalDotProduct = minDotProduct;
# ---------- end c_orientation_consistency ----------
expression_4 = Expression(x=c_orientation_consistency.minimalDotProduct, Expression="1-x")
flatten = FlattenTree(Tree=c_orientation_consistency.dotProductList, Path="{0}")
ma_3 = MassAddition(Input=flatten(expression_4))  # -> Result, PartialResults

c_surface_distance = CSharpScript(panel=panels, baseSurface=offset_3)  # -> out, surfaceDistances; inputs panel: Mesh, baseSurface: Surface
# ---------- c_surface_distance: C# ----------
    // create distance list
    int vertsTotal = panel.Vertices.Count;
    int vertsPerSide = vertsTotal / 2;
    double[] panelDistances = new double[vertsTotal];
    for(int i = 0; i < vertsPerSide; i++){
      // get point on this side and point at index +0.5
      Point3d p0 = panel.Vertices[i];
      Point3d px = panel.Vertices[i + vertsPerSide];
      Point3d midPoint = new Point3d((p0.X + px.X) / 2, (p0.Y + px.Y) / 2, (p0.Z + px.Z) / 2);
      // find point on surface that is closest
      double u;
      double v;
      baseSurface.ClosestPoint(midPoint, out u, out v);
      Point3d surfacePoint = baseSurface.PointAt(u, v);
      // measure distance to that point, add to list
      Vector3d surfaceDistanceVector = Point3d.Subtract(surfacePoint, midPoint);
      double surfaceDistance = surfaceDistanceVector.Length;
      if(Vector3d.Multiply(surfaceDistanceVector, baseSurface.NormalAt(u, v)) < 0){
        surfaceDistance *= -1;
      }

      panelDistances[i] = surfaceDistance;
      panelDistances[i + vertsPerSide] = surfaceDistance;
    }
    surfaceDistances = panelDistances;
# ---------- end c_surface_distance ----------

# ----
# extended strips
maxnrsegments = Slider(20, range=0..100)
c_end_sections = CSharpScript(
    p1=c_end_directions.point_A,
    p2=c_end_directions.point_B,
    v1=c_end_directions.vector_A,
    v2=c_end_directions.vector_B,
    segmentLength=Slider(0.12, range=0..1),
    maxSegments=maxnrsegments,
    baseSurface=offset_3)  # -> out, mesh; inputs p1: Point3d, p2: Point3d, v1: Vector3d, v2: Vector3d, segmentLength: Double, maxSegments: Int32, baseSurface: Surface
# ---------- c_end_sections: C# ----------
    double intersectPrecision = 0.0001;
    double overlapTolerance = 0.001;
    Vector3d creationDirection = v1;
    Mesh endMesh = new Mesh();
    bool pointFound = true;
    bool singlePointFound = false;
    Vector3d vA = v1;
    Vector3d vB = v2;
    Vector3d fanDir = v1;

    Point3d pA = p1;
    Point3d pB = p2;
    Point3d activeFanPoint = new Point3d();
    Point3d passiveFanPoint = new Point3d();
    int passiveCornerIndex = 0;
    bool faceDir = true;

    // calculate pointDistance and pointRadius
    double stripWidth = Point3d.Subtract(p2, p1).Length;
    double helperCirclePointDistance = secondPointBaseDistance(stripWidth, segmentLength);
    double helperCircleRadius = secondPointRadius(stripWidth, segmentLength);

    int safety = 0;
    while(pointFound && safety < maxSegments){
      safety++;
      // create intersection points
      Vector3d startLineDirA = Point3d.Subtract(pA, pB);

      // A
      Circle circleA = new Circle(new Plane(pA, startLineDirA), segmentLength);
      Rhino.Geometry.Intersect.CurveIntersections intA = Rhino.Geometry.Intersect.Intersection.CurveSurface(circleA.ToNurbsCurve(), baseSurface, intersectPrecision, overlapTolerance);
      Point3d newA = getRightPointOnSurface(pA, intA, vA);
      bool foundA = (newA.Z != 0); // if point is on XY plane, it is not valid

      // B
      bool foundB = false;
      Point3d newB = new Point3d();
      if(foundA){
        Vector3d startLineDirB = Point3d.Subtract(pB, newA);
        startLineDirB.Unitize();
        Point3d pointBcenter = Point3d.Add(newA, Vector3d.Multiply(startLineDirB, helperCirclePointDistance));
        //Point3d pointBB = new Point3d(newA.X - pointDistance * startLineDirB.X, newPoint1.Y - pointDistance * startLineDirB.Y, newPoint1.Z - pointDistance * startLineDirB.Z);
        Circle segmentCircleB = new Circle(new Plane(pointBcenter, startLineDirB), helperCircleRadius);
        Rhino.Geometry.Intersect.CurveIntersections intB = Rhino.Geometry.Intersect.Intersection.CurveSurface(segmentCircleB.ToNurbsCurve(), baseSurface, intersectPrecision, overlapTolerance);
        newB = getRightPointOnSurface(pB, intB, vB);
      }
      foundB = (newB.Z != 0);

      if(foundA && foundB){
        int nrVerts = endMesh.Vertices.Count;
        if(nrVerts == 0){
          endMesh.Vertices.Add(p1);
          endMesh.Vertices.Add(p2);
        }
        // create points and triangles
        endMesh.Vertices.Add(newA);
        endMesh.Vertices.Add(newB);
        nrVerts = endMesh.Vertices.Count;
        endMesh.Faces.AddFace(nrVerts - 2, nrVerts - 4, nrVerts - 3);
        endMesh.Faces.AddFace(nrVerts - 3, nrVerts - 1, nrVerts - 2);
        // update current position and direction
        vA = Point3d.Subtract(newA, pA);
        vB = Point3d.Subtract(newB, pB);
        pA = newA;
        pB = newB;
      }else{
        pointFound = false;
        if(foundA){
          activeFanPoint = pA;
          fanDir = vA;
          passiveFanPoint = pB;
          singlePointFound = true;
          passiveCornerIndex = endMesh.Vertices.Count - 1;
        }else{
          activeFanPoint = pB;
          fanDir = vB;
          passiveFanPoint = pA;
          singlePointFound = true;
          passiveCornerIndex = endMesh.Vertices.Count - 2;
          faceDir = false;
        }
      }
    }

    List<double> diagonalLengths = new List<double>();
    List<double> axisLengths = new List<double>();
    List<double> triAngles = new List<double>();
    double summedAngle = 0.0;
    List<Circle> circleList = new List<Circle>();

    //then start working on the active side only, fanning out triangles:
    int fanIteration = 0;
    while(singlePointFound && fanIteration < maxSegments){
      //get vector to active side
      Vector3d toActive = Point3d.Subtract(activeFanPoint, passiveFanPoint);
      //get intersection circle data:
      double segmentSideSum = (fanIteration + 1) * segmentLength;
      double totalAngle = Math.Atan(segmentSideSum / stripWidth);
      triAngles.Add(totalAngle);
      double previousAngle = summedAngle;
      double thisAngle = totalAngle - summedAngle;
      summedAngle += thisAngle;
      double diagonalLength = stripWidth / Math.Cos(summedAngle);
      double cRadius = diagonalLength * Math.Sin(thisAngle);
      double axisLength = cRadius / Math.Tan(thisAngle);
      // create circle
      Vector3d toCenter = new Vector3d(toActive);
      toCenter.Unitize();
      toCenter = Vector3d.Multiply(toCenter, axisLength);
      Point3d cCenter = Point3d.Add(passiveFanPoint, toCenter);
      Circle triCircle = new Circle(new Plane(cCenter, toCenter), cRadius);
      circleList.Add(triCircle);

      //get intersect points, check if there is any in the current direction

      Rhino.Geometry.Intersect.CurveIntersections intTri = Rhino.Geometry.Intersect.Intersection.CurveSurface(triCircle.ToNurbsCurve(), baseSurface, intersectPrecision, overlapTolerance);
      Point3d newTriPoint = getRightPointOnSurface(activeFanPoint, intTri, fanDir);


      if(newTriPoint.Z == 0){
        singlePointFound = false;
      }else{
        endMesh.Vertices.Add(newTriPoint);
        int nrV = endMesh.Vertices.Count;
        if(fanIteration == 0){
          endMesh.Faces.AddFace(nrV - 3, nrV - 2, nrV - 1);
        }else{
          if(faceDir){
            endMesh.Faces.AddFace(nrV - 1, nrV - 2, passiveCornerIndex);
          }else{
            endMesh.Faces.AddFace(nrV - 2, nrV - 1, passiveCornerIndex);
          }
        }
        fanDir = Point3d.Subtract(newTriPoint, activeFanPoint);
        activeFanPoint = newTriPoint;
      }

      fanIteration++;
    }

    //circle = circleList;

    mesh = endMesh;
# ---------- c_end_sections: C# additional code ----------
  Point3d getRightPointOnSurface(Point3d currentPosition, Rhino.Geometry.Intersect.CurveIntersections intersections, Vector3d desiredDirection){
    //bool pointFound = false;
    Point3d foundPoint = new Point3d();
    double bestDotProduct = 0.0;
    if (intersections.Count > 1){
      foreach(Rhino.Geometry.Intersect.IntersectionEvent iEvent in intersections){ // get dot product of shortDirection and direction to intersection; if positive, assign point to newPoint1;
        Vector3d intersectionDirection = Point3d.Subtract(iEvent.PointA, currentPosition);
        double thisDotProduct = Vector3d.Multiply(desiredDirection, intersectionDirection);
        if(thisDotProduct > bestDotProduct){
          bestDotProduct = thisDotProduct;
          foundPoint = iEvent.PointA;
          //pointFound = true;
        }
      }
    }
    return (foundPoint);
  }

  double secondPointBaseDistance(double panelWidth, double segmentLength){
    double a = panelWidth;
    double b = segmentLength;
    double c = Math.Pow(a * a + b * b, 0.5);
    double sideProjectionDistance = (c * c - a * a + b * b) / (2 * c);
    return (c - sideProjectionDistance);
  }

  double secondPointRadius(double panelWidth, double segmentLength){
    double a = panelWidth;
    double b = segmentLength;
    double c = Math.Pow(a * a + b * b, 0.5);
    double sideProjectionDistance = (c * c - a * a + b * b) / (2 * c);
    return (Math.Pow(b * b - sideProjectionDistance * sideProjectionDistance, 0.5));
  }
# ---------- end c_end_sections ----------
mjoin = MeshJoin(Meshes=flatten([triangle_mesh, c_end_sections.mesh]))

# ----
# curvature display - panels
c_radius_calculation = CSharpScript(panel=panels, segmentLength=panel_segment_length)  # -> out, simplify(curvatureRadius); inputs panel: Mesh, segmentLength: Double
# ---------- c_radius_calculation: C# ----------
    int sidePointCount = panel.Vertices.Count / 2;
    //Curve[] radiusCurves = getRadiusCircles(panel, sidePointCount, segmentLength);
    double[] radiuses = calculateRadiuses(panel, sidePointCount, segmentLength);
    //A = radiusCurves;
    curvatureRadius = radiuses;
# ---------- c_radius_calculation: C# additional code ----------
  public double[] calculateRadiuses(Mesh panelMesh, int nrPoints, double segmentLength){
    double[] radiuses = new double[2 * (nrPoints)];
    Rhino.Geometry.Collections.MeshVertexList sidePoints = panelMesh.Vertices;

    // get angles on first side
    for (int i = 1; i < nrPoints - 1; i++){ // skip first and last points
      // get vectors to neighbour points and angle between them
      Vector3d directionBack = Point3d.Subtract(sidePoints[i - 1], sidePoints[i]);
      Vector3d directionForward = Point3d.Subtract(sidePoints[i + 1], sidePoints[i]);
      double angleAtPoint = Vector3d.VectorAngle(directionBack, directionForward);
      // calculate radius and store it
      radiuses[i] = 0.5 * segmentLength / Math.Sin(0.5 * (Math.PI - angleAtPoint));
    }
    // for first and last point, use value calculated from neighbour
    radiuses[0] = radiuses[1];
    radiuses[nrPoints - 1] = radiuses[nrPoints - 2];

    // do the same for points on the other side
    for (int i = 1; i < nrPoints - 1; i++){ // skip first and last points
      // get vectors to neighbour points and angle between them
      Vector3d directionBack = Point3d.Subtract(sidePoints[nrPoints + i - 1], sidePoints[nrPoints + i]);
      Vector3d directionForward = Point3d.Subtract(sidePoints[nrPoints + i + 1], sidePoints[nrPoints + i]);
      double angleAtPoint = Vector3d.VectorAngle(directionBack, directionForward);
      // calculate radius and store it
      radiuses[i + nrPoints] = 0.5 * segmentLength / Math.Sin(0.5 * (Math.PI - angleAtPoint));
    }
    // for first and last point, use value calculated from neighbour
    radiuses[nrPoints] = radiuses[nrPoints + 1];
    radiuses[2 * nrPoints - 1] = radiuses[2 * nrPoints - 2];
    return radiuses;
  }





  public Curve[] getRadiusCircles(Mesh panelMesh, int nrPoints, double segmentLength){
    Curve[] radiusCircles = new Curve[2 * (nrPoints)];
    Rhino.Geometry.Collections.MeshVertexList sidePoints = panelMesh.Vertices;

    // draw circles on first side
    for (int i = 1; i < nrPoints - 1; i++){ // skip first and last points
      // get vectors to neighbour points and angle between them
      Vector3d directionBack = Point3d.Subtract(sidePoints[i - 1], sidePoints[i]);
      Vector3d directionForward = Point3d.Subtract(sidePoints[i + 1], sidePoints[i]);
      double angleAtPoint = Vector3d.VectorAngle(directionBack, directionForward);
      Vector3d directionCircle = Vector3d.Add(directionBack, directionForward);
      directionCircle.Unitize();
      Vector3d circleNormal = Vector3d.CrossProduct(directionBack, directionForward);
      double circleRadius = 0.5 * segmentLength / Math.Sin(0.5 * (Math.PI - angleAtPoint));
      // midPoint
      Point3d circleCenter = Point3d.Add(sidePoints[i], Vector3d.Multiply(directionCircle, circleRadius));
      Circle radiusCircle = new Circle(new Plane(circleCenter, circleNormal), circleRadius);
      radiusCircles[i] = radiusCircle.ToNurbsCurve();
    }
    // for first and last point, use value calculated from neighbour
    radiusCircles[0] = radiusCircles[1];
    radiusCircles[nrPoints - 1] = radiusCircles[nrPoints - 2];

    // todo: add circles on other side
    for (int i = 1; i < nrPoints - 1; i++){ // skip first and last points
      // get vectors to neighbour points and angle between them
      Vector3d directionBack = Point3d.Subtract(sidePoints[nrPoints + i - 1], sidePoints[nrPoints + i]);
      Vector3d directionForward = Point3d.Subtract(sidePoints[nrPoints + i + 1], sidePoints[nrPoints + i]);
      double angleAtPoint = Vector3d.VectorAngle(directionBack, directionForward);
      Vector3d directionCircle = Vector3d.Add(directionBack, directionForward);
      directionCircle.Unitize();
      Vector3d circleNormal = Vector3d.CrossProduct(directionBack, directionForward);
      double circleRadius = 0.5 * segmentLength / Math.Sin(0.5 * (Math.PI - angleAtPoint));
      // midPoint
      Point3d circleCenter = Point3d.Add(sidePoints[nrPoints + i], Vector3d.Multiply(directionCircle, circleRadius));
      Circle radiusCircle = new Circle(new Plane(circleCenter, circleNormal), circleRadius);
      radiusCircles[i + nrPoints] = radiusCircle.ToNurbsCurve();
    }
    // for first and last point, use value calculated from neighbour
    radiusCircles[nrPoints] = radiusCircles[1];
    radiusCircles[2 * nrPoints - 1] = radiusCircles[nrPoints - 2];

    return radiusCircles;
  }
# ---------- end c_radius_calculation ----------
absolute_minimum_radius = Slider(0.9, range=0..1)
safe_radius = Slider(1.8, range=0..20)
gradient = Gradient(
    LowerLimit=absolute_minimum_radius,
    UpperLimit=safe_radius,
    Parameter=c_radius_calculation.curvatureRadius,
    stops=[0: RGB(255, 0, 0), 0.497: RGB(255, 255, 0), 1: RGB(0, 128, 0)])
demesh_2 = DeconstructMesh(Mesh=simplify(graft(panels)))  # -> Vertices, Faces, Colours, Normals
conmesh = ConstructMesh(Vertices=demesh_2.Vertices, Faces=demesh_2.Faces, Colours=gradient)

panel_6 = Panel(analysisperiod.readMe)

# ----
# curvature compensated offset
number_slider_30 = Slider(0.005, range=0..0.01)
# DATA
c_compensate_deviation_offset = CSharpScript(
    panel=simplify(graft(panels)),
    surfaceDeviation=simplify(c_surface_distance.surfaceDistances),
    baseSurface=offset_3,
    additionalOffset=number_slider_30)  # -> out, A; inputs panel: Mesh, surfaceDeviation: list of Double, baseSurface: Surface, additionalOffset: Double
# ---------- c_compensate_deviation_offset: C# ----------
    Rhino.Geometry.Mesh offsetMesh = new Rhino.Geometry.Mesh();

    // add vertices
    for(int i = 0; i < panel.Vertices.Count; i++){
      Point3d oldPoint = panel.Vertices[i];
      double u;
      double v;
      baseSurface.ClosestPoint(oldPoint, out u, out v);
      Vector3d sNormal = baseSurface.NormalAt(u, v);
      sNormal = Vector3d.Multiply(sNormal, surfaceDeviation[i]+additionalOffset);
      Point3d newPoint = Point3d.Add(oldPoint, sNormal);
      offsetMesh.Vertices.Add(newPoint);
    }
    foreach(MeshFace f in panel.Faces){
      offsetMesh.Faces.AddFace(f);
    }
    A = offsetMesh;
# ---------- c_compensate_deviation_offset: C# additional code ----------
  public Rhino.Geometry.Mesh createTriangleMesh(int startPointIndex, int pointsPerPanelSide, Mesh inputMesh, bool direction){ // true is original direction, false has flipped diagonals
    int originalPointsPerSide = inputMesh.Vertices.Count / 2;

    Rhino.Geometry.Mesh generatedMesh = new Rhino.Geometry.Mesh();

    // get appropriate vertices from old mesh
    for(int i = 0; i < pointsPerPanelSide; i++){
      generatedMesh.Vertices.Add(inputMesh.Vertices[startPointIndex + i]);
    }

    for(int i = 0; i < pointsPerPanelSide; i++){
      generatedMesh.Vertices.Add(inputMesh.Vertices[originalPointsPerSide + startPointIndex + i]);
    }

    // add faces
    if(direction){
      for(int i = 0; i < pointsPerPanelSide - 1; i++){
        generatedMesh.Faces.AddFace(i, i + 1, i + pointsPerPanelSide);
        generatedMesh.Faces.AddFace(i + 1, i + pointsPerPanelSide + 1, i + pointsPerPanelSide);
      }
    }else{
      for(int i = 0; i < pointsPerPanelSide - 1; i++){
        generatedMesh.Faces.AddFace(i, i + pointsPerPanelSide + 1, i + pointsPerPanelSide);
        generatedMesh.Faces.AddFace(i, i + 1, i + pointsPerPanelSide + 1);
      }
    }

    // process and return mesh
    generatedMesh.Normals.ComputeNormals();
    generatedMesh.Compact();
    return generatedMesh;

  }
# ---------- end c_compensate_deviation_offset ----------

# ----
# curvature display - strips
path_mapper = PathMapper(radiuses, source="{a;b}", target="{a}(b)")
absolute_minimum_radius_2 = Slider(0.9, range=0..1)
safe_radius_2 = Slider(1.8, range=0..20)
gradient_2 = Gradient(
    LowerLimit=absolute_minimum_radius_2,
    UpperLimit=safe_radius_2,
    Parameter=path_mapper,
    stops=[0: RGB(255, 0, 0), 0.497: RGB(255, 255, 0), 1: RGB(0, 128, 0)])
demesh_3 = DeconstructMesh(Mesh=strip_mesh)  # -> Vertices, Faces, Colours, Normals
conmesh_2 = ConstructMesh(Vertices=demesh_3.Vertices, Faces=demesh_3.Faces, Colours=gradient_2)

# ----
# panel display
number_slider_31 = Slider(93, range=0..255)
number_slider_32 = Slider(78, range=0..255)
rgb = ColourRGB(Alpha=255, Red=number_slider_31, Green=number_slider_31, Blue=Slider(235, range=0..255))
rgb_2 = ColourRGB(Alpha=255, Red=number_slider_32, Green=number_slider_32, Blue=Slider(199, range=0..255))
demesh_4 = DeconstructMesh(Mesh=odd_panels)  # -> Vertices, Faces, Colours, Normals
demesh_5 = DeconstructMesh(Mesh=even_panels)  # -> Vertices, Faces, Colours, Normals
conmesh_3 = ConstructMesh(Vertices=demesh_5.Vertices, Faces=demesh_5.Faces, Colours=rgb)
conmesh_4 = ConstructMesh(Vertices=demesh_4.Vertices, Faces=demesh_4.Faces, Colours=rgb_2)
mesh_3 = Mesh([conmesh_3, conmesh_4])
medges_2 = MeshEdges(Mesh=mesh_3)  # -> NakedEdges, InteriorEdges, NonManifoldEdges

# ----
# flatness display
number_slider_33 = Slider(0.9, range=0..1)
gradient_3 = Gradient(
    LowerLimit=Slider(1, range=0..1),
    UpperLimit=number_slider_33,
    Parameter=c_orientation_consistency.minimalDotProduct,
    stops=[0: RGB(0, 128, 0), 0.5: RGB(255, 255, 0), 1: RGB(255, 0, 0)])
demesh_6 = DeconstructMesh(Mesh=panels)  # -> Vertices, Faces, Colours, Normals
conmesh_5 = ConstructMesh(Vertices=demesh_6.Vertices, Faces=demesh_6.Faces, Colours=graft(gradient_3))

panel_7 = Panel(selectskymtx.selectedSkyMtx)

# ----
# surface distance display
distance_cm = Slider(0.05, range=0..0.1)
gradient_4 = Gradient(
    LowerLimit=expr("-x", distance_cm),
    UpperLimit=distance_cm,
    Parameter=simplify(c_surface_distance.surfaceDistances),
    stops=[0: RGB(9, 219, 174), 0: RGB(47, 0, 255), 0.297: RGB(0, 204, 255), 0.502: RGB(255, 255, 255), 0.699: RGB(255, 132, 0), 1: RGB(255, 0, 0)])
demesh_7 = DeconstructMesh(Mesh=simplify(panels))  # -> Vertices, Faces, Colours, Normals
conmesh_6 = ConstructMesh(Vertices=demesh_7.Vertices, Faces=demesh_7.Faces, Colours=gradient_4)

geo_12 = Geometry()

# ----
# surface grid display
number_slider_34 = Slider(32, range=0..100)  # disabled
sdivide = DivideSurface(Surface=offset_3, UCount=number_slider_34, VCount=number_slider_34)  # -> simplify(Points), Normals, Parameters; disabled
flip_2 = FlipMatrix(Data=sdivide.Points)  # disabled
intcrv = Interpolate(Vertices=sdivide.Points, Degree=3, Periodic=False, KnotStyle=1)  # -> Curve, Length, Domain; disabled
intcrv_2 = Interpolate(Vertices=flip_2, Degree=3, Periodic=False, KnotStyle=1)  # -> Curve, Length, Domain; disabled

# ----
# panel number display
demesh_8 = DeconstructMesh(Mesh=panels)  # -> Vertices, Faces, Colours, Normals
avr = Average(Input=simplify(demesh_8.Vertices))  # -> flatten(ArithmeticMean)
lng_2 = ListLength(List=flatten(panels))
series_2 = Series(Start=0, Step=1, Count=lng_2)
number_slider_35 = Slider(1, range=0..1)
int_2 = Integer(series_2)
frgb = ColourRGBF(Alpha=1, Red=number_slider_35, Green=number_slider_35, Blue=number_slider_35)
tag = TextTag3D(Location=avr, Text=int_2, Size=Slider(0.22, range=0..1), Colour=frgb, Justification=Slider(5, range=0..10))

# ----
# inspect curvature circles
number_slider_36 = Slider(6, range=0..16)
# VISUALISATION
geo_13 = Geometry(radius_circles)
path = ConstructPath(Indices=[number_slider_36, Slider(29, range=0..100)])
branch = TreeBranch(Tree=geo_13, Path=path, MaintainPaths=True)

geo_14 = Geometry([radiationanalysis.radiationMesh, radiationanalysis.radiationLegend])

# ----
# colour display chooser
# 0 curvature strips - extended
# 1 curvature strips
# 2 curvature panels
# 3 panels
# 4 orientation consistency
# 5 Ladybug radiation
# 6 surface distance at panel mid line
# 7 offset faces
display = Slider(5, range=0..7)
filter = StreamFilter(
    Gate=display,
    Stream0=mjoin,
    Stream1=conmesh_2,
    Stream2=conmesh,
    Stream3=mesh_3,
    Stream4=conmesh_5,
    Stream5=geo_14,
    Stream6=conmesh_6,
    Stream7=c_compensate_deviation_offset.A)
coloured_mesh = Mesh(filter)

panel_8 = Panel(c_surface_distance.surfaceDistances)
Z = UnitZ(Factor=Slider(0.01, range=0..0.01))
crv_4 = Curve(medges_2.NakedEdges)
move_2 = Move(Geometry=crv_4, Motion=Z)  # -> Geometry, Transform
geo_15 = Geometry(move_2.Geometry)

# ----
# normals
demesh_9 = DeconstructMesh(Mesh=coloured_mesh)  # -> Vertices, Faces, Colours, Normals
# OUTPUT
vdis_3 = VectorDisplay(Anchor=demesh_9.Vertices, Vector=demesh_9.Normals)

# ----
# file path
panel_9 = Panel("_day_")  # disabled
panel_10 = Panel("_month_")  # disabled
panel_11 = Panel("_hour_")  # disabled
month = Integer(number_slider_26)  # disabled
day = Integer(number_slider_24)  # disabled
hour = Integer(number_slider_22)  # disabled
panel_12 = Panel("orientation_")  # disabled
panel_13 = Panel("curvature_")  # disabled
panel_14 = Panel("geometry_")  # disabled
angle_2 = Integer(angle)
join_date_string = TextJoin(Text=[panel_10, month, panel_9, day, panel_11, hour])  # disabled
filter_2 = StreamFilter(Gate=display, Stream0=panel_13, Stream1=panel_14, Stream2=panel_12, Stream3="surfaceDistance_")  # disabled

# ----
# screenshot export
panel_15 = Panel(".png")
join_2 = TextJoin(Text=["C:/test/angle_", angle_2, panel_15])
c_screenshot = CSharpScript(pngPath=join_2)  # -> out, A; inputs pngPath: String
# ---------- c_screenshot: C# ----------
    // get viewport
    Rhino.Display.RhinoView myView = Rhino.RhinoDoc.ActiveDoc.Views.ActiveView;

    // create bitmap object
    Bitmap myBitmap = myView.CaptureToBitmap();

    // write bitmap to file
    myBitmap.Save(pngPath);
# ---------- end c_screenshot ----------

# ----
# file export
panel_16 = Panel(".txt")
join_3 = TextJoin(Text=["C:/test/angle_", panel_16])
c_script = CSharpScript(
    totalRadiation=radiationanalysis.totalRadiation,
    totalSurfaceArea=ma_2.Result,
    minDotProducts=flatten(c_orientation_consistency.minimalDotProduct),
    radiationPerTriangle=radiationanalysis.radiationResult,
    curvatureAtPoint=c_radius_calculation.curvatureRadius,
    surfaceDeviation=simplify(c_surface_distance.surfaceDistances),
    fileName=join_3,
    pngPath=join_2)  # -> out, A; inputs totalRadiation: Double, totalSurfaceArea: Double, minDotProducts: list of Double, radiationPerTriangle: tree of Double, curvatureAtPoint: tree of Double, surfaceDeviation: tree of Double, fileName: String, pngPath: String
# ---------- c_script: C# ----------
    //
    // write text file
    //

    List<string> allLines = new List<string>();

    allLines.Add("total_radiation_(kWh per year)");
    allLines.Add(totalRadiation.ToString());
    allLines.Add("total surface area (square meter)");
    allLines.Add(totalSurfaceArea.ToString());

    // write a line with all dot products
    string dotProducts = "";
    foreach(double minProd in minDotProducts){
      dotProducts += minProd + " ";
    }

    allLines.Add("dot product deviation");
    allLines.Add(dotProducts);

    allLines.Add("radiation per triangle (kWh/m² per year, one panel per line)");
    int trianglesPerPanel = radiationPerTriangle.Branches[0].Count;
    for(int i = 0; i < radiationPerTriangle.BranchCount; i++){
      string radPerTriangle = "";
      for (int t = 0; t < trianglesPerPanel; t++){
        radPerTriangle += radiationPerTriangle.Branches[i][t].ToString() + " ";
      }
      allLines.Add(radPerTriangle);
    }

    allLines.Add("curvature radiuses, one panel per line");
    int pointsPerPanel = curvatureAtPoint.Branches[0].Count;
    for(int i = 0; i < curvatureAtPoint.BranchCount; i++){
      string radiusList = "";
      for (int t = 0; t < pointsPerPanel; t++){
        radiusList += curvatureAtPoint.Branches[i][t].ToString() + " ";
      }
      allLines.Add(radiusList);
    }

    allLines.Add("surface distance, one panel per line");
    int surfaceDistanceNr = surfaceDeviation.Branches[0].Count;
    for(int i = 0; i < surfaceDeviation.BranchCount; i++){
      string distanceList = "";
      for (int t = 0; t < surfaceDistanceNr; t++){
        distanceList += String.Format("{0:F20}", surfaceDeviation.Branches[i][t]) + " ";
      }
      allLines.Add(distanceList);
    }

    System.IO.File.WriteAllLines(fileName, allLines);

    //
    // save screenshot
    //

    // get viewport, create bitmap object, save to file
    Rhino.Display.RhinoView myView = Rhino.RhinoDoc.ActiveDoc.Views.ActiveView;
    Bitmap myBitmap = myView.CaptureToBitmap();
    myBitmap.Save(pngPath);
# ---------- end c_script ----------

# ----
# geometry bake
geo_16 = Geometry(filter)  # disabled
panel_17 = Panel("angle_")  # disabled
bake = BooleanToggle(True)  # disabled
join_4 = TextJoin(Text=[filter_2, panel_17, angle_2])  # disabled
c_script_2 = CSharpScript(obj=geo_16, layer=join_4, activate=bake)  # -> out; inputs obj: GeometryBase, name: String, layer: String, color: Color, pWidth: Double, wires: Int32, activate: Boolean; disabled
# ---------- c_script_2: C# ----------
    //Inserts geometry into the Rhino document, with custom attributes
    //Written by Giulio Piacentino edit by Florian Frank (for GH 0.9.0014)
    //Version written 2010 11 21 - for Grasshopper 0.8.002

    if (activate)
    {
      if(obj == null)
      {
        Print("No object to bake");
        return;
      }

      //Make new attribute to set name
      Rhino.DocObjects.ObjectAttributes att = new Rhino.DocObjects.ObjectAttributes();

      //Set object name
      if(!string.IsNullOrEmpty(name))
      {
        att.Name = name;
      }

      //Set color
      if(!color.IsEmpty)
      {
        att.ColorSource = Rhino.DocObjects.ObjectColorSource.ColorFromObject; //Make the color type "by object"
        att.ObjectColor = color;

        att.PlotColorSource = Rhino.DocObjects.ObjectPlotColorSource.PlotColorFromObject; //Make the plot color type "by object"
        att.PlotColor = color;
      }

      //Set layer
      if(!string.IsNullOrEmpty(layer) && Rhino.DocObjects.Layer.IsValidName(layer))
      {
        //Get the current layer index
        Rhino.DocObjects.Tables.LayerTable layerTable = doc.Layers;
        int layerIndex = layerTable.Find(layer, true);

        if(layerIndex < 0) //This layer does not exist, we add it
        {
          Rhino.DocObjects.Layer onlayer = new Rhino.DocObjects.Layer(); //Make a new layer
          onlayer.Name = layer;

          layerIndex = layerTable.Add(onlayer); //Add the layer to the layer table
          if (layerIndex > -1) //We manged to add layer!
          {
            att.LayerIndex = layerIndex;
            Print("Added new layer to the document at position " + layerIndex + " named " + layer + ". ");
          } else
            Print("Layer did not add. Try cleaning up your layers."); //This never happened to me.
        }
        else
          att.LayerIndex = layerIndex; //We simply add to the existing layer
      }


      //Set plotweight
      if(pWidth > 0)
      {
        att.PlotWeightSource = Rhino.DocObjects.ObjectPlotWeightSource.PlotWeightFromObject;
        att.PlotWeight = pWidth;
      }


      //Set material
      bool materialByName = !string.IsNullOrEmpty(material as string);
      Rhino.Display.DisplayMaterial inMaterial = material as Rhino.Display.DisplayMaterial;
      if(material is Color)
      {
        inMaterial = new Rhino.Display.DisplayMaterial((Color) material);
      }
      if(material != null && inMaterial == null && !materialByName)
      {
        if(!(material is string))
        {
          try //We also resort to try with IConvertible
          {
            inMaterial = (Rhino.Display.DisplayMaterial) Convert.ChangeType(material, typeof(Rhino.Display.DisplayMaterial));
          }
          catch(InvalidCastException)
          {
          }
        }
      }
      if(inMaterial != null || materialByName)
      {
        string matName;

        if(!materialByName)
        {
          matName = string.Format("A:{0}-D:{1}-E:{2}-S:{3},{4}-T:{5}",
            Format(inMaterial.Ambient),
            Format(inMaterial.Diffuse),
            Format(inMaterial.Emission),
            Format(inMaterial.Specular),
            inMaterial.Shine.ToString(),
            inMaterial.Transparency.ToString()
            );
        }
        else
        {
          matName = (string) material;
        }

        int materialIndex = doc.Materials.Find(matName, true);
        if(materialIndex < 0 && !materialByName) //Material does not exist and we have its specs
        {
          materialIndex = doc.Materials.Add();
          if(materialIndex > -1)
          {
            Print("Added new material at position " + materialIndex + " named \"" + matName + "\". ");
            Rhino.DocObjects.Material m = doc.Materials[materialIndex];
            m.Name = matName;
            m.AmbientColor = inMaterial.Ambient;
            m.DiffuseColor = inMaterial.Diffuse;
            m.EmissionColor = inMaterial.Emission;
            //m.ReflectionColor = no equivalent
            m.SpecularColor = inMaterial.Specular;
            m.Shine = inMaterial.Shine;
            m.Transparency = inMaterial.Transparency;
            //m.TransparentColor = no equivalent
            m.CommitChanges();

            att.MaterialSource = Rhino.DocObjects.ObjectMaterialSource.MaterialFromObject;
            att.MaterialIndex = materialIndex;
          }
          else
            Print("Material did not add. Try cleaning up your materials."); //This never happened to me.
        }
        else if(materialIndex < 0 && materialByName) //Material does not exist and we do not have its specs. We do nothing
        {
          Print("Warning: material name not found. I cannot set the source to this material name. Add a material with name: " + matName);
        }
        else
        {
          //If this material exists, we do not replace it!
          att.MaterialSource = Rhino.DocObjects.ObjectMaterialSource.MaterialFromObject;
          att.MaterialIndex = materialIndex;
        }
      }


      //Set wire density
      if(wires == -1 || wires > 0)
      {
        att.WireDensity = wires;
      }


      //Bake to the right type of object
      switch(obj.ObjectType)
      {
        case Rhino.DocObjects.ObjectType.Brep:
          doc.Objects.AddBrep(obj as Brep, att);
          break;
        case Rhino.DocObjects.ObjectType.Curve:
          doc.Objects.AddCurve(obj as Curve, att);
          break;
        case Rhino.DocObjects.ObjectType.Point:
          doc.Objects.AddPoint((obj as Rhino.Geometry.Point).Location, att);
          break;
        case Rhino.DocObjects.ObjectType.Surface:
          doc.Objects.AddSurface(obj as Surface, att);
          break;
        case Rhino.DocObjects.ObjectType.Mesh:
          doc.Objects.AddMesh(obj as Mesh, att);
          break;
        case Rhino.DocObjects.ObjectType.Extrusion:
          typeof(Rhino.DocObjects.Tables.ObjectTable).InvokeMember("AddExtrusion", BindingFlags.Instance | BindingFlags.InvokeMethod, null, doc.Objects, new object[]{obj, att});
          break;
        case Rhino.DocObjects.ObjectType.PointSet:
          doc.Objects.AddPointCloud(obj as Rhino.Geometry.PointCloud, att); //This is a speculative entry
          break;
        default:
          Print("The script does not know how to handle this type of geometry: " + obj.GetType().FullName);
          break;
      }
      Print("Added " + obj.GetType().Name);

    }
    else
    {
      Print("Inactive");
    }
# ---------- c_script_2: C# additional code ----------
  static string Format(Color c)
  {
    return (new System.Text.StringBuilder("A")).Append(c.A.ToString()).Append("R").Append(c.R.ToString()).Append("G")
      .Append(c.G.ToString()).Append("B").Append(c.B.ToString()).ToString();
  }
# ---------- end c_script_2 ----------

# ----
# Make sure that this is connected to to 'itteration count'
iterations_count = Integer(hoopsnake.IterationsCounter)

larger = LargerThan(FirstNumber=int, SecondNumber=hs.Feedback)  # -> LargerThan, OrEqualTo
expression_5 = Expression(x=hs.Feedback, Expression="x+1")
hs = HoopSnake(
    StartingData="0",
    Data=expression_5,
    TerminationCondition=larger.OrEqualTo,
    Hoopsnake_Data_autoUpdate=False,
    Hoopsnake_Data_dataLimit=2147483647,
    Hoopsnake_Data_delay=0,
    Hoopsnake_Data_resetCounter=True,
    Hoopsnake_Data_updateView=True)  # -> Feedback, CumulativeFeedback, LoopsCounter, IterationsCounter
c_script_3 = CSharpScript(
    iterator=hs.Feedback,
    p0min=number_slider_4,
    p0max=number_slider_5,
    p0nr=expression,
    p1min=number_slider,
    p1max=number_slider_6,
    p1nr=expression_2,
    p2min=number_slider_2,
    p2max=number_slider_3,
    p2nr=expression_3)  # -> out, panelLength, panelWidth, angle; inputs iterator: Int32, p0min: Double, p0max: Double, p0nr: Int32, p1min: Double, p1max: Double, p1nr: Int32, p2min: Double, p2max: Double, p2nr: Int32
# ---------- c_script_3: C# ----------
    int phaseP0 = (p0nr > 0) ? iterator % p0nr : 0;
    int phaseP1 = (p0nr > 0) ? (iterator / p0nr) % p1nr : 0;
    int phaseP2 = (iterator / (p0nr * p1nr)) % p2nr;
    double range0 = p0max - p0min;
    double range1 = p1max - p1min;
    double range2 = p2max - p2min;
    double step0 = (p0nr > 1) ? range0 / (p0nr - 1) : 0; // prevent division by 0 for parameter ranges of length 1
    double step1 = (p1nr > 1) ? range1 / (p1nr - 1) : 0;
    double step2 = (p2nr > 1) ? range2 / (p2nr - 1) : 0;

    panelLength = p0min + phaseP0 * step0;
    panelWidth = p1min + phaseP1 * step1;
    angle = p2min + phaseP2 * step2;
# ---------- end c_script_3 ----------
panel_18 = Panel(hs.Feedback)
panel_19 = Panel(c_script_3.panelLength)
panel_20 = Panel(c_script_3.angle)
panel_21 = Panel(c_script_3.panelWidth)
join_5 = TextJoin(Text=["_panelLength_", c_script_3.panelLength, "_panelWidth_", c_script_3.panelWidth])

panel_dimension_text = Text(join_5)

# ----
# Make sure second number is connected to maxcomb
smaller_than = SmallerThan(FirstNumber=addition_3, SecondNumber=combination_maker_v2.maxcomb)  # -> SmallerThan, OrEqualTo
addition_3 = Addition(A=hoopsnake.IterationsCounter, B=1)
hoopsnake = HoopSnake(
    StartingData=number_slider_8,
    Data=addition_3,
    TerminationCondition=smaller_than.SmallerThan,
    Hoopsnake_Data_autoUpdate=False,
    Hoopsnake_Data_dataLimit=2147483647,
    Hoopsnake_Data_delay=0,
    Hoopsnake_Data_resetCounter=True,
    Hoopsnake_Data_updateView=True)  # -> Feedback, CumulativeFeedback, LoopsCounter, IterationsCounter
# Run the E+ Simulation
viper_diva_thermal_analysis_for_gh = ViperDIVAThermalAnalysisForGH(
    ProjectName=hoopsnake.Feedback,
    People_m2=0.1,
    Lights_W_m2=11.74,
    Equipment_W_m2=4,
    HeatingSetPoint_deg_C=heating_setpoint,
    CoolingSetPoint_deg_C=cooling_setpoint,
    HeatingCOP=heating_cop,
    CoolingCOP=3,
    Infiltration=0.5,
    FreshAir=0.00944,
    LightingControl_lux=_300,
    ZoneBreps=[facade.Zone_2, all_adiabatic.Zone_2],
    Window=window_unit.Window_2,
    Shade=shade.Shade_2,
    WriteOnly=boolean_toggle_2,
    RunSimulation=boolean_toggle,
    ProjectName_2=hoopsnake.Feedback,
    People_m2_2=0.1,
    Lights_W_m2_2=11.74,
    Equipment_W_m2_2=4,
    HeatingSetPoint_deg_C_2=heating_setpoint,
    CoolingSetPoint_deg_C_2=cooling_setpoint,
    HeatingCOP_2=heating_cop,
    CoolingCOP_2=3,
    Infiltration_2=0.5,
    FreshAir_2=0.00944,
    LightingControl_lux_2=_300,
    ZoneBreps_2=[facade.Zone_2, all_adiabatic.Zone_2],
    Window_2=window_unit.Window_2,
    Shade_2=shade.Shade_2,
    WriteOnly_2=boolean_toggle_2,
    RunSimulation_2=boolean_toggle,
    CustomDates=False,
    Location=16,
    Occupancy=0,
    OutputStates=[True, True, False, False, True, True, False, False, False, False, False, False, False, False, False, False, False, False, False],
    ReportingPeriod=0,
    RunPeriod=0,
    ShadowFreq=30,
    ShadowOverlap=15000,
    SolarDist=2,
    Timestep=2)  # -> OutputMessage, MetricHeatingE, flatten(MetricCoolingE), flatten(MetricElecLights), MetricElecEquip, OutputMessage_2, MetricHeatingE_2, flatten(MetricCoolingE_2), flatten(MetricElecLights_2), MetricElecEquip_2
mass_addition = MassAddition(Input=viper_diva_thermal_analysis_for_gh.MetricCoolingE_2)  # -> Result, PartialResults
panel_22 = Panel(viper_diva_thermal_analysis_for_gh.MetricHeatingE_2)
panel_23 = Panel(viper_diva_thermal_analysis_for_gh.OutputMessage_2)
python_script = PythonScript(
    loopNo=hoopsnake.IterationsCounter,
    Heating=viper_diva_thermal_analysis_for_gh.MetricHeatingE_2,
    Cooling=viper_diva_thermal_analysis_for_gh.MetricCoolingE_2,
    Lighting=viper_diva_thermal_analysis_for_gh.MetricElecLights_2,
    Equip=viper_diva_thermal_analysis_for_gh.MetricElecEquip_2)  # -> out, a; inputs Heating: list, Cooling: list, Lighting: list, Equip: list
# ---------- python_script: Python ----------
#13.10.2015
#Prageeth Jayathissa
#Python script to read DIVA inputs and produce a CSV file

import sys, os
import datetime

# possible paths to save data:
destination_PJ = 'C:/Users/User/Documents/01_SuAT/01_HiLo/04_Facade/Rhino_Simulations'
destination_J = 'C:/Users/Assistenz/Documents/MT_Jeremias/Simulation_Data'

# assign destination:
destination = destination_J

#Create empty .csv files
if loopNo==0:
    with open(os.path.join(destination,'heating.csv'),'w') as f:
        pass
    with open(os.path.join(destination,'cooling.csv'),'w') as f:
        pass
    with open(os.path.join(destination,'lighting.csv'),'w') as f:
        pass
    with open(os.path.join(destination,'time.csv'),'w') as f:
        pass

#Write to csv files

#Each itteration will be stored in a row of a csv file
writestring=''

with open(os.path.join(destination,'heating.csv'),'a') as f:
    for ii in Heating:
        #Create row in csv
        writestring=writestring+str(ii)+','
    #remove the last comma
    writestring=writestring[:-1]
    #add a new line and write
    f.write(writestring+'\n')
    f.close()

writestring=''
with open(os.path.join(destination,'cooling.csv'),'a') as f:
    for ii in Cooling:

        writestring=writestring+str(ii)+','
    #print writestring
    writestring=writestring[:-1]
    f.write(writestring+'\n')
    f.close()
    
writestring=''
with open(os.path.join(destination,'lighting.csv'),'a') as f:
    for ii in Lighting:

        writestring=writestring+str(ii)+','
    #print writestring
    writestring=writestring[:-1]
    f.write(writestring+'\n')
    f.close()
    
with open(os.path.join(destination,'time.csv'),'a') as f:
    f.write(str(datetime.datetime.utcnow())+'\n')


#totalHeat=sum(Heating)
#totalCool=sum(Cool)
#totalLights=sum(Lights)
#totalEquip=sum(Equip)
# ---------- end python_script ----------
mass_addition_2 = MassAddition(Input=viper_diva_thermal_analysis_for_gh.MetricElecLights_2)  # -> Result, PartialResults
panel_24 = Panel(viper_diva_thermal_analysis_for_gh.MetricElecLights_2)
panel_25 = Panel(mass_addition.Result)
panel_26 = Panel(python_script.out)
panel_27 = Panel(mass_addition_2.Result)
