# Grasshopper definition 140325_GrasshopperModule_001_AT.gh (Grasshopper 0.9.70)

grid_angle = Slider(0, range=0..90)
panel_spacing = Slider(500, range=0..1000)
frame_size_y = Slider(1500, range=0..5000)
frame_size_x = Slider(4500, range=0..5000)
panel_angle_1 = Slider(0, range=-90..90)
panel_size = Slider(400, range=0..1000)
panel_angle_2 = Slider(0, range=-90..90)
panel_angle_3 = Slider(0, range=0..90)
actuator_length = Slider(150, range=0..200)
number_slider = Slider(10, range=0..10)
multiplication = Multiplication(A=panel_spacing, B=number_slider)
pt = ConstructPoint(XCoordinate=expr("-x/2", multiplication), YCoordinate=0, ZCoordinate=expr("-x/2", multiplication))
rad = Radians(Degrees=grid_angle)
xz = XZPlane(Origin=pt)
xz_2 = XZPlane(Origin=Point(0, 0, 0))
pt_2 = ConstructPoint(XCoordinate=expr("-x/2", frame_size_x), YCoordinate=0, ZCoordinate=expr("-x/2", frame_size_y))
rotate = Rotate(Geometry=xz, Angle=rad, Plane=xz_2)  # -> Geometry, Transform
xz_3 = XZPlane(Origin=pt_2)
rectangle = Rectangle(Plane=xz_3, XSize=frame_size_x, YSize=frame_size_y, Radius=0)  # -> Rectangle, Length
recgrid = Rectangular(Plane=rotate.Geometry, SizeX=panel_spacing, SizeY=panel_spacing, ExtentX=number_slider, ExtentY=number_slider)  # -> Cells, Points
incurve = PointInCurve(Point=recgrid.Points, Curve=rectangle.Rectangle)  # -> Relationship, Point
rad_2 = Radians(Degrees=panel_angle_1)
rad_3 = Radians(Degrees=panel_angle_2)
dispatch = Dispatch(List=recgrid.Points, DispatchPattern=incurve.Relationship)  # -> simplify(ListA), ListB
flip = FlipMatrix(Data=recgrid.Points)
xz_4 = XZPlane(Origin=dispatch.ListA)
xy = XYPlane(Origin=dispatch.ListA)
yz = YZPlane(Origin=dispatch.ListA)
pline = PolyLine(Vertices=flip, Closed=False)  # -> simplify(Polyline)
pline_2 = PolyLine(Vertices=recgrid.Points, Closed=False)  # -> simplify(Polyline)
rotate_2 = Rotate(Geometry=xz_4, Angle=rad_2, Plane=xy)  # -> Geometry, Transform
ccx = CurveCurve(CurveA=pline, CurveB=rectangle.Rectangle)  # -> Points, ParamsA, ParamsB
ccx_2 = CurveCurve(CurveA=pline_2, CurveB=rectangle.Rectangle)  # -> Points, ParamsA, ParamsB
rotate_3 = Rotate(Geometry=rotate_2.Geometry, Angle=rad_3, Plane=yz)  # -> Geometry, Transform
pline_3 = PolyLine(Vertices=ccx_2.Points, Closed=False)
pline_4 = PolyLine(Vertices=ccx.Points, Closed=False)
clean = CleanTree(Tree=dispatch.ListA, CleanInvalid=True, CleanEmpty=True)  # -> flatten(Tree)
partition = PartitionList(List=clean, Size=3)  # -> simplify(Chunks)
deplane = DeconstructPlane(Plane=rotate_3.Geometry)  # -> Origin, XAxis, YAxis, ZAxis
xz_5 = XZPlane(Origin=partition)
pdecon = Deconstruct(Point=deplane.Origin)  # -> XComponent, YComponent, ZComponent
pt_3 = Point(Point(0, 0, 0))
addition = Addition(A=pdecon.YComponent, B=actuator_length)
xz_6 = XZPlane(Origin=pt_3)
rotate_4 = Rotate(Geometry=xz_5, Angle=rad, Plane=xz_5)  # -> Geometry, Transform
pt_4 = ConstructPoint(XCoordinate=pdecon.XComponent, YCoordinate=addition, ZCoordinate=pdecon.ZComponent)
brep = Brep([<brep referenced from the Rhino model> x6])
vec2pt = Vector2Pt(PointA=deplane.Origin, PointB=pt_4, Unitize=False)  # -> Vector, Length
lng = ListLength(List=brep)
flatten = FlattenTree(Tree=rotate_4.Geometry, Path="{0}")
move = Move(Geometry=rotate_3.Geometry, Motion=vec2pt.Vector)  # -> Geometry, Transform
dup = DuplicateData(Data=flatten, Number=lng, Order=True)
lng_2 = ListLength(List=flatten)
partition_2 = PartitionList(List=dup, Size=lng_2)  # -> simplify(Chunks)
orient = Orient(Geometry=graft(brep), Source=xz_6, Target=partition_2)  # -> Geometry, Transform
deplane_2 = DeconstructPlane(Plane=move.Geometry)  # -> Origin, XAxis, YAxis, ZAxis
brep_2 = Brep([<brep referenced from the Rhino model> x5])
neg = Negative(Value=deplane_2.ZAxis)
lng_3 = ListLength(List=brep_2)
flatten_2 = FlattenTree(Tree=move.Geometry, Path="{0}")
unit = UnitVector(Vector=neg)
pt_5 = Point(Point(0, 68.75, 0))
dup_2 = DuplicateData(Data=flatten_2, Number=lng_3, Order=True)
lng_4 = ListLength(List=flatten_2)
multiplication_2 = Multiplication(A=unit, B=Slider(15, range=0..100))
xz_7 = XZPlane(Origin=pt_5)
partition_3 = PartitionList(List=dup_2, Size=lng_4)  # -> simplify(Chunks)
rad_4 = Radians(Degrees=panel_angle_3)
move_2 = Move(Geometry=move.Geometry, Motion=multiplication_2)  # -> Geometry, Transform
orient_2 = Orient(Geometry=graft(brep_2), Source=xz_7, Target=partition_3)  # -> Geometry, Transform
dom = ConstructDomain(DomainStart=expr("-x/2", panel_size), DomainEnd=expr("x/2", panel_size))
rotate_5 = Rotate(Geometry=move_2.Geometry, Angle=rad_4, Plane=move_2.Geometry)  # -> Geometry, Transform
rectangle_2 = Rectangle(Plane=rotate_5.Geometry, XSize=dom, YSize=dom, Radius=0)  # -> Rectangle, Length
multiplication_3 = Multiplication(A=unit, B=Slider(4, range=0..100))
xz_8 = XZPlane(Origin=Point(0, 0, 0))
extr = Extrude(Base=rectangle_2.Rectangle, Direction=multiplication_3)
crv = Curve(<curve referenced from the Rhino model>)
vec2pt_2 = Vector2Pt(PointA=xz_8, PointB=partition, Unitize=False)  # -> Vector, Length
cap = CapHoles(Brep=extr)
move_3 = Move(Geometry=crv, Motion=vec2pt_2.Vector)  # -> Geometry, Transform
flatten_3 = FlattenTree(Tree=move_3.Geometry, Path="{0}")  # -> simplify(graft(Tree))
flatten_4 = FlattenTree(Tree=move.Geometry, Path="{0}")  # -> simplify(graft(Tree))
Y = UnitY(Factor=1)
projecta = ProjectAlong(Geometry=flatten_3, Plane=flatten_4, Direction=Y)  # -> Geometry, Transform
merge = Merge(Data1=flatten_3, Data2=projecta.Geometry)
loft = Loft(Curves=merge, Options={Adjust=False, Closed=False, LoftEnds=0, LoftSimp=0, LoftType=0, Rebuild=10, Refit=0.01})
merge_2 = Merge(
    Data1=loft,
    Data2=cap,
    Data3=orient_2.Geometry,
    Data4=orient.Geometry,
    Data5=rectangle.Rectangle,
    Data6=pline_3,
    Data7=pline_4)

system_rotation = Slider(180, range=0..360)
rad_5 = Radians(Degrees=system_rotation)
xy_2 = XYPlane(Origin=Point(0, 0, 0))
rotate_6 = Rotate(Geometry=merge_2, Angle=rad_5, Plane=xy_2)  # -> Geometry, Transform
