# Grasshopper definition Thermal_Sim_tryout.gh (Grasshopper 0.9.76)
# plug-ins: DIVA.ForGrasshopper

grid_angle = Slider(0, range=0..90)
frame_size_y = Slider(500, range=0..5000)
number_slider = Slider(10, range=0..10)
panel_spacing = Slider(500, range=0..1000)
frame_size_x = Slider(4500, range=0..5000)
multiplication = Multiplication(A=panel_spacing, B=number_slider)
pt = ConstructPoint(XCoordinate=expr("-x/2", multiplication), YCoordinate=0, ZCoordinate=expr("-x/2", multiplication))
pt_2 = ConstructPoint(XCoordinate=expr("-x/2", frame_size_x), YCoordinate=0, ZCoordinate=expr("-x/2", frame_size_y))
xz = XZPlane(Origin=pt)
xz_2 = XZPlane(Origin=Point(0, 0, 0))
rad = Radians(Degrees=grid_angle)
rotate = Rotate(Geometry=xz, Angle=rad, Plane=xz_2)  # -> Geometry, Transform
xz_3 = XZPlane(Origin=pt_2)
recgrid = Rectangular(Plane=rotate.Geometry, SizeX=panel_spacing, SizeY=panel_spacing, ExtentX=number_slider, ExtentY=number_slider)  # -> Cells, Points
rectangle = Rectangle(Plane=xz_3, XSize=frame_size_x, YSize=frame_size_y, Radius=0)  # -> Rectangle, Length
incurve = PointInCurve(Point=recgrid.Points, Curve=rectangle.Rectangle)  # -> Relationship, Point
dispatch = Dispatch(List=recgrid.Points, DispatchPattern=incurve.Relationship)  # -> simplify(ListA), ListB

vertical_rotation = Slider(0, range=-90..90)
horizontal_rotation_group3 = Slider(89, range=1..89)
toggle = BooleanToggle(True)
horizontal_rotation_band1 = Slider(1, range=1..89)
horizontal_rotation_group_2 = Slider(1, range=1..90)

xz_4 = XZPlane(Origin=dispatch.ListA)
rad_2 = Radians(Degrees=horizontal_rotation_band1)
rad_3 = Radians(Degrees=vertical_rotation)
xy = XYPlane(Origin=dispatch.ListA)
yz = YZPlane(Origin=dispatch.ListA)
rotate_2 = Rotate(Geometry=xz_4, Angle=rad_3, Plane=xy)  # -> Geometry, Transform
rotate_3 = Rotate(Geometry=rotate_2.Geometry, Angle=rad_2, Plane=yz)  # -> Geometry, Transform
actuator_length = Slider(300, range=0..300)
deplane = DeconstructPlane(Plane=rotate_3.Geometry)  # -> Origin, XAxis, YAxis, ZAxis
pdecon = Deconstruct(Point=deplane.Origin)  # -> XComponent, YComponent, ZComponent
addition = Addition(A=pdecon.YComponent, B=actuator_length)
pt_3 = ConstructPoint(XCoordinate=pdecon.XComponent, YCoordinate=addition, ZCoordinate=pdecon.ZComponent)
vec2pt = Vector2Pt(PointA=deplane.Origin, PointB=pt_3, Unitize=False)  # -> Vector, Length
move = Move(Geometry=rotate_3.Geometry, Motion=vec2pt.Vector)  # -> Geometry, Transform
deplane_2 = DeconstructPlane(Plane=move.Geometry)  # -> Origin, XAxis, YAxis, ZAxis
neg = Negative(Value=deplane_2.ZAxis)
panel_angle_3 = Slider(0, range=0..90)
unit = UnitVector(Vector=neg)
multiplication_2 = Multiplication(A=unit, B=Slider(10, range=0..100))
panel_size = Slider(400, range=0..1000)
move_2 = Move(Geometry=move.Geometry, Motion=multiplication_2)  # -> Geometry, Transform
rad_4 = Radians(Degrees=panel_angle_3)
dom = ConstructDomain(DomainStart=expr("-x/2", panel_size), DomainEnd=expr("x/2", panel_size))
rotate_4 = Rotate(Geometry=move_2.Geometry, Angle=rad_4, Plane=move_2.Geometry)  # -> Geometry, Transform
system_rotation = Slider(180, range=0..360)
rectangle_2 = Rectangle(Plane=rotate_4.Geometry, XSize=dom, YSize=dom, Radius=0)  # -> Rectangle, Length
multiplication_3 = Multiplication(A=unit, B=Slider(4, range=0..100))
extr = Extrude(Base=rectangle_2.Rectangle, Direction=multiplication_3)
rad_5 = Radians(Degrees=system_rotation)
cap = CapHoles(Brep=extr)
xy_2 = XYPlane(Origin=Point(0, 0, 0))
position_1250 = Number(1250)
rotate_5 = Rotate(Geometry=flatten(cap), Angle=rad_5, Plane=xy_2)  # -> Geometry, Transform
Z = UnitZ(Factor=position_1250)
move_3 = Move(Geometry=rotate_5.Geometry, Motion=Z)  # -> Geometry, Transform

rad_6 = Radians(Degrees=vertical_rotation)
rad_7 = Radians(Degrees=horizontal_rotation_band1)
xy_3 = XYPlane(Origin=dispatch.ListA)
xz_5 = XZPlane(Origin=dispatch.ListA)
yz_2 = YZPlane(Origin=dispatch.ListA)
rotate_6 = Rotate(Geometry=xz_5, Angle=rad_6, Plane=xy_3)  # -> Geometry, Transform
rotate_7 = Rotate(Geometry=rotate_6.Geometry, Angle=rad_7, Plane=yz_2)  # -> Geometry, Transform
deplane_3 = DeconstructPlane(Plane=rotate_7.Geometry)  # -> Origin, XAxis, YAxis, ZAxis
actuator_lenght = Number(300)
pdecon_2 = Deconstruct(Point=deplane_3.Origin)  # -> XComponent, YComponent, ZComponent
addition_2 = Addition(A=pdecon_2.YComponent, B=actuator_lenght)
pt_4 = ConstructPoint(XCoordinate=pdecon_2.XComponent, YCoordinate=addition_2, ZCoordinate=pdecon_2.ZComponent)
vec2pt_2 = Vector2Pt(PointA=deplane_3.Origin, PointB=pt_4, Unitize=False)  # -> Vector, Length
move_4 = Move(Geometry=rotate_7.Geometry, Motion=vec2pt_2.Vector)  # -> Geometry, Transform
deplane_4 = DeconstructPlane(Plane=move_4.Geometry)  # -> Origin, XAxis, YAxis, ZAxis
neg_2 = Negative(Value=deplane_4.ZAxis)
unit_2 = UnitVector(Vector=neg_2)
extrusion_height = Number(4)
number = Number(10)
multiplication_4 = Multiplication(A=unit_2, B=number)
multiplication_5 = Multiplication(A=unit_2, B=extrusion_height)
panel_size_2 = Number(400)
move_5 = Move(Geometry=move_4.Geometry, Motion=multiplication_4)  # -> Geometry, Transform
dom_2 = ConstructDomain(DomainStart=expr("-x/2", panel_size_2), DomainEnd=expr("x/2", panel_size_2))
rectangle_3 = Rectangle(Plane=move_5.Geometry, XSize=dom_2, YSize=dom_2, Radius=0)  # -> Rectangle, Length
system_rotation_2 = Number(180)
extr_2 = Extrude(Base=rectangle_3.Rectangle, Direction=multiplication_5)
rad_8 = Radians(Degrees=system_rotation_2)
xy_4 = XYPlane(Origin=Point(0, 0, 0))
cap_2 = CapHoles(Brep=extr_2)
position_750 = Number(750)
rotate_8 = Rotate(Geometry=flatten(cap_2), Angle=rad_8, Plane=xy_4)  # -> Geometry, Transform
Z_2 = UnitZ(Factor=position_750)
move_6 = Move(Geometry=rotate_8.Geometry, Motion=Z_2)  # -> Geometry, Transform

rad_9 = Radians(Degrees=vertical_rotation)
rad_10 = Radians(Degrees=horizontal_rotation_group_2)
xy_5 = XYPlane(Origin=dispatch.ListA)
xz_6 = XZPlane(Origin=dispatch.ListA)
yz_3 = YZPlane(Origin=dispatch.ListA)
rotate_9 = Rotate(Geometry=xz_6, Angle=rad_9, Plane=xy_5)  # -> Geometry, Transform
rotate_10 = Rotate(Geometry=rotate_9.Geometry, Angle=rad_10, Plane=yz_3)  # -> Geometry, Transform
deplane_5 = DeconstructPlane(Plane=rotate_10.Geometry)  # -> Origin, XAxis, YAxis, ZAxis
actuator_lenght_2 = Number(300)
pdecon_3 = Deconstruct(Point=deplane_5.Origin)  # -> XComponent, YComponent, ZComponent
addition_3 = Addition(A=pdecon_3.YComponent, B=actuator_lenght_2)
pt_5 = ConstructPoint(XCoordinate=pdecon_3.XComponent, YCoordinate=addition_3, ZCoordinate=pdecon_3.ZComponent)
vec2pt_3 = Vector2Pt(PointA=deplane_5.Origin, PointB=pt_5, Unitize=False)  # -> Vector, Length
move_7 = Move(Geometry=rotate_10.Geometry, Motion=vec2pt_3.Vector)  # -> Geometry, Transform
deplane_6 = DeconstructPlane(Plane=move_7.Geometry)  # -> Origin, XAxis, YAxis, ZAxis
neg_3 = Negative(Value=deplane_6.ZAxis)
unit_3 = UnitVector(Vector=neg_3)
extrusion_height_2 = Number(4)
number_2 = Number(10)
multiplication_6 = Multiplication(A=unit_3, B=number_2)
multiplication_7 = Multiplication(A=unit_3, B=extrusion_height_2)
panel_size_3 = Number(400)
move_8 = Move(Geometry=move_7.Geometry, Motion=multiplication_6)  # -> Geometry, Transform
dom_3 = ConstructDomain(DomainStart=expr("-x/2", panel_size_3), DomainEnd=expr("x/2", panel_size_3))
rectangle_4 = Rectangle(Plane=move_8.Geometry, XSize=dom_3, YSize=dom_3, Radius=0)  # -> Rectangle, Length
system_rotation_3 = Number(180)
extr_3 = Extrude(Base=rectangle_4.Rectangle, Direction=multiplication_7)
rad_11 = Radians(Degrees=system_rotation_3)
xy_6 = XYPlane(Origin=Point(0, 0, 0))
cap_3 = CapHoles(Brep=extr_3)
position_250 = Number(250)
rotate_11 = Rotate(Geometry=flatten(cap_3), Angle=rad_11, Plane=xy_6)  # -> Geometry, Transform
Z_3 = UnitZ(Factor=position_250)
move_9 = Move(Geometry=rotate_11.Geometry, Motion=Z_3)  # -> Geometry, Transform

rad_12 = Radians(Degrees=vertical_rotation)
rad_13 = Radians(Degrees=horizontal_rotation_group_2)
xy_7 = XYPlane(Origin=dispatch.ListA)
xz_7 = XZPlane(Origin=dispatch.ListA)
yz_4 = YZPlane(Origin=dispatch.ListA)
rotate_12 = Rotate(Geometry=xz_7, Angle=rad_12, Plane=xy_7)  # -> Geometry, Transform
rotate_13 = Rotate(Geometry=rotate_12.Geometry, Angle=rad_13, Plane=yz_4)  # -> Geometry, Transform
deplane_7 = DeconstructPlane(Plane=rotate_13.Geometry)  # -> Origin, XAxis, YAxis, ZAxis
actuator_lenght_3 = Number(300)
pdecon_4 = Deconstruct(Point=deplane_7.Origin)  # -> XComponent, YComponent, ZComponent
addition_4 = Addition(A=pdecon_4.YComponent, B=actuator_lenght_3)
pt_6 = ConstructPoint(XCoordinate=pdecon_4.XComponent, YCoordinate=addition_4, ZCoordinate=pdecon_4.ZComponent)
vec2pt_4 = Vector2Pt(PointA=deplane_7.Origin, PointB=pt_6, Unitize=False)  # -> Vector, Length
move_10 = Move(Geometry=rotate_13.Geometry, Motion=vec2pt_4.Vector)  # -> Geometry, Transform
deplane_8 = DeconstructPlane(Plane=move_10.Geometry)  # -> Origin, XAxis, YAxis, ZAxis
neg_4 = Negative(Value=deplane_8.ZAxis)
unit_4 = UnitVector(Vector=neg_4)
extrusion_height_3 = Number(4)
number_3 = Number(10)
multiplication_8 = Multiplication(A=unit_4, B=number_3)
multiplication_9 = Multiplication(A=unit_4, B=extrusion_height_3)
panel_size_4 = Number(400)
move_11 = Move(Geometry=move_10.Geometry, Motion=multiplication_8)  # -> Geometry, Transform
dom_4 = ConstructDomain(DomainStart=expr("-x/2", panel_size_4), DomainEnd=expr("x/2", panel_size_4))
rectangle_5 = Rectangle(Plane=move_11.Geometry, XSize=dom_4, YSize=dom_4, Radius=0)  # -> Rectangle, Length
system_rotation_4 = Number(180)
extr_4 = Extrude(Base=rectangle_5.Rectangle, Direction=multiplication_9)
rad_14 = Radians(Degrees=system_rotation_4)
xy_8 = XYPlane(Origin=Point(0, 0, 0))
cap_4 = CapHoles(Brep=extr_4)
position_250_2 = Number(-250)
rotate_14 = Rotate(Geometry=flatten(cap_4), Angle=rad_14, Plane=xy_8)  # -> Geometry, Transform
Z_4 = UnitZ(Factor=position_250_2)
move_12 = Move(Geometry=rotate_14.Geometry, Motion=Z_4)  # -> Geometry, Transform

rad_15 = Radians(Degrees=vertical_rotation)
rad_16 = Radians(Degrees=horizontal_rotation_group3)
xy_9 = XYPlane(Origin=dispatch.ListA)
xz_8 = XZPlane(Origin=dispatch.ListA)
yz_5 = YZPlane(Origin=dispatch.ListA)
rotate_15 = Rotate(Geometry=xz_8, Angle=rad_15, Plane=xy_9)  # -> Geometry, Transform
rotate_16 = Rotate(Geometry=rotate_15.Geometry, Angle=rad_16, Plane=yz_5)  # -> Geometry, Transform
deplane_9 = DeconstructPlane(Plane=rotate_16.Geometry)  # -> Origin, XAxis, YAxis, ZAxis
actuator_lenght_4 = Number(300)
pdecon_5 = Deconstruct(Point=deplane_9.Origin)  # -> XComponent, YComponent, ZComponent
addition_5 = Addition(A=pdecon_5.YComponent, B=actuator_lenght_4)
pt_7 = ConstructPoint(XCoordinate=pdecon_5.XComponent, YCoordinate=addition_5, ZCoordinate=pdecon_5.ZComponent)
vec2pt_5 = Vector2Pt(PointA=deplane_9.Origin, PointB=pt_7, Unitize=False)  # -> Vector, Length
move_13 = Move(Geometry=rotate_16.Geometry, Motion=vec2pt_5.Vector)  # -> Geometry, Transform
deplane_10 = DeconstructPlane(Plane=move_13.Geometry)  # -> Origin, XAxis, YAxis, ZAxis
neg_5 = Negative(Value=deplane_10.ZAxis)
unit_5 = UnitVector(Vector=neg_5)
number_4 = Number(10)
extrusion_height_4 = Number(4)
multiplication_10 = Multiplication(A=unit_5, B=number_4)
multiplication_11 = Multiplication(A=unit_5, B=extrusion_height_4)
panel_size_5 = Number(400)
move_14 = Move(Geometry=move_13.Geometry, Motion=multiplication_10)  # -> Geometry, Transform
dom_5 = ConstructDomain(DomainStart=expr("-x/2", panel_size_5), DomainEnd=expr("x/2", panel_size_5))
rectangle_6 = Rectangle(Plane=move_14.Geometry, XSize=dom_5, YSize=dom_5, Radius=0)  # -> Rectangle, Length
system_rotation_5 = Number(180)
extr_5 = Extrude(Base=rectangle_6.Rectangle, Direction=multiplication_11)
rad_17 = Radians(Degrees=system_rotation_5)
xy_10 = XYPlane(Origin=Point(0, 0, 0))
cap_5 = CapHoles(Brep=extr_5)
position_750_2 = Number(-750)
rotate_17 = Rotate(Geometry=flatten(cap_5), Angle=rad_17, Plane=xy_10)  # -> Geometry, Transform
Z_5 = UnitZ(Factor=position_750_2)
move_15 = Move(Geometry=rotate_17.Geometry, Motion=Z_5)  # -> Geometry, Transform

rad_18 = Radians(Degrees=vertical_rotation)
rad_19 = Radians(Degrees=horizontal_rotation_group3)
xy_11 = XYPlane(Origin=dispatch.ListA)
xz_9 = XZPlane(Origin=dispatch.ListA)
yz_6 = YZPlane(Origin=dispatch.ListA)
rotate_18 = Rotate(Geometry=xz_9, Angle=rad_18, Plane=xy_11)  # -> Geometry, Transform
rotate_19 = Rotate(Geometry=rotate_18.Geometry, Angle=rad_19, Plane=yz_6)  # -> Geometry, Transform
deplane_11 = DeconstructPlane(Plane=rotate_19.Geometry)  # -> Origin, XAxis, YAxis, ZAxis
actuator_lenght_5 = Number(300)
pdecon_6 = Deconstruct(Point=deplane_11.Origin)  # -> XComponent, YComponent, ZComponent
addition_6 = Addition(A=pdecon_6.YComponent, B=actuator_lenght_5)
pt_8 = ConstructPoint(XCoordinate=pdecon_6.XComponent, YCoordinate=addition_6, ZCoordinate=pdecon_6.ZComponent)
vec2pt_6 = Vector2Pt(PointA=deplane_11.Origin, PointB=pt_8, Unitize=False)  # -> Vector, Length
move_16 = Move(Geometry=rotate_19.Geometry, Motion=vec2pt_6.Vector)  # -> Geometry, Transform
deplane_12 = DeconstructPlane(Plane=move_16.Geometry)  # -> Origin, XAxis, YAxis, ZAxis
neg_6 = Negative(Value=deplane_12.ZAxis)
unit_6 = UnitVector(Vector=neg_6)
number_5 = Number(10)
extrusion_height_5 = Number(4)
multiplication_12 = Multiplication(A=unit_6, B=number_5)
multiplication_13 = Multiplication(A=unit_6, B=extrusion_height_5)
panel_size_6 = Number(400)
move_17 = Move(Geometry=move_16.Geometry, Motion=multiplication_12)  # -> Geometry, Transform
dom_6 = ConstructDomain(DomainStart=expr("-x/2", panel_size_6), DomainEnd=expr("x/2", panel_size_6))
rectangle_7 = Rectangle(Plane=move_17.Geometry, XSize=dom_6, YSize=dom_6, Radius=0)  # -> Rectangle, Length
system_rotation_6 = Number(180)
extr_6 = Extrude(Base=rectangle_7.Rectangle, Direction=multiplication_13)
rad_20 = Radians(Degrees=system_rotation_6)
xy_12 = XYPlane(Origin=Point(0, 0, 0))
cap_6 = CapHoles(Brep=extr_6)
position_1250_2 = Number(-1250)
rotate_20 = Rotate(Geometry=flatten(cap_6), Angle=rad_20, Plane=xy_12)  # -> Geometry, Transform
Z_6 = UnitZ(Factor=position_1250_2)
move_18 = Move(Geometry=rotate_20.Geometry, Motion=Z_6)  # -> Geometry, Transform

ca = ConstructionAssembly(
    Brep=<geometry referenced from the Rhino model>,
    Brep_2=<geometry referenced from the Rhino model>,
    GetAssembly=12,
    GetCustom=False,
    GetLayerNum=1,
    GetMaterials=[-1, -1, -1, -1, -1])  # -> Zone, Zone_2
ca_2 = ConstructionAssembly(
    Brep=[<geometry referenced from the Rhino model> x5],
    Brep_2=[<geometry referenced from the Rhino model> x5],
    GetAssembly=6,
    GetCustom=False,
    GetLayerNum=1,
    GetMaterials=[-1, -1, -1, -1, -1])  # -> Zone, Zone_2
number_slider_2 = Slider(0.5, range=0..1)
wu = WindowUnit(
    Brep=<geometry referenced from the Rhino model>,
    Brep_2=<geometry referenced from the Rhino model>,
    GetAssembly=7,
    GetCustom=False,
    GetGas=[-1, -1],
    GetGlass=[-1, -1, -1],
    GetLayerNum=1,
    GetSimpleState=0)  # -> Window, Window_2
M = Material(Material="GenericCeiling_70")  # -> GeometryWithMaterialAssigned, GeometryWithMaterialAssigned_2
wu_2 = WindowUnit(
    Brep=<geometry referenced from the Rhino model>,
    Brep_2=<geometry referenced from the Rhino model>,
    GetAssembly=7,
    GetCustom=False,
    GetGas=[-1, -1],
    GetGlass=[-1, -1, -1],
    GetLayerNum=1,
    GetSimpleState=0)  # -> Window, Window_2
panel = Panel(vertical_rotation)
ca_3 = ConstructionAssembly(
    Brep=<geometry referenced from the Rhino model>,
    Brep_2=<geometry referenced from the Rhino model>,
    GetAssembly=12,
    GetCustom=False,
    GetLayerNum=1,
    GetMaterials=[-1, -1, -1, -1, -1])  # -> Zone, Zone_2
ca_4 = ConstructionAssembly(
    Brep=[<geometry referenced from the Rhino model> x5],
    Brep_2=[<geometry referenced from the Rhino model> x5],
    GetAssembly=6,
    GetCustom=False,
    GetLayerNum=1,
    GetMaterials=[-1, -1, -1, -1, -1])  # -> Zone, Zone_2
shade = Shade(
    Brep=[move_18.Geometry, move_15.Geometry, move_12.Geometry, move_9.Geometry, move_6.Geometry, move_3.Geometry],
    SR=number_slider_2,
    VR=number_slider_2,
    GlazedFraction=0,
    Brep_2=[move_18.Geometry, move_15.Geometry, move_12.Geometry, move_9.Geometry, move_6.Geometry, move_3.Geometry],
    SR_2=number_slider_2,
    VR_2=number_slider_2,
    GlazedFraction_2=0)  # -> Shade, Shade_2
num = Number(300)
toggle_2 = BooleanToggle(True)
read = ReadSavedThermalResults(
    manual_csv=False,
    OutputStates=[True, True, False, False, True, False, False, False, False, False, False, True, False, False, False, False, False, False, False, False, False, False, True, True, False],
    Project=32,
    ReportingPeriod=2)  # -> MetricHeatingE, MetricCoolingE, MetricElecLights, MetricIndoorTemp, MetricCarbon, MetricCarbonElec, MetricHeatingE_2, MetricCoolingE_2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
panel_2 = Panel(ca_4.Zone_2)
panel_3 = Panel(ca_3.Zone_2)
viper = ViperDIVAThermalAnalysisForGH(
    ProjectName=panel,
    People_m2=0.1,
    Lights_W_m2=11.74,
    Equipment_W_m2=4,
    HeatingSetPoint_deg_C=22,
    CoolingSetPoint_deg_C=26,
    HeatingCOP=0.8,
    CoolingCOP=3,
    Infiltration=0.5,
    FreshAir=0.00944,
    LightingControl_lux=num,
    ZoneBreps=[ca_2.Zone_2, ca.Zone_2],
    Window=wu.Window_2,
    WriteOnly=False,
    RunSimulation=toggle_2,
    ProjectName_2=panel,
    People_m2_2=0.1,
    Lights_W_m2_2=11.74,
    Equipment_W_m2_2=4,
    HeatingSetPoint_deg_C_2=22,
    CoolingSetPoint_deg_C_2=26,
    HeatingCOP_2=0.8,
    CoolingCOP_2=3,
    Infiltration_2=0.5,
    FreshAir_2=0.00944,
    LightingControl_lux_2=num,
    ZoneBreps_2=[ca_2.Zone_2, ca.Zone_2],
    Window_2=wu.Window_2,
    WriteOnly_2=False,
    RunSimulation_2=toggle_2,
    CustomDates=False,
    Location=16,
    Occupancy=0,
    OutputStates=[True, True, False, False, True, True, False, False, False, False, False, False, False, False, False, False, False, False, False],
    ReportingPeriod=0,
    RunPeriod=0,
    ShadowFreq=30,
    ShadowOverlap=15000,
    SolarDist=2,
    Timestep=2)  # -> OutputMessage, MetricHeatingE, MetricCoolingE, MetricElecLights, MetricElecEquip, OutputMessage_2, MetricHeatingE_2, MetricCoolingE_2, MetricElecLights_2, MetricElecEquip_2
graph = QuickGraph([read.MetricCoolingE_2, read.MetricHeatingE_2, read.MetricElecLights_2, read.MetricIndoorTemp_2])
panel_4 = Panel(viper.OutputMessage_2)
panel_5 = Panel(viper.MetricHeatingE_2)
panel_6 = Panel(viper.MetricCoolingE_2)
panel_7 = Panel(viper.MetricElecLights_2)
ma = MassAddition(Input=panel_5)  # -> Result, PartialResults
ma_2 = MassAddition(Input=panel_6)  # -> Result, PartialResults
panel_8 = Panel(ma_2.Result)
panel_9 = Panel(ma.Result)
