# Grasshopper definition reproduce_from_example.gh (Grasshopper 0.9.76)
# plug-ins: DIVA.ForGrasshopper

wu = WindowUnit(
    Brep=<geometry referenced from the Rhino model>,
    Brep_2=<geometry referenced from the Rhino model>,
    GetAssembly=7,
    GetCustom=False,
    GetGas=[-1, -1],
    GetGlass=[-1, -1, -1],
    GetLayerNum=1,
    GetSimpleState=0)  # -> Window, Window_2
ca = ConstructionAssembly(
    Brep=[<geometry referenced from the Rhino model> x5],
    Brep_2=[<geometry referenced from the Rhino model> x5],
    GetAssembly=6,
    GetCustom=False,
    GetLayerNum=1,
    GetMaterials=[-1, -1, -1, -1, -1])  # -> Zone, Zone_2
ca_2 = ConstructionAssembly(
    Brep=<geometry referenced from the Rhino model>,
    Brep_2=<geometry referenced from the Rhino model>,
    GetAssembly=12,
    GetCustom=False,
    GetLayerNum=1,
    GetMaterials=[-1, -1, -1, -1, -1])  # -> Zone, Zone_2
toggle = BooleanToggle(True)
num = Number(300)
viper = ViperDIVAThermalAnalysisForGH(
    ProjectName="Viper_Temp",
    People_m2=0.1,
    Lights_W_m2=11.74,
    Equipment_W_m2=4,
    HeatingSetPoint_deg_C=22,
    CoolingSetPoint_deg_C=26,
    HeatingCOP=0.8,
    CoolingCOP=3,
    Infiltration=0.5,
    FreshAir=0.00944,
    LightingControl_lux=num,
    ZoneBreps=[ca.Zone_2, ca_2.Zone_2],
    Window=wu.Window_2,
    WriteOnly=False,
    RunSimulation=toggle,
    ProjectName_2="Viper_Temp",
    People_m2_2=0.1,
    Lights_W_m2_2=11.74,
    Equipment_W_m2_2=4,
    HeatingSetPoint_deg_C_2=22,
    CoolingSetPoint_deg_C_2=26,
    HeatingCOP_2=0.8,
    CoolingCOP_2=3,
    Infiltration_2=0.5,
    FreshAir_2=0.00944,
    LightingControl_lux_2=num,
    ZoneBreps_2=[ca.Zone_2, ca_2.Zone_2],
    Window_2=wu.Window_2,
    WriteOnly_2=False,
    RunSimulation_2=toggle,
    CustomDates=False,
    Location=16,
    Occupancy=0,
    OutputStates=[True, True, False, False, True, True, False, False, False, False, False, False, False, False, False, False, False, False, False],
    ReportingPeriod=0,
    RunPeriod=0,
    ShadowFreq=30,
    ShadowOverlap=15000,
    SolarDist=2,
    Timestep=2)  # -> OutputMessage, MetricHeatingE, MetricCoolingE, MetricElecLights, MetricElecEquip, OutputMessage_2, MetricHeatingE_2, MetricCoolingE_2, MetricElecLights_2, MetricElecEquip_2
panel = Panel(viper.OutputMessage_2)
ma = MassAddition(Input=viper.MetricHeatingE_2)  # -> Result, PartialResults
ma_2 = MassAddition(Input=viper.MetricCoolingE_2)  # -> Result, PartialResults
ma_3 = MassAddition(Input=viper.MetricElecLights_2)  # -> Result, PartialResults
panel_2 = Panel(ma.Result)
panel_3 = Panel(ma_2.Result)
panel_4 = Panel(ma_3.Result)
