# Grasshopper definition illuminanceAnalysis.gh (Grasshopper 0.9.76)
# plug-ins: Python Interpreter

toggle = BooleanToggle(True)
panel = Panel("C:\Users\Assistenz\Desktop\Mauro\ASF_Simulation\Simulation_Tool\WeatherData\Zurich-Kloten_2013.epw")
updateladybug = Ladybug_UpdateLadybug(updateThisFile=toggle)  # -> readMe; plug-in component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
updatehoneybee = Honeybee_UpdateHoneybee(updateThisFile=toggle)  # -> readMe; plug-in component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

window = Brep([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])
rest = Brep([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])

number_slider = Slider(0.2, range=0..1)
floor = Brep(<brep referenced from the Rhino model>)
flip = Flip(Surface=floor)  # -> Surface, Result
ladybug = Ladybug_Ladybug()  # -> Vviiiiiiiiiizzz; plug-in component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
honeybee = Honeybee_Honeybee()  # -> Vviiiiiiiiiizzz; plug-in component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
radglassmaterial = Honeybee_RadianceGlassMaterial(
    materialName="TVIS_0.8",
    RTransmittance=number_slider,
    GTransmittance=number_slider,
    BTransmittance=number_slider,
    refractiveIndex=1.52)  # -> avrgTrans, RADMaterial; plug-in component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
path = FilePath(panel)
gentestpts = Honeybee_GenerateTestPoints(testGeometry=flip.Surface, gridSize=Slider(200, range=0..250), distBaseSrf=Slider(0.7, range=0..2), moveTestMesh=True)  # -> readMe, simplify(testPoints), simplify(ptsVectors), simplify(facesArea), simplify(mesh); plug-in component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
genstandardciesky = Honeybee_GenerateStandardCIESky(weatherFile=path, month=Slider(6, range=0..10), day=Slider(21, range=0..100), hour=Slider(12, range=0..100), skyType=0)  # -> skyFilePath; plug-in component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
brep = Brep(<brep referenced from the Rhino model>)
panel_2 = Panel(honeybee)
panel_3 = Panel(ladybug)
mass2zone = Honeybee_Masses2Zones(zoneMasses=flatten(brep), isConditioned=True, maxRoofAngle=30, createHBZones=Toggle(True))  # -> out, HBZones; plug-in component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
brep_2 = Brep(<brep referenced from the Rhino model>)
gridbasedsimulation = Honeybee_GridBasedSimulation(
    skyFile=genstandardciesky,
    testPoints=gentestpts.testPoints,
    ptsVectors=gentestpts.ptsVectors,
    testMesh=gentestpts.mesh,
    simulationType=Slider(0, range=0..100))  # -> analysisRecipe; plug-in component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
createhbsrfs = Honeybee_createHBSrfs(geometry=brep, RADMaterial=radglassmaterial.RADMaterial)  # -> readMe, simplify(HBSurface); plug-in component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
daylighfactorsimulation = Honeybee_DaylightFactorSimulation(uniformSky=False)  # -> analysisRecipe; plug-in component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
decomposebytype = Honeybee_DecomposeBasedOnType(HBZone=mass2zone.HBZones)  # -> walls, interiorWalls, airWalls, windows, interiorWindows, skylights, roofs, ceilings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; plug-in component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
toggle_2 = BooleanToggle(True)
mesh_brep = MeshBrep(Settings={GridMaxCount=0, GridMinCount=16, JaggedSeams=False, MaxEdgeLength=0, MinEdgeLength=0.0001, MinTolerance=0, Refine=True, RefineAngle=0, RelativeTolerance=0.65, SimplePlanes=True, Tolerance=0})
rundaylightanalysis = Honeybee_RunDaylightSimulation(
    HBObjects=flatten(createhbsrfs.HBSurface),
    analysisRecipe=gridbasedsimulation,
    writeRad=toggle_2,
    runRad=toggle_2,
    numOfCPUs=Slider(8, range=0..10),
    overwriteResults=True)  # -> readMe, analysisType, resultsUnit, illuminance_values, testPts, illuminance_files, radGeoFile, studyFolder, done; plug-in component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
addhbglz = Honeybee_addHBGlz(HBObj=mass2zone.HBZones, childSurfaces=flatten(decomposebytype.windows), RADMaterials=radglassmaterial.RADMaterial)  # -> HBObjWGLZ; plug-in component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
legendpar = Ladybug_LegendParameters(lowBound=Slider(0, range=0..8000), highBound=Slider(3549, range=0..8000))  # -> legendPar; plug-in component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
readradresults = Honeybee_ReadRADResult(
    analysisType=rundaylightanalysis.analysisType,
    resultFiles=rundaylightanalysis.illuminance_files,
    testPts=rundaylightanalysis.testPts,
    writeToFile=False)  # -> out, unit, values; plug-in component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
panel_4 = Panel(rundaylightanalysis.readMe)
panel_5 = Panel([rundaylightanalysis.analysisType, rundaylightanalysis.resultsUnit])
panel_6 = Panel(rundaylightanalysis.illuminance_values)
recolormesh = Ladybug_RecolorMesh(
    analysisResult=readradresults.values,
    inputMesh=gentestpts.mesh,
    legendPar=legendpar,
    analysisTitle=rundaylightanalysis.analysisType,
    legendTitle=rundaylightanalysis.resultsUnit)  # -> readMe, newMesh, newLegend, legendBasePt, meshColors, legendColors; plug-in component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
panel_7 = Panel(recolormesh.readMe)
mesh = Mesh(recolormesh.newMesh)
