# Grasshopper definition RadiationPanelsWithReflection.gh (Grasshopper 0.9.76)
# plug-ins: MeshEdit Components, Python Interpreter, Human

# ----
# Set Geometry
# ASF Simulation Inputs
# Geometry Inputs
# building orientation of 0 corresponds to south facing, 90 is east facing, -90 is west facing
panel = Panel("XANGLES = [0,15,30,45,60,75,90]")
panel_2 = Panel("YANGLES = [-45,-30,-15,0,15,30,45]")
panel_3 = Panel("YANGLES = [-45,-22.5,0,22.5,45]")
number_of_panels_in_first_row = Slider(6, range=0..20)
building_orientation = Slider(0, range=-360..360)
edge_tolerance = Slider(0, range=0..1000)
glazing_height = Slider(0.9677, range=0..1)
panel_spacing_mm = Slider(500, range=200..1500)
glazing_width = Slider(0.9183, range=0..1)
panel_offset_mm = Slider(400, range=100..1000)
number_of_rows = Slider(9, range=0..9)
room_depth = Slider(7000, range=1000..20000)
room_width = Slider(4900, range=1000..20000)
room_height = Slider(3100, range=1000..20000)
panel_size_mm = Slider(400, range=1..500)
boolean_diamond_array = BooleanToggle(True)
boolean_top_row_short = BooleanToggle(False)
desiredgridpointsize = Slider(25, range=1..200)
number_of_clusters = Slider(1, range=1..3)
combination = Slider(24, range=0..91)
xangles = Text("XANGLES = [0,22.5,45,67.5,90]")
yangles = Text("YANGLES = [0]")

number_slider = Slider(1, range=1..31)
panel_4 = Panel("EGY_Cairo.623660_IWEC.epw")

# ----
# Set Weather File
panel_5 = Panel("ESP_Madrid.082210_IWEC.epw")
panel_6 = Panel("SGP_Singapore.486980_IWEC.epw")
weatherpath = PythonScript(weather_data_file="Zuerich_Kloten_2013.epw")  # -> out, weather_path
# ---------- weatherpath: Python ----------
#Save Temperature from .epw weather file

import sys, os
import datetime

# assign destination:
file_path = ghenv.Component.OnPingDocument().FilePath
asf_folder = '\\'.join(file_path.split('\\')[0:-2])

weather_path = os.path.join(asf_folder + "\WeatherData", str(weather_data_file))

print weather_path
# ---------- end weatherpath ----------

panel_7 = Panel("FIN_Helsinki.029740_IWEC.epw")
datapath = PythonScript(data_file="comb.json")  # -> out, file_path
# ---------- datapath: Python ----------
#import json from python output

import sys, os
import datetime

# assign destination:
file_path = ghenv.Component.OnPingDocument().FilePath
asf_folder = '\\'.join(file_path.split('\\')[0:-1])

file_path = os.path.join(asf_folder , str(data_file))

print file_path
# ---------- end datapath ----------
datapath_2 = PythonScript(data_file="panel.json")  # -> out, file_path; same code as datapath
datapath_3 = PythonScript(data_file="building.json")  # -> out, file_path; same code as datapath
analysisperiod = Ladybug_AnalysisPeriod()  # -> readMe, analysisPeriod; plug-in component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
analysisperiod_2 = Ladybug_AnalysisPeriod()  # -> readMe, analysisPeriod; plug-in component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
analysisperiod_3 = Ladybug_AnalysisPeriod()  # -> readMe, analysisPeriod; plug-in component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
analysisperiod_4 = Ladybug_AnalysisPeriod()  # -> readMe, analysisPeriod; plug-in component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
read_file = ReadFile(File=datapath_2.file_path, PerLineParse=True)
read_file_2 = ReadFile(File=datapath_3.file_path, PerLineParse=True)
hour_of_year = Slider(5149, range=1..8760)
panel_8 = Panel("C:\Users\Assistenz\Desktop\Mauro\ASF_Simulation\Simulation_Tool\New_SimulationEnvironment\data")
ladybug = Ladybug_Ladybug()  # -> out; plug-in component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
python_script = PythonScript(x=read_file)  # -> out, XANGLESjson, YANGLESjson, NoClusters, numberHorizontal, numberVertical, panelOffset, panelSize, panelSpacing
# ---------- python_script: Python ----------
import json

x= json.loads(x)

print x

XANGLESjson= json.dumps(x['XANGLES'])
YANGLESjson= json.dumps(x['YANGLES'])

NoClusters= x['NoClusters']
numberHorizontal=x['numberHorizontal']
numberVertical=x['numberVertical']
panelOffset=x['panelOffset']
panelSize=x['panelSize']
panelSpacing=x['panelSpacing']


print YANGLESjson
# ---------- end python_script ----------
panel_9 = Panel(python_script.panelSpacing)
python_script_2 = PythonScript(x=read_file_2)  # -> out, room_width, room_height, glazing_percentage_w, glazing_percentage_h
# ---------- python_script_2: Python ----------
import json

x= json.loads(x)

print x


room_width= x['room_width']
room_height=x['room_height']
glazing_percentage_w=x['glazing_percentage_w']
glazing_percentage_h=x['glazing_percentage_h']
# ---------- end python_script_2 ----------
# Render the Building
render_room = PythonScript(
    buildingOrientation=building_orientation,
    room_depth=room_depth,
    room_width=python_script_2.room_width,
    room_height=python_script_2.room_height,
    glazing_percentage_w=python_script_2.glazing_percentage_w,
    glazing_percentage_h=python_script_2.glazing_percentage_h)  # -> WallF, AdiabaticSurfaces, WallG; inputs buildingOrientation: Int32
# ---------- render_room: Python ----------
#12.10.2015
#Prageeth Jayathissa
#Script for rendering the room based on input dimensions

import rhinoscriptsyntax as rs

#Room Dimensions (mm)
#room_depth=5000
#room_width=3700
#room_height=3000 #Check value (approximation)
#floorThick=200
#ceilThick=200
#intWallThick=110 #Real value is 110mm
#glazeThick=110 #Check this value again

intWallHeight=room_height

gpw=glazing_percentage_w
gph=glazing_percentage_h


#Define Global Plane
planexy=rs.WorldXYPlane()
planezx=rs.WorldZXPlane()
planeyz=rs.WorldYZPlane()

print planexy
#Create rectangle of floor and extrude 200mm
#base=rs.AddRectangle(plane, room_width+intWallThick*2, room_depth)

planeR=rs.PlaneFromNormal((room_width,0,0),(1,0,0))
planeB=rs.PlaneFromNormal((0,room_depth,0),(0,1,0))
planeC=rs.PlaneFromNormal((0,0,room_height),(0,0,1))
#myBox=rs.ExtrudeCurveStraight(base,(0,0,0),(0,0,room_height))

WallF=rs.AddPlaneSurface(planezx,room_height,room_width)
WallL=rs.AddPlaneSurface(planeyz,room_depth,room_height)
WallR=rs.AddPlaneSurface(planeR,room_depth,room_height)
WallB=rs.AddPlaneSurface(planeB,room_height,room_width)

#WallF=rs.RotateObject(WallF,[0,0,0],buildingOrientation,axis=(0,0,1))

Floor=rs.AddPlaneSurface(planexy,room_width,room_depth)
Ceiling=rs.AddPlaneSurface(planeC,room_width,room_depth)

WallG=rs.AddPlaneSurface(planezx,room_height*gph,room_width*gpw)
WallG=rs.MoveObject(WallG,((1-gpw)*room_width/2,0,(1-gph)*room_height/2))
#WallG=rs.RotateObject(WallG,[0,0,0],buildingOrientation,axis=(0,0,1))

#Floor=rs.RotateObject(Floor,[0,0,0],buildingOrientation,axis=(0,0,1))
#Ceiling=rs.RotateObject(Ceiling,[0,0,0],buildingOrientation,axis=(0,0,1))
#WallL=rs.RotateObject(WallL,[0,0,0],buildingOrientation,axis=(0,0,1))
#WallR=rs.RotateObject(WallR,[0,0,0],buildingOrientation,axis=(0,0,1))
#WallB=rs.RotateObject(WallB,[0,0,0],buildingOrientation,axis=(0,0,1))

AdiabaticSurfaces=[Floor,Ceiling,WallL,WallR,WallB]
# ---------- end render_room ----------
generate_diamond_array = PythonScript(
    edgeTol=edge_tolerance,
    numberHorizontal=python_script.numberHorizontal,
    Top_row_short=boolean_top_row_short,
    numberVertical=python_script.numberVertical,
    panelOffset=python_script.panelOffset,
    panelSize=python_script.panelSize,
    panelSpacing=python_script.panelSpacing,
    room_width=python_script_2.room_width,
    room_height=python_script_2.room_height,
    diamond_flag=boolean_diamond_array)  # -> outputASFarray, panelSize, panelOffset, diamond_flag
# ---------- generate_diamond_array: Python ----------
#15.12.2015
#Prageeth Jayathissa
#Script for calculating the grid layout of the ASF
#Edited by Jeremias Schmidli

#Description:
    #This script has three parts, out of which only one is executed, depending 
    #on the booleans diamond_flag (diamond- or rectangular-pattern) and 
    #only_odd_rows (if true it automatically determines pattern depending on 
    #room size, if false the number of panels in the first row, the number of 
    #rows and whether the first row is short or long has to be spezified).

#Notes:
    #All coordinates described as "y-value" actually correspond to the "z-value"
    #in Grasshopper.
    #To maximize performance of a simulation, it should be made sure, that this 
    #script is only evaluated once. 

#Staus: Complete

#To Do:
    #Add function to ensure the panel offset is greater than the panel size
#------------------------------------------------------------------------------

import rhinoscriptsyntax as rs
import Grasshopper as gh
import Rhino
import math
import json


#specify if layout should be generated automatically, depending on room size 
#(If False, the inputs numberHorizontal, Top_row_short and numberVertical are needed.
# If True, the input edgeTol is needed.
# Works only for diamond pattern):
automatic_layout = False

# calculate diamond pattern if True:
if diamond_flag == True:
    
    # code from PJ, generates automatic layout:
    if automatic_layout == True:
        
        #Function to determine the location of the first panel
        def first_coordinate():
            x=room_width/2 -((No_Hpanels-1)*Hspacing)/2 
            print x
            y=((No_Vpanels-1)*Vspacing)/2 +(room_height)/2
            
            if center_long:
                if bigstart:
                    x=x
                else:
                    x+=(Hspacing/2)
            else:
                if bigstart:
                    x-=(Hspacing/2)
                    print 'me'
                else:
                    x=x
            return (x,y)
                    
        
        #import paramters:
        #room_width=3700.0
        #room_height=3000.00
        
        
        
        #panel size and spacing along the diagonal axis
        #panelSize=400.0
        #panelSpacing=500.0
        #panelThick=2
        #panelOffset=500
        
        #minor adjustments to the panel size
        #edgeTol=1.4
        #V_translation=100
        edgeOverlap=(edgeTol/100)*panelSpacing
        
        
        #transform spacing into vertical and horizontal components
        #Note: sin(45) = 1/math.sqrt(2)
        Hspacing=(panelSpacing/math.sqrt(2))*2
        Vspacing = panelSpacing/math.sqrt(2)
        
        #initialise boolean to determine whether the center pannel line is long
        center_long=True
        #initialise boolean to determine wether the middle row needs to be offset
        center_offset=False 
        
        #find out how many panels fit on the horizontal axis
        #The edgeOverlap allows for more or less panels to fit around the edge
        No_Hpanels=int(math.floor((room_width-panelSize+edgeOverlap)/Hspacing))
        
        #The number of panels on the middle axis is always odd
        #check if the number is even, and if so subtract 1 and define center as a short row
        if not No_Hpanels & 1: #binary logic to determine if the number is even
            print 'even'
            No_Hpanels-=1 #subtract by one to make it odd
            center_long=False #state that the middle row is now the shorter row
        
        
        print 'Hpanels',No_Hpanels
        
        #find out how many panels fit on the vertical axis accounting for an overlap
        No_Vpanels=int(math.floor((room_height-panelSize+edgeOverlap)/Vspacing))
        
        #Number of rows must also be odd for asthetic reasons
        if not No_Vpanels &1:
            print 'even Vpanels'
            center_offset=True
            No_Vpanels-=1  
            
        print 'V panels' , No_Vpanels
        #Very Messy shit code to determine wether the first row has more panels than the second row
        
        #if (No_Vpanels-1)/2 is odd, then the top row has the same number of panels as the middle
        #if it is even then it has one more or one less depending on whether the center is long or short
        checker=int((No_Vpanels-1)/2)
        print 'checker',checker
        print 'center_long?', center_long
        if center_long:
            if checker &1: #if checker is odd
                print '3,7,11 etc Vpanels1'
                bigstart=False #Top row is shorter than second row
                oneswitch=-1 #top row has one less panel than middle row
            else:
                print '1,5,9 etc Vpanels2'
                bigstart=True #top row is longer than second row
                oneswitch=0
        else:
            if checker &1:
                print '3,7,11 etc Vpanels3'
                bigstart=True
                oneswitch=1 #top panel has one more panel than the middle row
            else:
                print '1,5,9 etc Vpanels4'
                bigstart=False
                oneswitch=0
        
        #End of messy shitty code
        
        #prints for debugging
        print 'bigstart', bigstart 
        print 'oneswitch',oneswitch
        
        #initialise ASFarray List
        ASFarray=[]
        
        #Produce an empy list nested in a list. The nested list represents each row
        for ii in range(No_Vpanels):
            ASFarray.append([])
           
        
        
        #aquire the first coordinate of the top left panel
        (x,y)=first_coordinate()  #see function at the top
        x_first=x #store initial x coordinate
        y_first=y #store initial y coordinate
        
        
        #This next for loop records the coordinate positions of each panel
        #initialise row counter
        icount=0
        for ii in ASFarray:
            #initialise collumn counter
            jcount=0
            
            for jj in range(No_Hpanels+oneswitch): #first row
                ii.append((x+jcount*Hspacing,y-icount*Vspacing)) #Append panel coordinate
                jcount+=1 #next column
            #Switches so the next row has either one more or one less panel
            #logic: If the center row is long, then it will switch between its own size
            #and a size smaller. If not it will switch between its own size and one bigger
            if center_long:
                oneswitch-=1
                oneswitch=(oneswitch%2)*-1 #output either 0 or -1
            else:
                oneswitch+=1
                oneswitch=oneswitch%2 #output is either 0 or 1
            icount+=1
            
            #Determines the starting position of the first panel of the row depending on
            #if its long or short
            if icount &1: #if odd
                if bigstart:
                    x=x_first+(Hspacing/2) #start half a space to the right
                else:
                    x=x_first -(Hspacing/2) #start half a space to the left
            else:
                x=x_first
            
            
        
        
        #Write the array output as a json and send to next python file
        #Note: Lists in Lists cannot be sent over grasshopper
        outputASFarray=json.dumps(ASFarray)
        print ASFarray
        
    # Code Jeremias, uses manual specification of number of panels in grid:
    else:
        #make number of rows and columns integers:
        numberHorizontal = int(numberHorizontal)
        numberVertical = int(numberVertical)
        
        #initialise ASFarray List:
        ASFarray=[]
        
            #Produce an empty list nested in a list. The nested list represents each row
        for ii in range(int(numberVertical)):
            ASFarray.append([])
        
        
        #store x and y coordinate of first panel in the top row 
        #( & 1 checks if the number is odd):
            
        #find initial x-coordinate:
        if numberHorizontal & 1 and Top_row_short:
            x_first=room_width/2-panelSpacing*math.sqrt(2)*(numberHorizontal-1)/2 
        elif numberHorizontal & 1 and not Top_row_short:
            x_first=room_width/2-panelSpacing*math.sqrt(2)*(numberHorizontal-1)/2 
        elif not numberHorizontal & 1 and Top_row_short:
            x_first=room_width/2-panelSpacing*math.sqrt(2)*(numberHorizontal)/2
        elif not numberHorizontal & 1 and not Top_row_short:
            x_first=room_width/2-panelSpacing*math.sqrt(2)*(numberHorizontal-1)/2 
            
        #find initial y-coordinate:
        if numberVertical & 1:
            y_first=room_height/2+panelSpacing*(math.sqrt(2)/2)*(numberVertical-1)/2
        else:
            y_first=room_height/2+panelSpacing*(math.sqrt(2)/2)*(numberVertical-1)/2 
            
        
        #This next for loop records the coordinate positions of each panel
        
        #initialise x and y coordinate:
        x = x_first
        y = y_first
        
        #initialise row counter
        icount=0
        for ii in ASFarray:
            #initialise collumn counter
            jcount=0
            
            if (numberHorizontal & 1) and (icount & 1) and Top_row_short:
                
                for jj in range(int(numberHorizontal)+1): #first row
                    ii.append((x-panelSpacing*math.sqrt(2)/2+jcount*panelSpacing*math.sqrt(2),y-icount*panelSpacing*math.sqrt(2)/2)) #Append panel coordinate
                    jcount+=1 #next column
                    
            elif (numberHorizontal & 1) and not (icount & 1) and Top_row_short:
                
                for jj in range(int(numberHorizontal)): #first row
                    ii.append((x+jcount*panelSpacing*math.sqrt(2),y-icount*panelSpacing*math.sqrt(2)/2)) #Append panel coordinate
                    jcount+=1 #next column
                    
            elif (numberHorizontal & 1) and (icount & 1) and not Top_row_short:
                
                for jj in range(int(numberHorizontal)-1): #first row
                    ii.append((x+panelSpacing*math.sqrt(2)/2+jcount*panelSpacing*math.sqrt(2),y-icount*panelSpacing*math.sqrt(2)/2)) #Append panel coordinate
                    jcount+=1 #next column
                    
            elif (numberHorizontal & 1) and not (icount & 1) and not Top_row_short:
                
                for jj in range(int(numberHorizontal)): #first row
                    ii.append((x+jcount*panelSpacing*math.sqrt(2),y-icount*panelSpacing*math.sqrt(2)/2)) #Append panel coordinate
                    jcount+=1 #next column
                    
            elif not (numberHorizontal & 1) and (icount & 1) and Top_row_short:
                
                for jj in range(int(numberHorizontal)+1): #first row
                    ii.append((x+jcount*panelSpacing*math.sqrt(2),y-icount*panelSpacing*math.sqrt(2)/2)) #Append panel coordinate
                    jcount+=1 #next column
            
            elif not (numberHorizontal & 1) and not (icount & 1) and Top_row_short:
                
                for jj in range(int(numberHorizontal)): #first row
                    ii.append((x+panelSpacing*math.sqrt(2)/2+jcount*panelSpacing*math.sqrt(2),y-icount*panelSpacing*math.sqrt(2)/2)) #Append panel coordinate
                    jcount+=1 #next column
            elif not (numberHorizontal & 1) and (icount & 1) and not Top_row_short:
                
                for jj in range(int(numberHorizontal)-1): #first row
                    ii.append((x+panelSpacing*math.sqrt(2)/2+jcount*panelSpacing*math.sqrt(2),y-icount*panelSpacing*math.sqrt(2)/2)) #Append panel coordinate
                    jcount+=1 #next column
            
            elif not (numberHorizontal & 1) and not (icount & 1) and not Top_row_short:
                
                for jj in range(int(numberHorizontal)): #first row
                    ii.append((x+jcount*panelSpacing*math.sqrt(2),y-icount*panelSpacing*math.sqrt(2)/2)) #Append panel coordinate
                    jcount+=1 #next columnelse :
           
            #next row
            icount+=1
            
            
        #Write the array output as a json and send to next python file
        #Note: Lists in Lists cannot be sent over grasshopper
        outputASFarray=json.dumps(ASFarray)
        print ASFarray
    
# calculate rectangular pattern:
else:
    
    #make number of rows and columns integers:
    numberHorizontal = int(numberHorizontal)
    numberVertical = int(numberVertical)
    
    #initialise ASFarray List:
    ASFarray=[]
    
        #Produce an empy list nested in a list. The nested list represents each row
    for ii in range(int(numberVertical)):
        ASFarray.append([])
    
    
    #store initial x and y coordinate:
    if numberHorizontal & 1:
        x_first=room_width/2-panelSpacing*(numberHorizontal-1)/2 
    else:
        x_first=room_width/2-panelSpacing*(numberHorizontal-2)/2 - panelSpacing/2 
    if numberVertical & 1:
        y_first=room_height/2+panelSpacing*(numberVertical-1)/2
    else:
        y_first=room_height/2+panelSpacing*(numberVertical-2)/2 + panelSpacing/2
        
    
    #This next for loop records the coordinate positions of each panel
    
    #initialise x and y coordinate:
    x = x_first
    y = y_first
    
    #initialise row counter
    icount=0
    for ii in ASFarray:
        #initialise collumn counter
        jcount=0
        
        for jj in range(int(numberHorizontal)): #first row
            ii.append((x+jcount*panelSpacing,y-icount*panelSpacing)) #Append panel coordinate
            jcount+=1 #next column
        
        #next row
        icount+=1
        
        
    #Write the array output as a json and send to next python file
    #Note: Lists in Lists cannot be sent over grasshopper
    outputASFarray=json.dumps(ASFarray)
    print ASFarray
# ---------- end generate_diamond_array ----------
# Geometry Calculations
save_parameters = PythonScript(
    XANGLES=python_script.XANGLESjson,
    YANGLES=python_script.YANGLESjson,
    NoClusters=python_script.NoClusters,
    desiredGridPointSize=desiredgridpointsize,
    panelSize=python_script.panelSize,
    panelSpacing=python_script.panelSpacing,
    outputASFarray=generate_diamond_array.outputASFarray,
    buildingOrientation=building_orientation)  # -> out, a
# ---------- save_parameters: Python ----------
#06.01.2016
#Jeremias Schmidli
#Python script to produce a python file with ASF layout and combination parameters for post processing

import sys, os
import json

# assign destination:
file_path = ghenv.Component.OnPingDocument().FilePath
current_folder = '\\'.join(file_path.split('\\')[0:-1])
destination = current_folder + '\\radiation_results'

print destination
#unpack json file and coppy ASF array to create an empty anglearray
ASFarray=json.loads(outputASFarray)

#Create empty .csv file and add information on parameters

with open(os.path.join(destination,'LayoutAndCombinations.txt'),'w') as f:
    f.write('XANGLES = ' + XANGLES+'\n')
    f.write('YANGLES = ' + YANGLES+'\n')
    f.write('NoClusters = ' + str(NoClusters) +'\n')
    f.write('panelSize = ' + str(panelSize) +'\n')
    f.write('panelSpacing = ' + str(panelSpacing) + '\n')
    f.write('ASFarray = ' + str(ASFarray) + '\n')
    f.write('desiredGridPointSize = ' + str(desiredGridPointSize) + '\n')
    f.write('buildingOrientation = ' + str(buildingOrientation))
    f.close()
# ---------- end save_parameters ----------
epluscomb = Integer(combination)
render_room_2 = PythonScript(
    buildingOrientation=building_orientation,
    WallF=render_room.WallF,
    AdiabaticSurfaces=render_room.AdiabaticSurfaces,
    WallG=render_room.WallG)  # -> WallF, AdiabaticSurfaces, WallG; inputs AdiabaticSurfaces: list
# ---------- render_room_2: Python ----------
#03.05.2016
#Jeremias
#Script to change orientation of building

import rhinoscriptsyntax as rs



#Define Global Plane
planexy=rs.WorldXYPlane()
planezx=rs.WorldZXPlane()
planeyz=rs.WorldYZPlane()


WallG=rs.RotateObject(WallG,[0,0,0],buildingOrientation,axis=(0,0,1))

WallF=rs.RotateObject(WallF,[0,0,0],buildingOrientation,axis=(0,0,1))
print len(AdiabaticSurfaces)
print AdiabaticSurfaces
AdSurf = []
for i in range(len(AdiabaticSurfaces)):
    AdSurf.append(rs.RotateObject(AdiabaticSurfaces[i],[0,0,0],buildingOrientation,axis=(0,0,1)))
# ---------- end render_room_2 ----------
cont_surf = PythonScript()  # -> ContextSurface
# ---------- cont_surf: Python ----------
#12.10.2015
#Prageeth Jayathissa
#Script for rendering the room based on input dimensions

import rhinoscriptsyntax as rs


room_width=37000
room_height=30000 #Check value (approximation)

intWallHeight=room_height



#Define Global Plane
planexy=rs.WorldXYPlane()
planezx=rs.WorldZXPlane()
planeyz=rs.WorldYZPlane()





WallF=rs.AddPlaneSurface(planezx,room_height,room_width)
WallF = rs.MoveObject(WallF,[-16000,1,-10000])


ContextSurface = WallF
# ---------- end cont_surf ----------
multiplication = Multiplication(A=building_orientation, _1=-1)
read_file_3 = ReadFile(File=datapath.file_path, PerLineParse=True)
panel_10 = Panel(read_file_3)
srf = Surface(render_room_2.WallG)
srf_2 = Surface(render_room_2.AdiabaticSurfaces)
srf_3 = Surface(render_room_2.WallF)
panel_11 = Panel("{\"y_angle\": 45, \"Month\": 7, \"Day\": 4, \"Hour\": 12, \"x_angle\": 90}")
honeybee = Honeybee_Honeybee()  # -> out; plug-in component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
number_slider_2 = Slider(0.25, range=0..1)
number_slider_3 = Slider(0.25, range=0..1)
mesh_plane = MeshPlane(Boundary=srf, WidthCount=Slider(25, range=10..100), HeightCount=Slider(25, range=10..100))  # -> Mesh, Area
python_script_3 = PythonScript(x=panel_11)  # -> out, x_angle, y_angle, HOD, combination, Month, Day
# ---------- python_script_3: Python ----------
import json

x= json.loads(x)

print x


x_angle=x['x_angle']
y_angle=x['y_angle']
HOD=x['Hour']
Month = x['Month']
Day = x['Day']



combination = x_angle + y_angle
# ---------- end python_script_3 ----------
python_script_4 = PythonScript(HOD=python_script_3.HOD, Month=python_script_3.Month)  # -> fromHour, toHour, fromMonth, toMonth; inputs HOD: Int32, Month: Int32
# ---------- python_script_4: Python ----------
import json


print HOD, Month


_fromHour_ = HOD
_toHour_ = HOD + 1

_fromMonth_ = Month
_toMonth_ = Month
# ---------- end python_script_4 ----------
analysisperiod_5 = Ladybug_AnalysisPeriod(
    fromMonth=python_script_4.fromMonth,
    fromDay=Slider(1, range=0..6),
    fromHour=python_script_4.fromHour,
    toMonth=python_script_4.toMonth,
    toDay=Slider(31, range=0..31),
    toHour=python_script_4.toHour)  # -> out, analysisPeriod; plug-in component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
panel_12 = Panel(analysisperiod_5.analysisPeriod)
# Render the ASF
combinationmaker_simple = PythonScript(outputASFarray=generate_diamond_array.outputASFarray, x_angle=python_script_3.x_angle, y_angle=python_script_3.y_angle)  # -> out, outputASFangles
# ---------- combinationmaker_simple: Python ----------
#Import Modules------------------------------------------------

import json
import math
import copy
####---CHAPTER1-------------------------

#unpack json file and coppy ASF array to create an empty anglearray
ASFarray=json.loads(outputASFarray)
ASFangles=copy.deepcopy(ASFarray)


for icount,ii in enumerate(ASFangles):
    for jcount, ii in enumerate(ii):
        ASFangles[icount][jcount]=(x_angle,y_angle)
        
        
outputASFangles=json.dumps(ASFangles)
# ---------- end combinationmaker_simple ----------
panel_13 = Panel(combinationmaker_simple.outputASFangles)
render_diamond_array = PythonScript(
    buildingOrientation=building_orientation,
    outputASFangles=combinationmaker_simple.outputASFangles,
    outputASFarray=generate_diamond_array.outputASFarray,
    panelSize=generate_diamond_array.panelSize,
    panelOffset=generate_diamond_array.panelOffset,
    diamond_flag=generate_diamond_array.diamond_flag)  # -> out, DIVA_temprender, LB_temprender; inputs buildingOrientation: Int32
# ---------- render_diamond_array: Python ----------
#13.10.2015
#Prageeth Jayathissa
#Python script to render the ASF based on room given array and angles

#Status: Completed with issues

#Issues: When rotating panels, the rotation around the Y axis doesn't rotate
#around the global Y axis, but the new Y axis based off the previous X axis roation
#------------------------------------------------

import json
import rhinoscriptsyntax as rs
import copy
import math

#diamond_flag = False
#Load JSON file
ASFarray=json.loads(outputASFarray)
ASFangles=json.loads(outputASFangles)


#define Plane where ASF will be built
plane=rs.WorldZXPlane()

#temprender is used for temproarily rendering the ASF. DIVA is rotated, LB not
DIVA_temprender=[]
LB_temprender=[]

#duplicate the ASFarray wihout linking it togher
#Note: ASFrectangles=ASFarray doesn't work as they will both be edited
ASFrectangles=copy.deepcopy(ASFarray)


print ASFangles


if diamond_flag:
    
    #initialise row counter
    icount=0
    for ii in ASFarray:
        #initialise column counter
        jcount=0
        for jj in ii:
            #Draw rectangles on the ZX plane
            LB_panel=rs.AddRectangle(plane, panelSize, panelSize)
            DIVA_panel=rs.AddRectangle(plane, panelSize, panelSize)
            
            #Move them so that the middle is in the origin
            LB_panel=rs.MoveObject(LB_panel,(-panelSize/2,0,-panelSize/2))
            DIVA_panel=rs.MoveObject(DIVA_panel,(-panelSize/2,0,-panelSize/2))
            
            #rotate it to make the diamond shape
            LB_panel=rs.RotateObject(LB_panel,[0,0,0],45,axis=(0,1,0))
            DIVA_panel=rs.RotateObject(DIVA_panel,[0,0,0],45,axis=(0,1,0))
            
            #Extrude it and cap the holes
            #DIVA_panel=rs.ExtrudeCurveStraight(DIVA_panel,(0,0,0),(0,-panelThick,0))
            #rs.CapPlanarHoles(DIVA_panel)
            
            #tilt the panels
            LB_panel=rs.RotateObject(LB_panel,[0,0,0],-ASFangles[icount][jcount][0],axis=(1,0,0))
            DIVA_panel=rs.RotateObject(DIVA_panel,[0,0,0],-ASFangles[icount][jcount][0],axis=(1,0,0))
            
            #rotate axis of panels:
            z_new = (0, -math.sin(math.pi/180*(-ASFangles[icount][jcount][0])) , math.cos(math.pi/180*(-ASFangles[icount][jcount][0])))
            
            #rotate panels azimuth
            LB_panel=rs.RotateObject(LB_panel,[0,0,0],ASFangles[icount][jcount][1],axis=z_new)
            DIVA_panel=rs.RotateObject(DIVA_panel,[0,0,0],ASFangles[icount][jcount][1],axis=z_new)
            
            #move panels
            LB_panel=rs.MoveObject(LB_panel,(jj[0],-panelOffset,jj[1]))
            DIVA_panel=rs.MoveObject(DIVA_panel,(jj[0],-panelOffset,jj[1]))
            
            #render LB panels
            LB_temprender.append(LB_panel)
            
            #rotate panels for DIVA by the building Orientation (this happens directly in LB, later)
            DIVA_panel=rs.RotateObject(DIVA_panel,[0,0,0],buildingOrientation,axis=(0,0,1))
            
            #render DIVA panels
            DIVA_temprender.append(DIVA_panel)
            
            #This is the true output which will be used for further analysis
            #ASFrectangles[icount][jcount]=DIVA_panel

            jcount+=1
        icount+=1
        
else:
    #initialise row counter
    icount=0
    for ii in ASFarray:
        #initialise column counter
        jcount=0
        for jj in ii:
            #Draw rectange on the ZX plane
            
            DIVA_panel=rs.AddRectangle(plane, panelSize, panelSize)
            DIVA_panel=rs.MoveObject(DIVA_panel,(-panelSize/2,0,-panelSize/2))
            #rotate it to make the diamond shape
            #DIVA_panel=rs.RotateObject(DIVA_panel,[0,0,0],45,axis=(0,1,0))
            #Extrude it and cap the holes
            #DIVA_panel=rs.ExtrudeCurveStraight(DIVA_panel,(0,0,0),(0,-panelThick,0))
            #rs.CapPlanarHoles(DIVA_panel)
            #tilt the panels
            DIVA_panel=rs.RotateObject(DIVA_panel,[0,0,0],-ASFangles[icount][jcount][0],axis=(1,0,0))
            z_new = (0, -math.sin(math.pi/180*(-ASFangles[icount][jcount][0])) , math.cos(math.pi/180*(-ASFangles[icount][jcount][0])))
            print z_new
            DIVA_panel=rs.RotateObject(DIVA_panel,[0,0,0],ASFangles[icount][jcount][1],axis=z_new)
            DIVA_panel=rs.MoveObject(DIVA_panel,(jj[0],-panelOffset,jj[1]))
            LB_panel=copy.deepcopy(DIVA_panel)
            DIVA_panel=rs.RotateObject(DIVA_panel,[0,0,0],buildingOrientation,axis=(0,0,1))
            
            
            DIVA_temprender.append(DIVA_panel)
            LB_temprender.append(LB_panel)
            #This is the true output which will be used for further analysis
            ASFrectangles[icount][jcount]=DIVA_panel
    
            jcount+=1
        icount+=1
# ---------- end render_diamond_array ----------

# ----
# Ladybug Solar Analysis
# Create Mesh for Radiation Analysis
# Calculate Radiation on Panels
# Run Ladybug
# Set Legend of Radiation Results
# Create Sky Matrix
# Sky Dome for reference
toggle = BooleanToggle(False)
gencumulativeskymtx = Ladybug_GenCumulativeSkyMtx(epwFile=weatherpath.weather_path, skyDensity=0, workingDir=panel_8, useOldRes=toggle, runIt=Toggle(True))  # -> readMe, cumulativeSkyMtx; plug-in component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
panel_14 = Panel(ladybug)
cpoly = ControlPolygon(Curve=render_diamond_array.LB_temprender)  # -> Polygon, Points
mesh_number = PythonScript(panelSize=python_script.panelSize, desiredGridPointSize=desiredgridpointsize)  # -> out, meshNumber
# ---------- mesh_number: Python ----------
""" 
Script to calculate the number of points into which the mesh of one panel should
be devided, in order to create approximately the desired meshPoint Size

author: Jeremias
"""

meshNumber = int(round(panelSize/float(desiredGridPointSize)))
print "mesh number equals: " + str(meshNumber)

if not (meshNumber)*desiredGridPointSize == panelSize:
    
    print "warning: desiredGridPointSize is not equal to the resulting grid point" \
        + " size. The grid point size will be: "  + str(panelSize/float(meshNumber))
# ---------- end mesh_number ----------
panel_15 = Panel(gencumulativeskymtx.readMe)
mplane = MeshPlane(Boundary=cpoly.Polygon, WidthCount=mesh_number.meshNumber, HeightCount=mesh_number.meshNumber)  # -> Mesh, Area
pt = ConstructPoint(
    XCoordinate=Slider(-1400, range=-1500..190),
    YCoordinate=Slider(-6000, range=-8000..4000),
    ZCoordinate=Slider(14, range=0..100))
legendpar = Ladybug_LegendParameters(
    decimalPlaces=Slider(4, range=0..6),
    legendLocation=pt,
    legendScale=Slider(5, range=0..10),
    fontSize=Slider(100, range=0..100))  # -> legendPar; plug-in component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
selectskymtx = Ladybug_selectSkyMtx(
    cumulativeSkyMtx=gencumulativeskymtx.cumulativeSkyMtx,
    analysisPeriod=analysisperiod_5.analysisPeriod,
    removeDiffuse=Toggle(False),
    removeDirect=Toggle(False))  # -> readMe, selectedSkyMtx; plug-in component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
flip = MeshFlip(Mesh=mplane.Mesh)
toggle_2 = BooleanToggle(False)
pt_2 = Point(Point(8638.094015, 3329.922026, 0))
num = Number(0.01)
skydome = Ladybug_SkyDome(
    north=multiplication,
    selectedSkyMtx=selectskymtx.selectedSkyMtx,
    centerPoint=pt_2,
    scale=num,
    showTotalOnly=False,
    runIt=Toggle(False),
    bakeIt=False)  # -> readMe, skyPatchesMesh, baseCrvs, legend, legendBasePts, skyPatchesCenPts, skyPatchesAreas, skyPatchesAsBrep, values; plug-in component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
radiationanalysis = Ladybug_RadiationAnalysis(
    north=multiplication,
    geometry=flatten(flip),
    context=flatten(cont_surf),
    disFromBase=Slider(0.5, range=-1..1),
    selectedSkyMtx=flatten(selectskymtx.selectedSkyMtx),
    legendPar=flatten(legendpar),
    parallel=Toggle(True),
    runIt=toggle_2,
    workingDir=toggle_2,
    projectName="testproject_01")  # -> readMe, contextMesh, analysisMesh, testPts, testVec, port, radiationResult, radiationMesh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; disabled; plug-in component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
pt_3 = ConstructPoint(XCoordinate=15000, YCoordinate=0, ZCoordinate=6000)
panel_16 = Panel(radiationanalysis.readMe)
screenmesh = ScreenOrientedMesh(Mesh=radiationanalysis.radiationLegend, Location=pt_3, SizeFactor=1, Depth=1, Absolute=True)

panel_17 = Panel(selectskymtx.selectedSkyMtx)
panel_18 = Panel(radiationanalysis.totalRadiation)
panel_19 = Panel(radiationanalysis.radiationResult)
panel_20 = Panel(python_script_3.out)
brep = Brep(srf_2)
number_slider_4 = Slider(1, range=0..1)
flip_2 = MeshFlip(Mesh=mesh_plane.Mesh)
houriterationnumber = Integer(python_script_3.HOD)
window = Brep(srf)
toggle_3 = BooleanToggle(False)

# ----
# Save Radiation Results
panel_21 = Panel("radiation_results")
set_radiation_data_path = PythonScript(runWhenChanged=toggle_2, folder_name=panel_21)  # -> out, file_path
# ---------- set_radiation_data_path: Python ----------
#Save Temperature from .epw weather file

import sys, os
import datetime

# assign destination:
file_path = ghenv.Component.OnPingDocument().FilePath
asf_folder = '\\'.join(file_path.split('\\')[0:-1])

file_path = os.path.join(asf_folder , str(folder_name))+'\\'

print file_path
# ---------- end set_radiation_data_path ----------
copylayoutandcomb = PythonScript(Iteration=houriterationnumber, destination=set_radiation_data_path.file_path)
# ---------- copylayoutandcomb: Python ----------
#06.01.2016
#Jeremias Schmidli
#Python script to produce a python file with ASF layout and combination parameters for post processing

from shutil import copyfile

if Iteration == 0 or Iteration == 1:
    # assign destination:
    file_path = ghenv.Component.OnPingDocument().FilePath
    current_folder = '\\'.join(file_path.split('\\')[0:-1])
    src = current_folder + "\data\grasshopper\LayoutAndCombinations.txt"
    
    dst = destination + 'LayoutAndCombinations.txt'
    copyfile(src, dst)
    print dst

pass
# ---------- end copylayoutandcomb ----------
c_script = CSharpScript(
    HourIterationNumber=houriterationnumber,
    x_angle=python_script_3.x_angle,
    y_angle=python_script_3.y_angle,
    hourOfMonth=python_script_3.HOD,
    month=python_script_3.Month,
    totalRadiation=radiationanalysis.totalRadiation,
    panelSize=generate_diamond_array.panelSize,
    radiationPerPanel=radiationanalysis.radiationResult,
    path=set_radiation_data_path.file_path,
    fileName="RadiationResults")  # -> out, A; inputs HourIterationNumber: Int32, CombIterationNumber: Int32, x_angle: Double, y_angle: Double, hourOfMonth: Int32, month: Int32, totalRadiation: Double, panelSize: Double, radiationPerPanel: tree of Double, path: String, fileName: String
# ---------- c_script: C# ----------
    //
    // write text file
    //

    List<string> allLines = new List<string>();

    allLines.Add("total_radiation_(kWh per year)");
    allLines.Add(totalRadiation.ToString());
    allLines.Add("panel size");
    allLines.Add(panelSize.ToString());
    allLines.Add("Hour iteration number, Combination iteration number,  hour of month , month, total Radiation");
    allLines.Add(HourIterationNumber.ToString() + ',' + CombIterationNumber.ToString() + ',' + hourOfMonth.ToString() + ',' + month.ToString() + ',' + totalRadiation.ToString());



    allLines.Add("radiation of each grid point (kWh/m² per year, one panel per line)");
    int fieldsPerPanel = radiationPerPanel.Branches[0].Count;
    for(int i = 0; i < radiationPerPanel.BranchCount; i++)
    {
      fieldsPerPanel = radiationPerPanel.Branches[i].Count;
      string radPerPanel = "";
      for (int t = 0; t < fieldsPerPanel - 1; t++)
      {
        radPerPanel += radiationPerPanel.Branches[i][t].ToString() + ",";
      }
      int ti = fieldsPerPanel - 1;
      radPerPanel += radiationPerPanel.Branches[i][ti].ToString();
      allLines.Add(radPerPanel);
    }

    string file = path + fileName + "_" + HourIterationNumber.ToString() + "_" + month.ToString() + "_" + x_angle.ToString() + "_" + y_angle.ToString() + ".csv";
    System.IO.File.WriteAllLines(file, allLines);

    //
    // save screenshot
    //

    // get viewport, create bitmap object, save to file

    //Rhino.Display.RhinoView myView = Rhino.RhinoDoc.ActiveDoc.Views.ActiveView;
    //Bitmap myBitmap = myView.CaptureToBitmap();
    //myBitmap.Save(pngPath);
# ---------- end c_script ----------

geometry = Geometry(flatten([brep, srf_3]))
path = FilePath(weatherpath.weather_path)
boundary_surfaces = BoundarySurfaces(Edges=render_diamond_array.LB_temprender)
radopaquematerial = Honeybee_RadianceOpaqueMaterial(
    materialName="CIGS",
    RReflectance=number_slider_4,
    GReflectance=number_slider_4,
    BReflectance=number_slider_4,
    roughness=Slider(0.1, range=0..1),
    specularity=Slider(0.05, range=0..1))  # -> avrgRef, RADMaterial; plug-in component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
brep_join = BrepJoin(Breps=flatten(geometry))  # -> Breps, Closed
panel_22 = Panel(set_radiation_data_path.file_path)
custom_preview = CustomPreview(Geometry=window, Shader=ColourSwatch(SwatchColor=RGB(255, 255, 255)))
genclimatebasedsky = Honeybee_GenerateClimateBasedSky(weatherFile=path, month=python_script_3.Month, day=python_script_3.Day, hour=python_script_3.HOD)  # -> out, skyFilePath; plug-in component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
flip_3 = Flip(Surface=window)  # -> Surface, Result
datapath_4 = PythonScript(data_file="illuminance.json")  # -> out, file_path; same code as datapath
number_slider_5 = Slider(0.744, range=0..1)
mass2zone = Honeybee_Masses2Zones(zoneMasses=flatten(brep_join.Breps), isConditioned=True, maxRoofAngle=30, createHBZones=Toggle(True))  # -> out, HBZones; plug-in component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
mesh = Mesh(flip)
read_file_4 = ReadFile(File=datapath_4.file_path, PerLineParse=True)
createhbsrfs = Honeybee_createHBSrfs(geometry=boundary_surfaces, srfType="'SHADING'")  # -> out, simplify(HBSurface); plug-in component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
mesh_join = MeshJoin(Meshes=mesh)
radiationanalysis_2 = Ladybug_RadiationAnalysis(
    north=multiplication,
    geometry=flatten(flip_2),
    context=flatten([cont_surf, mesh_join]),
    disFromBase=Slider(0.1, range=-1..1),
    selectedSkyMtx=flatten(selectskymtx.selectedSkyMtx),
    legendPar=flatten(legendpar),
    parallel=Toggle(True),
    runIt=toggle_3,
    workingDir=toggle_3,
    projectName="testproject_01")  # -> readMe, contextMesh, analysisMesh, testPts, testVec, port, radiationResult, radiationMesh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; disabled; plug-in component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
mesh_2 = Mesh(radiationanalysis_2.analysisMesh)
createhbsrfs_2 = Honeybee_createHBSrfs(geometry=mesh_join, srfName="ASFPanels", EPBC="Adiabatic", RADMaterial=radopaquematerial.RADMaterial)  # -> out, simplify(HBSurface); plug-in component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
panel_23 = Panel(radiationanalysis_2.readMe)
panel_24 = Panel([radiationanalysis_2.totalRadiation, radiationanalysis_2.radiationResult])
point_list = PointList(Points=radiationanalysis_2.testPts)
radglassmaterial = Honeybee_RadianceGlassMaterial(
    materialName="Visible Light Tansmittance of Window",
    RTransmittance=number_slider_5,
    GTransmittance=number_slider_5,
    BTransmittance=number_slider_5,
    refractiveIndex=1.52)  # -> avrgTrans, RADMaterial; plug-in component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
houriterationnumber_2 = Integer(python_script_3.HOD)
box_rectangle = BoxRectangle(Rectangle=boundary_surfaces, Height=Domain(0, 10))
panel_25 = Panel(createhbsrfs_2.HBSurface)
panel_26 = Panel(c_script.out)
set_radiation_data_path_2 = PythonScript(runWhenChanged=toggle_3, folder_name="radiation_wall")  # -> out, file_path; same code as set_radiation_data_path
panel_27 = Panel(set_radiation_data_path_2.file_path)
gentestpts = Honeybee_GenerateTestPoints(testGeometry=mesh_join, distBaseSrf=Slider(0.5, range=0..1), moveTestMesh=Toggle(True))  # -> out, simplify(testPoints), simplify(ptsVectors), simplify(facesArea), simplify(mesh); plug-in component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
radparameters = Honeybee_RADParameters(quality=0)  # -> out, radParameters; plug-in component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
number = Number("6")
number_2 = Number("5")
number_3 = Number("3")
c_script_2 = CSharpScript(
    HourIterationNumber=houriterationnumber,
    x_angle=python_script_3.x_angle,
    y_angle=python_script_3.y_angle,
    month=python_script_3.Month,
    totalRadiation=radiationanalysis_2.totalRadiation,
    panelSize=generate_diamond_array.panelSize,
    radiationPerPanel=radiationanalysis_2.radiationResult,
    path=set_radiation_data_path_2.file_path,
    fileName="RadiationWall")  # -> out, A; inputs HourIterationNumber: Int32, CombIterationNumber: Int32, x_angle: Double, y_angle: Double, hourOfMonth: Int32, month: Int32, totalRadiation: Double, panelSize: Double, radiationPerPanel: tree of Double, path: String, fileName: String
# ---------- c_script_2: C# ----------
    //
    // write text file
    //

    List<string> allLines = new List<string>();

    allLines.Add("total_radiation_(kWh per year)");
    allLines.Add(totalRadiation.ToString());
    allLines.Add("panel size");
    allLines.Add(panelSize.ToString());
    allLines.Add("X-Angle, Y-Angle, Hour iteration number, Combination iteration number,  hour of month , month, total Radiation");
    allLines.Add(x_angle.ToString() + ',' + y_angle.ToString() + ',' + HourIterationNumber.ToString() + ',' + CombIterationNumber.ToString() + ',' + hourOfMonth.ToString() + ',' + month.ToString() + ',' + totalRadiation.ToString());





    string file = path + fileName + "_" + HourIterationNumber.ToString() + "_" + month.ToString() + "_" + x_angle.ToString() + "_" + y_angle.ToString() + ".csv";
    System.IO.File.WriteAllLines(file, allLines);

    //
    // save screenshot
    //

    // get viewport, create bitmap object, save to file

    //Rhino.Display.RhinoView myView = Rhino.RhinoDoc.ActiveDoc.Views.ActiveView;
    //Bitmap myBitmap = myView.CaptureToBitmap();
    //myBitmap.Save(pngPath);
# ---------- end c_script_2 ----------
copylayoutandcomb_2 = PythonScript(Iteration=houriterationnumber_2, destination=set_radiation_data_path_2.file_path)  # same code as copylayoutandcomb
vector_display = VectorDisplay(Anchor=gentestpts.testPoints, Vector=gentestpts.ptsVectors)
callfromlibrary = Honeybee_CallFromRadianceLibrary()  # -> materials; plug-in component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
panel_28 = Panel(radparameters.out)
toggle_4 = BooleanToggle(True)
boolean_toggle = BooleanToggle(True)
gridbasedsimulation = Honeybee_GridBasedSimulation(
    skyFile=genclimatebasedsky.skyFilePath,
    testPoints=gentestpts.testPoints,
    ptsVectors=gentestpts.ptsVectors,
    testMesh=gentestpts.mesh,
    simulationType=Slider(1, range=0..100),
    radParameters=radparameters.radParameters)  # -> analysisRecipe; plug-in component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
panel_29 = Panel(c_script_2.out)
radmaterialsinfo = Honeybee_RadianceMaterialsInfo(RADMaterial=callfromlibrary)  # -> RADMaterialStr; plug-in component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
list_item = ListItem(List=radmaterialsinfo, Index=number, Wrap=True)
list_item_2 = ListItem(List=radmaterialsinfo, Index=number_3, Wrap=True)
list_item_3 = ListItem(List=radmaterialsinfo, Index=number_2, Wrap=True)
setradmaterials = Honeybee_SetRadianceMaterials(HBObject=mass2zone.HBZones, wallRADMaterial=list_item_2, floorRADMaterial=list_item, ceilingRADMaterial=list_item_3)  # -> simplify(modifiedHBObject); plug-in component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
createhbsrfs_3 = Honeybee_createHBSrfs(geometry=setradmaterials)  # -> out, simplify(HBSurface); plug-in component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
addhbglz = Honeybee_addHBGlz(HBObj=createhbsrfs_3.HBSurface, childSurfaces=flatten(window), RADMaterials=radglassmaterial.RADMaterial)  # -> HBObjWGLZ; plug-in component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
brep_2 = Brep([createhbsrfs.HBSurface, addhbglz])
brep_wireframe = BrepWireframe(Brep=brep_2, Density=-1)
panel_30 = Panel(list_item)
panel_31 = Panel(list_item_3)
panel_32 = Panel(list_item_2)
panel_33 = Panel("C:\Users\Assistenz\Desktop\Mauro\ASF_Simulation\Simulation_Tool\New_SimulationEnvironment\Illuminance")
updateladybug = Ladybug_UpdateLadybug(updateThisFile=boolean_toggle, updateAllUObjects=boolean_toggle)  # -> out; plug-in component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
panel_34 = Panel(radmaterialsinfo)
rundaylightanalysis = Honeybee_RunDaylightSimulation(
    HBObjects=flatten(brep_2),
    analysisRecipe=gridbasedsimulation,
    writeRad=toggle_4,
    runRad=toggle_4,
    numOfCPUs=Slider(8, range=0..10),
    workingDir=panel_33,
    radFileName="Test",
    overwriteResults=Toggle(True))  # -> out, analysisType, resultsUnit, results, testPts, resultFiles, radGeoFile, studyFolder, done; disabled; plug-in component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
panel_35 = Panel(rundaylightanalysis.out)
gradientlibrary = Ladybug_GradientLibrary(gradIndex="0")  # -> customColors; plug-in component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
panel_36 = Panel(rundaylightanalysis.results)
pt_4 = ConstructPoint(
    XCoordinate=Slider(-1400, range=-1500..190),
    YCoordinate=Slider(-6000, range=-8000..4000),
    ZCoordinate=Slider(14, range=0..100))
legendpar_2 = Ladybug_LegendParameters(
    numSegments=Slider(10, range=0..10),
    customColors=flatten(gradientlibrary),
    legendLocation=pt_4,
    legendScale=Slider(5, range=0..10),
    fontSize=Slider(100, range=0..100),
    decimalPlaces=Slider(2, range=0..6))  # -> legendPar; plug-in component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
save_illuminance = PythonScript(
    location="RadiationResultsReflection",
    month=python_script_3.Month,
    day=python_script_3.Day,
    hour=python_script_3.HOD,
    x_angle=python_script_3.x_angle,
    y_angle=python_script_3.y_angle,
    Transmittance=radglassmaterial.avrgTrans,
    illuminance_values=rundaylightanalysis.results,
    gridsize="25.0")  # -> out, destination; inputs location: list, illuminance_values: list
# ---------- save_illuminance: Python ----------
#Save Illuminance

import sys, os
import datetime

# assign destination:
  
file_path = ghenv.Component.OnPingDocument().FilePath
current_folder = '\\'.join(file_path.split('\\')[0:-1])
location = "RadiationReflection"
destination = os.path.join(current_folder, location)

#destination = "C:\Users\Assistenz\Desktop\Mauro\ASF_Simulation\Simulation_Tool\New_SimulationEnvironment\IlluminanceResults"

print destination

if not os.path.isdir(destination):
    os.makedirs(destination)

#Create empty .csv files
filename = 'RadiationReflection_gridSize_' + str(gridsize) + '_month_' + str(month)+'_day_' + str(day) + '_hour_' + str(hour) + '_xangle_' + str(x_angle)+ '_yangle_' + str(y_angle) + '_' + '.csv'

with open(os.path.join(destination,filename),'w') as f:
    pass
#Write to csv files

#Each itteration will be stored in a row of a csv file
writestring=''

with open(os.path.join(destination,filename),'a') as f:
    
    f.write('Radiation in kWh' +'\n')
    f.write('Month'+','+ str(month) +'\n')
    f.write('Day' + ','+str(day) +'\n')
    f.write('Hour' + ','+str(hour) +'\n')
    f.write('X-Angle' + ','+str(x_angle) +'\n')
    f.write('Y-Angle' + ','+str(y_angle) +'\n')
    writestring=''
    for ii in illuminance_values:
        #Create row in csv
        writestring=writestring+str(ii)+'\n'
    #writestring = 'writetest'
    #remove the last comma
    writestring=writestring[:-1]
    print writestring
    #add a new line and write
    f.write(writestring+'\n')
    
            
    f.close()


print "script was executed"
#totalHeat=sum(Heating)
#totalCool=sum(Cool)
#totalLights=sum(Lights)
#totalEquip=sum(Equip)
# ---------- end save_illuminance ----------
recolormesh = Ladybug_RecolorMesh(
    analysisResult=rundaylightanalysis.results,
    inputMesh=gentestpts.mesh,
    legendPar=legendpar_2,
    analysisTitle=rundaylightanalysis.analysisType,
    legendTitle=rundaylightanalysis.resultsUnit)  # -> out, newMesh, newLegend, legendBasePt, meshColors, legendColors; plug-in component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
panel_37 = Panel(save_illuminance.out)
