# Grasshopper definition mainHourly_TotalRadiation.gh (Grasshopper 1.0.7)
# plug-ins: Human, MeshEdit Components

# ----
# Input Paramters
panel = Panel("FolderName.json")
datapath = PythonScript(data_file="blinds.json")  # -> out, file_path
# ---------- datapath: Python ----------
#import json from python output

import sys, os
import datetime

# assign destination:
file_path = ghenv.Component.OnPingDocument().FilePath
asf_folder = '\\'.join(file_path.split('\\')[0:-1])

file_path = os.path.join(asf_folder , str(data_file))

print file_path
# ---------- end datapath ----------
datapath_2 = PythonScript(data_file="building_static.json")  # -> out, file_path; same code as datapath
datapath_3 = PythonScript(data_file=panel)  # -> out, file_path; same code as datapath
datapath_4 = PythonScript(data_file="comb_static.json")  # -> out, file_path; same code as datapath
file = ReadFile(File=datapath_3.file_path, PerLineParse=True)
file_2 = ReadFile(F=datapath.file_path, PerLineParse=True)  # -> C
#   port F: Uri of file to read
# ---------- file_2: VB line parser ----------
    action = GH_LineParserAction.Include
    Return line

    'Parse the line and return some data that represents the line.
    'If the line cannot be parsed, you can return Nothing and
    'assign a different action.
    'The default implementation is to just return the line itself.
    'If you return types that implement IGH_Goo, this component
    'will work substantially faster.
# ---------- end file_2 ----------
file_3 = ReadFile(File=datapath_2.file_path, PerLineParse=True)
file_4 = ReadFile(File=datapath_4.file_path, PerLineParse=True)
python_script = PythonScript(FolderName=file)  # -> EPW, DataName
# ---------- python_script: Python ----------
import json

FolderName= json.loads(FolderName)

 


DataName = FolderName['DataFolderName']
EPW = FolderName['EPW']



print EPW
# ---------- end python_script ----------

panel_2 = Panel("CEC_Modules.csv")  # disabled
panel_3 = Panel("PV_data.json")  # disabled
number_slider = Slider(0.25, range=0..1)  # disabled
toggle = BooleanToggle(True)
datapath_5 = PythonScript(data_file="static_panel.json")  # -> out, file_path; same code as datapath
datapath_6 = PythonScript(data_file=panel_2)  # -> out, file_path; disabled
# ---------- datapath_6: Python ----------
#import json from python output

import sys, os
import datetime

# assign destination:
file_path = ghenv.Component.OnPingDocument().FilePath
library_folder = '\\'.join(file_path.split('\\')[0:-1])

file_path = os.path.join(library_folder , 'SAM_libraries',str(data_file))

print file_path
# ---------- end datapath_6 ----------
datapath_7 = PythonScript(data_file=panel_3)  # -> out, file_path; disabled; same code as datapath
updateladybug = Ladybug_UpdateLadybug(updateThisFile=toggle, updateAllUObjects=toggle)  # -> out; disabled; plug-in component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
importcecphotovoltaicsmodule = Ladybug_ImportCECPhotovoltaicsModule(modulesLibraryFile=datapath_6.file_path, moduleIndex=number_slider, moduleActiveAreaPercent=90)  # -> out, allModuleNames, port, moduleName, moduleMaterial, moduleMountType, moduleArea, modulePower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; disabled; plug-in component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
file_5 = ReadFile(File=datapath_5.file_path, PerLineParse=True)
file_6 = ReadFile(File=datapath_7.file_path, PerLineParse=True)  # disabled
file_7 = ReadFile(File=datapath_6.file_path, PerLineParse=True)  # disabled
datafolder_for_skymatrix = PythonScript()  # -> data_folder
# ---------- datafolder_for_skymatrix: Python ----------
#Save Temperature from .epw weather file

import sys, os
import datetime

# assign destination:
file_path = ghenv.Component.OnPingDocument().FilePath
asf_folder = '\\'.join(file_path.split('\\')[0:-1])

data_folder = os.path.join(asf_folder, 'data')
print data_folder
# ---------- end datafolder_for_skymatrix ----------
ghpython_script = GhPythonScript(X=file_6)  # -> Out, A; disabled
panel_4 = Panel(python_script.DataName)
panel_5 = Panel(datafolder_for_skymatrix)
weatherpath = PythonScript(weather_data_file=python_script.EPW)  # -> out, weather_path, location_noSuffix
# ---------- weatherpath: Python ----------
#Save Temperature from .epw weather file

import sys, os
import datetime

# assign destination:
file_path = ghenv.Component.OnPingDocument().FilePath
asf_folder = '\\'.join(file_path.split('\\')[0:-2])

weather_path = os.path.join(asf_folder + "\WeatherData", str(weather_data_file))

#remove last four letters(suffix) from name = '.epw'  
location_noSuffix = weather_data_file[:-4]

print weather_path
print location_noSuffix
# ---------- end weatherpath ----------
python_script_2 = PythonScript(x=file_2)  # -> PERCENT_HEIGHTjson, TILT_ANGLEjson, slat_height, slat_thickness, BlindOffset, BlindGridSize
# ---------- python_script_2: Python ----------
from ghpythonlib.componentbase import executingcomponent as component
import Grasshopper, GhPython
import System
import Rhino
import rhinoscriptsyntax as rs

class MyComponent(component):
    
    def RunScript(self, x, y):
        #04.04.2022
        #Jasmine de Riedmatten
        #Edited from simulation from ASF
                        
        import json
                        
        x= json.loads(x) #json.loads(): parse JSON string and convert it to Python Dictionary
                        
        print x
                        
        # Need to make the distance % of the window size, not absolute value
        percents = x['PERCENT_HEIGHT']
        PERCENT_HEIGHT = [percent / 100 for percent in percents]
        PERCENT_HEIGHTjson= json.dumps(PERCENT_HEIGHT) #json.dumps(): converts Python object into json string
        TILT_ANGLEjson= json.dumps(x['TILT_ANGLE'])
        slat_height=x['slat_height']
        slat_thickness=x['slat_thickness']
        BlindOffset=x['BlindOffset']
        BlindGridSize=x['BlindGridSize']
                        
        print PERCENT_HEIGHTjson
        
        # return outputs if you have them; here I try it for you:
        return PERCENT_HEIGHTjson, TILT_ANGLEjson, slat_height, slat_thickness, BlindOffset, BlindGridSize
# ---------- end python_script_2 ----------
weatherpath_2 = PythonScript(weather_data_file=python_script.EPW)  # -> out, weather_path, location_noSuffix; same code as weatherpath
python_script_3 = PythonScript(x=file_3)  # -> room_width, room_height, room_depth, BuildingOrientation, glazing_percentage_w, glazing_percentage_h, WindowGridSize
# ---------- python_script_3: Python ----------
from ghpythonlib.componentbase import executingcomponent as component
import Grasshopper, GhPython
import System
import Rhino
import rhinoscriptsyntax as rs

class MyComponent(component):
    
    def RunScript(self, x, y):
        import json
        
        x= json.loads(x)
        
        print x
        
        
        room_width= x['room_width']
        room_height=x['room_height']
        room_depth=x['room_depth']
        BuildingOrientation=x['BuildingOrientation']
        glazing_percentage_w=x['glazing_percentage_w']
        glazing_percentage_h=x['glazing_percentage_h']
        WindowGridSize = x['WindowGridSize']

        
        # return outputs if you have them; here I try it for you:
        return (room_width, room_height, room_depth, BuildingOrientation, glazing_percentage_w, glazing_percentage_h, WindowGridSize)
# ---------- end python_script_3 ----------
python_script_4 = PythonScript(x=file_5)  # -> PV_height, moduleWidth, moduleHeight, PanelGridSize
# ---------- python_script_4: Python ----------
from ghpythonlib.componentbase import executingcomponent as component
import Grasshopper, GhPython
import System
import Rhino
import rhinoscriptsyntax as rs

class MyComponent(component):
    
    def RunScript(self, x, y):
        import json
                
        x= json.loads(x)
                
        print x
                
                
        PV_height=x['PV_Height']
        PanelGridSize=x['PanelGridSize']
        moduleWidth = x['moduleWidth']
        moduleHeight = x['moduleHeight']
        
        # return outputs if you have them; here I try it for you:
        return (PV_height,moduleWidth, moduleHeight, PanelGridSize)
# ---------- end python_script_4 ----------
python_script_5 = PythonScript(x=file_4)  # -> percent_blinds, tilt_angle, hour, combination, month, day
# ---------- python_script_5: Python ----------
from ghpythonlib.componentbase import executingcomponent as component
import Grasshopper, GhPython
import System
import Rhino
import rhinoscriptsyntax as rs

class MyComponent(component):
    
    def RunScript(self, x, y):
        import json
        
        x= json.loads(x)
        
        print x
        
        
        percent_blinds=x['percent_blinds']/100
        tilt_angle=x['tilt_angle']
        hour=x['Hour']
        day = x['Day']
        month = x['Month']
        
        print percent_blinds
        
        combination = percent_blinds + tilt_angle
        
        # return outputs if you have them; here I try it for you:
        return (percent_blinds, tilt_angle, hour, combination, month, day)
# ---------- end python_script_5 ----------
python_script_6 = PythonScript(hour=python_script_5.hour, day=python_script_5.day, month=python_script_5.month)  # -> fromHour, toHour, fromDay, toDay, fromMonth, toMonth; inputs hour: Int32, month: Int32
# ---------- python_script_6: Python ----------
import json


print hour, day, month


_fromHour_ = hour
_toHour_ = hour + 1

_fromDay_ = day
_toDay_ = day

_fromMonth_ = month
_toMonth_ = month
# ---------- end python_script_6 ----------
panel_6 = Panel(python_script_2.slat_height)
panel_7 = Panel(python_script_3.room_depth)
panel_8 = Panel([python_script_6.fromHour, python_script_6.toHour])
panel_9 = Panel([python_script_5.percent_blinds, python_script_5.tilt_angle])
define_geometry_facade = PythonScript(
    PV_height=python_script_4.PV_height,
    moduleWidth=python_script_4.moduleWidth,
    moduleHeight=python_script_4.moduleHeight,
    room_height=python_script_3.room_height,
    room_width=python_script_3.room_width)  # -> window_height, TotalPVmoduleSize, number_of_PV_module_h, number_of_PV_module_v
# ---------- define_geometry_facade: Python ----------
from ghpythonlib.componentbase import executingcomponent as component
import Grasshopper, GhPython
import System
import Rhino
import rhinoscriptsyntax as rs

class MyComponent(component):
    
    def RunScript(self, PV_height, modulelWidth, moduleHeight, room_height, room_width):
        window_height = room_height-PV_height
        number_of_PV_module_h =int(room_width /modulelWidth)
        number_of_PV_module_v =int(PV_height /moduleHeight)
        number_of_PV_module = number_of_PV_module_h+number_of_PV_module_v
        total_panelSize = number_of_PV_module*moduleHeight*modulelWidth
        print PV_height
        print room_width
        print total_panelSize
        print number_of_PV_module
                
        
        # return outputs if you have them; here I try it for you:
        return (window_height, total_panelSize, number_of_PV_module_h, number_of_PV_module_v)
# ---------- end define_geometry_facade ----------
panel_10 = Panel(define_geometry_facade.number_of_PV_module_h)

# ----
# Render the PV modules
generate_pv_module_array = PythonScript(
    number_of_PV_module_h=define_geometry_facade.number_of_PV_module_h,
    number_of_PV_module_v=define_geometry_facade.number_of_PV_module_v,
    room_width=python_script_3.room_width,
    PV_height=python_script_4.PV_height,
    moduleWidth=python_script_4.moduleWidth,
    moduleHeight=python_script_4.moduleHeight)  # -> outputPVModuleArray
# ---------- generate_pv_module_array: Python ----------
from ghpythonlib.componentbase import executingcomponent as component
import Grasshopper, GhPython
import System
import Rhino
import rhinoscriptsyntax as rs

class MyComponent(component):
    
    def RunScript(self, number_of_PV_module_h, number_of_PV_module_v, room_width, PV_height, moduleWidth, moduleHeight):
        #Import Modules------------------------------------------------
        
        import json
        import math
        import copy
        ####---CHAPTER1-------------------------
        
        #unpack json file and coppy ASF array to create an empty anglearray
        #ASFarray=json.loads(outputASFarray)
        #ASFangles=copy.deepcopy(ASFarray)
        
        PVModuleArray = []
        for nmod_v in range(number_of_PV_module_v):
            PVModuleArray.append([])
            
        current_height = moduleHeight/2
        for ii in PVModuleArray:
            current_width = moduleWidth/2
            for nmod_h in range(number_of_PV_module_h):
                ii.append((current_width, current_height))
                current_width+=moduleWidth
            current_height+=moduleHeight
                
        outputPVModuleArray=json.dumps(PVModuleArray)
        print PVModuleArray
        
        # return outputs if you have them; here I try it for you:
        return outputPVModuleArray
# ---------- end generate_pv_module_array ----------
render_pvmodulearray = PythonScript(
    buildingOrientation=python_script_3.BuildingOrientation,
    outputPVModuleArray=generate_pv_module_array,
    moduleWidth=python_script_4.moduleWidth,
    moduleHeight=python_script_4.moduleHeight,
    room_height=python_script_3.room_height,
    BlindOffset=python_script_2.BlindOffset)  # -> DIVA_temprender, LB_temprender; inputs buildingOrientation: Int32
# ---------- render_pvmodulearray: Python ----------
from ghpythonlib.componentbase import executingcomponent as component
import Grasshopper, GhPython
import System
import Rhino
import rhinoscriptsyntax as rs

class MyComponent(component):
    
    def RunScript(self, buildingOrientation, outputPVModuleArray, moduleWidth, moduleHeight, room_height, BlindOffset):
        #29.03.2022
        #Jasmine de Riedmatten
        #Python script to render the static facade based on room given array and angles
        
        #
        #------------------------------------------------
        
        import json
        import rhinoscriptsyntax as rs
        import copy
        import math
        
        #diamond_flag = False
        #Load JSON file
        PVModuleArray=json.loads(outputPVModuleArray)
        #ASFangles=json.loads(outputASFangles)
        
        #define Plane where Facade will be built
        plane=rs.WorldZXPlane()
        
        #temprender is used for temproarily rendering the ASF. DIVA is rotated, LB not
        DIVA_temprender=[]
        LB_temprender=[]
        
        #duplicate the ASFarray wihout linking it togher
        #Note: ASFrectangles=ASFarray doesn't work as they will both be edited
        #ASFrectangles=copy.deepcopy(ASFarray)

        #initialise slat counter
        icount=0
        for ii in PVModuleArray:
            #initialise column counter
            jcount=0
            
            for jj in ii:
                #Draw rectangles on the ZX plane
                LB_module=rs.AddRectangle(plane, moduleHeight, moduleWidth)
                DIVA_module=rs.AddRectangle(plane, moduleHeight, moduleWidth)
            
                #Move them so that the middle is in the origin
                LB_panel=rs.MoveObject(LB_module,(-moduleWidth/2, 0, -moduleHeight/2))
                DIVA_module=rs.MoveObject(DIVA_module,(-moduleWidth/2, 0, -moduleHeight/2))
    
                #move panels
                #print room_width/2,-BlindOffset,ii
                LB_module=rs.MoveObject(LB_module,(jj[0],0,jj[1]))
                DIVA_module=rs.MoveObject(DIVA_module,(jj[0],0,jj[1]))
            
                #render LB panels
                LB_temprender.append(LB_module)
                
                #rotate panels for DIVA by the building Orientation (this happens directly in LB, later)
                DIVA_module=rs.RotateObject(DIVA_module,[0,0,0],buildingOrientation,axis=(0,0,1))
                
                #render DIVA panels
                DIVA_temprender.append(DIVA_module)
                
                #This is the true output which will be used for further analysis
                #ASFrectangles[icount][jcount]=DIVA_panel
            
                jcount+=1
            icount+=1
        
        
        #This is the true output which will be used for further analysis
        #ASFrectangles[icount][jcount]=DIVA_panel
        
        # return outputs if you have them; here I try it for you:
        return (DIVA_temprender, LB_temprender)
# ---------- end render_pvmodulearray ----------
mesh_number = PythonScript(
    moduleHeight=python_script_4.moduleHeight,
    moduleWidth=python_script_4.moduleWidth,
    desiredGridPointSize=python_script_4.PanelGridSize)  # -> meshNumber_ver, meshNumber_hor
# ---------- mesh_number: Python ----------
from ghpythonlib.componentbase import executingcomponent as component
import Grasshopper, GhPython
import System
import Rhino
import rhinoscriptsyntax as rs

class MyComponent(component):
    
    def RunScript(self, moduleHeight, moduleWidth, desiredGridPointSize):
        """ 
        Script to calculate the number of points into which the mesh of the panel should
        be devided, in order to create approximately the desired meshPoint Size
        
        author: Jeremias
        edit: Jasmine
        """
        
        meshNumber_ver = int(round(moduleHeight/float(desiredGridPointSize)))
        meshNumber_hor = int(round(moduleWidth/float(desiredGridPointSize)))
        print "mesh number vertically equals: " + str(meshNumber_ver)
        print "mesh number horizontally equals: " + str(meshNumber_hor)
        
        if not (meshNumber_ver)*desiredGridPointSize == moduleHeight:
            
            print "warning: Vertically, desiredGridPointSize is not equal to the resulting grid point" \
                + " size. The grid point size will be: "  + str(moduleHeight/float(meshNumber_ver))
        
        if not (meshNumber_hor)*desiredGridPointSize == moduleWidth:
            
            print "warning: Horizontally, desiredGridPointSize is not equal to the resulting grid point" \
                + " size. The grid point size will be: "  + str(moduleWidth/float(meshNumber_hor))
        # return outputs if you have them; here I try it for you:
        return meshNumber_ver, meshNumber_hor
# ---------- end mesh_number ----------
cpoly = ControlPolygon(Curve=render_pvmodulearray.LB_temprender)  # -> Polygon, Points
mplane = MeshPlane(Boundary=cpoly.Polygon, WidthCount=mesh_number.meshNumber_hor, HeightCount=mesh_number.meshNumber_ver)  # -> Mesh, Area
flip = MeshFlip(Mesh=mplane.Mesh)
mesh = Mesh(flip)

# ----
# Geometry Calculations
render_room = PythonScript(
    buildingOrientation=python_script_3.BuildingOrientation,
    room_depth=python_script_3.room_depth,
    room_width=python_script_3.room_width,
    room_height=python_script_3.room_height,
    glazing_percentage_w=python_script_3.glazing_percentage_w,
    glazing_percentage_h=python_script_3.glazing_percentage_h,
    PV_height=python_script_4.PV_height,
    window_height=define_geometry_facade.window_height)  # -> WallF_W, WallF_PV, AdiabaticSurfaces, WallG; inputs buildingOrientation: Int32
# ---------- render_room: Python ----------
from ghpythonlib.componentbase import executingcomponent as component
import Grasshopper, GhPython
import System
import Rhino
import rhinoscriptsyntax as rs

class MyComponent(component):
    
    def RunScript(self, buildingOrientation, room_depth, room_width, room_height, glazing_percentage_w, glazing_percentage_h, PV_height, window_height):
        #12.10.2015
        #Prageeth Jayathissa
        #Script for rendering the room based on input dimensions
        
        import rhinoscriptsyntax as rs
        
        #Room Dimensions (mm)
        #room_depth=5000
        #room_width=3700
        #room_height=3000 #Check value (approximation)
        #floorThick=200
        #ceilThick=200
        #intWallThick=110 #Real value is 110mm
        #glazeThick=110 #Check this value again
        
        intWallHeight=room_height
        
        gpw=glazing_percentage_w
        gph=glazing_percentage_h
        
        
        #Define Global Plane
        planexy=rs.WorldXYPlane()
        planezx=rs.WorldZXPlane()
        planeyz=rs.WorldYZPlane()
        
        print planexy
        #Create rectangle of floor and extrude 200mm
        #base=rs.AddRectangle(plane, room_width+intWallThick*2, room_depth)
        
        planeR=rs.PlaneFromNormal((room_width,0,0),(1,0,0)) #RightWall
        planeB=rs.PlaneFromNormal((0,room_depth,0),(0,1,0)) #BehindWall
        planeC=rs.PlaneFromNormal((0,0,room_height),(0,0,1)) #Ceiling
        planeW =rs.PlaneFromNormal((0,0,PV_height),(0,1,0)) #Window
        #myBox=rs.ExtrudeCurveStraight(base,(0,0,0),(0,0,room_height))
        
        WallF_W=rs.AddPlaneSurface(planeW,window_height,room_width)
        WallF_PV=rs.AddPlaneSurface(planezx,PV_height,room_width)
        WallL=rs.AddPlaneSurface(planeyz,room_depth,room_height)
        WallR=rs.AddPlaneSurface(planeR,room_depth,room_height)
        WallB=rs.AddPlaneSurface(planeB,room_height,room_width)
        
        #WallF=rs.RotateObject(WallF,[0,0,0],buildingOrientation,axis=(0,0,1))
        
        Floor=rs.AddPlaneSurface(planexy,room_width,room_depth)
        Ceiling=rs.AddPlaneSurface(planeC,room_width,room_depth)
        
        WallG=rs.AddPlaneSurface(planeW,window_height*gph,room_width*gpw)
        WallG=rs.MoveObject(WallG,((1-gpw)*room_width/2,0,(1-gph)*window_height/2))
        #WallG=rs.RotateObject(WallG,[0,0,0],buildingOrientation,axis=(0,0,1))
        
        #Floor=rs.RotateObject(Floor,[0,0,0],buildingOrientation,axis=(0,0,1))
        #Ceiling=rs.RotateObject(Ceiling,[0,0,0],buildingOrientation,axis=(0,0,1))
        #WallL=rs.RotateObject(WallL,[0,0,0],buildingOrientation,axis=(0,0,1))
        #WallR=rs.RotateObject(WallR,[0,0,0],buildingOrientation,axis=(0,0,1))
        #WallB=rs.RotateObject(WallB,[0,0,0],buildingOrientation,axis=(0,0,1))
        
        AdiabaticSurfaces=[Floor,Ceiling,WallL,WallR,WallB]
        
        # return outputs if you have them; here I try it for you:
        return (WallF_W, WallF_PV, AdiabaticSurfaces, WallG)
# ---------- end render_room ----------

# ----
# Render the Blinds
generate_blind_array = PythonScript(
    percent_blind=python_script_5.percent_blinds,
    window_height=define_geometry_facade.window_height,
    slat_height=python_script_2.slat_height,
    room_height=python_script_3.room_height)  # -> outputBlindArray, number_of_slat
# ---------- generate_blind_array: Python ----------
from ghpythonlib.componentbase import executingcomponent as component
import Grasshopper, GhPython
import System
import Rhino
import rhinoscriptsyntax as rs

class MyComponent(component):
    
    def RunScript(self, percent_blind, window_height, slat_height, room_height):
        #Import Modules------------------------------------------------
        
        import json
        import math
        import copy
        ####---CHAPTER1-------------------------
        
        #unpack json file and coppy ASF array to create an empty anglearray
        #ASFarray=json.loads(outputASFarray)
        #ASFangles=copy.deepcopy(ASFarray)
        
        BlindArray = []
        print slat_height
        number_of_slat = int(percent_blind * window_height /slat_height)
        
        print number_of_slat
        
        current_height = room_height
        for islat in range(number_of_slat):
            BlindArray.append(current_height-slat_height)
            current_height-=slat_height

                
        outputBlindArray=json.dumps(BlindArray)
        
        # return outputs if you have them; here I try it for you:
        return outputBlindArray, number_of_slat
# ---------- end generate_blind_array ----------
render_blindarray = PythonScript(
    buildingOrientation=python_script_3.BuildingOrientation,
    outputBlindArray=generate_blind_array.outputBlindArray,
    tilt_angle=python_script_5.tilt_angle,
    room_width=python_script_3.room_width,
    room_height=python_script_3.room_height,
    slat_height=python_script_2.slat_height,
    number_of_slat=generate_blind_array.number_of_slat,
    BlindOffset=python_script_2.BlindOffset)  # -> DIVA_temprender, LB_temprender; inputs buildingOrientation: Int32
# ---------- render_blindarray: Python ----------
from ghpythonlib.componentbase import executingcomponent as component
import Grasshopper, GhPython
import System
import Rhino
import rhinoscriptsyntax as rs

class MyComponent(component):
    
    def RunScript(self, buildingOrientation, outputBlindArray, tilt_angle, room_width, room_height, slat_height, number_of_slat, BlindOffset):
        #29.03.2022
        #Jasmine de Riedmatten
        #Python script to render the static facade based on room given array and angles
        
        #
        #------------------------------------------------
        
        import json
        import rhinoscriptsyntax as rs
        import copy
        import math
        
        #diamond_flag = False
        #Load JSON file
        BlindArray=json.loads(outputBlindArray)
        #ASFangles=json.loads(outputASFangles)
        
        #define Plane where Facade will be built
        plane=rs.WorldZXPlane()
        
        #temprender is used for temproarily rendering the ASF. DIVA is rotated, LB not
        DIVA_temprender=[]
        LB_temprender=[]
        
        #duplicate the ASFarray wihout linking it togher
        #Note: ASFrectangles=ASFarray doesn't work as they will both be edited
        #ASFrectangles=copy.deepcopy(ASFarray)
        
        blind_covering_heigth=number_of_slat*slat_height
        print blind_covering_heigth
        
        #if diamond_flag:
        
        #initialise slat counter
        icount=0
        for ii in BlindArray:
            #initialise column counter
            #jcount=0
            #for jj in ii:
            #Draw rectangles on the ZX plane
            LB_panel=rs.AddRectangle(plane, slat_height, room_width)
            DIVA_panel=rs.AddRectangle(plane, slat_height, room_width)
            
            #Move them so that the middle is in the origin
            LB_panel=rs.MoveObject(LB_panel,(-room_width/2, 0, -slat_height/2))
            DIVA_panel=rs.MoveObject(DIVA_panel,(-room_width/2, 0, -slat_height/2))
            
            #rotate it to make the diamond shape
            #LB_panel=rs.RotateObject(LB_panel,[0,0,0],45,axis=(0,1,0))
            #DIVA_panel=rs.RotateObject(DIVA_panel,[0,0,0],45,axis=(0,1,0))
            
            #Extrude it and cap the holes
            #DIVA_panel=rs.ExtrudeCurveStraight(DIVA_panel,(0,0,0),(0,-panelThick,0))
            #rs.CapPlanarHoles(DIVA_panel)
            
            #tilt the panels
            LB_panel=rs.RotateObject(LB_panel,[0,0,0],-tilt_angle,axis=(1,0,0))
            DIVA_panel=rs.RotateObject(DIVA_panel,[0,0,0],-tilt_angle,axis=(1,0,0))
            
            #rotate axis of panels:
            #z_new = (0, -math.sin(math.pi/180*(-ASFangles[icount][jcount][0])) , math.cos(math.pi/180*(-ASFangles[icount][jcount][0])))
            
            #rotate panels azimuth
            #LB_panel=rs.RotateObject(LB_panel,[0,0,0],ASFangles[icount][jcount][1],axis=z_new)
            #DIVA_panel=rs.RotateObject(DIVA_panel,[0,0,0],ASFangles[icount][jcount][1],axis=z_new)
            
            #move panels
            #print room_width/2,-BlindOffset,ii
            LB_panel=rs.MoveObject(LB_panel,(room_width/2,-BlindOffset,ii))
            DIVA_panel=rs.MoveObject(DIVA_panel,(room_width/2,-BlindOffset,ii))
            
            #render LB panels
            LB_temprender.append(LB_panel)
            
            #rotate panels for DIVA by the building Orientation (this happens directly in LB, later)
            DIVA_panel=rs.RotateObject(DIVA_panel,[0,0,0],buildingOrientation,axis=(0,0,1))
            
            #render DIVA panels
            DIVA_temprender.append(DIVA_panel)
            
            #This is the true output which will be used for further analysis
            #ASFrectangles[icount][jcount]=DIVA_panel
            
            #jcount+=1
            icount+=1
        
        # Create surface of blind box
        LB_box=rs.AddRectangle(plane, BlindOffset, room_width)
        DIVA_box=rs.AddRectangle(plane, BlindOffset, room_width)
        
        #Move them so that the middle is in the origin
        LB_box=rs.MoveObject(LB_box,(-room_width/2, 0, -BlindOffset/2))
        DIVA_box=rs.MoveObject(DIVA_box,(-room_width/2, 0, -BlindOffset/2))
        
        #rotate it to make the diamond shape
        #LB_panel=rs.RotateObject(LB_panel,[0,0,0],45,axis=(0,1,0))
        #DIVA_panel=rs.RotateObject(DIVA_panel,[0,0,0],45,axis=(0,1,0))
        
        #Extrude it and cap the holes
        #DIVA_panel=rs.ExtrudeCurveStraight(DIVA_panel,(0,0,0),(0,-panelThick,0))
        #rs.CapPlanarHoles(DIVA_panel)
        
        #tilt the panels
        LB_box=rs.RotateObject(LB_box,[0,0,0],-90,axis=(1,0,0))
        DIVA_box=rs.RotateObject(DIVA_box,[0,0,0],-90,axis=(1,0,0))
        
        #rotate axis of panels:
        #z_new = (0, -math.sin(math.pi/180*(-ASFangles[icount][jcount][0])) , math.cos(math.pi/180*(-ASFangles[icount][jcount][0])))
        
        #rotate panels azimuth
        #LB_panel=rs.RotateObject(LB_panel,[0,0,0],ASFangles[icount][jcount][1],axis=z_new)
        #DIVA_panel=rs.RotateObject(DIVA_panel,[0,0,0],ASFangles[icount][jcount][1],axis=z_new)
        
        #move panels
        #print room_width/2,-BlindOffset,ii
        LB_box=rs.MoveObject(LB_box,(room_width/2,-BlindOffset,room_height))
        DIVA_box=rs.MoveObject(DIVA_box,(room_width/2,-BlindOffset,room_height))
        
        #render LB panels
        LB_temprender.append(LB_box)
        
        #rotate panels for DIVA by the building Orientation (this happens directly in LB, later)
        DIVA_box=rs.RotateObject(DIVA_box,[0,0,0],buildingOrientation,axis=(0,0,1))
        
        #render DIVA panels
        DIVA_temprender.append(DIVA_box)
        
        #This is the true output which will be used for further analysis
        #ASFrectangles[icount][jcount]=DIVA_panel
        
        # return outputs if you have them; here I try it for you:
        return (DIVA_temprender, LB_temprender)
# ---------- end render_blindarray ----------
mesh_number_2 = PythonScript(
    SlatHeight=python_script_2.slat_height,
    room_width=python_script_3.room_width,
    desiredGridPointSize=python_script_2.BlindGridSize)  # -> meshNumber_ver, meshNumber_hor
# ---------- mesh_number_2: Python ----------
from ghpythonlib.componentbase import executingcomponent as component
import Grasshopper, GhPython
import System
import Rhino
import rhinoscriptsyntax as rs

class MyComponent(component):
    
    def RunScript(self, panelHeight, room_width, desiredGridPointSize):
        """ 
        Script to calculate the number of points into which the mesh of the panel should
        be devided, in order to create approximately the desired meshPoint Size
        
        author: Jeremias
        edit: Jasmine
        """
        
        meshNumber_ver = int(round(panelHeight/float(desiredGridPointSize)))
        meshNumber_hor = int(round(room_width/float(desiredGridPointSize)))
        print "mesh number vertically equals: " + str(meshNumber_ver)
        print "mesh number horizontally equals: " + str(meshNumber_hor)
        
        if not (meshNumber_ver)*desiredGridPointSize == panelHeight:
            
            print "warning: Vertically, desiredGridPointSize is not equal to the resulting grid point" \
                + " size. The grid point size will be: "  + str(panelHeight/float(meshNumber_ver))
        if not (meshNumber_hor)*desiredGridPointSize == panelHeight:
            
            print "warning: Horizontally, desiredGridPointSize is not equal to the resulting grid point" \
                + " size. The grid point size will be: "  + str(room_width/float(meshNumber_hor))
        # return outputs if you have them; here I try it for you:
        return meshNumber_ver, meshNumber_hor
# ---------- end mesh_number_2 ----------
cpoly_2 = ControlPolygon(Curve=render_blindarray.LB_temprender)  # -> Polygon, Points
mplane_2 = MeshPlane(Boundary=cpoly_2.Polygon, WidthCount=mesh_number_2.meshNumber_hor, HeightCount=mesh_number_2.meshNumber_ver)  # -> Mesh, Area
flip_2 = MeshFlip(Mesh=mplane_2.Mesh)
mesh_2 = Mesh(flip_2)

panel_11 = Panel(weatherpath_2.location_noSuffix)
importepw = Ladybug_ImportEpw(epwFile=weatherpath_2.weather_path)  # -> readMe, latitude, location, dryBulbTemperature, dewPointTemperature, relativeHumidity, windSpeed, windDirection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; plug-in component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
multiplication = Multiplication(A=python_script_3.BuildingOrientation, _1=-1)
panel_12 = Panel(importepw.location)
# Render the Building
render_room_2 = PythonScript(
    buildingOrientation=python_script_3.BuildingOrientation,
    WallF_W=render_room.WallF_W,
    WallF_PV=render_room.WallF_PV,
    AdiabaticSurfaces=render_room.AdiabaticSurfaces,
    WallG=render_room.WallG)  # -> WallF_W, WallF_PV, AdiabaticSurfaces, WallG; inputs AdiabaticSurfaces: list
# ---------- render_room_2: Python ----------
from ghpythonlib.componentbase import executingcomponent as component
import Grasshopper, GhPython
import System
import Rhino
import rhinoscriptsyntax as rs

class MyComponent(component):
    
    def RunScript(self, buildingOrientation, WallF_W, WallF_PV, AdiabaticSurfaces, WallG):
        #03.05.2016
        #Jeremias
        #Script to change orientation of building
        
        import rhinoscriptsyntax as rs
        
        
        
        #Define Global Plane
        planexy=rs.WorldXYPlane()
        planezx=rs.WorldZXPlane()
        planeyz=rs.WorldYZPlane()
        
        
        WallG=rs.RotateObject(WallG,[0,0,0],buildingOrientation,axis=(0,0,1))
        
        WallF_W=rs.RotateObject(WallF_W,[0,0,0],buildingOrientation,axis=(0,0,1))
        WallF_PV=rs.RotateObject(WallF_PV,[0,0,0],buildingOrientation,axis=(0,0,1))

        print len(AdiabaticSurfaces)
        print AdiabaticSurfaces
        AdSurf = []
        for i in range(len(AdiabaticSurfaces)):
            AdSurf.append(rs.RotateObject(AdiabaticSurfaces[i],[0,0,0],buildingOrientation,axis=(0,0,1)))
        
        
        # return outputs if you have them; here I try it for you:
        return (WallF_W, WallF_PV, AdiabaticSurfaces, WallG)
# ---------- end render_room_2 ----------
save_parameters = PythonScript(
    PERCENT_HEIGHT=python_script_2.PERCENT_HEIGHTjson,
    TILT_ANGLE=python_script_2.TILT_ANGLEjson,
    PanelDesiredGridPointSize=python_script_4.PanelGridSize,
    moduleHeight=python_script_4.moduleHeight,
    moduleWidth=python_script_4.moduleWidth,
    slat_height=python_script_2.slat_height,
    BlindOffset=python_script_2.BlindOffset,
    outputPVModuleArray=generate_pv_module_array,
    buildingOrientation=python_script_3.BuildingOrientation,
    room_width=python_script_3.room_width,
    room_height=python_script_3.room_height,
    room_depth=python_script_3.room_depth,
    gpW=python_script_3.glazing_percentage_w,
    gpH=python_script_3.glazing_percentage_h,
    WindowGridSize=python_script_3.WindowGridSize,
    DataName=python_script.DataName)  # -> out, a
# ---------- save_parameters: Python ----------
from ghpythonlib.componentbase import executingcomponent as component
import Grasshopper, GhPython
import System
import Rhino
import rhinoscriptsyntax as rs

class MyComponent(component):
    
    def RunScript(self, PERCENT_HEIGHT, TILT_ANGLE, PanelDesiredGridPointSize, moduleHeight, moduleWidth, slat_height, BlindOffset, outputPVModuleArray, buildingOrientation, room_width, room_height, room_depth, gpW, gpH, WindowGridSize, DataName):
        #06.01.2016
        #Jeremias Schmidli
        #29.03.2022
        #update Jasmine de Riedmatten
        #Python script to produce a python file with static layout and combination parameters for post processing
                        
        import sys, os
        import json
                        
        # assign destination:
        file_path = ghenv.Component.OnPingDocument().FilePath
        current_folder = '\\'.join(file_path.split('\\')[0:-1])
        destination =  DataName
                        
        destination_path = os.path.join(os.path.join(current_folder, 'RadiationData'), 'radiation_results_' + DataName)
        print destination_path
        print destination
        #unpack json file and coppy ASF array to create an empty anglearray
        PVModuleArray=json.loads(outputPVModuleArray)
                        
        #Create empty .csv file and add information on parameters
                        
        with open(os.path.join(destination_path,'LayoutAndCombinations.txt'),'w') as f:
            f.write('PERCENT_HEIGHT = ' + PERCENT_HEIGHT+'\n')
            f.write('TILT_ANGLE = ' + TILT_ANGLE+'\n')
            f.write('moduleHeight = ' + str(moduleHeight) +'\n')
            f.write('moduleWidth = ' + str(moduleWidth) +'\n')
            f.write('slat_height = ' + str(slat_height) +'\n')
            f.write('BlindOffset = ' + str(BlindOffset) +'\n')
            f.write('room_width = ' + str(room_width) + '\n')
            f.write('room_height = ' + str(room_height) +'\n')
            f.write('room_depth = ' + str(room_depth) +'\n')
            f.write('glazingPercWidth = ' + str(gpW) + '\n')
            f.write('glazingPercHeight = ' + str(gpH) + '\n')
            f.write('WindowGridSize = ' + str(WindowGridSize) + '\n')
            f.write('PanelDesiredGridPointSize = ' + str(PanelDesiredGridPointSize) + '\n')
            f.write('buildingOrientation = ' + str(buildingOrientation) + '\n')
            f.write('PVModuleArray = ' + str(PVModuleArray))
            f.close()
# ---------- end save_parameters ----------
houriterationnumber = Integer(python_script_5.hour)
panel_13 = Panel(houriterationnumber)
srf = Surface(render_room_2.WallF_W)
srf_2 = Surface(render_room_2.WallF_PV)
srf_3 = Surface(render_room_2.AdiabaticSurfaces)
srf_4 = Surface(render_room_2.WallG)
horizon = PythonScript()  # -> ContextSurface
# ---------- horizon: Python ----------
#12.10.2015
#Prageeth Jayathissa
#Script for rendering the room based on input dimensions

import rhinoscriptsyntax as rs


room_width=200000
room_height=200000 #Check value (approximation)

intWallHeight=room_height



#Define Global Plane
planexy=rs.WorldXYPlane()
planezx=rs.WorldZXPlane()
planeyz=rs.WorldYZPlane()





WallF=rs.AddPlaneSurface(planexy,room_height,room_width)
WallF = rs.MoveObject(WallF,[-100000,-190000,-6000])


ContextSurface = WallF
# ---------- end horizon ----------
cont_surf = PythonScript()  # -> ContextSurface
# ---------- cont_surf: Python ----------
#12.10.2015
#Prageeth Jayathissa
#Script for rendering the room based on input dimensions

import rhinoscriptsyntax as rs


room_width=37000
room_height=30000 #Check value (approximation)

intWallHeight=room_height



#Define Global Plane
planexy=rs.WorldXYPlane()
planezx=rs.WorldZXPlane()
planeyz=rs.WorldYZPlane()





WallF=rs.AddPlaneSurface(planezx,room_height,room_width)
WallF = rs.MoveObject(WallF,[-16000,1,-10000])


ContextSurface = WallF
# ---------- end cont_surf ----------

# ----
# Ladybug Solar Analysis
# Set Legend of Radiation Results
# Calculate Radiation on PV panel
# Create Sky Matrix
# Sky Dome for reference
toggle_2 = BooleanToggle(False)
ladybug = Ladybug_Ladybug()  # -> out; plug-in component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
gencumulativeskymtx = Ladybug_GenCumulativeSkyMtx(
    epwFile=weatherpath_2.weather_path,
    skyDensity=0,
    workingDir=datafolder_for_skymatrix,
    useOldRes=toggle_2,
    runIt=Toggle(True))  # -> out, cumulativeSkyMtx; plug-in component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
analysisperiod = Ladybug_AnalysisPeriod(
    fromMonth=python_script_6.fromMonth,
    fromDay=python_script_6.fromDay,
    fromHour=python_script_6.fromHour,
    toMonth=python_script_6.toMonth,
    toDay=python_script_6.toDay,
    toHour=python_script_6.toHour)  # -> readMe, analysisPeriod; plug-in component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
panel_14 = Panel(ladybug)
panel_15 = Panel(gencumulativeskymtx.out)
toggle_3 = BooleanToggle(False)
toggle_4 = BooleanToggle(False)
selectskymtx = Ladybug_selectSkyMtx(
    cumulativeSkyMtx=gencumulativeskymtx.cumulativeSkyMtx,
    analysisPeriod=analysisperiod.analysisPeriod,
    removeDiffuse=toggle_3,
    removeDirect=toggle_4)  # -> readMe, selectedSkyMtx; plug-in component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
pt = ConstructPoint(
    XCoordinate=Slider(-1400, range=-1500..190),
    YCoordinate=Slider(-6000, range=-8000..4000),
    ZCoordinate=Slider(14, range=0..100))
legendpar = Ladybug_LegendParameters(
    legendLocation=pt,
    legendScale=Slider(0.01, range=0..10),
    fontSize=Slider(100, range=0..100),
    decimalPlaces=Slider(4, range=0..6))  # -> legendPar; plug-in component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
panel_16 = Panel(selectskymtx.readMe)
toggle_5 = BooleanToggle(False)
pt_2 = Point(Point(8638.094015, 3329.922026, 0))
num = Number(0.01)
radiationanalysis = Ladybug_RadiationAnalysis(
    north=multiplication,
    geometry=flatten(mesh),
    context=flatten([cont_surf, horizon]),
    gridSize=python_script_4.PanelGridSize,
    disFromBase=Slider(0.5, range=-1..1),
    selectedSkyMtx=flatten(selectskymtx.selectedSkyMtx),
    legendPar=flatten(legendpar),
    parallel=Toggle(True),
    runIt=toggle_5,
    workingDir=toggle_5,
    projectName="testproject_01")  # -> out, contextMesh, analysisMesh, testPts, testVec, port, radiationResult, radiationMesh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; plug-in component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
skydome = Ladybug_SkyDome(
    north=multiplication,
    selectedSkyMtx=selectskymtx.selectedSkyMtx,
    centerPoint=pt_2,
    scale=num,
    showTotalOnly=False,
    runIt=Toggle(False))  # -> readMe, skyPatchesMesh, baseCrvs, altitudeCrvs, legend, legendBasePts, skyPatchesCenPts, skyPatchesAreas, skyPatchesAsBrep, values; plug-in component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
pt_3 = ConstructPoint(XCoordinate=15000, YCoordinate=0, ZCoordinate=6000)
panel_17 = Panel(radiationanalysis.out)
screenmesh = ScreenOrientedMesh(Mesh=radiationanalysis.radiationLegend, Location=pt_3, SizeFactor=1, Depth=1, Absolute=True)
panel_18 = Panel(radiationanalysis.radiationResult)

panel_19 = Panel(analysisperiod.analysisPeriod)
panel_20 = Panel(horizon)
panel_21 = Panel([mesh_number_2.meshNumber_ver, mesh_number_2.meshNumber_hor])
panel_22 = Panel([mesh_number.meshNumber_ver, mesh_number.meshNumber_hor])

# ----
# Ladybug Window Analysis
python_script_7 = PythonScript(
    gridSize=python_script_3.WindowGridSize,
    room_width=python_script_3.room_width,
    room_height=python_script_3.room_height,
    glazing_w=python_script_3.glazing_percentage_w,
    glazing_h=python_script_3.glazing_percentage_h)  # -> WidthCount, HeightCount
# ---------- python_script_7: Python ----------
print gridSize

WidthCount = round((glazing_w * room_width)/gridSize)
HeightCount = round((glazing_h * room_height)/gridSize)

print WidthCount
print HeightCount
# ---------- end python_script_7 ----------
number_slider_2 = Slider(0.5, range=-1..1)
panel_23 = Panel([python_script_7.HeightCount, python_script_7.WidthCount])
toggle_6 = BooleanToggle(True)
toggle_7 = BooleanToggle(False)
mplane_3 = MeshPlane(Boundary=srf_4, WidthCount=python_script_7.WidthCount, HeightCount=python_script_7.HeightCount)  # -> Mesh, Area
flip_3 = MeshFlip(Mesh=mplane_3.Mesh)
radiationanalysis_2 = Ladybug_RadiationAnalysis(
    north=multiplication,
    geometry=flatten(flip_3),
    context=flatten([cont_surf, horizon, mesh_2]),
    disFromBase=number_slider_2,
    selectedSkyMtx=flatten(selectskymtx.selectedSkyMtx),
    legendPar=flatten(legendpar),
    parallel=toggle_6,
    runIt=toggle_7,
    workingDir=toggle_7,
    projectName="testproject_01")  # -> out, contextMesh, analysisMesh, testPts, testVec, port, radiationResult, radiationMesh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; plug-in component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
panel_24 = Panel(radiationanalysis_2.out)
mesh_3 = Mesh(radiationanalysis_2.analysisMesh)
points = PointList(Points=radiationanalysis_2.testPts)

radiationanalysis_3 = Ladybug_RadiationAnalysis(
    north=multiplication,
    geometry=flatten(flip_3),
    context=flatten([cont_surf, horizon]),
    disFromBase=number_slider_2,
    selectedSkyMtx=flatten(selectskymtx.selectedSkyMtx),
    legendPar=flatten(legendpar),
    parallel=toggle_6,
    runIt=toggle_7,
    workingDir=toggle_7,
    projectName="testproject_01")  # -> out, contextMesh, analysisMesh, testPts, testVec, port, radiationResult, radiationMesh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; plug-in component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

# ----
# Save Radiation Results ASF
panel_25 = Panel("radiation_results")
set_radiation_data_path = PythonScript(radData="RadiationData", runWhenChanged=toggle_5, folder_name=panel_25, DataNamePV=python_script.DataName)  # -> out, file_path
# ---------- set_radiation_data_path: Python ----------
#Save Temperature from .epw weather file

import sys, os
import datetime

# assign destination:
file_path = ghenv.Component.OnPingDocument().FilePath
asf_folder = '\\'.join(file_path.split('\\')[0:-1])

file_path = os.path.join(asf_folder , str(radData) + '\\' + str(folder_name) + '_' + DataNamePV)+'\\'

print file_path
# ---------- end set_radiation_data_path ----------
copylayoutandcomb = PythonScript(Iteration=houriterationnumber, destination=set_radiation_data_path.file_path)
# ---------- copylayoutandcomb: Python ----------
#06.01.2016
#Jeremias Schmidli
#Python script to produce a python file with ASF layout and combination parameters for post processing

from shutil import copyfile

if Iteration == 0 or Iteration == 1:
    # assign destination:
    file_path = ghenv.Component.OnPingDocument().FilePath
    current_folder = '\\'.join(file_path.split('\\')[0:-1])
    src = current_folder + "\data\grasshopper\LayoutAndCombinations.txt"
    
    dst = destination + 'LayoutAndCombinations.txt'
    copyfile(src, dst)
    print dst

pass
# ---------- end copylayoutandcomb ----------

# ----
# Electricity Production
toggle_8 = BooleanToggle(False)
photovoltaicssurface = Ladybug_PhotovoltaicsSurface(
    epwFile=weatherpath_2.weather_path,
    PVsurface=graft(render_pvmodulearray.LB_temprender),
    PVsurfacePercent=100,
    DCtoACderateFactor=0.85,
    PVmoduleSettings=["close roof mount", "c-Si", 1, 90, 15, -0.5, -2.98, -0.0471, 1],
    north=multiplication,
    runIt=toggle_8)  # -> out, port, ACenergyPerHour, ACenergyPerYear, averageDailyACenergyPerYear, port_2, DCenergyPerHour, totalRadiationPerHour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; plug-in component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
set_radiation_data_path_2 = PythonScript(radData="RadiationData", runWhenChanged=toggle_8, folder_name="electricity_LB", DataNameWin=python_script.DataName)  # -> out, file_path
# ---------- set_radiation_data_path_2: Python ----------
#Save Temperature from .epw weather file

import sys, os
import datetime

# assign destination:
file_path = ghenv.Component.OnPingDocument().FilePath
asf_folder = '\\'.join(file_path.split('\\')[0:-1])

file_path = os.path.join(asf_folder ,  str(radData) + '\\'+ str(folder_name) + '_' + DataNameWin)+'\\'

print file_path
# ---------- end set_radiation_data_path_2 ----------
split = SplitList(List=photovoltaicssurface.DCenergyPerHour, Index="7")  # -> ListA, ListB
split_2 = SplitList(List=photovoltaicssurface.ACenergyPerHour, Index="7")  # -> ListA, ListB
split_3 = SplitList(List=photovoltaicssurface.totalRadiationPerHour, Index="7")  # -> ListA, ListB
split_4 = SplitList(List=photovoltaicssurface.cellTemperaturePerHour, Index="7")  # -> ListA, ListB
c_script = CSharpScript(
    ACenergyPerHour=split_2.ListB,
    ACenergyPerYear=photovoltaicssurface.ACenergyPerYear,
    averageDailyACenergyPerYear=photovoltaicssurface.averageDailyACenergyPerYear,
    DCenergyPerHour=split.ListB,
    totalRadiationPerHour=split_3.ListB,
    cellTemperaturePerHour=split_4.ListB,
    PVsurfaceTiltAngle=photovoltaicssurface.PVsurfaceTiltAngle,
    PVsurfaceAzimuthAngle=photovoltaicssurface.PVsurfaceAzimuthAngle,
    systemSize=photovoltaicssurface.systemSize,
    path=set_radiation_data_path_2.file_path,
    fileName="ElectricityResults")  # -> out, A; inputs ACenergyPerHour: list of Double, ACenergyPerYear: Double, averageDailyACenergyPerYear: Double, DCenergyPerHour: list of Double, totalRadiationPerHour: list of Double, cellTemperaturePerHour: list of Double, PVsurfaceTiltAngle: Double, PVsurfaceAzimuthAngle: Double, systemSize: Double, path: String, fileName: String
# ---------- c_script: C# ----------
    //
    // write text file
    //

    List<string> allLines = new List<string>();

    allLines.Add("ACenergyPerYear(kWh per year)");
    allLines.Add(ACenergyPerYear.ToString());
    allLines.Add("averageDailyACenergyPerYear(kWh per day)");
    allLines.Add(averageDailyACenergyPerYear.ToString());
    allLines.Add("PVsurfaceTiltAngle");
    allLines.Add(PVsurfaceTiltAngle.ToString());
    allLines.Add("PVsurfaceAzimuthAngle");
    allLines.Add(PVsurfaceAzimuthAngle.ToString());
    allLines.Add("systemSize(m2)");
    allLines.Add(systemSize.ToString());
    allLines.Add("ACenergyPerHour(kWh per Hour)");
    allLines.Add("DCenergyPerHour(kWh per Hour)");
    allLines.Add("totalRadiationPerHour(kWh per Hour)");
    allLines.Add("cellTemperaturePerHour(°C)");

    string yearACenergyPerHour = "";
    string yearDCenergyPerHour = "";
    string yearTotalRadiationPerHour = "";
    string yearCellTemperaturePerHour = "";
    for(int i = 0; i < ACenergyPerHour.Count; i++)
    {
      yearACenergyPerHour += (ACenergyPerHour[i]*1000).ToString() + ",";
      yearDCenergyPerHour += (DCenergyPerHour[i] * 1000).ToString() + ",";
      yearTotalRadiationPerHour += (totalRadiationPerHour[i] * 1000).ToString() + ",";
      yearCellTemperaturePerHour += cellTemperaturePerHour[i].ToString() + ",";
    }


    allLines.Add(yearACenergyPerHour);
    allLines.Add(yearDCenergyPerHour);
    allLines.Add(yearTotalRadiationPerHour);
    allLines.Add(yearCellTemperaturePerHour);
    //allLines.Add("panel size");
    //allLines.Add(panelSize.ToString());
    //allLines.Add("Hour iteration number, Combination iteration number,  hour of month , month, total Radiation");
    //allLines.Add(HourIterationNumber.ToString() + ',' + CombIterationNumber.ToString() + ',' + hourOfMonth.ToString() + ',' + month.ToString() + ',' + totalRadiation.ToString());



    //allLines.Add("radiation of each grid point (kWh/m² per year, one panel per line)");
    //int fieldsPerPanel = radiationPerPanel.Branches[0].Count;
    //for(int i = 0; i < radiationPerPanel.BranchCount; i++)
    //{
    //  fieldsPerPanel = radiationPerPanel.Branches[i].Count;
    //  string radPerPanel = "";
    // for (int t = 0; t < fieldsPerPanel - 1; t++)
    //  {
    //    radPerPanel += radiationPerPanel.Branches[i][t].ToString() + ",";
    //  }
    //  int ti = fieldsPerPanel - 1;
    //  radPerPanel += radiationPerPanel.Branches[i][ti].ToString();
    //  allLines.Add(radPerPanel);
    //}
    string file = path + fileName + ".csv";
    //+ HourIterationNumber.ToString() + "_" + day.ToString() + "_" + month.ToString() + "_" + percent_blinds.ToString() + "_" + tilt_angle.ToString() + ".csv";
    System.IO.File.WriteAllLines(file, allLines);

    //
    // save screenshot
    //

    // get viewport, create bitmap object, save to file

    //Rhino.Display.RhinoView myView = Rhino.RhinoDoc.ActiveDoc.Views.ActiveView;
    //Bitmap myBitmap = myView.CaptureToBitmap();
    //myBitmap.Save(pngPath);
# ---------- end c_script ----------

radiation_pv_from_radiationanalysis = Panel(radiationanalysis.totalRadiation)
radiation_window_with_blinds = Panel(radiationanalysis_2.totalRadiation)
radiation_window_without_blinds = Panel(radiationanalysis_3.totalRadiation)
radiation_pv_from_pv_surface = Panel(split_3.ListB)
panel_26 = Panel(set_radiation_data_path.file_path)
panel_27 = Panel(radiationanalysis_2.radiationResult)
panel_28 = Panel(photovoltaicssurface.ACenergyPerHour)
c_script_2 = CSharpScript(
    HourIterationNumber=houriterationnumber,
    percent_blinds=python_script_5.percent_blinds,
    tilt_angle=python_script_5.tilt_angle,
    hourOfMonth=python_script_5.hour,
    day=python_script_5.day,
    month=python_script_5.month,
    totalRadiation=radiationanalysis.totalRadiation,
    panelSize=define_geometry_facade.TotalPVmoduleSize,
    radiationPerPanel=radiationanalysis.radiationResult,
    path=set_radiation_data_path.file_path,
    fileName="RadiationResults")  # -> out, A; inputs HourIterationNumber: Int32, CombIterationNumber: Int32, percent_blinds: Double, tilt_angle: Double, hourOfMonth: Int32, day: Int32, month: Int32, totalRadiation: Double, panelSize: Double, radiationPerPanel: tree of Double, path: String, fileName: String
# ---------- c_script_2: C# usings ----------
using System.IO;
using System.Linq;
using System.Data;
using System.Drawing;
using System.Reflection;
using System.Windows.Forms;
using System.Xml;
using System.Xml.Linq;
using System.Runtime.InteropServices;

using Rhino.DocObjects;
using Rhino.Collections;
using GH_IO;
using GH_IO.Serialization;
# ---------- c_script_2: C# ----------
    //
    // write text file
    //

    List<string> allLines = new List<string>();

    allLines.Add("total_radiation_(kWh per year)");
    allLines.Add(totalRadiation.ToString());
    allLines.Add("panel size");
    allLines.Add(panelSize.ToString());
    allLines.Add("Hour iteration number, Combination iteration number,  hour of month , month, total Radiation");
    allLines.Add(HourIterationNumber.ToString() + ',' + CombIterationNumber.ToString() + ',' + hourOfMonth.ToString() + ',' + month.ToString() + ',' + totalRadiation.ToString());



    allLines.Add("radiation of each grid point (kWh/m² per year, one panel per line)");
    int fieldsPerPanel = radiationPerPanel.Branches[0].Count;
    for(int i = 0; i < radiationPerPanel.BranchCount; i++)
    {
      fieldsPerPanel = radiationPerPanel.Branches[i].Count;
      string radPerPanel = "";
      for (int t = 0; t < fieldsPerPanel - 1; t++)
      {
        radPerPanel += radiationPerPanel.Branches[i][t].ToString() + ",";
      }
      int ti = fieldsPerPanel - 1;
      radPerPanel += radiationPerPanel.Branches[i][ti].ToString();
      allLines.Add(radPerPanel);
    }

    percent_blinds = percent_blinds * 100;
    string file = path + fileName + "_" + HourIterationNumber.ToString() + "_" + day.ToString() + "_" + month.ToString() + ".csv";
    System.IO.File.WriteAllLines(file, allLines);

    //
    // save screenshot
    //

    // get viewport, create bitmap object, save to file

    //Rhino.Display.RhinoView myView = Rhino.RhinoDoc.ActiveDoc.Views.ActiveView;
    //Bitmap myBitmap = myView.CaptureToBitmap();
    //myBitmap.Save(pngPath);
# ---------- end c_script_2 ----------

# ----
# Save Radiation Results Window
panel_29 = Panel("radiation_wall")
set_radiation_data_path_3 = PythonScript(radData="RadiationData", runWhenChanged=toggle_7, folder_name=panel_29, DataNameWin=python_script.DataName)  # -> out, file_path; same code as set_radiation_data_path_2
copylayoutandcomb_2 = PythonScript(Iteration=houriterationnumber, destination=set_radiation_data_path_3.file_path)  # same code as copylayoutandcomb
panel_30 = Panel(set_radiation_data_path_3.file_path)
c_script_3 = CSharpScript(
    HourIterationNumber=houriterationnumber,
    percent_blinds=python_script_5.percent_blinds,
    tilt_angle=python_script_5.tilt_angle,
    hourOfMonth=python_script_5.hour,
    day=python_script_5.day,
    month=python_script_5.month,
    totalRadiation=radiationanalysis_2.totalRadiation,
    panelSize=define_geometry_facade.TotalPVmoduleSize,
    radiationPerPanel=radiationanalysis_2.radiationResult,
    path=set_radiation_data_path_3.file_path,
    fileName="RadiationWall")  # -> out, A; inputs HourIterationNumber: Int32, CombIterationNumber: Int32, percent_blinds: Double, tilt_angle: Double, hourOfMonth: Int32, day: Int32, month: Int32, totalRadiation: Double, panelSize: Double, radiationPerPanel: tree of Double, path: String, fileName: String
# ---------- c_script_3: C# ----------
    //
    // write text file
    //

    List<string> allLines = new List<string>();

    allLines.Add("total_radiation_(kWh per year)");
    allLines.Add(totalRadiation.ToString());
    allLines.Add("panel size");
    allLines.Add(panelSize.ToString());
    allLines.Add("Percent Blind, tilt anlge, Hour iteration number, Combination iteration number,  hour of month , month, total Radiation");
    allLines.Add(percent_blinds.ToString() + ',' + tilt_angle.ToString() + ',' + HourIterationNumber.ToString() + ',' + CombIterationNumber.ToString() + ',' + hourOfMonth.ToString() + ',' + month.ToString() + ',' + totalRadiation.ToString());

    



    percent_blinds = percent_blinds * 100;
    string file = path + fileName + "_" + HourIterationNumber.ToString() + "_" + day.ToString() + "_" + month.ToString() + "_" + percent_blinds.ToString() + "_" + tilt_angle.ToString() + ".csv";
    System.IO.File.WriteAllLines(file, allLines);

    //
    // save screenshot
    //

    // get viewport, create bitmap object, save to file

    //Rhino.Display.RhinoView myView = Rhino.RhinoDoc.ActiveDoc.Views.ActiveView;
    //Bitmap myBitmap = myView.CaptureToBitmap();
    //myBitmap.Save(pngPath);
# ---------- end c_script_3 ----------

# ----
# Save details of weather file
number_slider_3 = Slider(1, range=1..31)

analysisperiod_2 = Ladybug_AnalysisPeriod(
    fromMonth=number_slider_3,
    fromDay=Slider(1, range=1..31),
    fromHour=Slider(1, range=1..24),
    toMonth=Slider(12, range=1..12),
    toDay=Slider(31, range=1..31),
    toHour=Slider(24, range=1..31))  # -> readMe, analysisPeriod; plug-in component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
sunpath = Ladybug_SunPath(
    location=importepw.location,
    hour=12,
    day=21,
    month=12,
    timeStep=1,
    analysisPeriod=analysisperiod_2.analysisPeriod,
    dailyOrAnnualSunPath=True)  # -> out, sunVectors, sunAltitudes, sunAzimuths, port, sunSpheresMesh, sunPathCrvs, compassCrvs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; disabled; plug-in component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
selectskymtx_2 = Ladybug_selectSkyMtx(
    cumulativeSkyMtx=gencumulativeskymtx.cumulativeSkyMtx,
    analysisPeriod=analysisperiod_2.analysisPeriod,
    removeDiffuse=toggle_3,
    removeDirect=toggle_4)  # -> readMe, selectedSkyMtx; plug-in component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

savesunposition = PythonScript(location=panel_11, HOY=sunpath.sunPositionsHOY, Altitude=sunpath.sunAltitudes, Azimuth=sunpath.sunAzimuths)  # -> out, destination; inputs location: list, HOY: list, Altitude: list, Azimuth: list; disabled
# ---------- savesunposition: Python ----------
#13.10.2015
#Prageeth Jayathissa
#Python script to read DIVA inputs and produce a CSV file

import sys, os
import datetime

# assign destination:
file_path = ghenv.Component.OnPingDocument().FilePath
current_folder = '\\'.join(file_path.split('\\')[0:-1])
location = str(location)[2:-2]
destination = os.path.join(current_folder + "\data\geographical_location", location)

print destination
print location
if not os.path.isdir(destination):
    os.makedirs(destination)

#Create empty .csv files

with open(os.path.join(destination,'SunPosition.csv'),'w') as f:
    pass
#Write to csv files

#Each itteration will be stored in a row of a csv file
writestring=''
#print HOY
with open(os.path.join(destination,'SunPosition.csv'),'a') as f:
    
    f.write('HOY on line 2, Altitude (degrees from horizontal) on line 3, Azimuth (degrees east of north) on line 4' +'\n')
    
    writestring=''
    for ii in HOY:
        #Create row in csv
        writestring=writestring+str(ii)+','
    #writestring = 'writetest'
    #remove the last comma
    writestring=writestring[:-1]
    print writestring
    #add a new line and write
    f.write(writestring+'\n')
    
    writestring=''
    for ii in Altitude:
        #Create row in csv
        writestring=writestring+str(ii)+','
    #writestring = 'writetest'
    #remove the last comma
    writestring=writestring[:-1]
    print writestring
    #add a new line and write
    f.write(writestring+'\n')
    
    writestring=''    
    for ii in Azimuth:
        #Create row in csv
        writestring=writestring+str(ii)+','
    #writestring = 'writetest'
    #remove the last comma
    writestring=writestring[:-1]
    print writestring
    #add a new line and write
    f.write(writestring+'\n')
    
    f.close()


print "script was executed"
#totalHeat=sum(Heating)
#totalCool=sum(Cool)
#totalLights=sum(Lights)
#totalEquip=sum(Equip)
# ---------- end savesunposition ----------
