# Grasshopper definition mainNew_static.gh (Grasshopper 1.0.7)
# plug-ins: Human, MeshEdit Components

# Input Paramters
panel = Panel("blinds.json")

datapath = PythonScript(data_file=panel)  # -> out, file_path
# ---------- datapath: Python ----------
#import json from python output

import sys, os
import datetime

# assign destination:
file_path = ghenv.Component.OnPingDocument().FilePath
asf_folder = '\\'.join(file_path.split('\\')[0:-1])

file_path = os.path.join(asf_folder , str(data_file))

print file_path
# ---------- end datapath ----------
datapath_2 = PythonScript(data_file="building.json")  # -> out, file_path; same code as datapath
datapath_3 = PythonScript(data_file="FolderName.json")  # -> out, file_path; same code as datapath
datapath_4 = PythonScript(data_file="static_panel.json")  # -> out, file_path; same code as datapath
datapath_5 = PythonScript(data_file="comb_static.json")  # -> out, file_path; same code as datapath
read_file = ReadFile(File=datapath.file_path, PerLineParse=True)
read_file_2 = ReadFile(File=datapath_2.file_path, PerLineParse=True)
read_file_3 = ReadFile(File=datapath_3.file_path, PerLineParse=True)
read_file_4 = ReadFile(File=datapath_4.file_path, PerLineParse=True)
read_file_5 = ReadFile(File=datapath_5.file_path, PerLineParse=True)

panel_2 = Panel(read_file_5)
panel_3 = Panel("{\"percent_blinds\":50, \"HOD\":16.0, \"tilt_angle\":45, \"Month\":4}")
panel_4 = Panel(read_file_3)
panel_5 = Panel(datapath.file_path)
python_script = PythonScript(x=read_file)  # -> PERCENT_HEIGHTjson, TILT_ANGLEjson, slat_height, slat_thickness, BlindBoxThickness, BlindBoxHeight, BlindGridSize
# ---------- python_script: Python ----------
from ghpythonlib.componentbase import executingcomponent as component
import Grasshopper, GhPython
import System
import Rhino
import rhinoscriptsyntax as rs

class MyComponent(component):
    
    def RunScript(self, x, y):
        #04.04.2022
        #Jasmine de Riedmatten
        #Edited from simulation from ASF
                        
        import json
                        
        x= json.loads(x) #json.loads(): parse JSON string and convert it to Python Dictionary
                        
        print x
                        
        # Need to make the distance % of the window size, not absolute value
        percents = x['PERCENT_HEIGHT']
        PERCENT_HEIGHT = [percent / 100 for percent in percents]
        PERCENT_HEIGHTjson= json.dumps(PERCENT_HEIGHT) #json.dumps(): converts Python object into json string
        TILT_ANGLEjson= json.dumps(x['TILT_ANGLE'])
        slat_height=x['slat_height']
        slat_thickness=x['slat_thickness']
        BlindBoxThickness=x['BlindBoxThickness']
        BlindBoxHeight=x['BlindBoxHeight']
        BlindGridSize=x['BlindGridSize']
                        
        print PERCENT_HEIGHTjson
        
        # return outputs if you have them; here I try it for you:
        return PERCENT_HEIGHTjson, TILT_ANGLEjson, slat_height, slat_thickness, BlindBoxThickness,BlindBoxHeight,  BlindGridSize
# ---------- end python_script ----------
python_script_2 = PythonScript(x=read_file_2)  # -> room_width, room_height, room_depth, BuildingOrientation, glazing_percentage_w, glazing_percentage_h, WindowGridSize, window_percentage_w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
# ---------- python_script_2: Python ----------
from ghpythonlib.componentbase import executingcomponent as component
import Grasshopper, GhPython
import System
import Rhino
import rhinoscriptsyntax as rs

class MyComponent(component):
    
    def RunScript(self, x, y):
        import json
                
        x= json.loads(x)
                
        print x
                
                
        room_width= x['room_width']
        room_height=x['room_height']
        room_depth=x['room_depth']
        BuildingOrientation=x['BuildingOrientation']
        
        WindowGridSize = x['WindowGridSize']
        window_percentage_w = 1.0
        window_percentage_h = x['WWR']/100
        FrameThickness = x['FrameThickness']
        glazing_percentage_w=(window_percentage_w*room_width-3*2*FrameThickness)/room_width
        glazing_percentage_h=(window_percentage_h*room_height-2*FrameThickness)/room_height
                
        print glazing_percentage_w
        print glazing_percentage_h
        
        WindowArea = window_percentage_w*room_width*window_percentage_h*room_height
        print WindowArea
                
                
                
        
        # return outputs if you have them; here I try it for you:
        return (room_width, room_height, room_depth, BuildingOrientation, glazing_percentage_w, glazing_percentage_h, WindowGridSize, window_percentage_w, window_percentage_h, FrameThickness, WindowArea)
# ---------- end python_script_2 ----------
python_script_3 = PythonScript(FolderName=read_file_3)  # -> EPW, DataName
# ---------- python_script_3: Python ----------
import json

FolderName= json.loads(FolderName)

 


DataName = FolderName['DataFolderName']
EPW = FolderName['EPW']



print EPW
# ---------- end python_script_3 ----------
python_script_4 = PythonScript(x=read_file_4)  # -> PV_height, moduleWidth, moduleHeight, panelGridSize
# ---------- python_script_4: Python ----------
from ghpythonlib.componentbase import executingcomponent as component
import Grasshopper, GhPython
import System
import Rhino
import rhinoscriptsyntax as rs

class MyComponent(component):
    
    def RunScript(self, x, y):
        import json
                
        x= json.loads(x)
                
        print x
                
                
        PV_height=x['PV_Height']
        PanelGridSize=x['PanelGridSize']
        moduleWidth = x['moduleWidth']
        moduleHeight = x['moduleHeight']
        
        # return outputs if you have them; here I try it for you:
        return (PV_height,moduleWidth, moduleHeight, PanelGridSize)
# ---------- end python_script_4 ----------
python_script_5 = PythonScript(x=read_file_5)  # -> percent_blinds, tilt_angle, HOD, combination, Month
# ---------- python_script_5: Python ----------
from ghpythonlib.componentbase import executingcomponent as component
import Grasshopper, GhPython
import System
import Rhino
import rhinoscriptsyntax as rs

class MyComponent(component):
    
    def RunScript(self, x, y):
        import json
        
        x= json.loads(x)
        
        print x
        
        
        percent_blinds=x['percent_blinds']/100
        tilt_angle=x['tilt_angle']
        HOD=x['HOD']
        month = x['Month']
        
        print percent_blinds
        
        combination = percent_blinds + tilt_angle
        
        # return outputs if you have them; here I try it for you:
        return (percent_blinds, tilt_angle, HOD, combination, month)
# ---------- end python_script_5 ----------
python_script_6 = PythonScript(HOD=python_script_5.HOD, Month=python_script_5.Month)  # -> fromHour, toHour, fromMonth, toMonth; inputs HOD: Int32, Month: Int32
# ---------- python_script_6: Python ----------
import json


print HOD, Month


_fromHour_ = HOD
_toHour_ = HOD + 1

_fromMonth_ = Month
_toMonth_ = Month
# ---------- end python_script_6 ----------
panel_6 = Panel(python_script_2.WindowArea)
analysisperiod = Ladybug_AnalysisPeriod(
    fromMonth=python_script_6.fromMonth,
    fromDay=Slider(1, range=0..6),
    fromHour=python_script_6.fromHour,
    toMonth=python_script_6.toMonth,
    toDay=Slider(31, range=0..31),
    toHour=python_script_6.toHour)  # -> out, analysisPeriod; plug-in component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
panel_7 = Panel(python_script_5.HOD)
datafolder_for_skymatrix = PythonScript()  # -> data_folder
# ---------- datafolder_for_skymatrix: Python ----------
#Save Temperature from .epw weather file

import sys, os
import datetime

# assign destination:
file_path = ghenv.Component.OnPingDocument().FilePath
asf_folder = '\\'.join(file_path.split('\\')[0:-1])

data_folder = os.path.join(asf_folder, 'data')


print data_folder
# ---------- end datafolder_for_skymatrix ----------
panel_8 = Panel(datafolder_for_skymatrix)
panel_9 = Panel(python_script_5.percent_blinds)
define_geometry_facade = GhPythonScript(
    PV_height=python_script_4.PV_height,
    moduleWidth=python_script_4.moduleWidth,
    moduleHeight=python_script_4.moduleHeight,
    room_height=python_script_2.room_height,
    room_width=python_script_2.room_width)  # -> window_height, TotalPVmoduleSize, number_of_PV_module_h, nuimber_of_PV_module_v
# ---------- define_geometry_facade: Python ----------
from ghpythonlib.componentbase import executingcomponent as component
import Grasshopper, GhPython
import System
import Rhino
import rhinoscriptsyntax as rs

class MyComponent(component):
    
    def RunScript(self, PV_height, modulelWidth, moduleHeight, room_height, room_width):
        window_height = room_height-PV_height
        number_of_PV_module_h =int(room_width /modulelWidth)
        number_of_PV_module_v =int(PV_height /moduleHeight)
        number_of_PV_module = number_of_PV_module_h+number_of_PV_module_v
        total_panelSize = number_of_PV_module*moduleHeight*modulelWidth
        print PV_height
        print room_width
        print total_panelSize
        print number_of_PV_module
                
        
        # return outputs if you have them; here I try it for you:
        return (window_height, total_panelSize, number_of_PV_module_h, number_of_PV_module_v)
# ---------- end define_geometry_facade ----------
weatherpath = PythonScript(weather_data_file=python_script_3.EPW)  # -> out, weather_path, location_noSuffix
# ---------- weatherpath: Python ----------
#Save Temperature from .epw weather file

import sys, os
import datetime

# assign destination:
file_path = ghenv.Component.OnPingDocument().FilePath
asf_folder = '\\'.join(file_path.split('\\')[0:-2])

weather_path = os.path.join(asf_folder + "\WeatherData", str(weather_data_file))

#remove last four letters(suffix) from name = '.epw'  
location_noSuffix = weather_data_file[:-4]

print weather_path
print location_noSuffix
# ---------- end weatherpath ----------

# ----
# Render the PV modules
generate_pv_module_array = PythonScript(
    number_of_PV_module_h=define_geometry_facade.number_of_PV_module_h,
    number_of_PV_module_v=define_geometry_facade.nuimber_of_PV_module_v,
    room_width=python_script_2.room_width,
    PV_height=python_script_4.PV_height,
    moduleWidth=python_script_4.moduleWidth,
    moduleHeight=python_script_4.moduleHeight)  # -> outputPVModuleArray
# ---------- generate_pv_module_array: Python ----------
from ghpythonlib.componentbase import executingcomponent as component
import Grasshopper, GhPython
import System
import Rhino
import rhinoscriptsyntax as rs

class MyComponent(component):
    
    def RunScript(self, number_of_PV_module_h, number_of_PV_module_v, room_width, PV_height, moduleWidth, moduleHeight):
        #Import Modules------------------------------------------------
        
        import json
        import math
        import copy
        ####---CHAPTER1-------------------------
        
        #unpack json file and coppy ASF array to create an empty anglearray
        #ASFarray=json.loads(outputASFarray)
        #ASFangles=copy.deepcopy(ASFarray)
        
        PVModuleArray = []
        for nmod_v in range(number_of_PV_module_v):
            PVModuleArray.append([])
            
        current_height = moduleHeight/2
        for ii in PVModuleArray:
            current_width = (room_width-number_of_PV_module_h*moduleWidth+moduleWidth)/2
            for nmod_h in range(number_of_PV_module_h):
                ii.append((current_width, current_height))
                current_width+=moduleWidth
            current_height+=moduleHeight
                
        outputPVModuleArray=json.dumps(PVModuleArray)
        print PVModuleArray
        
        # return outputs if you have them; here I try it for you:
        return outputPVModuleArray
# ---------- end generate_pv_module_array ----------
render_pvmodulearray = PythonScript(
    buildingOrientation=python_script_2.BuildingOrientation,
    outputPVModuleArray=generate_pv_module_array,
    moduleWidth=python_script_4.moduleWidth,
    moduleHeight=python_script_4.moduleHeight,
    room_height=python_script_2.room_height,
    BlindOffset=python_script.BlindBoxThickness)  # -> DIVA_temprender, LB_temprender; inputs buildingOrientation: Int32
# ---------- render_pvmodulearray: Python ----------
from ghpythonlib.componentbase import executingcomponent as component
import Grasshopper, GhPython
import System
import Rhino
import rhinoscriptsyntax as rs

class MyComponent(component):
    
    def RunScript(self, buildingOrientation, outputPVModuleArray, moduleWidth, moduleHeight, room_height, BlindOffset):
        #29.03.2022
        #Jasmine de Riedmatten
        #Python script to render the static facade based on room given array and angles
        
        #
        #------------------------------------------------
        
        import json
        import rhinoscriptsyntax as rs
        import copy
        import math
        
        #diamond_flag = False
        #Load JSON file
        PVModuleArray=json.loads(outputPVModuleArray)
        #ASFangles=json.loads(outputASFangles)
        
        #define Plane where Facade will be built
        plane=rs.WorldZXPlane()
        
        #temprender is used for temproarily rendering the ASF. DIVA is rotated, LB not
        DIVA_temprender=[]
        LB_temprender=[]
        
        #duplicate the ASFarray wihout linking it togher
        #Note: ASFrectangles=ASFarray doesn't work as they will both be edited
        #ASFrectangles=copy.deepcopy(ASFarray)

        #initialise slat counter
        icount=0
        for ii in PVModuleArray:
            #initialise column counter
            jcount=0
            
            for jj in ii:
                #Draw rectangles on the ZX plane
                LB_module=rs.AddRectangle(plane, moduleHeight, moduleWidth)
                DIVA_module=rs.AddRectangle(plane, moduleHeight, moduleWidth)
            
                #Move them so that the middle is in the origin
                LB_panel=rs.MoveObject(LB_module,(-moduleWidth/2, 0, -moduleHeight/2))
                DIVA_module=rs.MoveObject(DIVA_module,(-moduleWidth/2, 0, -moduleHeight/2))
    
                #move panels
                #print room_width/2,-BlindOffset,ii
                LB_module=rs.MoveObject(LB_module,(jj[0],0,jj[1]))
                DIVA_module=rs.MoveObject(DIVA_module,(jj[0],0,jj[1]))
            
                #render LB panels
                LB_temprender.append(LB_module)
                
                #rotate panels for DIVA by the building Orientation (this happens directly in LB, later)
                DIVA_module=rs.RotateObject(DIVA_module,[0,0,0],buildingOrientation,axis=(0,0,1))
                
                #render DIVA panels
                DIVA_temprender.append(DIVA_module)
                
                #This is the true output which will be used for further analysis
                #ASFrectangles[icount][jcount]=DIVA_panel
            
                jcount+=1
            icount+=1
        
        
        #This is the true output which will be used for further analysis
        #ASFrectangles[icount][jcount]=DIVA_panel
        
        # return outputs if you have them; here I try it for you:
        return (DIVA_temprender, LB_temprender)
# ---------- end render_pvmodulearray ----------
cpoly = ControlPolygon(Curve=render_pvmodulearray.LB_temprender)  # -> Polygon, Points
mesh_number = PythonScript(
    moduleHeight=python_script_4.moduleHeight,
    moduleWidth=python_script_4.moduleWidth,
    desiredGridPointSize=python_script_4.panelGridSize)  # -> meshNumber_ver, meshNumber_hor
# ---------- mesh_number: Python ----------
from ghpythonlib.componentbase import executingcomponent as component
import Grasshopper, GhPython
import System
import Rhino
import rhinoscriptsyntax as rs

class MyComponent(component):
    
    def RunScript(self, moduleHeight, moduleWidth, desiredGridPointSize):
        """ 
        Script to calculate the number of points into which the mesh of the panel should
        be devided, in order to create approximately the desired meshPoint Size
        
        author: Jeremias
        edit: Jasmine
        """
        
        meshNumber_ver = int(round(moduleHeight/float(desiredGridPointSize)))
        meshNumber_hor = int(round(moduleWidth/float(desiredGridPointSize)))
        print "mesh number vertically equals: " + str(meshNumber_ver)
        print "mesh number horizontally equals: " + str(meshNumber_hor)
        
        if not (meshNumber_ver)*desiredGridPointSize == moduleHeight:
            
            print "warning: Vertically, desiredGridPointSize is not equal to the resulting grid point" \
                + " size. The grid point size will be: "  + str(moduleHeight/float(meshNumber_ver))
        
        if not (meshNumber_hor)*desiredGridPointSize == moduleWidth:
            
            print "warning: Horizontally, desiredGridPointSize is not equal to the resulting grid point" \
                + " size. The grid point size will be: "  + str(moduleWidth/float(meshNumber_hor))
        # return outputs if you have them; here I try it for you:
        return meshNumber_ver, meshNumber_hor
# ---------- end mesh_number ----------
mplane = MeshPlane(Boundary=cpoly.Polygon, WidthCount=mesh_number.meshNumber_hor, HeightCount=mesh_number.meshNumber_ver)  # -> Mesh, Area
flip = MeshFlip(Mesh=mplane.Mesh)
mesh = Mesh(flip)

# ----
# Save Parameters
save_parameters = PythonScript(
    PERCENT_HEIGHT=python_script.PERCENT_HEIGHTjson,
    TILT_ANGLE=python_script.TILT_ANGLEjson,
    PaneldesiredGridPointSize=python_script_4.panelGridSize,
    moduleHeight=python_script_4.moduleHeight,
    moduleWidth=python_script_4.moduleWidth,
    slat_height=python_script.slat_height,
    BlindOffset=python_script.BlindBoxThickness,
    outputPVModuleArray=generate_pv_module_array,
    buildingOrientation=python_script_2.BuildingOrientation,
    room_width=python_script_2.room_width,
    room_height=python_script_2.room_height,
    room_depth=python_script_2.room_depth,
    gpW=python_script_2.glazing_percentage_w,
    gpH=python_script_2.glazing_percentage_h,
    WindowGridSize=python_script_2.WindowGridSize,
    DataName=python_script_3.DataName,
    WindowArea=python_script_2.WindowArea)  # -> a
# ---------- save_parameters: Python ----------
from ghpythonlib.componentbase import executingcomponent as component
import Grasshopper, GhPython
import System
import Rhino
import rhinoscriptsyntax as rs

class MyComponent(component):
    
    def RunScript(self, PERCENT_HEIGHT, TILT_ANGLE, PanelDesiredGridPointSize, moduleHeight, moduleWidth, slat_height, BlindOffset, outputPVModuleArray, buildingOrientation, room_width, room_height, room_depth, gpW, gpH, WindowGridSize, DataName, WindowArea):
        #06.01.2016
        #Jeremias Schmidli
        #29.03.2022
        #update Jasmine de Riedmatten
        #Python script to produce a python file with static layout and combination parameters for post processing
                        
        import sys, os
        import json
                        
        # assign destination:
        file_path = ghenv.Component.OnPingDocument().FilePath
        current_folder = '\\'.join(file_path.split('\\')[0:-1])
        destination =  DataName
                        
        destination_path = os.path.join(os.path.join(current_folder, 'RadiationData'), 'radiation_results_' + DataName)
        print destination_path
        print destination
        #unpack json file and coppy ASF array to create an empty anglearray
        PVModuleArray=json.loads(outputPVModuleArray)
                        
        #Create empty .csv file and add information on parameters
                        
        with open(os.path.join(destination_path,'LayoutAndCombinations.txt'),'w') as f:
            f.write('PERCENT_HEIGHT = ' + PERCENT_HEIGHT+'\n')
            f.write('TILT_ANGLE = ' + TILT_ANGLE+'\n')
            f.write('moduleHeight = ' + str(moduleHeight) +'\n')
            f.write('moduleWidth = ' + str(moduleWidth) +'\n')
            f.write('slat_height = ' + str(slat_height) +'\n')
            f.write('BlindOffset = ' + str(BlindOffset) +'\n')
            f.write('room_width = ' + str(room_width) + '\n')
            f.write('room_height = ' + str(room_height) +'\n')
            f.write('room_depth = ' + str(room_depth) +'\n')
            f.write('glazingPercWidth = ' + str(gpW) + '\n')
            f.write('glazingPercHeight = ' + str(gpH) + '\n')
            f.write('WindowGridSize = ' + str(WindowGridSize) + '\n')
            f.write('PanelDesiredGridPointSize = ' + str(PanelDesiredGridPointSize) + '\n')
            f.write('buildingOrientation = ' + str(buildingOrientation) + '\n')
            f.write('PVModuleArray = ' + str(PVModuleArray)+'\n')
            f.write('WindowArea = ' + str(WindowArea))
            f.close()
# ---------- end save_parameters ----------

# ----
# Geometry Calculations
# Render the Building
render_room = PythonScript(
    buildingOrientation=python_script_2.BuildingOrientation,
    room_depth=python_script_2.room_depth,
    room_width=python_script_2.room_width,
    room_height=python_script_2.room_height,
    glazing_percentage_w=python_script_2.glazing_percentage_w,
    glazing_percentage_h=python_script_2.glazing_percentage_h,
    PV_height=python_script_4.PV_height,
    BlindBoxThickness=python_script.BlindBoxThickness,
    BlindBoxHeight=python_script.BlindBoxHeight,
    window_percentage_w=python_script_2.window_percentage_w,
    window_percentage_h=python_script_2.window_percentage_h)  # -> WallF_W, WallF_PV, AdiabaticSurfaces, WallG; inputs buildingOrientation: Int32
# ---------- render_room: Python ----------
from ghpythonlib.componentbase import executingcomponent as component
import Grasshopper, GhPython
import System
import Rhino
import rhinoscriptsyntax as rs

class MyComponent(component):
    
    def RunScript(self, buildingOrientation, room_depth, room_width, room_height, glazing_percentage_w, glazing_percentage_h, PV_height, BlindBoxThickness, BlindBoxHeight, window_percentage_w, window_percentage_h):
        #12.10.2015
        #Prageeth Jayathissa
        #Script for rendering the room based on input dimensions
        
        import rhinoscriptsyntax as rs
        
        #Room Dimensions (mm)
        #room_depth=5000
        #room_width=3700
        #room_height=3000 #Check value (approximation)
        #floorThick=200
        #ceilThick=200
        #intWallThick=110 #Real value is 110mm
        #glazeThick=110 #Check this value again
        
        intWallHeight=room_height
        
        gpw=glazing_percentage_w
        gph=glazing_percentage_h
        
        wpw = window_percentage_w
        wph = window_percentage_h
        
        frame_thickness = 100
        
        #Define Global Plane
        planexy=rs.WorldXYPlane()
        planezx=rs.WorldZXPlane()
        planeyz=rs.WorldYZPlane()
        
        print planexy
        #Create rectangle of floor and extrude 200mm
        #base=rs.AddRectangle(plane, room_width+intWallThick*2, room_depth)
        
        planeR=rs.PlaneFromNormal((room_width,0,0),(1,0,0)) #RightWall
        planeB=rs.PlaneFromNormal((0,room_depth,0),(0,1,0)) #BehindWall
        planeC=rs.PlaneFromNormal((0,0,room_height),(0,0,1)) #Ceiling
        planeW =rs.PlaneFromNormal((0,BlindBoxThickness,0),(0,1,0)) #Window
        #myBox=rs.ExtrudeCurveStraight(base,(0,0,0),(0,0,room_height))
    
        
        WallF=rs.AddPlaneSurface(planezx,room_height*(1-wph),room_width)
        WallF_W=rs.AddPlaneSurface(planeW,room_height*wph,room_width*wpw)
        WallG=rs.AddPlaneSurface(planeW,room_height*gph,room_width*gpw)
        WallL=rs.AddPlaneSurface(planeyz,room_depth,room_height)
        WallR=rs.AddPlaneSurface(planeR,room_depth,room_height)
        WallB=rs.AddPlaneSurface(planeB,room_height,room_width)
        
        #WallF=rs.RotateObject(WallF,[0,0,0],buildingOrientation,axis=(0,0,1))
        
        Floor=rs.AddPlaneSurface(planexy,room_width,room_depth)
        Ceiling=rs.AddPlaneSurface(planeC,room_width,room_depth)
        
        WallF_W=rs.MoveObject(WallF_W,((1-wpw)*room_width/2,0,room_height-room_height*wph))
        WallG=rs.MoveObject(WallG,((1-gpw)*room_width/2,0,room_height-gph*room_height-frame_thickness))
        #WallG=rs.RotateObject(WallG,[0,0,0],buildingOrientation,axis=(0,0,1))
        
        #Floor=rs.RotateObject(Floor,[0,0,0],buildingOrientation,axis=(0,0,1))
        #Ceiling=rs.RotateObject(Ceiling,[0,0,0],buildingOrientation,axis=(0,0,1))
        #WallL=rs.RotateObject(WallL,[0,0,0],buildingOrientation,axis=(0,0,1))
        #WallR=rs.RotateObject(WallR,[0,0,0],buildingOrientation,axis=(0,0,1))
        #WallB=rs.RotateObject(WallB,[0,0,0],buildingOrientation,axis=(0,0,1))
        
        AdiabaticSurfaces=[Floor,Ceiling,WallL,WallR,WallB]
        
        # return outputs if you have them; here I try it for you:
        return (WallF, WallF_W,  AdiabaticSurfaces, WallG)
# ---------- end render_room ----------
render_room_2 = PythonScript(
    buildingOrientation=python_script_2.BuildingOrientation,
    WallF_W=render_room.WallF_W,
    WallF_PV=render_room.WallF_PV,
    AdiabaticSurfaces=render_room.AdiabaticSurfaces,
    WallG=render_room.WallG)  # -> WallF_W, WallF_PV, AdiabaticSurfaces, WallG; inputs AdiabaticSurfaces: list
# ---------- render_room_2: Python ----------
from ghpythonlib.componentbase import executingcomponent as component
import Grasshopper, GhPython
import System
import Rhino
import rhinoscriptsyntax as rs

class MyComponent(component):
    
    def RunScript(self, buildingOrientation, WallF_W, WallF_PV, AdiabaticSurfaces, WallG):
        #03.05.2016
        #Jeremias
        #Script to change orientation of building
        
        import rhinoscriptsyntax as rs
        
        
        
        #Define Global Plane
        planexy=rs.WorldXYPlane()
        planezx=rs.WorldZXPlane()
        planeyz=rs.WorldYZPlane()
        
        
        WallG=rs.RotateObject(WallG,[0,0,0],buildingOrientation,axis=(0,0,1))
        
        WallF_W=rs.RotateObject(WallF_W,[0,0,0],buildingOrientation,axis=(0,0,1))
        WallF_PV=rs.RotateObject(WallF_PV,[0,0,0],buildingOrientation,axis=(0,0,1))

        print len(AdiabaticSurfaces)
        print AdiabaticSurfaces
        AdSurf = []
        for i in range(len(AdiabaticSurfaces)):
            AdSurf.append(rs.RotateObject(AdiabaticSurfaces[i],[0,0,0],buildingOrientation,axis=(0,0,1)))
        
        
        # return outputs if you have them; here I try it for you:
        return (WallF_W, WallF_PV, AdiabaticSurfaces, WallG)
# ---------- end render_room_2 ----------
srf = Surface(render_room_2.WallF_W)
srf_2 = Surface(render_room_2.WallF_PV)
srf_3 = Surface(render_room_2.AdiabaticSurfaces)
srf_4 = Surface(render_room_2.WallG)

# ----
# Render the Blinds
generate_blind_array = PythonScript(
    percent_blind=python_script_5.percent_blinds,
    window_percentage_h=python_script_2.window_percentage_h,
    slat_height=python_script.slat_height,
    room_height=python_script_2.room_height,
    BlindBoxHeight=python_script.BlindBoxHeight)  # -> outputBlindArray, number_of_slat
# ---------- generate_blind_array: Python ----------
from ghpythonlib.componentbase import executingcomponent as component
import Grasshopper, GhPython
import System
import Rhino
import rhinoscriptsyntax as rs

class MyComponent(component):
    
    def RunScript(self, percent_blind, window_percentage_h, slat_height, room_height, BlindBoxHeight):
        #Import Modules------------------------------------------------
        
        import json
        import math
        import copy
        ####---CHAPTER1-------------------------
        
        #unpack json file and coppy ASF array to create an empty anglearray
        #ASFarray=json.loads(outputASFarray)
        #ASFangles=copy.deepcopy(ASFarray)
        
        BlindArray = []
        number_of_slat = int(percent_blind * window_percentage_h*room_height /slat_height)
        
        print number_of_slat
        
        current_height = room_height+slat_height
        for islat in range(number_of_slat+1):
            BlindArray.append(current_height-slat_height)
            current_height-=slat_height

                
        outputBlindArray=json.dumps(BlindArray)
        
        # return outputs if you have them; here I try it for you:
        return outputBlindArray, number_of_slat
# ---------- end generate_blind_array ----------
render_blinds_array = PythonScript(
    buildingOrientation=python_script_2.BuildingOrientation,
    outputBlindArray=generate_blind_array.outputBlindArray,
    tilt_angle=python_script_5.tilt_angle,
    room_width=python_script_2.room_width,
    room_height=python_script_2.room_height,
    slat_height=python_script.slat_height,
    number_of_slat=generate_blind_array.number_of_slat,
    BlindBoxThickness=python_script.BlindBoxThickness,
    BlindBoxHeight=python_script.BlindBoxHeight,
    window_percentage_h=python_script_2.window_percentage_h)  # -> DIVA_temprender, LB_temprender; inputs buildingOrientation: Int32
# ---------- render_blinds_array: Python ----------
from ghpythonlib.componentbase import executingcomponent as component
import Grasshopper, GhPython
import System
import Rhino
import rhinoscriptsyntax as rs

class MyComponent(component):
    
    def RunScript(self, buildingOrientation, outputBlindArray, tilt_angle, room_width, room_height, slat_height, number_of_slat, BlindBoxThickness, BlindBoxHeight, window_percentage_h):
        #29.03.2022
        #Jasmine de Riedmatten
        #Python script to render the static facade based on room given array and angles
        
        #
        #------------------------------------------------
        
        import json
        import rhinoscriptsyntax as rs
        import copy
        import math
        
        #diamond_flag = False
        #Load JSON file
        BlindArray=json.loads(outputBlindArray)
        #ASFangles=json.loads(outputASFangles)
        
        #define Plane where Facade will be built
        plane=rs.WorldZXPlane()
        
        #temprender is used for temproarily rendering the ASF. DIVA is rotated, LB not
        DIVA_temprender=[]
        LB_temprender=[]
        
        #duplicate the ASFarray wihout linking it togher
        #Note: ASFrectangles=ASFarray doesn't work as they will both be edited
        #ASFrectangles=copy.deepcopy(ASFarray)
        
        blind_covering_heigth=number_of_slat*slat_height
        print blind_covering_heigth
        
        #if diamond_flag:
        
        #initialise slat counter
        icount=0
        for ii in BlindArray:
            #initialise column counter
            #jcount=0
            #for jj in ii:
            #Draw rectangles on the ZX plane
            LB_panel=rs.AddRectangle(plane, slat_height, room_width)
            DIVA_panel=rs.AddRectangle(plane, slat_height, room_width)
            
            #Move them so that the middle is in the origin
            LB_panel=rs.MoveObject(LB_panel,(-room_width/2, 0, -slat_height/2))
            DIVA_panel=rs.MoveObject(DIVA_panel,(-room_width/2, 0, -slat_height/2))
            
            #rotate it to make the diamond shape
            #LB_panel=rs.RotateObject(LB_panel,[0,0,0],45,axis=(0,1,0))
            #DIVA_panel=rs.RotateObject(DIVA_panel,[0,0,0],45,axis=(0,1,0))
            
            #Extrude it and cap the holes
            #DIVA_panel=rs.ExtrudeCurveStraight(DIVA_panel,(0,0,0),(0,-panelThick,0))
            #rs.CapPlanarHoles(DIVA_panel)
            
            #tilt the panels
            LB_panel=rs.RotateObject(LB_panel,[0,0,0],-tilt_angle,axis=(1,0,0))
            DIVA_panel=rs.RotateObject(DIVA_panel,[0,0,0],-tilt_angle,axis=(1,0,0))
            
            #rotate axis of panels:
            #z_new = (0, -math.sin(math.pi/180*(-ASFangles[icount][jcount][0])) , math.cos(math.pi/180*(-ASFangles[icount][jcount][0])))
            
            #rotate panels azimuth
            #LB_panel=rs.RotateObject(LB_panel,[0,0,0],ASFangles[icount][jcount][1],axis=z_new)
            #DIVA_panel=rs.RotateObject(DIVA_panel,[0,0,0],ASFangles[icount][jcount][1],axis=z_new)
            
            #move panels
            #print room_width/2,-BlindOffset,ii
            LB_panel=rs.MoveObject(LB_panel,(room_width/2,BlindBoxThickness/2,ii))
            DIVA_panel=rs.MoveObject(DIVA_panel,(room_width/2,BlindBoxThickness/2,ii))
            
            #render LB panels
            LB_temprender.append(LB_panel)
            
            #rotate panels for DIVA by the building Orientation (this happens directly in LB, later)
            DIVA_panel=rs.RotateObject(DIVA_panel,[0,0,0],buildingOrientation,axis=(0,0,1))
            
            #render DIVA panels
            DIVA_temprender.append(DIVA_panel)
            
            #This is the true output which will be used for further analysis
            #ASFrectangles[icount][jcount]=DIVA_panel
            
            #jcount+=1
            icount+=1
        zxplane=rs.WorldZXPlane()
        yzplane=rs.WorldYZPlane()
        xyplane=rs.WorldXYPlane()
        
        # Create surface of blind box top
        LB_box_top=rs.AddRectangle(xyplane,room_width, BlindBoxThickness)
        DIVA_box_top=rs.AddRectangle(xyplane,room_width, BlindBoxThickness)
        
        #Move them so that the middle is in the origin
        LB_box_top=rs.MoveObject(LB_box_top,(-room_width/2, -BlindBoxThickness/2,0))
        DIVA_box_top=rs.MoveObject(DIVA_box_top,(-room_width/2, -BlindBoxThickness/2,0))
        
        #move to place
        LB_box_top=rs.MoveObject(LB_box_top,(room_width/2,BlindBoxThickness/2,room_height))
        DIVA_box_top=rs.MoveObject(DIVA_box_top,(room_width/2,BlindBoxThickness/2,room_height))
        
        
        # Create surface of blind box front
        #LB_box_front=rs.AddRectangle(zxplane,BlindBoxHeight, room_width)
        #DIVA_box_front=rs.AddRectangle(zxplane,BlindBoxHeight, room_width)
        
        #move to place
        #LB_box_front=rs.MoveObject(LB_box_front,(0,0,room_height-BlindBoxHeight))
        #DIVA_box_front=rs.MoveObject(DIVA_box_front,(0,0,room_height-BlindBoxHeight))
        
        # Create surface of blind box back
        #LB_box_back=rs.AddRectangle(zxplane,BlindBoxHeight, room_width)
        #DIVA_box_back=rs.AddRectangle(zxplane,BlindBoxHeight, room_width)
        
        #move to place
        #LB_box_back=rs.MoveObject(LB_box_back,(0,BlindBoxThickness,room_height-BlindBoxHeight))
        #DIVA_box_back=rs.MoveObject(DIVA_box_back,(0,BlindBoxThickness,room_height-BlindBoxHeight))
        
        # Create surface of blind box right
        LB_box_right=rs.AddRectangle(yzplane,BlindBoxThickness, room_height)
        DIVA_box_right=rs.AddRectangle(yzplane,BlindBoxThickness, room_height)
        
        #move to place
        LB_box_right=rs.MoveObject(LB_box_right,(0,0,0))
        DIVA_box_right=rs.MoveObject(DIVA_box_right,(0,0,0))
        
        # Create surface of blind box left
        LB_box_left=rs.AddRectangle(yzplane,BlindBoxThickness, room_height)
        DIVA_box_left=rs.AddRectangle(yzplane,BlindBoxThickness, room_height)
        
        #move to place
        LB_box_left=rs.MoveObject(LB_box_left,(room_width,0,0))
        DIVA_box_left=rs.MoveObject(DIVA_box_left,(room_width,0,0))
        
        # Create surface of window bottom
        LB_box_bottom=rs.AddRectangle(xyplane,room_width, BlindBoxThickness)
        DIVA_box_bottom=rs.AddRectangle(xyplane,room_width, BlindBoxThickness)
        
        #Move them so that the middle is in the origin
        LB_box_bottom=rs.MoveObject(LB_box_bottom,(-room_width/2, -BlindBoxThickness/2,0))
        DIVA_box_bottom=rs.MoveObject(DIVA_box_bottom,(-room_width/2, -BlindBoxThickness/2,0))
        
        #move to place
        LB_box_bottom=rs.MoveObject(LB_box_bottom,(room_width/2,BlindBoxThickness/2,(1-window_percentage_h)*room_height))
        DIVA_box_bottom=rs.MoveObject(DIVA_box_bottom,(room_width/2,BlindBoxThickness/2,(1-window_percentage_h)*room_height))
        
        #render LB panels
        LB_temprender.append(LB_box_top)
        #LB_temprender.append(LB_box_front)
        #LB_temprender.append(LB_box_back)
        LB_temprender.append(LB_box_right)
        LB_temprender.append(LB_box_left)
        LB_temprender.append(LB_box_bottom)
        
        #rotate panels for DIVA by the building Orientation (this happens directly in LB, later)
        DIVA_box_top=rs.RotateObject(DIVA_box_top,[0,0,0],buildingOrientation,axis=(0,0,1))
        #DIVA_box_front=rs.RotateObject(DIVA_box_front,[0,0,0],buildingOrientation,axis=(0,0,1))
        #DIVA_box_back=rs.RotateObject(DIVA_box_back,[0,0,0],buildingOrientation,axis=(0,0,1))
        DIVA_box_right=rs.RotateObject(DIVA_box_right,[0,0,0],buildingOrientation,axis=(0,0,1))
        DIVA_box_left=rs.RotateObject(DIVA_box_left,[0,0,0],buildingOrientation,axis=(0,0,1))
        DIVA_box_bottom=rs.RotateObject(DIVA_box_bottom,[0,0,0],buildingOrientation,axis=(0,0,1))
        
        #render DIVA panels
        DIVA_temprender.append(DIVA_box_top)
        #DIVA_temprender.append(DIVA_box_front)
        #DIVA_temprender.append(DIVA_box_back)
        DIVA_temprender.append(DIVA_box_right)
        DIVA_temprender.append(DIVA_box_left)
        DIVA_temprender.append(DIVA_box_bottom)
        
        #This is the true output which will be used for further analysis
        #ASFrectangles[icount][jcount]=DIVA_panel
        
        # return outputs if you have them; here I try it for you:
        return (DIVA_temprender, LB_temprender)
# ---------- end render_blinds_array ----------
cpoly_2 = ControlPolygon(Curve=render_blinds_array.LB_temprender)  # -> Polygon, Points
mesh_number_2 = PythonScript(
    StatHeight=python_script.slat_height,
    room_width=python_script_2.room_width,
    desiredGridPointSize=python_script.BlindGridSize)  # -> meshNumber_ver, meshNumber_hor
# ---------- mesh_number_2: Python ----------
from ghpythonlib.componentbase import executingcomponent as component
import Grasshopper, GhPython
import System
import Rhino
import rhinoscriptsyntax as rs

class MyComponent(component):
    
    def RunScript(self, panelHeight, room_width, desiredGridPointSize):
        """ 
        Script to calculate the number of points into which the mesh of the panel should
        be devided, in order to create approximately the desired meshPoint Size
        
        author: Jeremias
        edit: Jasmine
        """
        
        meshNumber_ver = int(round(panelHeight/float(desiredGridPointSize)))
        meshNumber_hor = int(round(room_width/float(desiredGridPointSize)))
        print "mesh number vertically equals: " + str(meshNumber_ver)
        print "mesh number horizontally equals: " + str(meshNumber_hor)
        
        if not (meshNumber_ver)*desiredGridPointSize == panelHeight:
            
            print "warning: Vertically, desiredGridPointSize is not equal to the resulting grid point" \
                + " size. The grid point size will be: "  + str(panelHeight/float(meshNumber_ver))
        if not (meshNumber_hor)*desiredGridPointSize == panelHeight:
            
            print "warning: Horizontally, desiredGridPointSize is not equal to the resulting grid point" \
                + " size. The grid point size will be: "  + str(room_width/float(meshNumber_hor))
        # return outputs if you have them; here I try it for you:
        return meshNumber_ver, meshNumber_hor
# ---------- end mesh_number_2 ----------
mplane_2 = MeshPlane(Boundary=cpoly_2.Polygon, WidthCount=mesh_number_2.meshNumber_ver, HeightCount=mesh_number_2.meshNumber_ver)  # -> Mesh, Area
flip_2 = MeshFlip(Mesh=mplane_2.Mesh)
mesh_2 = Mesh(flip_2)

panel_10 = Panel(weatherpath.location_noSuffix)

# ----
# Save details of weather file
number_slider = Slider(1, range=1..31)
importepw = Ladybug_ImportEpw(epwFile=weatherpath.weather_path)  # -> readMe, latitude, location, dryBulbTemperature, dewPointTemperature, relativeHumidity, windSpeed, windDirection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; plug-in component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
analysisperiod_2 = Ladybug_AnalysisPeriod(
    fromMonth=Slider(1, range=1..31),
    fromDay=number_slider,
    fromHour=Slider(1, range=1..24),
    toMonth=Slider(12, range=1..12),
    toDay=Slider(31, range=1..31),
    toHour=Slider(24, range=1..31))  # -> readMe, analysisPeriod; plug-in component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
sunpath = Ladybug_SunPath(
    location=importepw.location,
    hour=12,
    day=21,
    month=12,
    timeStep=1,
    analysisPeriod=analysisperiod_2.analysisPeriod,
    dailyOrAnnualSunPath=True)  # -> readMe, sunVectors, sunAltitudes, sunAzimuths, port, sunSpheresMesh, sunPathCrvs, legend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; disabled; plug-in component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
savesunposition = PythonScript(location=panel_10, HOY=sunpath.sunPositionsHOY, Altitude=sunpath.sunAltitudes, Azimuth=sunpath.sunAzimuths)  # -> out, destination; inputs location: list, HOY: list, Altitude: list, Azimuth: list; disabled
# ---------- savesunposition: Python ----------
#13.10.2015
#Prageeth Jayathissa
#Python script to read DIVA inputs and produce a CSV file

import sys, os
import datetime

# assign destination:
file_path = ghenv.Component.OnPingDocument().FilePath
current_folder = '\\'.join(file_path.split('\\')[0:-1])
location = str(location)[2:-2]
destination = os.path.join(current_folder + "\data\geographical_location", location)

print destination
print location
if not os.path.isdir(destination):
    os.makedirs(destination)

#Create empty .csv files

with open(os.path.join(destination,'SunPosition.csv'),'w') as f:
    pass
#Write to csv files

#Each itteration will be stored in a row of a csv file
writestring=''
#print HOY
with open(os.path.join(destination,'SunPosition.csv'),'a') as f:
    
    f.write('HOY on line 2, Altitude (degrees from horizontal) on line 3, Azimuth (degrees east of north) on line 4' +'\n')
    
    writestring=''
    for ii in HOY:
        #Create row in csv
        writestring=writestring+str(ii)+','
    #writestring = 'writetest'
    #remove the last comma
    writestring=writestring[:-1]
    print writestring
    #add a new line and write
    f.write(writestring+'\n')
    
    writestring=''
    for ii in Altitude:
        #Create row in csv
        writestring=writestring+str(ii)+','
    #writestring = 'writetest'
    #remove the last comma
    writestring=writestring[:-1]
    print writestring
    #add a new line and write
    f.write(writestring+'\n')
    
    writestring=''    
    for ii in Azimuth:
        #Create row in csv
        writestring=writestring+str(ii)+','
    #writestring = 'writetest'
    #remove the last comma
    writestring=writestring[:-1]
    print writestring
    #add a new line and write
    f.write(writestring+'\n')
    
    f.close()


print "script was executed"
#totalHeat=sum(Heating)
#totalCool=sum(Cool)
#totalLights=sum(Lights)
#totalEquip=sum(Equip)
# ---------- end savesunposition ----------

panel_11 = Panel(weatherpath.out)
panel_12 = Panel(analysisperiod.analysisPeriod)
cont_surf = GhPythonScript(BlindBoxThickness=python_script.BlindBoxThickness)  # -> ContextSurface; disabled
# ---------- cont_surf: Python ----------
from ghpythonlib.componentbase import executingcomponent as component
import Grasshopper, GhPython
import System
import Rhino
import rhinoscriptsyntax as rs

class MyComponent(component):
    
    def RunScript(self, BlindBoxThickness):
        """Provides a scripting component.
            Inputs:
                x: The x script variable
                y: The y script variable
            Output:
                a: The a output variable"""
                
        #12.10.2015
        #Prageeth Jayathissa
        #Script for rendering the room based on input dimensions
        #Modified by Jasmine de Riedmaten
        
        import rhinoscriptsyntax as rs
        import rhinoscriptsyntax as rs
        
        
        room_width=37000
        room_height=30000 #Check value (approximation)
        
        intWallHeight=room_height
        
        
        
        #Define Global Plane
        planexy=rs.WorldXYPlane()
        planezx=rs.WorldZXPlane()
        planeyz=rs.WorldYZPlane()
        
        
        
        
        
        WallF=rs.AddPlaneSurface(planezx,room_height,room_width)
        WallF = rs.MoveObject(WallF,[-16000,1,-10000])
        
        
        ContextSurface = WallF
        
        # return outputs if you have them; here I try it for you:
        return ContextSurface
# ---------- end cont_surf ----------
cont_surf_2 = GhPythonScript(BlindBoxThickness=python_script.BlindBoxThickness)  # -> ContextSurface
# ---------- cont_surf_2: Python ----------
from ghpythonlib.componentbase import executingcomponent as component
import Grasshopper, GhPython
import System
import Rhino
import rhinoscriptsyntax as rs

class MyComponent(component):
    
    def RunScript(self, BlindBoxThickness):
        """Provides a scripting component.
            Inputs:
                x: The x script variable
                y: The y script variable
            Output:
                a: The a output variable"""
                
        #12.10.2015
        #Prageeth Jayathissa
        #Script for rendering the room based on input dimensions
        #Modified by Jasmine de Riedmaten
        
        import rhinoscriptsyntax as rs
        import rhinoscriptsyntax as rs
        
        
        room_width=37000
        room_height=30000 #Check value (approximation)
        
        intWallHeight=room_height
        
        
        
        #Define Global Plane
        planexy=rs.WorldXYPlane()
        planezx=rs.WorldZXPlane()
        planeyz=rs.WorldYZPlane()
        
        
        
        
        
        WallF=rs.AddPlaneSurface(planezx,room_height,room_width)
        WallF = rs.MoveObject(WallF,[-16000,BlindBoxThickness+1,-10000])
        
        
        ContextSurface = WallF
        
        # return outputs if you have them; here I try it for you:
        return ContextSurface
# ---------- end cont_surf_2 ----------
cont_surf_3 = PythonScript()  # -> ContextSurface; disabled
# ---------- cont_surf_3: Python ----------
from ghpythonlib.componentbase import executingcomponent as component
import Grasshopper, GhPython
import System
import Rhino
import rhinoscriptsyntax as rs

class MyComponent(component):
    
    def RunScript(self, ):
        #12.10.2015
        #Prageeth Jayathissa
        #Script for rendering the room based on input dimensions
        
        import rhinoscriptsyntax as rs
        
        
        room_width=37000
        room_height=30000 #Check value (approximation)
        
        intWallHeight=room_height
        
        
        
        #Define Global Plane
        planexy=rs.WorldXYPlane()
        planezx=rs.WorldZXPlane()
        planeyz=rs.WorldYZPlane()
        
        
        
        
        
        WallF=rs.AddPlaneSurface(planezx,room_height,room_width)
        WallF = rs.MoveObject(WallF,[-16000,1,-10000])
        
        
        ContextSurface = WallF
        
        # return outputs if you have them; here I try it for you:
        return ContextSurface
# ---------- end cont_surf_3 ----------
multiplication = Multiplication(A=python_script_2.BuildingOrientation, _1=-1)
horizon = PythonScript()  # -> ContextSurface
# ---------- horizon: Python ----------
#12.10.2015
#Prageeth Jayathissa
#Script for rendering the room based on input dimensions

import rhinoscriptsyntax as rs


room_width=200000
room_height=200000 #Check value (approximation)

intWallHeight=room_height



#Define Global Plane
planexy=rs.WorldXYPlane()
planezx=rs.WorldZXPlane()
planeyz=rs.WorldYZPlane()





WallF=rs.AddPlaneSurface(planexy,room_height,room_width)
WallF = rs.MoveObject(WallF,[-100000,-190000,-6000])


ContextSurface = WallF
# ---------- end horizon ----------

# ----
# Ladybug ASF Analysis
# Calculate Radiation on Panels
# Run Ladybug
# Set Legend of Radiation Results
# Create Sky Matrix
# Sky Dome for reference
ladybug = Ladybug_Ladybug()  # -> Vviiiiiiiiiizzz; plug-in component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
gencumulativeskymtx = Ladybug_GenCumulativeSkyMtx(
    epwFile=weatherpath.weather_path,
    skyDensity=0,
    workingDir=datafolder_for_skymatrix,
    useOldRes=Toggle(False),
    runIt=Toggle(True))  # -> readMe, cumulativeSkyMtx; plug-in component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
panel_13 = Panel(ladybug)
panel_14 = Panel(gencumulativeskymtx.readMe)
selectskymtx = Ladybug_selectSkyMtx(
    cumulativeSkyMtx=gencumulativeskymtx.cumulativeSkyMtx,
    analysisPeriod=analysisperiod.analysisPeriod,
    removeDiffuse=Toggle(False),
    removeDirect=Toggle(False))  # -> readMe, selectedSkyMtx; plug-in component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
pt = ConstructPoint(
    XCoordinate=Slider(-1400, range=-1500..190),
    YCoordinate=Slider(-6000, range=-8000..4000),
    ZCoordinate=Slider(14, range=0..100))
legendpar = Ladybug_LegendParameters(
    decimalPlaces=Slider(4, range=0..6),
    legendLocation=pt,
    legendScale=Slider(0.01, range=0..10),
    fontSize=Slider(100, range=0..100))  # -> legendPar; plug-in component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
toggle = BooleanToggle(True)
pt_2 = Point(Point(8638.094015, 3329.922026, 0))
num = Number(0.01)
radiationanalysis = Ladybug_RadiationAnalysis(
    north=multiplication,
    geometry=flatten(mesh),
    context=flatten([horizon, cont_surf_2]),
    disFromBase=Slider(0.5, range=-1..1),
    selectedSkyMtx=flatten(selectskymtx.selectedSkyMtx),
    legendPar=flatten(legendpar),
    parallel=Toggle(True),
    runIt=toggle,
    workingDir=toggle,
    projectName="testproject_01")  # -> readMe, contextMesh, analysisMesh, testPts, testVec, port, radiationResult, radiationMesh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; plug-in component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
skydome = Ladybug_SkyDome(
    north=multiplication,
    selectedSkyMtx=selectskymtx.selectedSkyMtx,
    centerPoint=pt_2,
    scale=num,
    showTotalOnly=False,
    runIt=Toggle(False),
    bakeIt=False)  # -> readMe, skyPatchesMesh, baseCrvs, legend, legendBasePts, skyPatchesCenPts, skyPatchesAreas, skyPatchesAsBrep, values; plug-in component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
pt_3 = ConstructPoint(XCoordinate=15000, YCoordinate=0, ZCoordinate=6000)
panel_15 = Panel(radiationanalysis.readMe)
screenmesh = ScreenOrientedMesh(Mesh=radiationanalysis.radiationLegend, Location=pt_3, SizeFactor=1, Depth=1, Absolute=True)

panel_16 = Panel(selectskymtx.readMe)
panel_17 = Panel(selectskymtx.selectedSkyMtx)
python_script_7 = PythonScript(
    gridSize=python_script_2.WindowGridSize,
    room_width=python_script_2.room_width,
    room_height=python_script_2.room_height,
    glazing_w=python_script_2.glazing_percentage_w,
    glazing_h=python_script_2.glazing_percentage_h)  # -> WidthCount, HeightCount
# ---------- python_script_7: Python ----------
print gridSize

WidthCount = round((glazing_w * room_width)/gridSize)
HeightCount = round((glazing_h * room_height)/gridSize)

print WidthCount
print HeightCount
# ---------- end python_script_7 ----------

# ----
# Ladybug Window Analysis
panel_18 = Panel([python_script_7.HeightCount, python_script_7.WidthCount])
mesh_plane = MeshPlane(Boundary=srf_4, WidthCount=python_script_7.HeightCount, HeightCount=python_script_7.WidthCount)  # -> Mesh, Area
flip_3 = MeshFlip(Mesh=mesh_plane.Mesh)
toggle_2 = BooleanToggle(True)
radiationanalysis_2 = Ladybug_RadiationAnalysis(
    north=multiplication,
    geometry=flatten(flip_3),
    context=flatten([horizon, mesh_2, cont_surf_2]),
    disFromBase=Slider(0.5, range=-1..1),
    selectedSkyMtx=flatten(selectskymtx.selectedSkyMtx),
    legendPar=flatten(legendpar),
    parallel=Toggle(True),
    runIt=toggle_2,
    workingDir=toggle_2,
    projectName="testproject_01")  # -> readMe, contextMesh, analysisMesh, testPts, testVec, port, radiationResult, radiationMesh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; plug-in component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
panel_19 = Panel(radiationanalysis_2.readMe)
point_list = PointList(Points=radiationanalysis_2.testPts)
mesh_3 = Mesh(radiationanalysis_2.analysisMesh)
houriterationnumber = Integer(python_script_5.HOD)

panel_20 = Panel(radiationanalysis.totalRadiation)
houriterationnumber_2 = Integer(python_script_5.HOD)

# ----
# Save Radiation Results ASF
panel_21 = Panel("radiation_results")
set_radiation_data_path = PythonScript(radData="RadiationData", runWhenChanged=toggle, folder_name=panel_21, DataNamePV=python_script_3.DataName)  # -> out, file_path
# ---------- set_radiation_data_path: Python ----------
#Save Temperature from .epw weather file

import sys, os
import datetime

# assign destination:
file_path = ghenv.Component.OnPingDocument().FilePath
asf_folder = '\\'.join(file_path.split('\\')[0:-1])

file_path = os.path.join(asf_folder , str(radData) + '\\' + str(folder_name) + '_' + DataNamePV)+'\\'

print file_path
# ---------- end set_radiation_data_path ----------
copylayoutandcomb = PythonScript(Iteration=houriterationnumber_2, destination=set_radiation_data_path.file_path)
# ---------- copylayoutandcomb: Python ----------
#06.01.2016
#Jeremias Schmidli
#Python script to produce a python file with ASF layout and combination parameters for post processing

from shutil import copyfile

if Iteration == 0 or Iteration == 1:
    # assign destination:
    file_path = ghenv.Component.OnPingDocument().FilePath
    current_folder = '\\'.join(file_path.split('\\')[0:-1])
    src = current_folder + "\data\grasshopper\LayoutAndCombinations.txt"
    
    dst = destination + 'LayoutAndCombinations.txt'
    copyfile(src, dst)
    print dst

pass
# ---------- end copylayoutandcomb ----------
c_script = CSharpScript(
    HourIterationNumber=houriterationnumber_2,
    hourOfMonth=python_script_5.HOD,
    month=python_script_5.Month,
    totalRadiation=radiationanalysis.totalRadiation,
    moduleHeight=python_script_4.moduleHeight,
    moduleWidth=python_script_4.moduleWidth,
    radiationPerPanel=radiationanalysis.radiationResult,
    path=set_radiation_data_path.file_path,
    fileName="RadiationResults")  # -> out, A; inputs HourIterationNumber: Int32, hourOfMonth: Int32, month: Int32, totalRadiation: Double, moduleHeight: Int32, moduleWidth: Int32, radiationPerPanel: tree of Double, path: String, fileName: String
# ---------- c_script: C# usings ----------
using System.IO;
using System.Linq;
using System.Data;
using System.Drawing;
using System.Reflection;
using System.Windows.Forms;
using System.Xml;
using System.Xml.Linq;
using System.Runtime.InteropServices;

using Rhino.DocObjects;
using Rhino.Collections;
using GH_IO;
using GH_IO.Serialization;
# ---------- c_script: C# ----------
    //
    // write text file
    //

    List<string> allLines = new List<string>();

    allLines.Add("total_radiation_(kWh per year)");
    allLines.Add(totalRadiation.ToString());
    allLines.Add("panel width, panel height");
    allLines.Add(moduleWidth.ToString() + ',' + moduleHeight.ToString());
    allLines.Add("Hour iteration number,  hour of month , month, total Radiation");
    allLines.Add(HourIterationNumber.ToString() + ',' + hourOfMonth.ToString() + ',' + month.ToString() + ',' + totalRadiation.ToString());



    allLines.Add("radiation of each grid point (kWh/m² per year, one panel per line)");
    int fieldsPerPanel = radiationPerPanel.Branches[0].Count;
    for(int i = 0; i < radiationPerPanel.BranchCount; i++)
    {
      fieldsPerPanel = radiationPerPanel.Branches[i].Count;
      string radPerPanel = "";
      for (int t = 0; t < fieldsPerPanel - 1; t++)
      {
        radPerPanel += radiationPerPanel.Branches[i][t].ToString() + ",";
      }
      int ti = fieldsPerPanel - 1;
      radPerPanel += radiationPerPanel.Branches[i][ti].ToString();
      allLines.Add(radPerPanel);
    }

    string file = path + fileName + "_" + HourIterationNumber.ToString() + "_" + month.ToString() + ".csv";
    System.IO.File.WriteAllLines(file, allLines);

    //
    // save screenshot
    //

    // get viewport, create bitmap object, save to file

    //Rhino.Display.RhinoView myView = Rhino.RhinoDoc.ActiveDoc.Views.ActiveView;
    //Bitmap myBitmap = myView.CaptureToBitmap();
    //myBitmap.Save(pngPath);
# ---------- end c_script ----------

# ----
# Save Radiation Results Window
set_radiation_data_path_2 = PythonScript(radData="RadiationData", runWhenChanged=toggle_2, folder_name="radiation_wall", DataNameWin=python_script_3.DataName)  # -> out, file_path
# ---------- set_radiation_data_path_2: Python ----------
#Save Temperature from .epw weather file

import sys, os
import datetime

# assign destination:
file_path = ghenv.Component.OnPingDocument().FilePath
asf_folder = '\\'.join(file_path.split('\\')[0:-1])

file_path = os.path.join(asf_folder ,  str(radData) + '\\'+ str(folder_name) + '_' + DataNameWin)+'\\'

print file_path
# ---------- end set_radiation_data_path_2 ----------
copylayoutandcomb_2 = PythonScript(Iteration=houriterationnumber, destination=set_radiation_data_path_2.file_path)  # same code as copylayoutandcomb
c_script_2 = CSharpScript(
    HourIterationNumber=houriterationnumber_2,
    CombIterationNumber=python_script_5.combination,
    x_angle=python_script_5.percent_blinds,
    y_angle=python_script_5.tilt_angle,
    hourOfMonth=python_script_5.HOD,
    month=python_script_5.Month,
    totalRadiation=radiationanalysis_2.totalRadiation,
    BlindSize=python_script.slat_height,
    radiationPerWindowMesh=radiationanalysis_2.radiationResult,
    path=set_radiation_data_path_2.file_path,
    fileName="RadiationWall")  # -> out, A; inputs HourIterationNumber: Int32, CombIterationNumber: Int32, x_angle: Double, y_angle: Double, hourOfMonth: Int32, month: Int32, totalRadiation: Double, BlindSize: Double, radiationPerWindowMesh: tree of Double, path: String, fileName: String
# ---------- c_script_2: C# ----------
    //
    // write text file
    //

    List<string> allLines = new List<string>();

    allLines.Add("total_radiation_(kWh per year)");
    allLines.Add(totalRadiation.ToString());
    allLines.Add("blind size");
    allLines.Add(BlindSize.ToString());
    allLines.Add("X-Angle, Y-Angle, Hour iteration number, Combination iteration number,  hour of month , month, total Radiation");
    allLines.Add((x_angle * 100).ToString() + ',' + y_angle.ToString() + ',' + HourIterationNumber.ToString() + ',' + CombIterationNumber.ToString() + ',' + hourOfMonth.ToString() + ',' + month.ToString() + ',' + totalRadiation.ToString());





    string file = path + fileName + "_" + HourIterationNumber.ToString() + "_" + month.ToString() + "_" + (x_angle * 100).ToString() + "_" + y_angle.ToString() + ".csv";
    System.IO.File.WriteAllLines(file, allLines);

    //
    // save screenshot
    //

    // get viewport, create bitmap object, save to file

    //Rhino.Display.RhinoView myView = Rhino.RhinoDoc.ActiveDoc.Views.ActiveView;
    //Bitmap myBitmap = myView.CaptureToBitmap();
    //myBitmap.Save(pngPath);
# ---------- end c_script_2 ----------
panel_22 = Panel(c_script_2.out)
