# Grasshopper definition main_test_mauro_ill.gh (Grasshopper 0.9.76)
# plug-ins: DIVA.ForGrasshopper, MeshEdit Components, Python Interpreter, Human, DIVA Daylight, HoopSnake

panel = Panel("XANGLES = [0,5,10,15,20,25,30,35,40,45,50,55,60,65,70,75,80,85,90]")
panel_2 = Panel("XANGLES = [10,15,20,25,35,55,90]")
panel_3 = Panel("YANGLES = [-45,-40,-35,-30,-25,-20,-15,-10,-5,0,5,10,15,20,25,30,35,40,45]")

# ----
# Graveyard
c_script = CSharpScript()  # -> out, p0, p1, p2; inputs iterator: Int32, p0min: Double, p0max: Double, p0nr: Int32, p1min: Double, p1max: Double, p1nr: Int32, p2min: Double, p2max: Double, p2nr: Int32; disabled
# ---------- c_script: C# ----------
    int phaseP0 = (p0nr > 0) ? iterator % p0nr : 0;
    int phaseP1 = (p0nr > 0) ? (iterator / p0nr) % p1nr : 0;
    int phaseP2 = (iterator / (p0nr * p1nr)) % p2nr;
    double range0 = p0max - p0min;
    double range1 = p1max - p1min;
    double range2 = p2max - p2min;
    double step0 = (p0nr > 1) ? range0 / (p0nr - 1) : 0; // prevent division by 0 for parameter ranges of length 1
    double step1 = (p1nr > 1) ? range1 / (p1nr - 1) : 0;
    double step2 = (p2nr > 1) ? range2 / (p2nr - 1) : 0;

    p0 = p0min + phaseP0 * step0;
    p1 = p1min + phaseP1 * step1;
    p2 = p2min + phaseP2 * step2;
# ---------- end c_script ----------
hour_of_year = Slider(3058, range=1..8760)
calculate_mdh = PythonScript(Hour_of_Year=hour_of_year)  # -> out, month, day, hour; inputs Hour_of_Year: Int32
# ---------- calculate_mdh: Python ----------
#06.01.2016
#Jeremias Schmidli
#Python script to calculate month, day, and hour based on hour of the year
import math
message = ''
hours_per_day=24
#days_in_month=[31,28,31,30,31,30,31,31,30,31,30,31]
days_in_month=[0,31,59,90,120,151,181,212,243,273,304,334,365]

day_in_year=math.floor((Hour_of_Year-1)/hours_per_day)+1
hour_of_day=(Hour_of_Year-1)%hours_per_day+1

for i in range(0,len(days_in_month)):
    if day_in_year<=days_in_month[i]:
        month = i
        day = int(day_in_year-days_in_month[i-1])
        break
    else:
        pass

print 'hour in the year: ', int(Hour_of_Year)
print 'day in the year: ', int(day_in_year)
hour = int(hour_of_day)

print 'month: ', month
print 'day: ', day
print 'hour: ', hour

#return month, day, hour
# ---------- end calculate_mdh ----------
panel_4 = Panel(calculate_mdh.out)

panel_5 = Panel("EGY_Cairo.623660_IWEC.epw")

# ----
# Set Weather File
panel_6 = Panel("ESP_Madrid.082210_IWEC.epw")
panel_7 = Panel("SGP_Singapore.486980_IWEC.epw")
weatherpath = PythonScript(weather_data_file="Zurich-Kloten_2013.epw")  # -> out, weather_path
# ---------- weatherpath: Python ----------
#Save Temperature from .epw weather file

import sys, os
import datetime

# assign destination:
file_path = ghenv.Component.OnPingDocument().FilePath
asf_folder = '\\'.join(file_path.split('\\')[0:-2])

weather_path = os.path.join(asf_folder + "\WeatherData", str(weather_data_file))

print weather_path
# ---------- end weatherpath ----------

# ----
# Save details of weather file
number_slider = Slider(1, range=1..31)
importepw = Ladybug_ImportEpw(epwFile=weatherpath.weather_path)  # -> readMe, latitude, location, dryBulbTemperature, dewPointTemperature, relativeHumidity, windSpeed, windDirection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; plug-in component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
analysisperiod = Ladybug_AnalysisPeriod(
    fromMonth=Slider(8, range=1..31),
    fromDay=number_slider,
    fromHour=Slider(12, range=1..24),
    toMonth=Slider(8, range=1..12),
    toDay=Slider(31, range=1..31),
    toHour=Slider(13, range=1..31))  # -> readMe, analysisPeriod; plug-in component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
separatedata = Ladybug_SeparateData(inputList=flatten(importepw.dryBulbTemperature))  # -> numbers, strings; plug-in component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
sunpath = Ladybug_SunPath(
    location=importepw.location,
    hour=12,
    day=21,
    month=12,
    timeStep=1,
    analysisPeriod=analysisperiod.analysisPeriod,
    dailyOrAnnualSunPath=True)  # -> readMe, sunVectors, sunAltitudes, sunAzimuths, port, sunSpheresMesh, sunPathCrvs, legend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; disabled; plug-in component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
save_temperature = PythonScript(LB_header=separatedata.strings, Temperature=separatedata.numbers)  # -> out, destination; inputs LB_header: list, Temperature: list
# ---------- save_temperature: Python ----------
#Save Temperature from .epw weather file

import sys, os
import datetime

# assign destination:
file_path = ghenv.Component.OnPingDocument().FilePath
current_folder = '\\'.join(file_path.split('\\')[0:-1])
location = LB_header[1]
destination = os.path.join(current_folder + "\data\geographical_location", location)

print destination

if not os.path.isdir(destination):
    os.makedirs(destination)

#Create empty .csv files

with open(os.path.join(destination,'Temperature.csv'),'w') as f:
    pass
#Write to csv files

#Each itteration will be stored in a row of a csv file
writestring=''
#print HOY
with open(os.path.join(destination,'Temperature.csv'),'a') as f:
    
    f.write('Dry Bulb Temperature for every hour of the year in degrees celcius' +'\n')
    
    
    writestring=''
    for ii in LB_header:
        #Create row in csv
        writestring=writestring+str(ii)+','
    #writestring = 'writetest'
    #remove the last comma
    writestring=writestring[:-1]
    print writestring
    #add a new line and write
    f.write(writestring+'\n')
    
    
    writestring=''
    for ii in Temperature:
        #Create row in csv
        writestring=writestring+str(ii)+','
    #writestring = 'writetest'
    #remove the last comma
    writestring=writestring[:-1]
    print writestring
    #add a new line and write
    f.write(writestring+'\n')
    
    f.close()


print "script was executed"
#totalHeat=sum(Heating)
#totalCool=sum(Cool)
#totalLights=sum(Lights)
#totalEquip=sum(Equip)
# ---------- end save_temperature ----------
savesunposition = PythonScript(LB_header=separatedata.strings, HOY=sunpath.sunPositionsHOY, Altitude=sunpath.sunAltitudes, Azimuth=sunpath.sunAzimuths)  # -> out, a; inputs LB_header: list, HOY: list, Altitude: list, Azimuth: list
# ---------- savesunposition: Python ----------
#13.10.2015
#Prageeth Jayathissa
#Python script to read DIVA inputs and produce a CSV file

import sys, os
import datetime

# assign destination:
file_path = ghenv.Component.OnPingDocument().FilePath
current_folder = '\\'.join(file_path.split('\\')[0:-1])
location = LB_header[1]
destination = os.path.join(current_folder + "\data\geographical_location", location)

print destination
print LB_header[0]
if not os.path.isdir(destination):
    os.makedirs(destination)

#Create empty .csv files

with open(os.path.join(destination,'SunPosition.csv'),'w') as f:
    pass
#Write to csv files

#Each itteration will be stored in a row of a csv file
writestring=''
#print HOY
with open(os.path.join(destination,'SunPosition.csv'),'a') as f:
    
    f.write('HOY on line 2, Altitude (degrees from horizontal) on line 3, Azimuth (degrees east of north) on line 4' +'\n')
    
    writestring=''
    for ii in HOY:
        #Create row in csv
        writestring=writestring+str(ii)+','
    #writestring = 'writetest'
    #remove the last comma
    writestring=writestring[:-1]
    print writestring
    #add a new line and write
    f.write(writestring+'\n')
    
    writestring=''
    for ii in Altitude:
        #Create row in csv
        writestring=writestring+str(ii)+','
    #writestring = 'writetest'
    #remove the last comma
    writestring=writestring[:-1]
    print writestring
    #add a new line and write
    f.write(writestring+'\n')
    
    writestring=''    
    for ii in Azimuth:
        #Create row in csv
        writestring=writestring+str(ii)+','
    #writestring = 'writetest'
    #remove the last comma
    writestring=writestring[:-1]
    print writestring
    #add a new line and write
    f.write(writestring+'\n')
    
    f.close()


print "script was executed"
#totalHeat=sum(Heating)
#totalCool=sum(Cool)
#totalLights=sum(Lights)
#totalEquip=sum(Equip)
# ---------- end savesunposition ----------
_3dchart = Ladybug_3DChart(inputData=flatten(importepw.directNormalRadiation))  # -> readMe, graphMesh, graphCurves, legend, legendBasePts, title, titleBasePts, dataPts, conditionalHOY; disabled; plug-in component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

panel_8 = Panel("FIN_Helsinki.029740_IWEC.epw")

# ----
# Set Geometry
# ASF Simulation Inputs
# Geometry Inputs
# building orientation of 0 corresponds to south facing, 90 is east facing, -90 is west facing
panel_9 = Panel("XANGLES = [0,15,30,45,60,75,90]")
panel_10 = Panel("XANGLES = [0,22.5,45,67.5,90]")
panel_11 = Panel("YANGLES = [-45,-30,-15,0,15,30,45]")
panel_12 = Panel("YANGLES = [-45,-22.5,0,22.5,45]")
number_of_panels_in_first_row = Slider(6, range=0..20)
building_orientation = Slider(0, range=-360..360)
edge_tolerance = Slider(0, range=0..1000)
panel_thickness_mm = Slider(10, range=0.5..10)
glazing_height = Slider(0.9677, range=0..1)
glazing_width = Slider(0.9183, range=0..1)
panel_spacing_mm = Slider(500, range=200..1500)
panel_offset_mm = Slider(400, range=100..1000)
number_of_rows = Slider(9, range=0..9)
room_depth = Slider(7000, range=1000..20000)
room_width = Slider(4900, range=1000..20000)
room_height = Slider(3100, range=1000..20000)
panel_size_mm = Slider(400, range=1..500)
boolean_diamond_array = BooleanToggle(True)
boolean_top_row_short = BooleanToggle(False)
desiredgridpointsize = Slider(25, range=1..200)
number_of_clusters = Slider(1, range=1..3)
panel_13 = Panel("YANGLES = [-45]")
combination = Slider(0, range=0..91)
xangles = Text("XANGLES = [0]")
yangles = Text(panel_3)

panel_14 = Panel("YANGLES = [-45,-35,-20,-15,-10,-5,0,5,10,15,20,35,45]")
illuminance = Illuminance(
    Name="Temp",
    Grids=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,
    RhinoScene=False,
    Sky=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,
    Run=False,
    BooleanValue_0=False,
    BooleanValue_1=False,
    BooleanValue_10=False,
    BooleanValue_11=False,
    BooleanValue_12=False,
    BooleanValue_13=False,
    BooleanValue_14=False,
    BooleanValue_2=False,
    BooleanValue_3=False,
    BooleanValue_4=False,
    BooleanValue_5=False,
    BooleanValue_6=False,
    BooleanValue_7=False,
    BooleanValue_8=False,
    BooleanValue_9=False,
    Hidden_0=False,
    Hidden_1=False,
    Hidden_10=True,
    Hidden_11=True,
    Hidden_12=True,
    Hidden_13=True,
    Hidden_14=False,
    Hidden_2=False,
    Hidden_3=False,
    Hidden_4=False,
    Hidden_5=True,
    Hidden_6=True,
    Hidden_7=False,
    Hidden_8=True,
    Hidden_9=True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)  # -> Out, Grid
python = PythonScript()  # -> out, a; disabled
# ---------- python: Python ----------
import math

a = 5.4*math.cos(math.pi/180*x)
# ---------- end python ----------
panel_15 = Panel(save_temperature.destination)
multiplication = Multiplication(A=building_orientation, _1=-1)
cont_surf = PythonScript()  # -> ContextSurface
# ---------- cont_surf: Python ----------
#12.10.2015
#Prageeth Jayathissa
#Script for rendering the room based on input dimensions

import rhinoscriptsyntax as rs

#Room Dimensions (mm)
#room_depth=5000
room_width=37000
room_height=30000 #Check value (approximation)
#floorThick=200
#ceilThick=200
#intWallThick=110 #Real value is 110mm
#glazeThick=110 #Check this value again

intWallHeight=room_height



#Define Global Plane
planexy=rs.WorldXYPlane()
planezx=rs.WorldZXPlane()
planeyz=rs.WorldYZPlane()

print planexy
#Create rectangle of floor and extrude 200mm
#base=rs.AddRectangle(plane, room_width+intWallThick*2, room_depth)

planeR=rs.PlaneFromNormal((room_width,0,0),(1,0,0))
#planeB=rs.PlaneFromNormal((0,room_depth,0),(0,1,0))
planeC=rs.PlaneFromNormal((0,0,room_height),(0,0,1))
#myBox=rs.ExtrudeCurveStraight(base,(0,0,0),(0,0,room_height))

WallF=rs.AddPlaneSurface(planezx,room_height,room_width)
WallF = rs.MoveObject(WallF,[-16000,0,-10000])
#WallF=rs.RotateObject(WallF,[0,0,0],buildingOrientation,axis=(0,0,1))



ContextSurface = WallF

#LegendSurface=rs.AddPlaneSurface(planexy,room_width,room_width)
#LegendSurface = rs.MoveObject(LegendSurface,[-16000,0,0])
#LegendSurface=rs.RotateObject(LegendSurface,[0,0,0],buildingOrientation,axis=(0,0,1))
# ---------- end cont_surf ----------
addhbglz = Honeybee_addHBGlz()  # -> HBObjWGLZ; plug-in component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
boolean_toggle = BooleanToggle(False)
daylighfactorsimulation = Honeybee_DaylightFactorSimulation(uniformSky=False)  # -> analysisRecipe; plug-in component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
mass2zone = Honeybee_Masses2Zones(isConditioned=True, maxRoofAngle=30)  # -> out, HBZones; plug-in component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
createhbsrfs = Honeybee_createHBSrfs()  # -> out, simplify(HBSurface); plug-in component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
infiltration = Slider(1, range=0..10)
fresh_air = Slider(0.016, range=0..20)
honeybee = Honeybee_Honeybee()  # -> out; plug-in component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
panel_16 = Panel(honeybee)

# ----
# Loop LadyBug
number_slider_2 = Slider(144, range=1..144)
number_slider_3 = Slider(48, range=0..143)
number_slider_4 = Slider(0, range=0..144)
number_slider_5 = Slider(0, range=-90..90)
number_slider_6 = Slider(0, range=0..143)
number_slider_7 = Slider(0, range=0..90)
expression = Expression(minX=number_slider_7, maxX=number_slider_5, step=Slider(1, range=0..60), Expression="(maxX - minX) / step + 1")

# ----
# Geometry Calculations
# Save Inputs
# Render the ASF
# Render the Building
render_room = PythonScript(
    buildingOrientation=building_orientation,
    room_depth=room_depth,
    room_width=room_width,
    room_height=room_height,
    glazing_percentage_w=glazing_width,
    glazing_percentage_h=glazing_height)  # -> WallF, AdiabaticSurfaces, WallG; inputs buildingOrientation: Int32
# ---------- render_room: Python ----------
#12.10.2015
#Prageeth Jayathissa
#Script for rendering the room based on input dimensions

import rhinoscriptsyntax as rs

#Room Dimensions (mm)
#room_depth=5000
#room_width=3700
#room_height=3000 #Check value (approximation)
#floorThick=200
#ceilThick=200
#intWallThick=110 #Real value is 110mm
#glazeThick=110 #Check this value again

intWallHeight=room_height

gpw=glazing_percentage_w
gph=glazing_percentage_h


#Define Global Plane
planexy=rs.WorldXYPlane()
planezx=rs.WorldZXPlane()
planeyz=rs.WorldYZPlane()

print planexy
#Create rectangle of floor and extrude 200mm
#base=rs.AddRectangle(plane, room_width+intWallThick*2, room_depth)

planeR=rs.PlaneFromNormal((room_width,0,0),(1,0,0))
planeB=rs.PlaneFromNormal((0,room_depth,0),(0,1,0))
planeC=rs.PlaneFromNormal((0,0,room_height),(0,0,1))
#myBox=rs.ExtrudeCurveStraight(base,(0,0,0),(0,0,room_height))

WallF=rs.AddPlaneSurface(planezx,room_height,room_width)
WallL=rs.AddPlaneSurface(planeyz,room_depth,room_height)
WallR=rs.AddPlaneSurface(planeR,room_depth,room_height)
WallB=rs.AddPlaneSurface(planeB,room_height,room_width)

#WallF=rs.RotateObject(WallF,[0,0,0],buildingOrientation,axis=(0,0,1))

Floor=rs.AddPlaneSurface(planexy,room_width,room_depth)
Ceiling=rs.AddPlaneSurface(planeC,room_width,room_depth)

WallG=rs.AddPlaneSurface(planezx,room_height*gph,room_width*gpw)
WallG=rs.MoveObject(WallG,((1-gpw)*room_width/2,0,(1-gph)*room_height/2))
#WallG=rs.RotateObject(WallG,[0,0,0],buildingOrientation,axis=(0,0,1))

#Floor=rs.RotateObject(Floor,[0,0,0],buildingOrientation,axis=(0,0,1))
#Ceiling=rs.RotateObject(Ceiling,[0,0,0],buildingOrientation,axis=(0,0,1))
#WallL=rs.RotateObject(WallL,[0,0,0],buildingOrientation,axis=(0,0,1))
#WallR=rs.RotateObject(WallR,[0,0,0],buildingOrientation,axis=(0,0,1))
#WallB=rs.RotateObject(WallB,[0,0,0],buildingOrientation,axis=(0,0,1))

AdiabaticSurfaces=[Floor,Ceiling,WallL,WallR,WallB]
# ---------- end render_room ----------
generate_diamond_array = PythonScript(
    edgeTol=edge_tolerance,
    panelThick=panel_thickness_mm,
    numberHorizontal=number_of_panels_in_first_row,
    Top_row_short=boolean_top_row_short,
    numberVertical=number_of_rows,
    panelOffset=panel_offset_mm,
    panelSize=panel_size_mm,
    panelSpacing=panel_spacing_mm,
    room_width=room_width,
    room_height=room_height,
    diamond_flag=boolean_diamond_array)  # -> outputASFarray, panelSize, panelOffset, panelThick, diamond_flag
# ---------- generate_diamond_array: Python ----------
#15.12.2015
#Prageeth Jayathissa
#Script for calculating the grid layout of the ASF
#Edited by Jeremias Schmidli

#Description:
    #This script has three parts, out of which only one is executed, depending 
    #on the booleans diamond_flag (diamond- or rectangular-pattern) and 
    #only_odd_rows (if true it automatically determines pattern depending on 
    #room size, if false the number of panels in the first row, the number of 
    #rows and whether the first row is short or long has to be spezified).

#Notes:
    #All coordinates described as "y-value" actually correspond to the "z-value"
    #in Grasshopper.
    #To maximize performance of a simulation, it should be made sure, that this 
    #script is only evaluated once. 

#Staus: Complete

#To Do:
    #Add function to ensure the panel offset is greater than the panel size
#------------------------------------------------------------------------------

import rhinoscriptsyntax as rs
import Grasshopper as gh
import Rhino
import math
import json


#specify if layout should be generated automatically, depending on room size 
#(If False, the inputs numberHorizontal, Top_row_short and numberVertical are needed.
# If True, the input edgeTol is needed.
# Works only for diamond pattern):
automatic_layout = False

# calculate diamond pattern if True:
if diamond_flag == True:
    
    # code from PJ, generates automatic layout:
    if automatic_layout == True:
        
        #Function to determine the location of the first panel
        def first_coordinate():
            x=room_width/2 -((No_Hpanels-1)*Hspacing)/2 
            print x
            y=((No_Vpanels-1)*Vspacing)/2 +(room_height)/2
            
            if center_long:
                if bigstart:
                    x=x
                else:
                    x+=(Hspacing/2)
            else:
                if bigstart:
                    x-=(Hspacing/2)
                    print 'me'
                else:
                    x=x
            return (x,y)
                    
        
        #import paramters:
        #room_width=3700.0
        #room_height=3000.00
        
        
        
        #panel size and spacing along the diagonal axis
        #panelSize=400.0
        #panelSpacing=500.0
        #panelThick=2
        #panelOffset=500
        
        #minor adjustments to the panel size
        #edgeTol=1.4
        #V_translation=100
        edgeOverlap=(edgeTol/100)*panelSpacing
        
        
        #transform spacing into vertical and horizontal components
        #Note: sin(45) = 1/math.sqrt(2)
        Hspacing=(panelSpacing/math.sqrt(2))*2
        Vspacing = panelSpacing/math.sqrt(2)
        
        #initialise boolean to determine whether the center pannel line is long
        center_long=True
        #initialise boolean to determine wether the middle row needs to be offset
        center_offset=False 
        
        #find out how many panels fit on the horizontal axis
        #The edgeOverlap allows for more or less panels to fit around the edge
        No_Hpanels=int(math.floor((room_width-panelSize+edgeOverlap)/Hspacing))
        
        #The number of panels on the middle axis is always odd
        #check if the number is even, and if so subtract 1 and define center as a short row
        if not No_Hpanels & 1: #binary logic to determine if the number is even
            print 'even'
            No_Hpanels-=1 #subtract by one to make it odd
            center_long=False #state that the middle row is now the shorter row
        
        
        print 'Hpanels',No_Hpanels
        
        #find out how many panels fit on the vertical axis accounting for an overlap
        No_Vpanels=int(math.floor((room_height-panelSize+edgeOverlap)/Vspacing))
        
        #Number of rows must also be odd for asthetic reasons
        if not No_Vpanels &1:
            print 'even Vpanels'
            center_offset=True
            No_Vpanels-=1  
            
        print 'V panels' , No_Vpanels
        #Very Messy shit code to determine wether the first row has more panels than the second row
        
        #if (No_Vpanels-1)/2 is odd, then the top row has the same number of panels as the middle
        #if it is even then it has one more or one less depending on whether the center is long or short
        checker=int((No_Vpanels-1)/2)
        print 'checker',checker
        print 'center_long?', center_long
        if center_long:
            if checker &1: #if checker is odd
                print '3,7,11 etc Vpanels1'
                bigstart=False #Top row is shorter than second row
                oneswitch=-1 #top row has one less panel than middle row
            else:
                print '1,5,9 etc Vpanels2'
                bigstart=True #top row is longer than second row
                oneswitch=0
        else:
            if checker &1:
                print '3,7,11 etc Vpanels3'
                bigstart=True
                oneswitch=1 #top panel has one more panel than the middle row
            else:
                print '1,5,9 etc Vpanels4'
                bigstart=False
                oneswitch=0
        
        #End of messy shitty code
        
        #prints for debugging
        print 'bigstart', bigstart 
        print 'oneswitch',oneswitch
        
        #initialise ASFarray List
        ASFarray=[]
        
        #Produce an empy list nested in a list. The nested list represents each row
        for ii in range(No_Vpanels):
            ASFarray.append([])
           
        
        
        #aquire the first coordinate of the top left panel
        (x,y)=first_coordinate()  #see function at the top
        x_first=x #store initial x coordinate
        y_first=y #store initial y coordinate
        
        
        #This next for loop records the coordinate positions of each panel
        #initialise row counter
        icount=0
        for ii in ASFarray:
            #initialise collumn counter
            jcount=0
            
            for jj in range(No_Hpanels+oneswitch): #first row
                ii.append((x+jcount*Hspacing,y-icount*Vspacing)) #Append panel coordinate
                jcount+=1 #next column
            #Switches so the next row has either one more or one less panel
            #logic: If the center row is long, then it will switch between its own size
            #and a size smaller. If not it will switch between its own size and one bigger
            if center_long:
                oneswitch-=1
                oneswitch=(oneswitch%2)*-1 #output either 0 or -1
            else:
                oneswitch+=1
                oneswitch=oneswitch%2 #output is either 0 or 1
            icount+=1
            
            #Determines the starting position of the first panel of the row depending on
            #if its long or short
            if icount &1: #if odd
                if bigstart:
                    x=x_first+(Hspacing/2) #start half a space to the right
                else:
                    x=x_first -(Hspacing/2) #start half a space to the left
            else:
                x=x_first
            
            
        
        
        #Write the array output as a json and send to next python file
        #Note: Lists in Lists cannot be sent over grasshopper
        outputASFarray=json.dumps(ASFarray)
        print ASFarray
        
    # Code Jeremias, uses manual specification of number of panels in grid:
    else:
        #make number of rows and columns integers:
        numberHorizontal = int(numberHorizontal)
        numberVertical = int(numberVertical)
        
        #initialise ASFarray List:
        ASFarray=[]
        
            #Produce an empty list nested in a list. The nested list represents each row
        for ii in range(int(numberVertical)):
            ASFarray.append([])
        
        
        #store x and y coordinate of first panel in the top row 
        #( & 1 checks if the number is odd):
            
        #find initial x-coordinate:
        if numberHorizontal & 1 and Top_row_short:
            x_first=room_width/2-panelSpacing*math.sqrt(2)*(numberHorizontal-1)/2 
        elif numberHorizontal & 1 and not Top_row_short:
            x_first=room_width/2-panelSpacing*math.sqrt(2)*(numberHorizontal-1)/2 
        elif not numberHorizontal & 1 and Top_row_short:
            x_first=room_width/2-panelSpacing*math.sqrt(2)*(numberHorizontal)/2
        elif not numberHorizontal & 1 and not Top_row_short:
            x_first=room_width/2-panelSpacing*math.sqrt(2)*(numberHorizontal-1)/2 
            
        #find initial y-coordinate:
        if numberVertical & 1:
            y_first=room_height/2+panelSpacing*(math.sqrt(2)/2)*(numberVertical-1)/2
        else:
            y_first=room_height/2+panelSpacing*(math.sqrt(2)/2)*(numberVertical-1)/2 
            
        
        #This next for loop records the coordinate positions of each panel
        
        #initialise x and y coordinate:
        x = x_first
        y = y_first
        
        #initialise row counter
        icount=0
        for ii in ASFarray:
            #initialise collumn counter
            jcount=0
            
            if (numberHorizontal & 1) and (icount & 1) and Top_row_short:
                
                for jj in range(int(numberHorizontal)+1): #first row
                    ii.append((x-panelSpacing*math.sqrt(2)/2+jcount*panelSpacing*math.sqrt(2),y-icount*panelSpacing*math.sqrt(2)/2)) #Append panel coordinate
                    jcount+=1 #next column
                    
            elif (numberHorizontal & 1) and not (icount & 1) and Top_row_short:
                
                for jj in range(int(numberHorizontal)): #first row
                    ii.append((x+jcount*panelSpacing*math.sqrt(2),y-icount*panelSpacing*math.sqrt(2)/2)) #Append panel coordinate
                    jcount+=1 #next column
                    
            elif (numberHorizontal & 1) and (icount & 1) and not Top_row_short:
                
                for jj in range(int(numberHorizontal)-1): #first row
                    ii.append((x+panelSpacing*math.sqrt(2)/2+jcount*panelSpacing*math.sqrt(2),y-icount*panelSpacing*math.sqrt(2)/2)) #Append panel coordinate
                    jcount+=1 #next column
                    
            elif (numberHorizontal & 1) and not (icount & 1) and not Top_row_short:
                
                for jj in range(int(numberHorizontal)): #first row
                    ii.append((x+jcount*panelSpacing*math.sqrt(2),y-icount*panelSpacing*math.sqrt(2)/2)) #Append panel coordinate
                    jcount+=1 #next column
                    
            elif not (numberHorizontal & 1) and (icount & 1) and Top_row_short:
                
                for jj in range(int(numberHorizontal)+1): #first row
                    ii.append((x+jcount*panelSpacing*math.sqrt(2),y-icount*panelSpacing*math.sqrt(2)/2)) #Append panel coordinate
                    jcount+=1 #next column
            
            elif not (numberHorizontal & 1) and not (icount & 1) and Top_row_short:
                
                for jj in range(int(numberHorizontal)): #first row
                    ii.append((x+panelSpacing*math.sqrt(2)/2+jcount*panelSpacing*math.sqrt(2),y-icount*panelSpacing*math.sqrt(2)/2)) #Append panel coordinate
                    jcount+=1 #next column
            elif not (numberHorizontal & 1) and (icount & 1) and not Top_row_short:
                
                for jj in range(int(numberHorizontal)-1): #first row
                    ii.append((x+panelSpacing*math.sqrt(2)/2+jcount*panelSpacing*math.sqrt(2),y-icount*panelSpacing*math.sqrt(2)/2)) #Append panel coordinate
                    jcount+=1 #next column
            
            elif not (numberHorizontal & 1) and not (icount & 1) and not Top_row_short:
                
                for jj in range(int(numberHorizontal)): #first row
                    ii.append((x+jcount*panelSpacing*math.sqrt(2),y-icount*panelSpacing*math.sqrt(2)/2)) #Append panel coordinate
                    jcount+=1 #next columnelse :
           
            #next row
            icount+=1
            
            
        #Write the array output as a json and send to next python file
        #Note: Lists in Lists cannot be sent over grasshopper
        outputASFarray=json.dumps(ASFarray)
        print ASFarray
    
# calculate rectangular pattern:
else:
    
    #make number of rows and columns integers:
    numberHorizontal = int(numberHorizontal)
    numberVertical = int(numberVertical)
    
    #initialise ASFarray List:
    ASFarray=[]
    
        #Produce an empy list nested in a list. The nested list represents each row
    for ii in range(int(numberVertical)):
        ASFarray.append([])
    
    
    #store initial x and y coordinate:
    if numberHorizontal & 1:
        x_first=room_width/2-panelSpacing*(numberHorizontal-1)/2 
    else:
        x_first=room_width/2-panelSpacing*(numberHorizontal-2)/2 - panelSpacing/2 
    if numberVertical & 1:
        y_first=room_height/2+panelSpacing*(numberVertical-1)/2
    else:
        y_first=room_height/2+panelSpacing*(numberVertical-2)/2 + panelSpacing/2
        
    
    #This next for loop records the coordinate positions of each panel
    
    #initialise x and y coordinate:
    x = x_first
    y = y_first
    
    #initialise row counter
    icount=0
    for ii in ASFarray:
        #initialise collumn counter
        jcount=0
        
        for jj in range(int(numberHorizontal)): #first row
            ii.append((x+jcount*panelSpacing,y-icount*panelSpacing)) #Append panel coordinate
            jcount+=1 #next column
        
        #next row
        icount+=1
        
        
    #Write the array output as a json and send to next python file
    #Note: Lists in Lists cannot be sent over grasshopper
    outputASFarray=json.dumps(ASFarray)
    print ASFarray
# ---------- end generate_diamond_array ----------
save_parameters = PythonScript(
    XANGLES=xangles,
    YANGLES=yangles,
    NoClusters=number_of_clusters,
    desiredGridPointSize=desiredgridpointsize,
    panelSize=panel_size_mm,
    panelSpacing=panel_spacing_mm,
    outputASFarray=generate_diamond_array.outputASFarray,
    buildingOrientation=building_orientation)  # -> out, a
# ---------- save_parameters: Python ----------
#06.01.2016
#Jeremias Schmidli
#Python script to produce a python file with ASF layout and combination parameters for post processing

import sys, os
import json

# assign destination:
file_path = ghenv.Component.OnPingDocument().FilePath
current_folder = '\\'.join(file_path.split('\\')[0:-1])
destination = current_folder + "\data\grasshopper"

print destination
#unpack json file and coppy ASF array to create an empty anglearray
ASFarray=json.loads(outputASFarray)

#Create empty .csv file and add information on parameters

with open(os.path.join(destination,'LayoutAndCombinations.txt'),'w') as f:
    f.write(XANGLES+'\n')
    f.write(YANGLES+'\n')
    f.write('NoClusters = ' + str(NoClusters) +'\n')
    f.write('panelSize = ' + str(panelSize) +'\n')
    f.write('panelSpacing = ' + str(panelSpacing) + '\n')
    f.write('ASFarray = ' + str(ASFarray) + '\n')
    f.write('desiredGridPointSize = ' + str(desiredGridPointSize) + '\n')
    f.write('buildingOrientation = ' + str(buildingOrientation))
    f.close()
# ---------- end save_parameters ----------

render_room_2 = PythonScript(
    buildingOrientation=building_orientation,
    WallF=render_room.WallF,
    AdiabaticSurfaces=render_room.AdiabaticSurfaces,
    WallG=render_room.WallG)  # -> WallF, AdiabaticSurfaces, WallG; inputs AdiabaticSurfaces: list
# ---------- render_room_2: Python ----------
#03.05.2016
#Jeremias
#Script to change orientation of building

import rhinoscriptsyntax as rs



#Define Global Plane
planexy=rs.WorldXYPlane()
planezx=rs.WorldZXPlane()
planeyz=rs.WorldYZPlane()


WallG=rs.RotateObject(WallG,[0,0,0],buildingOrientation,axis=(0,0,1))

WallF=rs.RotateObject(WallF,[0,0,0],buildingOrientation,axis=(0,0,1))
print len(AdiabaticSurfaces)
print AdiabaticSurfaces
AdSurf = []
for i in range(len(AdiabaticSurfaces)):
    AdSurf.append(rs.RotateObject(AdiabaticSurfaces[i],[0,0,0],buildingOrientation,axis=(0,0,1)))
# ---------- end render_room_2 ----------
srf = Surface(render_room_2.WallG)
srf_2 = Surface(render_room_2.AdiabaticSurfaces)
srf_3 = Surface(render_room_2.WallF)

# ----
# Ladybug Solar Analysis
# Create Mesh for Radiation Analysis
# Calculate Radiation on Panels
# Run Ladybug
# Set Legend of Radiation Results
# Create Sky Matrix
# Sky Dome for reference
ladybug = Ladybug_Ladybug()  # -> Vviiiiiiiiiizzz; plug-in component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
gencumulativeskymtx = Ladybug_GenCumulativeSkyMtx(epwFile=weatherpath.weather_path, skyDensity=0, useOldRes=Toggle(True), runIt=Toggle(True))  # -> readMe, cumulativeSkyMtx; plug-in component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
panel_17 = Panel(gencumulativeskymtx.readMe)
panel_18 = Panel(ladybug)
mesh_number = PythonScript(panelSize=panel_size_mm, desiredGridPointSize=desiredgridpointsize)  # -> out, meshNumber
# ---------- mesh_number: Python ----------
""" 
Script to calculate the number of points into which the mesh of one panel should
be devided, in order to create approximately the desired meshPoint Size

author: Jeremias
"""

meshNumber = int(round(panelSize/float(desiredGridPointSize)))
print "mesh number equals: " + str(meshNumber)

if not (meshNumber)*desiredGridPointSize == panelSize:
    
    print "warning: desiredGridPointSize is not equal to the resulting grid point" \
        + " size. The grid point size will be: "  + str(panelSize/float(meshNumber))
# ---------- end mesh_number ----------
hour_of_year_2 = Slider(5149, range=1..8760)
pt = ConstructPoint(
    XCoordinate=Slider(-1400, range=-1500..190),
    YCoordinate=Slider(-6000, range=-8000..4000),
    ZCoordinate=Slider(14, range=0..100))
legendpar = Ladybug_LegendParameters(
    decimalPlaces=Slider(4, range=0..6),
    legendLocation=pt,
    legendScale=Slider(5, range=0..10),
    fontSize=Slider(100, range=0..100))  # -> legendPar; plug-in component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
toggle = BooleanToggle(True)
pt_2 = Point(Point(8638.094015, 3329.922026, 0))
num = Number(0.01)
pt_3 = ConstructPoint(XCoordinate=15000, YCoordinate=0, ZCoordinate=6000)

# ----
# Set Evaluation Period
read_json_file = PythonScript(destination=save_temperature.destination)  # -> out, HOY, HoursInMonthTracking, MonthTracking, XanglesTracking, YanglesTracking
# ---------- read_json_file: Python ----------
# Python Scrip to read json file for suntracking

import sys, os
import datetime
import json

# possible paths to save data:
destination_PJ = 'C:/Users/User/Documents/01_SuAT/01_HiLo/04_Facade/Rhino_Simulations'
destination_J = 'C:/Users/Assistenz/Documents/MT_Jeremias/Simulation_Data/RadiationEvaluation'

# assign destination:
#destination = destination_J


with open(destination + '/' + 'SunTrackingData.json', 'r') as fp:
    SunTrackingData = json.load(fp)
    fp.close()
    
HOY = SunTrackingData['HOY']
HoursInMonth = SunTrackingData['HoursInMonth']
XanglesTracking = SunTrackingData['Xangles']
YanglesTracking = SunTrackingData['Yangles']

HoursInMonthTracking = []
MonthTracking = []
monthi=1
for i in HoursInMonth:
    HoursInMonthTracking += i
    for j in i:
        MonthTracking.append(monthi)
    monthi+=1
    
print HoursInMonthTracking
print "script was executed"
#totalHeat=sum(Heating)
#totalCool=sum(Cool)
#totalLights=sum(Lights)
#totalEquip=sum(Equip)
# ---------- end read_json_file ----------

calc_max_iter_number = PythonScript(XANGLES=xangles, YANGLES=yangles, NoClusters=number_of_clusters, Hours=read_json_file.HOY)  # -> out, numComb, numHours; inputs NoClusters: Int32, Hours: list
# ---------- calc_max_iter_number: Python ----------
#11.04.2016
#Jeremias Schmidli
#script to find number of combinations and number of hours

#------------------------------------------------

import json
import math
import copy

exec XANGLES
exec YANGLES


print XANGLES
print YANGLES

#Number of groups that the facade can exist in (now input to function)
NoClusters=int(NoClusters)

NoAngles=len(XANGLES)*len(YANGLES)

maxcomb=NoAngles**NoClusters

print 'max number of combinations is', maxcomb

numComb = maxcomb
numHours = len(Hours)

#print (outputASFangles)
# ---------- end calc_max_iter_number ----------
subtraction = Subtraction(A=calc_max_iter_number.numComb, B=1)
expression_2 = Expression(minX=number_slider_6, maxX=subtraction, step=Slider(1, range=0..1), Expression="(maxX - minX) / step + 1")

subtraction_2 = Subtraction(A=calc_max_iter_number.numHours, B=1)

expression_3 = Expression(minX=number_slider_4, maxX=subtraction_2, step=Slider(1, range=0..1), Expression="(maxX - minX) / step + 1")
mm = MassMultiplication(Input=flatten([expression_2, expression_3, expression]))  # -> Result, PartialResults
int = Integer(mm.Result)
subtraction_3 = Subtraction(A=int, B=1)

# ----
# Loop E+
max_combination = Slider(3, range=0..10)

# ----
# E+ Simulation
# Convert planar surfaces
#  to DIVA inputs
# Save Thermal and Lighting Data
# Run the E+ Simulation
# A Zone is a Box
# A window is a planar surface that overlaps the zone
# Shade can be a box or plane
panel_19 = Panel("0.5")
wu = WindowUnit(
    Brep=srf,
    Brep_2=srf,
    GetAssembly=8,
    GetCustom=False,
    GetGas=[3, -1],
    GetGlass=[-1, -1, -1],
    GetLayerNum=2,
    GetSimpleState=0)  # -> Window, Window_2
facade = ConstructionAssembly(Brep=srf_3, Brep_2=srf_3, GetAssembly=12, GetCustom=False, GetLayerNum=1, GetMaterials=[-1, -1, -1, -1, -1])  # -> Zone, Zone_2
all_adiabatic = ConstructionAssembly(Brep=srf_2, Brep_2=srf_2, GetAssembly=6, GetCustom=False, GetLayerNum=1, GetMaterials=[-1, -1, -1, -1, -1])  # -> Zone, Zone_2
heating_cop = Slider(4, range=0..10)
lighting_load = Slider(11.74, range=0..20)
cooling_cop = Slider(3, range=0..10)
toggle_2 = BooleanToggle(False)
_300 = Integer(300)

# ----
# Save Radiation Results
panel_20 = Panel("radiation_results")
set_radiation_data_path = PythonScript(runWhenChanged=toggle, folder_name=panel_20)  # -> out, radiation_results_path
# ---------- set_radiation_data_path: Python ----------
#Save Temperature from .epw weather file

import sys, os
import datetime

# assign destination:
file_path = ghenv.Component.OnPingDocument().FilePath
main_folder = '\\'.join(file_path.split('\\')[0:-1])

radiation_results_path = main_folder + "\data\grasshopper\LadyBug\\" + folder_name + '\\'

# create folder if it does not yet exist:
if not os.path.isdir(radiation_results_path):
            os.makedirs(radiation_results_path)

print radiation_results_path
# ---------- end set_radiation_data_path ----------

larger = LargerThan(FirstNumber=subtraction_3, SecondNumber=hs.Feedback)  # -> LargerThan, OrEqualTo
expression_4 = Expression(x=hs.Feedback, Expression="x+1")
hs = HoopSnake(
    StartingData="0",
    Data=expression_4,
    TerminationCondition=larger.LargerThan,
    Hoopsnake_Data_autoUpdate=False,
    Hoopsnake_Data_dataLimit=2147483647,
    Hoopsnake_Data_delay=0,
    Hoopsnake_Data_resetCounter=True,
    Hoopsnake_Data_updateView=True)  # -> Feedback, CumulativeFeedback, LoopsCounter, IterationsCounter
multiple_loops = PythonScript(
    iterator=hs.IterationsCounter,
    p0min=number_slider_6,
    p0max=subtraction,
    p0nr=expression_2,
    p1min=number_slider_4,
    p1max=subtraction_2,
    p1nr=expression_3,
    p2min=number_slider_7,
    p2max=number_slider_5,
    p2nr=expression)  # -> out, p0, p1, p2; inputs iterator: Int32, p0nr: Int32, p1nr: Int32, p2nr: Int32
# ---------- multiple_loops: Python ----------
""" 
script to loop multiple values

author: Johannes Hofer, translated to pyhton by Jeremias Schmidli

"""
import math

if p0nr > 0:
    phaseP0 = iterator % p0nr
else:
    phaseP0 = 0
    
if p0nr > 0:
    phaseP1 = iterator // p0nr % p1nr
else:
    phaseP1 = 0
    
phaseP2 = iterator // (p0nr*p1nr) % p2nr

range0 = p0max - p0min
range1 = p1max - p1min
range2 = p2max - p2min

if p0nr > 1: # prevent division by 0 for parameter ranges of length 1
    step0 = range0/(p0nr-1)
else: 
    step0 = 0
    
if p1nr > 1:
    step1 = range1/(p1nr-1)
else:
    step1 = 0
    
if p2nr > 1:
    step2 = range2/(p2nr-1)
else:
    step2 = 0
    
p0 = p0min + phaseP0 * step0
p1 = p1min + phaseP1 * step1
p2 = p2min + phaseP2 * step2
# ---------- end multiple_loops ----------
panel_21 = Panel(hs.Feedback)
int_2 = Integer(multiple_loops.p0)
int_3 = Integer(multiple_loops.p2)
int_4 = Integer(multiple_loops.p1)
panel_22 = Panel(int_3)
panel_23 = Panel(int_2)
panel_24 = Panel(int_4)

int_5 = Integer(int_4)
select_item_from_list = PythonScript(List=read_json_file.HoursInMonthTracking, position=int_5)  # -> out, Item; inputs List: list
# ---------- select_item_from_list: Python ----------
Item = List[int(position)]
# ---------- end select_item_from_list ----------
select_item_from_list_2 = PythonScript(List=read_json_file.MonthTracking, position=int_5)  # -> out, Item; inputs List: list; same code as select_item_from_list
select_item_from_list_3 = PythonScript(List=read_json_file.XanglesTracking, position=int_5)  # -> out, Item; inputs List: list; same code as select_item_from_list
select_item_from_list_4 = PythonScript(List=read_json_file.YanglesTracking, position=int_5)  # -> out, Item; inputs List: list; same code as select_item_from_list
addition = Addition(A=select_item_from_list.Item, B=0)
addition_2 = Addition(A=select_item_from_list.Item, B=1)
analysisperiod_2 = Ladybug_AnalysisPeriod(fromMonth=select_item_from_list_2.Item, fromHour=addition, toMonth=select_item_from_list_2.Item, toHour=addition_2)  # -> readMe, analysisPeriod; plug-in component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
panel_25 = Panel(analysisperiod_2.analysisPeriod)

houriterationnumber = Integer(int_4)

radiationcomb = Integer(int_2)
combination_maker_v2 = PythonScript(
    combination=radiationcomb,
    XANGLES=xangles,
    YANGLES=yangles,
    NoClusters=number_of_clusters,
    outputASFarray=generate_diamond_array.outputASFarray)  # -> out, maxcomb, outputASFangles, combination
# ---------- combination_maker_v2: Python ----------
#13.10.2015
#Prageeth Jayathissa
#Python script to produce all possible angle combinations of the facade

#Status: Complete but difficult to read

#Warning: If NoCluster>2 then the program becomes slow

#------------------------------------------------
'''README

This code can be read as three chapters

Chapter1: Produces a list of possible angle combinations for a single panel
    Output: ANGLES - a list of all possible angle combinations

Chapter2: Splits the facade into independant clusters of rows. 
    Output: rowsplit - a list of intergers that indicate the start and end point
        of clusters
    Example: If a facade with 9 rows is split into 2 clusters, rowsplit=[0,4,9]
        this indicates that one cluser starts at 0 and ends at 4
        the second cluster starts at 4 and ends at 9

Chapter3: Itterates through all possible panel combinations and produces an output
    list which contains each outputASFangle combination
    Output: ListASFangles - a list of all possible ASFangles
    
Chapter4: Determines that combination of Angles should be recorded for each itteration
    How it works: In priciple, this is a counter where base= Number of angle combinations
    Example: If number of angles =10 and number of clusters =2 this would be a normal 2digit base10 counter
    rowVal=[0,0]
    rowVal=[0,1]
    ...
    rowVal=[0,9]
    rowVal=[1,0]
    
    if number of angles =49 then
    rowVal=[0,0]
    rowVal=[0,1]
    ...
    rowVal=[0,48]
    rowVal=[1,0]
    rowVal=[1,1] etc
    
    This numer rowVal is then used to call on the ANGLE list produced in Chapter 1
    which is then fed into Chapter 3
        
        '''

#Import Modules------------------------------------------------

import json
import math
import copy
####---CHAPTER1-------------------------

#unpack json file and coppy ASF array to create an empty anglearray
ASFarray=json.loads(outputASFarray)
ASFangles=copy.deepcopy(ASFarray)


#Possible Angles in simulation
#XANGLES=[0,30,45,60,90]#[0,45,90]#[0,15,30,45,60,75,90]
#YANGLES=[0]#[-45,0,45]#[-45,-30,-15,0,15,30,45]
exec XANGLES
exec YANGLES

#XANGLES = [XANGLES]
#YANGLES = [YANGLES]

print XANGLES
print YANGLES

#Array to hold final list
ListASFangles=[]

#Number of groups that the facade can exist in (now input to function)
NoClusters=int(NoClusters)
#NoClusters=1
#Number of angle combinations
NoAngles=len(XANGLES)*len(YANGLES)

#Define the angle value that a row is in
#the value is between 0 and NoAngles
rowVal=[0]*NoClusters

#Make a list of all angle combinations
ANGLES= [(x, y) for x in XANGLES for y in YANGLES]

####---CHAPTER2-------------------------

#Deside which rows to break according to the Number
#of clusters
#How many items do we split the ASF into
rowdivide=int(math.floor(len(ASFangles)/NoClusters))
#What is remaining
rowremain=len(ASFangles)%NoClusters
#print rowdivide
#print rowremain
rowsplit=[]
ii=0
#These are positions within ASF array where we split
for ii in range(NoClusters-1):
    rowsplit.append(rowdivide*(ii+1)+1) #a =y, b=2y...
rowsplit.append(rowdivide*(ii+2)+rowremain) #c=2y+x
#Add a 0 at the start of the list to indicate the top row is 0
rowsplit = [0] + rowsplit
#Bypass funciton if the number of clusters is 1
if NoClusters==1:
    rowsplit=[]
    rowsplit.append(rowdivide) #Note rowdivide=Number of rows
    rowsplit = [0] + rowsplit

#print rowsplit

####---CHAPTER3-------------------------

#Loop through all combinations of the facade
keepLooping=True
combcount=0
while keepLooping:
    #If we have reached the maximum number of combinations then break the main loop
    if rowVal==[NoAngles-1]*NoClusters: #eg: if [48,48,48]==[48,48,48]
        keepLooping=False
    #re-initialise jj  jcount and icount 
    jj=0
    jcount=0
    icount=0
    
    if combcount==combination:
    
        #Script to make the ASFAngle matrix
        #Loop through the number of divisions in the facade
        rscount=0 
        #print 'hello'
        #loop through ASFangles matrix to substitute values
        for icount,ii in enumerate(ASFangles):
            for jcount,jj in enumerate(ii):
                
                #if the row is at the point that it should go to the next rowsplit combiniation
                #eg, rowsplit =[0,4,9]
                #+1 is required because icount and rscount start at 0
                if icount+1==rowsplit[rscount+1]: #eg if 4==4
                    #if it is not the last element because otherwise rscount is out of bounds
                    if rowsplit[-2]!=rowsplit[rscount]:
                        #move to the next rowsplit value
                        rscount+=1
                        
                #Replace ASFAngle unit with angle
                #rowVal: is the ANGLE element identifier between 1,49
                #eg: rowVal=[5,29] the first element is the angle identifier for the top cluster, 
                    #the second element is the angle identifier for the second cluster
                #rscount: is rowVal element identifier        
                ASFangles[icount][jcount]=ANGLES[rowVal[rscount]]
            
            
            
            

    ####---CHAPTER4-------------------------

    #Find the next itteration or rowVal, the Agnel element identifier
    #Process: very similar to a counter where the base=NoAngles, eg base49
    for jcount,jj in enumerate(rowVal):
        #if the number of the position has it its maximum, set to zero
        #and itterate the next column
        if jj==NoAngles-1:
            rowVal[jcount]=0
        #if the number is not the maximum, then increase once more and break the loop
        else:
            rowVal[jcount]+=1
            break
    combcount+=1
    
#outputListASFangles=json.dumps(ListASFangles)


#This has been commented out as it is not used in Combination Selector
#if combination<len(ListASFangles):
#    outputASFangles=json.dumps(ListASFangles[int(combination)])
#else:
#    outputASFangles=json.dumps(ListASFangles[0])
    
#print ListASFangles

maxcomb=NoAngles**NoClusters

print 'max number of combinations is', maxcomb
if combination>combcount:
    print 'Warning! Requested Combination is not available'

outputASFangles=json.dumps(ASFangles)

#print (outputASFangles)
# ---------- end combination_maker_v2 ----------
max_combinations = Panel(combination_maker_v2.outputASFangles)
render_diamond_array = PythonScript(
    buildingOrientation=building_orientation,
    outputASFangles=combination_maker_v2.outputASFangles,
    outputASFarray=generate_diamond_array.outputASFarray,
    panelSize=generate_diamond_array.panelSize,
    panelOffset=generate_diamond_array.panelOffset,
    panelThick=generate_diamond_array.panelThick,
    diamond_flag=generate_diamond_array.diamond_flag)  # -> out, DIVA_temprender, LB_temprender; inputs buildingOrientation: Int32
# ---------- render_diamond_array: Python ----------
#13.10.2015
#Prageeth Jayathissa
#Python script to render the ASF based on room given array and angles

#Status: Completed with issues

#Issues: When rotating panels, the rotation around the Y axis doesn't rotate
#around the global Y axis, but the new Y axis based off the previous X axis roation
#------------------------------------------------

import json
import rhinoscriptsyntax as rs
import copy
import math

#diamond_flag = False
#Load JSON file
ASFarray=json.loads(outputASFarray)
ASFangles=json.loads(outputASFangles)


#define Plane where ASF will be built
plane=rs.WorldZXPlane()

#temprender is used for temproarily rendering the ASF. DIVA is rotated, LB not
DIVA_temprender=[]
LB_temprender=[]

#duplicate the ASFarray wihout linking it togher
#Note: ASFrectangles=ASFarray doesn't work as they will both be edited
ASFrectangles=copy.deepcopy(ASFarray)


print ASFangles


if diamond_flag:
    
    #initialise row counter
    icount=0
    for ii in ASFarray:
        #initialise column counter
        jcount=0
        for jj in ii:
            #Draw rectangles on the ZX plane
            LB_panel=rs.AddRectangle(plane, panelSize, panelSize)
            DIVA_panel=rs.AddRectangle(plane, panelSize, panelSize)
            
            #Move them so that the middle is in the origin
            LB_panel=rs.MoveObject(LB_panel,(-panelSize/2,0,-panelSize/2))
            DIVA_panel=rs.MoveObject(DIVA_panel,(-panelSize/2,0,-panelSize/2))
            
            #rotate it to make the diamond shape
            LB_panel=rs.RotateObject(LB_panel,[0,0,0],45,axis=(0,1,0))
            DIVA_panel=rs.RotateObject(DIVA_panel,[0,0,0],45,axis=(0,1,0))
            
            #Extrude it and cap the holes
            #DIVA_panel=rs.ExtrudeCurveStraight(DIVA_panel,(0,0,0),(0,-panelThick,0))
            #rs.CapPlanarHoles(DIVA_panel)
            
            #tilt the panels
            LB_panel=rs.RotateObject(LB_panel,[0,0,0],-ASFangles[icount][jcount][0],axis=(1,0,0))
            DIVA_panel=rs.RotateObject(DIVA_panel,[0,0,0],-ASFangles[icount][jcount][0],axis=(1,0,0))
            
            #rotate axis of panels:
            z_new = (0, -math.sin(math.pi/180*(-ASFangles[icount][jcount][0])) , math.cos(math.pi/180*(-ASFangles[icount][jcount][0])))
            
            #rotate panels azimuth
            LB_panel=rs.RotateObject(LB_panel,[0,0,0],ASFangles[icount][jcount][1],axis=z_new)
            DIVA_panel=rs.RotateObject(DIVA_panel,[0,0,0],ASFangles[icount][jcount][1],axis=z_new)
            
            #move panels
            LB_panel=rs.MoveObject(LB_panel,(jj[0],-panelOffset,jj[1]))
            DIVA_panel=rs.MoveObject(DIVA_panel,(jj[0],-panelOffset,jj[1]))
            
            #render LB panels
            LB_temprender.append(LB_panel)
            
            #rotate panels for DIVA by the building Orientation (this happens directly in LB, later)
            DIVA_panel=rs.RotateObject(DIVA_panel,[0,0,0],buildingOrientation,axis=(0,0,1))
            
            #render DIVA panels
            DIVA_temprender.append(DIVA_panel)
            
            #This is the true output which will be used for further analysis
            #ASFrectangles[icount][jcount]=DIVA_panel

            jcount+=1
        icount+=1
        
else:
    #initialise row counter
    icount=0
    for ii in ASFarray:
        #initialise column counter
        jcount=0
        for jj in ii:
            #Draw rectange on the ZX plane
            
            DIVA_panel=rs.AddRectangle(plane, panelSize, panelSize)
            DIVA_panel=rs.MoveObject(DIVA_panel,(-panelSize/2,0,-panelSize/2))
            #rotate it to make the diamond shape
            #DIVA_panel=rs.RotateObject(DIVA_panel,[0,0,0],45,axis=(0,1,0))
            #Extrude it and cap the holes
            #DIVA_panel=rs.ExtrudeCurveStraight(DIVA_panel,(0,0,0),(0,-panelThick,0))
            #rs.CapPlanarHoles(DIVA_panel)
            #tilt the panels
            DIVA_panel=rs.RotateObject(DIVA_panel,[0,0,0],-ASFangles[icount][jcount][0],axis=(1,0,0))
            z_new = (0, -math.sin(math.pi/180*(-ASFangles[icount][jcount][0])) , math.cos(math.pi/180*(-ASFangles[icount][jcount][0])))
            print z_new
            DIVA_panel=rs.RotateObject(DIVA_panel,[0,0,0],ASFangles[icount][jcount][1],axis=z_new)
            DIVA_panel=rs.MoveObject(DIVA_panel,(jj[0],-panelOffset,jj[1]))
            LB_panel=copy.deepcopy(DIVA_panel)
            DIVA_panel=rs.RotateObject(DIVA_panel,[0,0,0],buildingOrientation,axis=(0,0,1))
            
            
            DIVA_temprender.append(DIVA_panel)
            LB_temprender.append(LB_panel)
            #This is the true output which will be used for further analysis
            ASFrectangles[icount][jcount]=DIVA_panel
    
            jcount+=1
        icount+=1
# ---------- end render_diamond_array ----------

cpoly = ControlPolygon(Curve=render_diamond_array.LB_temprender)  # -> Polygon, Points
mplane = MeshPlane(Boundary=cpoly.Polygon, WidthCount=mesh_number.meshNumber, HeightCount=mesh_number.meshNumber)  # -> Mesh, Area
flip = MeshFlip(Mesh=mplane.Mesh)
selectskymtx = Ladybug_selectSkyMtx(
    cumulativeSkyMtx=gencumulativeskymtx.cumulativeSkyMtx,
    analysisPeriod=analysisperiod_2.analysisPeriod,
    removeDiffuse=Toggle(False),
    removeDirect=Toggle(False))  # -> readMe, selectedSkyMtx; plug-in component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
radiationanalysis = Ladybug_RadiationAnalysis(
    north=multiplication,
    geometry=flatten(flip),
    context=flatten(cont_surf),
    disFromBase=Slider(0.5, range=-1..1),
    selectedSkyMtx=flatten(selectskymtx.selectedSkyMtx),
    legendPar=flatten(legendpar),
    parallel=Toggle(True),
    runIt=toggle,
    projectName="testproject_01")  # -> readMe, contextMesh, analysisMesh, testPts, testVec, port, radiationResult, radiationMesh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; plug-in component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
skydome = Ladybug_SkyDome(
    north=multiplication,
    selectedSkyMtx=selectskymtx.selectedSkyMtx,
    centerPoint=pt_2,
    scale=num,
    showTotalOnly=False,
    runIt=Toggle(False),
    bakeIt=False)  # -> readMe, skyPatchesMesh, baseCrvs, legend, legendBasePts, skyPatchesCenPts, skyPatchesAreas, skyPatchesAsBrep, values; plug-in component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
panel_26 = Panel(radiationanalysis.totalRadiation)
screenmesh = ScreenOrientedMesh(Mesh=radiationanalysis.radiationLegend, Location=pt_3, SizeFactor=1, Depth=1, Absolute=True)

panel_27 = Panel(selectskymtx.selectedSkyMtx)
mesh = Mesh(radiationanalysis.radiationMesh)
gridbasedsimulation = Honeybee_GridBasedSimulation(testPoints=radiationanalysis.testPts, testMesh=radiationanalysis.analysisMesh, simulationType="0")  # -> analysisRecipe; plug-in component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

c_script_2 = CSharpScript(
    HourIterationNumber=houriterationnumber,
    CombIterationNumber=int_2,
    hourOfMonth=select_item_from_list.Item,
    month=select_item_from_list_2.Item,
    totalRadiation=radiationanalysis.totalRadiation,
    panelSize=generate_diamond_array.panelSize,
    radiationPerPanel=radiationanalysis.radiationResult,
    path=set_radiation_data_path.radiation_results_path,
    fileName="RadiationResultsElectrical_monthly_hourIt_combIt_")  # -> out, A; inputs HourIterationNumber: Int32, CombIterationNumber: Int32, hourOfMonth: Int32, month: Int32, totalRadiation: Double, panelSize: Double, radiationPerPanel: tree of Double, path: String, fileName: String
# ---------- c_script_2: C# ----------
    //
    // write text file
    //

    List<string> allLines = new List<string>();

    allLines.Add("total_radiation_(kWh per year)");
    allLines.Add(totalRadiation.ToString());
    allLines.Add("panel size");
    allLines.Add(panelSize.ToString());
    allLines.Add("Hour iteration number, Combination iteration number,  hour of month , month, total Radiation");
    allLines.Add(HourIterationNumber.ToString() + ',' + CombIterationNumber.ToString() + ',' + hourOfMonth.ToString() + ',' + month.ToString() + ',' + totalRadiation.ToString());



    allLines.Add("radiation of each grid point (kWh/m² per year, one panel per line)");
    int fieldsPerPanel = radiationPerPanel.Branches[0].Count;
    for(int i = 0; i < radiationPerPanel.BranchCount; i++)
    {
      fieldsPerPanel = radiationPerPanel.Branches[i].Count;
      string radPerPanel = "";
      for (int t = 0; t < fieldsPerPanel - 1; t++)
      {
        radPerPanel += radiationPerPanel.Branches[i][t].ToString() + ",";
      }
      int ti = fieldsPerPanel - 1;
      radPerPanel += radiationPerPanel.Branches[i][ti].ToString();
      allLines.Add(radPerPanel);
    }

    string file = path + fileName + HourIterationNumber.ToString() + "_" + CombIterationNumber.ToString() + ".csv";
    System.IO.File.WriteAllLines(file, allLines);

    //
    // save screenshot
    //

    // get viewport, create bitmap object, save to file

    //Rhino.Display.RhinoView myView = Rhino.RhinoDoc.ActiveDoc.Views.ActiveView;
    //Bitmap myBitmap = myView.CaptureToBitmap();
    //myBitmap.Save(pngPath);
# ---------- end c_script_2 ----------
copylayoutandcomb = PythonScript(Iteration=houriterationnumber, destination=set_radiation_data_path.radiation_results_path)
# ---------- copylayoutandcomb: Python ----------
#06.01.2016
#Jeremias Schmidli
#Python script to produce a python file with ASF layout and combination parameters for post processing

from shutil import copyfile

if Iteration == 0 or Iteration == 1:
    # assign destination:
    file_path = ghenv.Component.OnPingDocument().FilePath
    current_folder = '\\'.join(file_path.split('\\')[0:-1])
    src = current_folder + "\data\grasshopper\LayoutAndCombinations.txt"
    
    dst = destination + 'LayoutAndCombinations.txt'
    copyfile(src, dst)
    print dst

pass
# ---------- end copylayoutandcomb ----------

rundaylightanalysis = Honeybee_RunDaylightSimulation(analysisRecipe=gridbasedsimulation, meshSettings=radiationanalysis.analysisMesh, overwriteResults=True)  # -> out, analysisType, resultsUnit, results, testPts, resultFiles, radGeoFile, studyFolder, done; plug-in component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

render_panel_layout = Brep(render_diamond_array.DIVA_temprender)
shade = Shade(
    Brep=render_panel_layout,
    SR=panel_19,
    VR=panel_19,
    GlazedFraction=0,
    Brep_2=render_panel_layout,
    SR_2=panel_19,
    VR_2=panel_19,
    GlazedFraction_2=0)  # -> Shade, Shade_2

epluscomb = Integer(hs_2.IterationsCounter)

smaller = SmallerThan(FirstNumber=hs_2.Feedback, SecondNumber=combination_maker_v2.maxcomb)  # -> SmallerThan, OrEqualTo

and = GateAnd(A=smaller.SmallerThan, B=Toggle(False))
viper = ViperDIVAThermalAnalysisForGH(
    ProjectName="Viper_Temp",
    People_m2=0.1,
    Lights_W_m2=lighting_load,
    Equipment_W_m2=4,
    HeatingSetPoint_deg_C=22,
    CoolingSetPoint_deg_C=26,
    HeatingCOP=heating_cop,
    CoolingCOP=cooling_cop,
    Infiltration=infiltration,
    FreshAir=fresh_air,
    LightingControl_lux=_300,
    ZoneBreps=[facade.Zone_2, all_adiabatic.Zone_2],
    Window=wu.Window_2,
    Shade=shade.Shade_2,
    WriteOnly=toggle_2,
    RunSimulation=and,
    ProjectName_2="Viper_Temp",
    People_m2_2=0.1,
    Lights_W_m2_2=lighting_load,
    Equipment_W_m2_2=4,
    HeatingSetPoint_deg_C_2=22,
    CoolingSetPoint_deg_C_2=26,
    HeatingCOP_2=heating_cop,
    CoolingCOP_2=cooling_cop,
    Infiltration_2=infiltration,
    FreshAir_2=fresh_air,
    LightingControl_lux_2=_300,
    ZoneBreps_2=[facade.Zone_2, all_adiabatic.Zone_2],
    Window_2=wu.Window_2,
    Shade_2=shade.Shade_2,
    WriteOnly_2=toggle_2,
    RunSimulation_2=and,
    CustomDates=False,
    Location=22,
    Occupancy=0,
    OutputStates=[True, True, False, False, True, True, False, False, False, False, False, True, False, False, False, False, False, False, False],
    ReportingPeriod=0,
    RunPeriod=0,
    ShadowFreq=30,
    ShadowOverlap=15000,
    SolarDist=2,
    Timestep=2)  # -> OutputMessage, MetricHeatingE, flatten(MetricCoolingE), flatten(MetricElecLights), MetricElecEquip, MetricIndoorTemp, OutputMessage_2, MetricHeatingE_2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
ma = MassAddition(Input=viper.MetricHeatingE_2)  # -> Result, PartialResults
ma_2 = MassAddition(Input=viper.MetricElecLights_2)  # -> Result, PartialResults
set_diva_data_path = PythonScript(runWhenChanged=and, folder_name="DIVA_results")  # -> out, DIVA_results_path
# ---------- set_diva_data_path: Python ----------
#Save Temperature from .epw weather file

import sys, os
import datetime

# assign destination:
file_path = ghenv.Component.OnPingDocument().FilePath
main_folder = '\\'.join(file_path.split('\\')[0:-1])

DIVA_results_path = main_folder + "\data\grasshopper\DIVA\\" + folder_name + '\\'

if not os.path.isdir(DIVA_results_path):
    os.makedirs(DIVA_results_path)

print DIVA_results_path
# ---------- end set_diva_data_path ----------
panel_29 = Panel(viper.OutputMessage_2)
panel_30 = Panel(ma_2.Result)
panel_31 = Panel(ma.Result)

panel_32 = Panel(viper.MetricIndoorTemp_2)

expression_5 = Expression(x=hs_2.Feedback, Expression="x+1")
hs_2 = HoopSnake(
    StartingData="0",
    Data=expression_5,
    TerminationCondition=smaller.SmallerThan,
    Hoopsnake_Data_autoUpdate=False,
    Hoopsnake_Data_dataLimit=2147483647,
    Hoopsnake_Data_delay=0,
    Hoopsnake_Data_resetCounter=True,
    Hoopsnake_Data_updateView=True)  # -> Feedback, CumulativeFeedback, LoopsCounter, IterationsCounter

python_2 = PythonScript(
    loopNo=hs_2.Feedback,
    runScript=smaller.SmallerThan,
    Heating=viper.MetricHeatingE_2,
    Cooling=viper.MetricCoolingE_2,
    Lighting=viper.MetricElecLights_2,
    Equip=viper.MetricElecEquip_2,
    lightingLoad=lighting_load,
    H_COP=heating_cop,
    C_COP=cooling_cop,
    Infiltration=infiltration,
    FreshAir=fresh_air,
    destination=set_diva_data_path.DIVA_results_path)  # -> out, a; inputs loopNo: Int32, runScript: Boolean, Heating: list, Cooling: list, Lighting: list, Equip: list
# ---------- python_2: Python ----------
#13.10.2015
#Prageeth Jayathissa
#Python script to read DIVA inputs and produce a CSV file

import sys, os
import datetime
import json
from shutil import copyfile



if runScript:
    

    if loopNo==0:
        
        # copy corresponding LayoutAndCombinations File
        file_path = ghenv.Component.OnPingDocument().FilePath
        current_folder = '\\'.join(file_path.split('\\')[0:-1])
        LayoutAndCombinations_src = current_folder + "\data\grasshopper\LayoutAndCombinations.txt"
        dst = destination + 'LayoutAndCombinations.txt'
        copyfile(LayoutAndCombinations_src, dst)
        
        # save lighting load, heating and cooling COP
        efficiencies = {'L_Load':lightingLoad, 'H_COP':H_COP, 'C_COP':C_COP, 'Infiltration':Infiltration, 'FreshAir':FreshAir}
        with open(os.path.join(destination ,'efficiencies.json'), 'w') as fp:
            json.dump(efficiencies, fp)
            fp.close()
        
        #Create empty .csv files
        with open(os.path.join(destination,'heating.csv'),'w') as f:
            pass
        with open(os.path.join(destination,'cooling.csv'),'w') as f:
            pass
        with open(os.path.join(destination,'lighting.csv'),'w') as f:
            pass
        with open(os.path.join(destination,'time.csv'),'w') as f:
            pass
            
    if loopNo//50 == 0:
        #Write to csv files
        
        #Each itteration will be stored in a row of a csv file
        writestring=''
        
        with open(os.path.join(destination,'heating.csv'),'a') as f:
            for ii in Heating:
                #Create row in csv
                writestring=writestring+str(ii)+','
            #remove the last comma
            writestring=writestring[:-1]
            #add a new line and write
            f.write(writestring+'\n')
            f.close()
        
        writestring=''
        with open(os.path.join(destination,'cooling.csv'),'a') as f:
            for ii in Cooling:
        
                writestring=writestring+str(ii)+','
            #print writestring
            writestring=writestring[:-1]
            f.write(writestring+'\n')
            f.close()
            
        writestring=''
        with open(os.path.join(destination,'lighting.csv'),'a') as f:
            for ii in Lighting:
        
                writestring=writestring+str(ii)+','
            #print writestring
            writestring=writestring[:-1]
            f.write(writestring+'\n')
            f.close()
            
        with open(os.path.join(destination,'time.csv'),'a') as f:
            f.write('combination: ' + str(loopNo) + ' time: ' + str(datetime.datetime.now())+'\n')
            f.close()
    
    else:
        fileNo = loopNo//50 
        if loopNo%50 == 0:
        
            #Create empty .csv files
            with open(os.path.join(destination,'heating' + str(fileNo) + '.csv'),'w') as f:
                pass
            with open(os.path.join(destination,'cooling' + str(fileNo) + '.csv'),'w') as f:
                pass
            with open(os.path.join(destination,'lighting' + str(fileNo) + '.csv'),'w') as f:
                pass
            with open(os.path.join(destination,'time' + str(fileNo) + '.csv'),'w') as f:
                pass
            
        #Write to csv files
        
        #Each itteration will be stored in a row of a csv file
        writestring=''
        
        with open(os.path.join(destination,'heating' + str(fileNo) + '.csv'),'a') as f:
            for ii in Heating:
                #Create row in csv
                writestring=writestring+str(ii)+','
            #remove the last comma
            writestring=writestring[:-1]
            #add a new line and write
            f.write(writestring+'\n')
            f.close()
        
        writestring=''
        with open(os.path.join(destination,'cooling' + str(fileNo) + '.csv'),'a') as f:
            for ii in Cooling:
        
                writestring=writestring+str(ii)+','
            #print writestring
            writestring=writestring[:-1]
            f.write(writestring+'\n')
            f.close()
            
        writestring=''
        with open(os.path.join(destination,'lighting' + str(fileNo) + '.csv'),'a') as f:
            for ii in Lighting:
        
                writestring=writestring+str(ii)+','
            #print writestring
            writestring=writestring[:-1]
            f.write(writestring+'\n')
            f.close()
            
        with open(os.path.join(destination,'time' + str(fileNo) + '.csv'),'a') as f:
            f.write('combination: ' + str(loopNo) + ' time: ' + str(datetime.datetime.now())+'\n')
            f.close()
    
    print "script was executed"
    #totalHeat=sum(Heating)
    #totalCool=sum(Cool)
    #totalLights=sum(Lights)
    #totalEquip=sum(Equip)
# ---------- end python_2 ----------
panel_33 = Panel(python_2.out)
