# Grasshopper definition importAnnualResultsForWholeYear.gh (Grasshopper 0.9.75)
# plug-ins: Python Interpreter

panel = Panel("C:\ladybug\density_option_.25test_grid_size_1\annualSimulation")
lookupfolder_daylighting = Honeybee_LookupDaylightingFolder(studyFolder=panel)  # -> analysisType, illFiles, ptsFiles, hdrFiles, imageFiles, epwFile, radianceFiles, materialFiles, skyFiles, analysisMesh; plug-in component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
importpts = Honeybee_ImportPtsFile(ptsFileAddress=lookupfolder_daylighting.ptsFiles)  # -> points, vectors; plug-in component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
readallthedshourlyresults = Honeybee_ReadAllTheHourlyResultsFromAnnualDaylightStudy(testPoints=importpts.points)  # -> iIllumLevelsNoDynamicSHD, iIllumLevelsDynamicSHDGroupI, iIllumLevelsDynamicSHDGroupII, iIlluminanceBasedOnOccupancy, shadingGroupInEffect; plug-in component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
